# Dynamo graph 02 - FOUNDATION MARKS (2024).dyn (Dynamo 2.17.0.3472)

# group: INPUTS
left_right_bottom_top = BoolSelector(true)  # graph input
left_right_top_bottom = BoolSelector(true)  # graph input
right_left_bottom_top = BoolSelector(false)  # graph input
right_left_top_bottom = BoolSelector(false)  # graph input
refresh_script = BoolSelector(true)  # graph input
foundation_mark_prefix = StringInput("P")  # graph input

if_statement = Python(IN[0]=left_right_bottom_top, IN[1]=left_right_top_bottom, IN[2]=right_left_bottom_top, IN[3]=right_left_top_bottom)  # IronPython2
# ---------- if_statement.python (13 lines) ----------
A = IN[0]
B = IN[1]
C = IN[2]
D =  IN[3]

if A and not B:
	OUT = True,True
elif B and not C:
	OUT = False,True
elif C and not D:
	OUT = False,False
else:
	OUT = True,False
# ----------------------------------------
code_block = CodeBlock(BOOL=if_statement) { BOOL[0]; BOOL[1]; }
python_script = Python(IN[0]=refresh_script)  # IronPython2
# ---------- python_script.python (83 lines) ----------
#	DEVELOPED BY KEHINDE AYOBADE
#	FREE FOR USE


import clr
import sys
sys.path.append('C:\Program Files (x86)\IronPython 2.7\Lib')

import System
from System import Array
from System.Collections.Generic import *
clr.AddReference('ProtoGeometry')
from Autodesk.DesignScript.Geometry import *

clr.AddReference("RevitNodes")
import Revit
clr.ImportExtensions(Revit.Elements)
clr.ImportExtensions(Revit.GeometryConversion)

clr.AddReference("RevitServices")
import RevitServices
from RevitServices.Persistence import DocumentManager 
from RevitServices.Transactions import TransactionManager 

clr.AddReference("RevitAPI")
from Autodesk.Revit.DB import *

clr.AddReference("RevitAPIUI")
from Autodesk.Revit.UI import *

doc = DocumentManager.Instance.CurrentDBDocument
uiapp = DocumentManager.Instance.CurrentUIApplication 
app = uiapp.Application 
uidoc = uiapp.ActiveUIDocument

TransactionManager.Instance.EnsureInTransaction(doc)


#categoryName = cat.Name


taskD = TaskDialog("Foundation Numbering")
taskD.Title = "Select Foundation Element"
taskD.CommonButtons = TaskDialogCommonButtons.Ok
taskD.MainInstruction = "Please Select Foundation Element(s) to Number"
taskD.Show()

try:
	def PickedFdns():
		class MySelectionFilter(Selection.ISelectionFilter):
			def __init__(self):
				pass
			def AllowElement(self, element):
				if element.Category.Name == "Structural Foundations":
					return True
				else:
					return False
			def AllowReference(self, element):
				return False

		Fdns = []


		Sel_filter = MySelectionFilter()
		obj_type = Selection.ObjectType.Element

		selection = uidoc.Selection.PickObjects(obj_type,Sel_filter,"Select Structural Foundation Element(s)")

		for elems in selection:
				Fdns.append(Document.GetElement(doc,elems))
		return Fdns

	Fdns = PickedFdns()

except Exception or NameError or EOFError:
	pass
#	sys.exit()


TransactionManager.Instance.TransactionTaskDone()


OUT = Fdns
# ----------------------------------------
getLocation = Element.GetLocation(element=python_script)
Y = Point.Y(point=getLocation)
code_block_2 = CodeBlock { 2; }
round = Math.Round(number=Y, digits=code_block_2)
groupByKey = List.GroupByKey(list=python_script, keys=round)
sortByKey = List.SortByKey(list=groupByKey.groups, keys=groupByKey.uniqueKeys)
reverse = List.Reverse(list=sortByKey.sortedList)
if_statement_2 = Python(IN[0]=sortByKey.sortedList, IN[1]=reverse, IN[2]=code_block.out0)  # IronPython2
# ---------- if_statement_2.python (8 lines) ----------
A = IN[0]
B = IN[1]
BOOL = IN[2]

if BOOL:
	OUT = A
else:
	OUT = B
# ----------------------------------------
groupByKey_2 = List.GroupByKey(list=getLocation, keys=round)
sortByKey_2 = List.SortByKey(list=groupByKey_2.groups, keys=groupByKey_2.uniqueKeys)
reverse_2 = List.Reverse(list=sortByKey_2.sortedList)
if_statement_3 = Python(IN[0]=sortByKey_2.sortedList, IN[1]=reverse_2, IN[2]=code_block.out0)  # IronPython2; same code as if_statement_2
X = Point.X(point=if_statement_3)
sortByKey_3 = List.SortByKey(list=if_statement_2, keys=X, lacing=Longest)
flatten = List.Flatten(list=sortByKey_3.sortedList)
reverse_3 = List.Reverse(list=flatten)
if_ = RefactoredIf(test=code_block.out1, true=flatten, false=reverse_3)
string = StringInput("Mark")
count = List.Count(list=python_script)
code_block_3 = CodeBlock(C=count) { 1..C; }
add = foundation_mark_prefix + code_block_3
setParameterByName = Element.SetParameterByName(element=if_, parameterName=string, value=add)
