# Dynamo graph 02 - FOUNDATION MARKS (21ST MAY 2021).dyn (Dynamo 2.6.2.15705)

# group: INPUTS
left_right_bottom_top = BoolSelector(true)  # graph input
left_right_top_bottom = BoolSelector(false)  # graph input
right_left_bottom_top = BoolSelector(false)  # graph input
right_left_top_bottom = BoolSelector(false)  # graph input
foundation_element_name = StringInput("800mm Diameter")  # graph input
tag_all_foundation_elements = BoolSelector(true)  # graph input
refresh_script = BoolSelector(true)  # graph input
foundation_mark_prefix = StringInput("")  # graph input
python_script = Python()  # frozen; unwired: IN[0]
# ---------- python_script.python (79 lines) ----------
import clr
import sys
sys.path.append('C:\Program Files (x86)\IronPython 2.7\Lib')

import System
from System import Array
from System.Collections.Generic import *
clr.AddReference('ProtoGeometry')
from Autodesk.DesignScript.Geometry import *

clr.AddReference("RevitNodes")
import Revit
clr.ImportExtensions(Revit.Elements)
clr.ImportExtensions(Revit.GeometryConversion)

clr.AddReference("RevitServices")
import RevitServices
from RevitServices.Persistence import DocumentManager 
from RevitServices.Transactions import TransactionManager 

clr.AddReference("RevitAPI")
from Autodesk.Revit.DB import *

clr.AddReference("RevitAPIUI")
from Autodesk.Revit.UI import *

doc = DocumentManager.Instance.CurrentDBDocument
uiapp = DocumentManager.Instance.CurrentUIApplication 
app = uiapp.Application 
uidoc = uiapp.ActiveUIDocument

TransactionManager.Instance.EnsureInTransaction(doc)


#categoryName = cat.Name


taskD = TaskDialog("Foundation Numbering")
taskD.Title = "Select Foundation Element"
taskD.CommonButtons = TaskDialogCommonButtons.Ok
taskD.MainInstruction = "Please Select Foundation Element(s) to Number"
taskD.Show()

try:
	def PickedFdns():
		class MySelectionFilter(Selection.ISelectionFilter):
			def __init__(self):
				pass
			def AllowElement(self, element):
				if element.Category.Name == "Structural Foundations":
					return True
				else:
					return False
			def AllowReference(self, element):
				return False

		Fdns = []


		Sel_filter = MySelectionFilter()
		obj_type = Selection.ObjectType.Element

		selection = uidoc.Selection.PickObjects(obj_type,Sel_filter,"Select Structural Foundation Element(s)")

		for elems in selection:
				Fdns.append(Document.GetElement(doc,elems))
		return Fdns

	Fdns = PickedFdns()

except Exception or NameError or EOFError:
	pass
#	sys.exit()


TransactionManager.Instance.TransactionTaskDone()


OUT = Fdns
# ----------------------------------------

python_script_2 = Python(IN[0]=foundation_element_name, IN[1]=tag_all_foundation_elements, IN[2]=refresh_script)
# ---------- python_script_2.python (46 lines) ----------
import clr
import sys
sys.path.append('C:\Program Files (x86)\IronPython 2.7\Lib')

import System
from System import Array
from System.Collections.Generic import *
clr.AddReference('ProtoGeometry')
from Autodesk.DesignScript.Geometry import *

clr.AddReference("RevitNodes")
import Revit
clr.ImportExtensions(Revit.Elements)
clr.ImportExtensions(Revit.GeometryConversion)

clr.AddReference("RevitServices")
import RevitServices
from RevitServices.Persistence import DocumentManager 
from RevitServices.Transactions import TransactionManager 

clr.AddReference("RevitAPI")
from Autodesk.Revit.DB import *

clr.AddReference("RevitAPIUI")
from Autodesk.Revit.UI import *

doc = DocumentManager.Instance.CurrentDBDocument
uiapp = DocumentManager.Instance.CurrentUIApplication 
app = uiapp.Application 
uidoc = uiapp.ActiveUIDocument

pileName = IN[0]
AllElements = IN[1]

filter = ElementCategoryFilter(BuiltInCategory.OST_StructuralFoundation)

collector = FilteredElementCollector(doc, doc.ActiveView.Id)

foundations = collector.WherePasses(filter).WhereElementIsNotElementType().ToElements();

if AllElements:
	foundations = foundations
else:
	foundations = [fdn for fdn in  foundations if fdn.Name == pileName]
		
OUT = foundations
# ----------------------------------------

# group: PILE NUMBERING
if_statement = Python(IN[0]=left_right_bottom_top, IN[1]=left_right_top_bottom, IN[2]=right_left_bottom_top, IN[3]=right_left_top_bottom)
# ---------- if_statement.python (13 lines) ----------
A = IN[0]
B = IN[1]
C = IN[2]
D =  IN[3]

if A and not B:
	OUT = True,True
elif B and not C:
	OUT = False,True
elif C and not D:
	OUT = False,False
else:
	OUT = True,False
# ----------------------------------------
code_block = CodeBlock(BOOL=if_statement) { BOOL[0]; BOOL[1]; }
getLocation = Element.GetLocation(element=python_script_2)  # frozen
Y = Point.Y(point=getLocation)
code_block_2 = CodeBlock { 2; }
round = Math.Round(number=Y, digits=code_block_2)
groupByKey = List.GroupByKey(list=python_script_2, keys=round)
sortByKey = List.SortByKey(list=groupByKey.groups, keys=groupByKey.unique_keys)
reverse = List.Reverse(list=sortByKey.sorted_list)
if_statement_2 = Python(IN[0]=sortByKey.sorted_list, IN[1]=reverse, IN[2]=code_block.out0)
# ---------- if_statement_2.python (8 lines) ----------
A = IN[0]
B = IN[1]
BOOL = IN[2]

if BOOL:
	OUT = A
else:
	OUT = B
# ----------------------------------------
groupByKey_2 = List.GroupByKey(list=getLocation, keys=round)
sortByKey_2 = List.SortByKey(list=groupByKey_2.groups, keys=groupByKey_2.unique_keys)
reverse_2 = List.Reverse(list=sortByKey_2.sorted_list)
if_statement_3 = Python(IN[0]=sortByKey_2.sorted_list, IN[1]=reverse_2, IN[2]=code_block.out0)  # same code as if_statement_2
X = Point.X(point=if_statement_3)
sortByKey_3 = List.SortByKey(list=if_statement_2, keys=X, lacing=Longest)
flatten = List.Flatten(list=sortByKey_3.sorted_list)
reverse_3 = List.Reverse(list=flatten)
if_ = If(test=code_block.out1, true=flatten, false=reverse_3)
string = StringInput("Mark")
count = List.Count(list=python_script_2)
code_block_3 = CodeBlock(C=count) { 1..C; }
add = foundation_mark_prefix + code_block_3
setParameterByName = Element.SetParameterByName(element=if_, parameterName=string, value=add)  # frozen

string_2 = StringInput("A1010130")
boolean = BoolSelector(true)
python_script_3 = Python(IN[0]=string_2, IN[1]=boolean)
# ---------- python_script_3.python (38 lines) ----------
import sys
import clr
clr.AddReference('ProtoGeometry')
from Autodesk.DesignScript.Geometry import *

clr.AddReference("RevitNodes")
import Revit
clr.ImportExtensions(Revit.Elements)
clr.ImportExtensions(Revit.GeometryConversion)

clr.AddReference("RevitServices")
import RevitServices
from RevitServices.Persistence import DocumentManager 
from RevitServices.Transactions import TransactionManager 

clr.AddReference("RevitAPI")
from Autodesk.Revit.DB import *

clr.AddReference("RevitAPIUI")
from Autodesk.Revit.UI import *

doc = DocumentManager.Instance.CurrentDBDocument


FDNS = FilteredElementCollector(doc).OfCategory(BuiltInCategory.OST_StructuralFoundation).WhereElementIsNotElementType().ToElements()

TransactionManager.Instance.EnsureInTransaction(doc)
pileCaps = []
assemblyCode = IN[0]

for fdn in FDNS:
	fdnType = doc.GetElement(fdn.GetTypeId())
	AssCode = fdnType.LookupParameter("Assembly Code")
	if AssCode.AsString() == assemblyCode:
		pileCaps.append(fdn)
		

OUT = pileCaps
# ----------------------------------------
geometry = Element.Geometry(element=python_script_3)
flatten_2 = List.Flatten(list=geometry)
name = Element.Name(element=python_script_2)
foundation_element_name_2 = StringInput("Diameter")  # graph input
contains = String.Contains(str=name, searchFor=foundation_element_name_2)
filterByBoolMask = List.FilterByBoolMask(list=python_script_2, mask=contains)
geometry_2 = Element.Geometry(element=filterByBoolMask.in)
flatten_3 = List.Flatten(list=geometry_2)
doesIntersect = Geometry.DoesIntersect(geometry=flatten_2, other=flatten_3, lacing=CrossProduct)
boolean_2 = BoolSelector(true)
allIndicesOf = List.AllIndicesOf(list=doesIntersect@L2, item=boolean_2)
isEmpty = List.IsEmpty(list=allIndicesOf, lacing=Longest)
boolean_3 = BoolSelector(false)
allIndicesOf_2 = List.AllIndicesOf(list=isEmpty, item=boolean_3)
getItemAtIndex = List.GetItemAtIndex(list=allIndicesOf, index=allIndicesOf_2)

# group: PILE CAPS WITH UN-INSTALLED PILES
getItemAtIndex_2 = List.GetItemAtIndex(list=python_script_3, index=allIndicesOf_2)
getItemAtIndex_3 = List.GetItemAtIndex(list=filterByBoolMask.in, index=getItemAtIndex)

# group: ASSIGN PILE CAP MARK TO PILE
string_3 = StringInput("Pile Cap Mark")
string_4 = StringInput("Mark")
getParameterValueByName = Element.GetParameterValueByName(element=getItemAtIndex_2, parameterName=string_4)
setParameterByName_2 = Element.SetParameterByName(element=getItemAtIndex_3, parameterName=string_3, value=getParameterValueByName)

# group: DICTIONARY TO STORE PILES IN PILECAPS
id = Element.Id(element=getItemAtIndex_2)
string_from_object = FromObject(obj=id)
byKeysValues = DesignScript.Builtin.Dictionary.ByKeysValues(keys=string_from_object, values=setParameterByName_2)

getItemAtIndex_4 = List.GetItemAtIndex(list=flatten_2, index=allIndicesOf_2)
centroid = Solid.Centroid(solid=getItemAtIndex_4)
Y_2 = Point.Y(point=centroid)
code_block_4 = CodeBlock { 1000; }
div = Y_2 / code_block_4
code_block_5 = CodeBlock { 0.3; }
add_2 = div + code_block_5
code_block_6 = CodeBlock { 3; }
round_2 = Math.Round(number=add_2, digits=code_block_6)
round_3 = Math.Round(number=round_2)
groupByKey_3 = List.GroupByKey(list=getItemAtIndex_2, keys=round_3)
sortByKey_4 = List.SortByKey(list=groupByKey_3.groups, keys=groupByKey_3.unique_keys)
reverse_4 = List.Reverse(list=sortByKey_4.sorted_list)
groupByKey_4 = List.GroupByKey(list=centroid, keys=round_3)
sortByKey_5 = List.SortByKey(list=groupByKey_4.groups, keys=groupByKey_4.unique_keys)
reverse_5 = List.Reverse(list=sortByKey_5.sorted_list)
X_2 = Point.X(point=reverse_5)
code_block_7 = CodeBlock { 1000; }
div_2 = X_2 / code_block_7
sortByKey_6 = List.SortByKey(list=reverse_4@L2, keys=div_2@L2)
id_2 = Element.Id(element=sortByKey_6.sorted_list)
string_from_object_2 = FromObject(obj=id_2)
valueAtKey = DesignScript.Builtin.Dictionary.ValueAtKey(dictionary=byKeysValues, key=string_from_object_2)
code_block_8 = CodeBlock { 1; }
flatten_4 = List.Flatten(list=valueAtKey, amt=code_block_8)

# group: PILE NUMBERING
if_statement_4 = Python(IN[0]=left_right_bottom_top, IN[1]=left_right_top_bottom, IN[2]=right_left_bottom_top, IN[3]=right_left_top_bottom)  # same code as if_statement
code_block_9 = CodeBlock(BOOL=if_statement_4) { BOOL[0]; BOOL[1]; }
getLocation_2 = Element.GetLocation(element=flatten_4)
Y_3 = Point.Y(point=getLocation_2)
code_block_10 = CodeBlock { 2; }
round_4 = Math.Round(number=Y_3, digits=code_block_10)
sortByKey_7 = List.SortByKey(list=valueAtKey@L2, keys=round_4@L2)
reverse_6 = List.Reverse(list=sortByKey_7.sorted_list)
if_statement_5 = Python(IN[0]=sortByKey_7.sorted_list, IN[1]=reverse_6, IN[2]=code_block_9.out0)  # same code as if_statement_2
sortByKey_8 = List.SortByKey(list=getLocation_2@L2, keys=round_4@L2)
reverse_7 = List.Reverse(list=sortByKey_8.sorted_list)
if_statement_6 = Python(IN[0]=sortByKey_8.sorted_list, IN[1]=reverse_7, IN[2]=code_block_9.out0)  # same code as if_statement_2
X_3 = Point.X(point=if_statement_6)
sortByKey_9 = List.SortByKey(list=if_statement_5, keys=X_3, lacing=Longest)
flatten_5 = List.Flatten(list=sortByKey_9.sorted_list)
reverse_8 = List.Reverse(list=flatten_5)
if_2 = If(test=code_block_9.out1, true=flatten_5, false=reverse_8)
string_5 = StringInput("Mark")
count_2 = List.Count(list=valueAtKey@L2)
sum = Math.Sum(values=count_2)
code_block_11 = CodeBlock(C=sum) { 1..C; }
python_script_4 = Python(IN[0]=code_block_11)
# ---------- python_script_4.python (14 lines) ----------
# Load the Python Standard and DesignScript Libraries
import sys
import clr
clr.AddReference('ProtoGeometry')
from Autodesk.DesignScript.Geometry import *

# The inputs to this node will be stored as a list in the IN variables.
dataEnteringNode = IN

numbers = []
for num in IN[0]:
	numbers.append(str(int(num)))
# Assign your output to the OUT variable.
OUT = numbers
# ----------------------------------------
add_3 = foundation_mark_prefix + python_script_4
setParameterByName_3 = Element.SetParameterByName(element=if_2, parameterName=string_5, value=add_3)

sortByKey_10 = List.SortByKey(list=div_2@L2, keys=div_2@L2)
