# Dynamo graph As-Built Pile Coordinates.dyn (Dynamo 2.6.2.15705)

pile_annotation_family_type = FamilyTypes("EMMS-UFA - Pile Annotation BLUE:Blue Circle")  # graph input
pin_annotation = BoolSelector(true)  # graph input
diameter_parameter_name = StringInput("Diameter")  # graph input
assembly_code = StringInput("A1020110")  # graph input
python_script = Python(IN[0]=pile_annotation_family_type, IN[1]=pin_annotation, IN[2]=diameter_parameter_name, IN[3]=assembly_code)  # frozen
# ---------- python_script.python (50 lines) ----------
# Load the Python Standard and DesignScript Libraries
import sys
import clr
clr.AddReference('ProtoGeometry')
from Autodesk.DesignScript.Geometry import *

clr.AddReference("RevitNodes")
import Revit
clr.ImportExtensions(Revit.Elements)
clr.ImportExtensions(Revit.GeometryConversion)

clr.AddReference("RevitServices")
import RevitServices
from RevitServices.Persistence import DocumentManager 
from RevitServices.Transactions import TransactionManager 

clr.AddReference("RevitAPI")
from Autodesk.Revit.DB import *

clr.AddReference("RevitAPIUI")
from Autodesk.Revit.UI import *

doc = DocumentManager.Instance.CurrentDBDocument

PileAnnoType = UnwrapElement(IN[0])

FDNS = FilteredElementCollector(doc,doc.ActiveView.Id).OfCategory(BuiltInCategory.OST_StructuralFoundation).WhereElementIsNotElementType().ToElements()

TransactionManager.Instance.EnsureInTransaction(doc)
piles = []
pileDiameter = IN[2]
assemblyCode = IN[3]

for fdn in FDNS:
	fdnType = doc.GetElement(fdn.GetTypeId())
	AssCode = fdnType.LookupParameter("Assembly Code")
	if AssCode.AsString() == assemblyCode:
		points = fdn.Location.Point
		piles.append(fdn)
		PileDiameter = fdnType.LookupParameter(pileDiameter).AsDouble()
		
		pileAnno = doc.Create.NewFamilyInstance(points,PileAnnoType,doc.ActiveView)
		
		pileAnno.LookupParameter("Diameter").Set(PileDiameter)
		
		pileAnno.Pinned = IN[1]

TransactionManager.Instance.TransactionTaskDone()

OUT = piles
# ----------------------------------------
pile_annotation_family_type_2 = FamilyTypes("EMMS-UFA - Pile Annotation RED:Red Circle")  # graph input
pile_installation_parameter_name = StringInput("KSD_Pile Installation")  # graph input
python_script_2 = Python(IN[0]=pile_annotation_family_type, IN[1]=pin_annotation, IN[2]=diameter_parameter_name, IN[3]=assembly_code, IN[4]=pile_annotation_family_type_2, IN[5]=pile_installation_parameter_name)
# ---------- python_script_2.python (70 lines) ----------
# Load the Python Standard and DesignScript Libraries
import sys
import clr
clr.AddReference('ProtoGeometry')
from Autodesk.DesignScript.Geometry import *

clr.AddReference("RevitNodes")
import Revit
clr.ImportExtensions(Revit.Elements)
clr.ImportExtensions(Revit.GeometryConversion)

clr.AddReference("RevitServices")
import RevitServices
from RevitServices.Persistence import DocumentManager 
from RevitServices.Transactions import TransactionManager 

clr.AddReference("RevitAPI")
from Autodesk.Revit.DB import *

clr.AddReference("RevitAPIUI")
from Autodesk.Revit.UI import *

doc = DocumentManager.Instance.CurrentDBDocument

PileAnnoTypeA = UnwrapElement(IN[0])
PileAnnoTypeB = UnwrapElement(IN[4])

FDNS = FilteredElementCollector(doc,doc.ActiveView.Id).OfCategory(BuiltInCategory.OST_StructuralFoundation).WhereElementIsNotElementType().ToElements()

sharedParams = FilteredElementCollector(doc).OfClass(SharedParameterElement).ToElements()

pileInstallParam = None

for param in sharedParams:
	defintion = param.GetDefinition()
	if defintion.Name == "KSD_Pile Installation":
		pileInstallParam = param

paramGUID = pileInstallParam.GuidValue


TransactionManager.Instance.EnsureInTransaction(doc)
piles = []
pileDiameter = IN[2]
assemblyCode = IN[3]
installParamName = IN[5]

pileInstalled = []
pileNotInstalled = []

for fdn in FDNS:
	fdnType = doc.GetElement(fdn.GetTypeId())
	AssCode = fdnType.LookupParameter("Assembly Code")

	if AssCode.AsString() == assemblyCode:
		points = fdn.Location.Point
		piles.append(fdn)
		PileDiameter = fdnType.LookupParameter(pileDiameter).AsDouble()
		
		if fdn.LookupParameter(installParamName).AsValueString() == "Yes":	
			pileInstalled.append(fdn)

		else:	
			pileNotInstalled.append(fdn)
			
TransactionManager.Instance.TransactionTaskDone()



OUT = pileInstalled, pileNotInstalled
# ----------------------------------------
code_block = CodeBlock(x=python_script_2) { x[0]; }
python_script_3 = Python(IN[0]=code_block)
# ---------- python_script_3.python (50 lines) ----------
# Load the Python Standard and DesignScript Libraries
import sys
import clr
clr.AddReference('ProtoGeometry')
from Autodesk.DesignScript.Geometry import *

clr.AddReference("RevitNodes")
import Revit
clr.ImportExtensions(Revit.Elements)
clr.ImportExtensions(Revit.GeometryConversion)

clr.AddReference("RevitServices")
import RevitServices
from RevitServices.Persistence import DocumentManager 
from RevitServices.Transactions import TransactionManager 

clr.AddReference("RevitAPI")
from Autodesk.Revit.DB import *

clr.AddReference("RevitAPIUI")
from Autodesk.Revit.UI import *

doc = DocumentManager.Instance.CurrentDBDocument

piles = UnwrapElement(IN[0])

mark = []
xCoord = []
yCoord = []
zCoord = []
locations = []
projectLocation = doc.ActiveProjectLocation

for elem in piles:
	if hasattr(elem.Location, "Point"):
		locations.append(elem.Location.Point)
		positions = projectLocation.GetProjectPosition(elem.Location.Point)
		mark.append(float(elem.LookupParameter("Mark").AsString()))
		xCoord.append(positions.EastWest*0.3048)
		yCoord.append(positions.NorthSouth*0.3048)
		zCoord.append(positions.Elevation*0.3048)
		
#TransactionManager.Instance.EnsureInTransaction(doc)

			
#TransactionManager.Instance.TransactionTaskDone()



OUT = mark,xCoord,yCoord,zCoord
# ----------------------------------------
file_path = Filename("..\..\..\..\..\..\..\Dropbox\KS DIGITAL INNOVATIIONS\15 - PROJECTS\ENGR. ADEWUYI\CLOSE 101 (RIVERSIDE 2) - 17 + GRD\STRUCTURE\CONTRACTOR PDF\CLOSE 101 PILES SETTING OUT DATA.xlsx")
file_from_path = FileObject(path=file_path)
string = StringInput("Pile Coordinates")
boolean = BoolSelector(false)
importExcel = Data.ImportExcel(file=file_from_path, sheetName=string, showExcel=boolean)
transpose = List.Transpose(lists=importExcel)
code_block_2 = CodeBlock(x=python_script_3, y=transpose) { x[0]; y[0]; }
type = Object.Type(obj=code_block_2.out0)
allIndicesOf = List.AllIndicesOf(list=code_block_2.out1@L2, item=code_block_2.out0, lacing=CrossProduct)
isEmpty = List.IsEmpty(list=allIndicesOf@L2)
filterByBoolMask = List.FilterByBoolMask(list=code_block_2.out0, mask=isEmpty)
filterByBoolMask_2 = List.FilterByBoolMask(list=code_block, mask=isEmpty)
getLocation = Element.GetLocation(element=filterByBoolMask_2.out)
code_block_3 = CodeBlock(C=transpose) { xCoord = C[1]; yCoord = C[2]; }
getItemAtIndex = List.GetItemAtIndex(list=code_block_3.xCoord, index=allIndicesOf)
flatten = List.Flatten(list=getItemAtIndex)
getItemAtIndex_2 = List.GetItemAtIndex(list=code_block_3.yCoord, index=allIndicesOf)
flatten_2 = List.Flatten(list=getItemAtIndex_2)
code_block_4 = CodeBlock(z=python_script_3) { z[3]; }
filterByBoolMask_3 = List.FilterByBoolMask(list=code_block_4, mask=isEmpty)
flatten_3 = List.Flatten(list=filterByBoolMask_3.out)
byCoordinates = Point.ByCoordinates(x=flatten, y=flatten_2, z=flatten_3)
code_block_5 = CodeBlock { 0.4; }

# group: AS-BUILT PILES
byCoordinates_2 = Point.ByCoordinates(x=flatten)
byCenterPointRadius = Circle.ByCenterPointRadius(centerPoint=byCoordinates_2, radius=code_block_5)
color_palette = ColorPalette({R: 255, G: 140, B: 0, A: 255})
byGeometryColor = Modifiers.GeometryColor.ByGeometryColor(geometry=byCenterPointRadius, color=color_palette)
code_block_6 = CodeBlock(c=transpose) { x = c[1]; y = c[2]; }
ZAxis = Vector.ZAxis()
reverse = Vector.Reverse(vector=ZAxis)
code_block_7 = CodeBlock { 3; }
extrudeAsSolid = Curve.ExtrudeAsSolid(curve=byCenterPointRadius, direction=reverse, distance=code_block_7)
byGeometryColor_2 = Modifiers.GeometryColor.ByGeometryColor(geometry=extrudeAsSolid, color=color_palette)

python_script_4 = Python(IN[0]=filterByBoolMask_2.out, IN[1]=flatten, IN[2]=flatten_2, IN[3]=flatten_3)
# ---------- python_script_4.python (68 lines) ----------
# Load the Python Standard and DesignScript Libraries
import sys
import clr
clr.AddReference('ProtoGeometry')
from Autodesk.DesignScript.Geometry import *

clr.AddReference("RevitNodes")
import Revit
clr.ImportExtensions(Revit.Elements)
clr.ImportExtensions(Revit.GeometryConversion)

clr.AddReference("RevitServices")
import RevitServices
from RevitServices.Persistence import DocumentManager 
from RevitServices.Transactions import TransactionManager 

clr.AddReference("RevitAPI")
from Autodesk.Revit.DB import *

clr.AddReference("RevitAPIUI")
from Autodesk.Revit.UI import *

doc = DocumentManager.Instance.CurrentDBDocument

piles = UnwrapElement(IN[0])
newX = IN[1]
newY = IN[2]
newZ = IN[3]


mark = []
xCoord = []
yCoord = []
zCoord = []
locations = []
projectLocation = doc.ActiveProjectLocation

for elem in piles:
	if hasattr(elem.Location, "Point"):
		locations.append(elem.Location.Point)
		positions = projectLocation.GetProjectPosition(elem.Location.Point)
		mark.append(float(elem.LookupParameter("Mark").AsString()))

TransactionManager.Instance.EnsureInTransaction(doc)

for pile,x,y,z in zip(piles,newX,newY,newZ):
	position = projectLocation.GetProjectPosition(pile.Location.Point)
	oldEasting = position.EastWest
	oldNorthing = position.NorthSouth
	oldElevation = position.Elevation
	
	
	eastWest = x/0.3048
	northSouth = y/0.3048
	elevation = z/0.3048
	angle = position.Angle
	#projectLocation.SetProjectPosition(pile.Location.Point, ProjectPosition(eastWest,northSouth,elevation,angle))
		
TransactionManager.Instance.TransactionTaskDone()

for pile,x,y,z in zip(piles,newX,newY,newZ):
	position = projectLocation.GetProjectPosition(pile.Location.Point)
	xCoord.append(position.EastWest*0.3048)
	yCoord.append(position.NorthSouth*0.3048)
	zCoord.append(position.Elevation*0.3048)


OUT = mark,xCoord,yCoord,zCoord
# ----------------------------------------
code_block_8 = CodeBlock(c=python_script_4) { x = c[1]; y = c[2]; z = c[3]; }

# group: PROJECT PILES
byCoordinates_3 = Point.ByCoordinates(x=code_block_8.x, y=code_block_8.y)
byCenterPointRadius_2 = Circle.ByCenterPointRadius(centerPoint=byCoordinates_3, radius=code_block_5)
color_palette_2 = ColorPalette({R: 138, G: 43, B: 226, A: 255})
byGeometryColor_3 = Modifiers.GeometryColor.ByGeometryColor(geometry=byCenterPointRadius_2, color=color_palette_2)
flatten_4 = List.Flatten(list=python_script_2)
python_script_5 = Python(IN[0]=flatten_4)
# ---------- python_script_5.python (48 lines) ----------
# Load the Python Standard and DesignScript Libraries
import sys
import clr
clr.AddReference('ProtoGeometry')
from Autodesk.DesignScript.Geometry import *

clr.AddReference("RevitNodes")
import Revit
clr.ImportExtensions(Revit.Elements)
clr.ImportExtensions(Revit.GeometryConversion)

clr.AddReference("RevitServices")
import RevitServices
from RevitServices.Persistence import DocumentManager 
from RevitServices.Transactions import TransactionManager 

clr.AddReference("RevitAPI")
from Autodesk.Revit.DB import *

clr.AddReference("RevitAPIUI")
from Autodesk.Revit.UI import *

doc = DocumentManager.Instance.CurrentDBDocument

piles = UnwrapElement(IN[0])


mark = []
xCoord = []
yCoord = []
zCoord = []
locations = []
projectLocation = doc.ActiveProjectLocation

for elem in piles:
	if hasattr(elem.Location, "Point"):
		locations.append(elem.Location.Point)
		positions = projectLocation.GetProjectPosition(elem.Location.Point)
		xCoord.append(positions.EastWest*0.3048)
		yCoord.append(positions.NorthSouth*0.3048)
		zCoord.append(positions.Elevation*0.3048)

TransactionManager.Instance.EnsureInTransaction(doc)

TransactionManager.Instance.TransactionTaskDone()


OUT = xCoord,yCoord,zCoord
# ----------------------------------------
code_block_9 = CodeBlock(C=python_script_5) { x = C[0]; y = C[1]; }
ZAxis_2 = Vector.ZAxis()
reverse_2 = Vector.Reverse(vector=ZAxis_2)
code_block_10 = CodeBlock { 3; }
extrudeAsSolid_2 = Curve.ExtrudeAsSolid(curve=byCenterPointRadius_2, direction=reverse_2, distance=code_block_10)
byGeometryColor_4 = Modifiers.GeometryColor.ByGeometryColor(geometry=extrudeAsSolid_2, color=color_palette_2)

code_block_11 = CodeBlock { 7.1; }
code_block_12 = CodeBlock(x=transpose) { x[0]; }
count = List.Count(list=code_block_12)
cycle = List.Cycle(list=code_block_11, amount=count)
