# Dynamo graph Beam - Marks.dyn (Dynamo 2.12.1.8246)

# group: INPUTS
refresh_script = BoolSelector(true)  # graph input
wall_mark_prefix = StringInput("0LW")  # graph input
horizontal_beams_b_t = BoolSelector(false)  # graph input
start_number = DoubleInput(1)  # graph input
start_with_horizontal_beams = BoolSelector(true)  # graph input
vertical_beams_l_r = BoolSelector(true)  # graph input

categories = Categories("OST_Walls")
name = Category.Name(category=categories)

# group: BEAM SELECTION AND FILTERING
beam_ui_selection = Python(IN[0]=refresh_script, IN[1]=name)  # IronPython2
# ---------- beam_ui_selection.python (54 lines) ----------
# Load the Python Standard and DesignScript Libraries
import sys
import clr
clr.AddReference('ProtoGeometry')
from Autodesk.DesignScript.Geometry import *

clr.AddReference("RevitNodes")
import Revit
clr.ImportExtensions(Revit.Elements)
clr.ImportExtensions(Revit.GeometryConversion)

clr.AddReference("RevitServices")
import RevitServices
from RevitServices.Persistence import DocumentManager 
from RevitServices.Transactions import TransactionManager 

clr.AddReference("RevitAPI")
from Autodesk.Revit.DB import *

clr.AddReference("RevitAPIUI")
from Autodesk.Revit.UI import *

doc = DocumentManager.Instance.CurrentDBDocument
uiapp = DocumentManager.Instance.CurrentUIApplication 
app = uiapp.Application 
uidoc = uiapp.ActiveUIDocument

catName = IN[1];

class MySelectionFilter(Selection.ISelectionFilter):
	def __init__(self):
		pass
	def AllowElement(self, element):
		if element.Category.Name == catName:
			return True
		else:
			return False
	def AllowReference(self, element):
		return False

refresh = IN[0]
beams = []


Sel_filter = MySelectionFilter()
obj_type = Selection.ObjectType.Element

selection = uidoc.Selection.PickObjects(obj_type,Sel_filter,"Select Structural Framing Element")

for elems in selection:
	#if doc.GetElement(elems).LookupParameter("Reference Level").AsValueString() != "":
	beams.append(doc.GetElement(elems))
# Assign your output to the OUT variable.
OUT = beams
# ----------------------------------------
string = StringInput("Base Constraint")
getParameterValueByName = Element.GetParameterValueByName(element=beam_ui_selection, parameterName=string)
name_2 = Element.Name(element=getParameterValueByName)
reference_level = Levels("-02 - T.O.LIFT FOUNDATION")  # graph input
name_3 = Element.Name(element=reference_level)
eq = name_2 == name_3
filterByBoolMask = List.FilterByBoolMask(list=beam_ui_selection, mask=eq)
getLocation = Element.GetLocation(element=filterByBoolMask.in)
type = Object.Type(object=getLocation)
string_2 = StringInput("Line")
contains = String.Contains(string=type, searchFor=string_2)
filterByBoolMask_2 = List.FilterByBoolMask(list=beam_ui_selection, mask=contains)
filterByBoolMask_3 = List.FilterByBoolMask(list=getLocation, mask=contains)
direction = Line.Direction(line=filterByBoolMask_3.in)
XAxis = Vector.XAxis()
angleWithVector = Vector.AngleWithVector(vector=direction, otherVector=XAxis)
code_block = CodeBlock { 45; 135; }
ge = angleWithVector >= code_block.out0
le = angleWithVector <= code_block.out1
and_ = ge && le
filterByBoolMask_4 = List.FilterByBoolMask(list=filterByBoolMask_2.in, mask=and_)
code_block_2 = CodeBlock { 0.5; }

# group: VERTICAL BEAMS
mark_parameter = StringInput("Mark")  # graph input
code_block_3 = CodeBlock { 1; }
getLocation_2 = Element.GetLocation(element=filterByBoolMask_4.in)
pointAtParameter = Curve.PointAtParameter(curve=getLocation_2, param=code_block_2)
X = Point.X(point=pointAtParameter)
sortByKey = List.SortByKey(list=filterByBoolMask_4.in, keys=X)
sortByKey_2 = List.SortByKey(list=pointAtParameter, keys=X)
round = Math.Round(number=sortByKey_2.sortedKeys, digits=code_block_3)
groupByKey = List.GroupByKey(list=sortByKey.sortedList, keys=round)
reverse = List.Reverse()  # unwired: list
map = List.Map(list=groupByKey.groups, f_x=reverse)
flatten = List.Flatten(list=map)
reverse_2 = List.Reverse(list=flatten)

# group: OTHER BEAMS
join = List.Join(list0=filterByBoolMask_2.out)
count = List.Count(list=filterByBoolMask_2.in)
count_2 = List.Count(list=join)
code_block_4 = CodeBlock(start=count, C=count_2) { (1+start)..(1+start+C); }
add = wall_mark_prefix + code_block_4
setParameterByName = Element.SetParameterByName(element=join, parameterName=mark_parameter, value=add)

# group: HORIZONTAL BEAMS
getLocation_3 = Element.GetLocation(element=filterByBoolMask_4.out)
pointAtParameter_2 = Curve.PointAtParameter(curve=getLocation_3, param=code_block_2)
Y = Point.Y(point=pointAtParameter_2)
sortByKey_3 = List.SortByKey(list=filterByBoolMask_4.out, keys=Y)
sortByKey_4 = List.SortByKey(list=filterByBoolMask_4.out, keys=Y)
round_2 = Math.Round(number=sortByKey_3.sortedKeys, digits=code_block_3)
groupByKey_2 = List.GroupByKey(list=sortByKey_4.sortedList, keys=round_2)
reverse_3 = List.Reverse()  # unwired: list
map_2 = List.Map(list=groupByKey_2.groups, f_x=reverse_3)
flatten_2 = List.Flatten(list=map_2)
reverse_4 = List.Reverse(list=flatten_2)
if_ = RefactoredIf(test=horizontal_beams_b_t, true=sortByKey_3.sortedList, false=reverse_4)

if_2 = RefactoredIf(test=vertical_beams_l_r, true=flatten, false=reverse_2)

# group: SPLIT MARKS BASED ON WHICH BEAM STARTS
count_3 = List.Count(list=filterByBoolMask_2.in)
code_block_5 = CodeBlock(start=start_number, C=count_3) { start..C; }
add_2 = wall_mark_prefix + code_block_5
count_4 = List.Count(list=if_)
count_5 = List.Count(list=if_2)
python_script = Python(IN[0]=add_2, IN[1]=start_with_horizontal_beams, IN[2]=count_4, IN[3]=count_5)  # IronPython2
# ---------- python_script.python (16 lines) ----------
bMarks = IN[0]
hBool = IN[1]
hCount = IN[2]
vCount = IN[3]

hMarks = []
vMarks = []

if hBool:
	hMarks = bMarks[:hCount]
	vMarks = bMarks[hCount:]
else:
	hMarks = bMarks[vCount:]
	vMarks = bMarks[:vCount]

OUT = hMarks, vMarks
# ----------------------------------------
code_block_6 = CodeBlock(BM=python_script) { XBeams = BM[0]; YBeams = BM[1]; }

# group (continued): HORIZONTAL BEAMS
setParameterByName_2 = Element.SetParameterByName(element=if_, parameterName=mark_parameter, value=code_block_6.XBeams)

# group (continued): VERTICAL BEAMS
setParameterByName_3 = Element.SetParameterByName(element=if_2, parameterName=mark_parameter, value=code_block_6.YBeams)
