# Dynamo graph Mark & Tag Columns by Type and Direction.dyn (Dynamo 2.6.2.15705)

categories = Categories("OST_StructuralColumns")
all_elements_of_category = ElementsOfCategory(Category=categories)
name = Element.Name(element=all_elements_of_category)
column_type_name = StringInput("")  # graph input
contains = String.Contains(str=name, searchFor=column_type_name)
current = Document.Current()
activeView = Document.ActiveView(document=current)
levels = Levels("-01 - T.O.FDN (LIFT PIT)")
name_2 = Element.Name(element=levels)
string = StringInput("Base Level")
getParameterValueByName = Element.GetParameterValueByName(element=all_elements_of_category, parameterName=string)
name_3 = Element.Name(element=getParameterValueByName)
eq = name_2 == name_3
levels_2 = Levels("-01 - T.O.FDN (PILE CAPS)")
name_4 = Element.Name(element=levels_2)
eq_2 = name_4 == name_3
or_ = eq || eq_2
filterByBoolMask = List.FilterByBoolMask(list=all_elements_of_category, mask=or_)
getLocation = Element.GetLocation(element=filterByBoolMask.in)
Z = Point.Z(point=getLocation)
groupByKey = List.GroupByKey(list=filterByBoolMask.in, keys=Z)
transpose = List.Transpose(lists=groupByKey.groups)
string_2 = StringInput("Mark")
column_mark_prefix = StringInput("C")  # graph input
count = List.Count(list=transpose)
code_block = CodeBlock(pref=column_mark_prefix, count=count) { pref + (1..count); }
setParameterByName = Element.SetParameterByName(element=transpose, parameterName=string_2, value=code_block)
getLocation_2 = Element.GetLocation(element=setParameterByName)
tag_ve_x_direction = BoolSelector(true)  # graph input
tag_direction_vector = DoubleInput(1)
code_block_2 = CodeBlock(coord=tag_direction_vector) { -1*coord; }
if_ = If(test=tag_ve_x_direction, true=tag_direction_vector, false=code_block_2)
tag_ve_y_direction = BoolSelector(true)  # graph input
if_2 = If(test=tag_ve_y_direction, true=tag_direction_vector, false=code_block_2)
byCoordinates = Vector.ByCoordinates(x=if_, y=if_2)
tag_offset_xy_direction = DoubleSlider(2.5, range=0..3 step 0.1)  # graph input
code_block_3 = CodeBlock(dist=tag_offset_xy_direction) { 1000*dist; }
translate = Geometry.Translate(geometry=getLocation_2, direction=byCoordinates, distance=code_block_3)
byElementAndLocation = Tag.ByElementAndLocation(view=activeView, element=setParameterByName, location=translate)  # frozen
count_2 = List.Count(list=byElementAndLocation@L2)
sum = Math.Sum(values=count_2)
uniqueItems = List.UniqueItems(list=name)
contains_2 = String.Contains(str=uniqueItems, searchFor=column_type_name)
filterByBoolMask_2 = List.FilterByBoolMask(list=uniqueItems, mask=contains_2)
python_script = Python(IN[0]=sum, IN[1]=filterByBoolMask_2.in)
# ---------- python_script.python (16 lines) ----------
# Load the Python Standard and DesignScript Libraries
import sys
import clr
clr.AddReference('ProtoGeometry')
from Autodesk.DesignScript.Geometry import *

# The inputs to this node will be stored as a list in the IN variables.

count = IN[0]
columntype = IN[1][0]


Note = str(int(count)) + " Nos. of " + columntype + " now have marks and are tagged " 


OUT = Note
# ----------------------------------------
output_note = Watch(python_script)  # graph output
geometry = Element.Geometry(element=filterByBoolMask.in)
