# Dynamo graph Mark Beams by Axis Location.dyn (Dynamo 2.6.1.8786)

# group: INPUTS
reverse_x_beam_marks = BoolSelector(true)  # graph input
refresh_script = BoolSelector(true)  # graph input
reverse_y_beam_marks = BoolSelector(false)  # graph input
beam_mark_prefix = StringInput("1B")  # graph input

# group: SELECT BEAM IN REVIT
ui_select_beam_python_script = Python(IN[0]=refresh_script)
# ---------- ui_select_beam_python_script.python (55 lines) ----------
# Load the Python Standard and DesignScript Libraries
import sys
import clr
clr.AddReference('ProtoGeometry')
from Autodesk.DesignScript.Geometry import *

clr.AddReference("RevitNodes")
import Revit
clr.ImportExtensions(Revit.Elements)
clr.ImportExtensions(Revit.GeometryConversion)

clr.AddReference("RevitServices")
import RevitServices
from RevitServices.Persistence import DocumentManager 
from RevitServices.Transactions import TransactionManager 

clr.AddReference("RevitAPI")
from Autodesk.Revit.DB import *

clr.AddReference("RevitAPIUI")
from Autodesk.Revit.UI import *

doc = DocumentManager.Instance.CurrentDBDocument
uiapp = DocumentManager.Instance.CurrentUIApplication 
app = uiapp.Application 
uidoc = uiapp.ActiveUIDocument

class MySelectionFilter(Selection.ISelectionFilter):
	def __init__(self):
		pass
	def AllowElement(self, element):
		if element.Category.Name == "Structural Framing":
			return True
		else:
			return False
	def AllowReference(self, element):
		return False

refresh = IN[0]
beams = []


Sel_filter = MySelectionFilter()
obj_type = Selection.ObjectType.Element

if refresh:
	selection = uidoc.Selection.PickObjects(obj_type,Sel_filter,"Select Structural Framing Element")
	
	for elems in selection:
			beams.append(Document.GetElement(doc,elems))
else:
	beams.append("Please Set Toggle to True")
	beams = beams[0]
# Assign your output to the OUT variable.
OUT = beams
# ----------------------------------------

# group: GET BEAMS AXIS (X/Y)
getLocation = Element.GetLocation(element=ui_select_beam_python_script)
flatten = List.Flatten(list=getLocation)
type = Object.Type(obj=flatten)
string = StringInput("Line")
boolean = BoolSelector(false)
contains = String.Contains(str=type, searchFor=string, ignoreCase=boolean)
filterByBoolMask = List.FilterByBoolMask(list=ui_select_beam_python_script, mask=contains)
filterByBoolMask_2 = List.FilterByBoolMask(list=flatten, mask=contains)
direction = Line.Direction(line=filterByBoolMask_2.in)

# group: GROUPING CONDITION
XAxis = Vector.XAxis()
isParallel = Vector.IsParallel(vector=direction, other=XAxis)

# group: FILTER BEAMS BY AXIS
groupByKey = List.GroupByKey(list=filterByBoolMask.in, keys=isParallel)
code_block = CodeBlock(LIST=groupByKey.groups, BOOL=groupByKey.unique_keys) { LIST[List.IndexOf(BOOL,true)]; LIST[List.IndexOf(BOOL,false)]; }
code_block_2 = CodeBlock(True=code_block.out0, False=code_block.out1) { True; False; }
getLocation_2 = Element.GetLocation(element=code_block_2.True)
startPoint = Curve.StartPoint(curve=getLocation_2)
Y = Point.Y(point=startPoint)
round = Math.Round(number=Y)
getLocation_3 = Element.GetLocation(element=code_block_2.False)
direction_2 = Line.Direction(line=getLocation_3)
YAxis = Vector.YAxis()
isParallel_2 = Vector.IsParallel(vector=direction_2, other=YAxis)
filterByBoolMask_3 = List.FilterByBoolMask(list=code_block_2.False, mask=isParallel_2)
getLocation_4 = Element.GetLocation(element=filterByBoolMask_3.in)
startPoint_2 = Curve.StartPoint(curve=getLocation_4)
X = Point.X(point=startPoint_2)
round_2 = Math.Round(number=X)
join = List.Join(list0=filterByBoolMask_3.out, list1=filterByBoolMask.out)

# group: SORTING
sortByKey = List.SortByKey(list=code_block_2.True, keys=round)
sortByKey_2 = List.SortByKey(list=filterByBoolMask_3.in, keys=round_2)

# group: MARK BEAMS BASED ON X AND Y AXIS
groupByKey_2 = List.GroupByKey(list=sortByKey.sorted_list, keys=sortByKey.sorted_keys)
reverse = List.Reverse(list=groupByKey_2.groups)
if_statement_python_script = Python(IN[0]=reverse_x_beam_marks, IN[1]=reverse, IN[2]=groupByKey_2.groups)
# ---------- if_statement_python_script.python (23 lines) ----------
# Load the Python Standard and DesignScript Libraries
import sys
import clr
clr.AddReference('ProtoGeometry')
from Autodesk.DesignScript.Geometry import *

# The inputs to this node will be stored as a list in the IN variables.
BOOL = IN[0]
Arg_A = IN[1]
Arg_B = IN[2]

result = []

if BOOL == True:
	for a in Arg_A: 
		result.append(a)
else:
	for b in Arg_B: 
		result.append(b)
		pass

# Assign your output to the OUT variable.
OUT = result
# ----------------------------------------
groupByKey_3 = List.GroupByKey(list=sortByKey_2.sorted_list, keys=sortByKey_2.sorted_keys)
reverse_2 = List.Reverse(list=groupByKey_3.groups)
if_statement_python_script_2 = Python(IN[0]=reverse_y_beam_marks, IN[1]=reverse_2, IN[2]=groupByKey_3.groups)  # same code as if_statement_python_script
mark_beams_based_on_x_y_axis = CodeBlock(XBeams=if_statement_python_script, YBeams=if_statement_python_script_2, OBeams=join, Mark=beam_mark_prefix)
# ---------- mark_beams_based_on_x_y_axis.designscript (15 lines) ----------
Count1 = List.Count(XBeams);
Count2 = List.Count(YBeams);
Count3 = List.Count(OBeams);

count1 = 1..Count1;
count2 = (1+Count1)..(Count1+Count2);
count3 = (1+Count1+Count2)..(Count1+Count2+Count3);

Xmark = Mark + count1;
Ymark = Mark + count2;
Omark = Mark + count3;

Elements.Element.SetParameterByName(XBeams,"Mark",Xmark);
Elements.Element.SetParameterByName(YBeams,"Mark",Ymark);
Elements.Element.SetParameterByName(OBeams,"Mark",Omark);
# ----------------------------------------

# group: BEAMS MARKS BY AXIS
beams_x_axis = Watch(mark_beams_based_on_x_y_axis.Xmark)
beams_y_axis = Watch(mark_beams_based_on_x_y_axis.Ymark)
beams_o_axis = Watch(mark_beams_based_on_x_y_axis.Omark)
