# Dynamo graph Mark Beams by Level and Axis Location.dyn (Dynamo 2.6.1.8786)
# packages: Clockwork for Dynamo 2.x 2.3.0

# group: INPUTS
level_to_create_marks = Levels("03 - ROOF")  # graph input
beam_mark = StringInput("1B")  # graph input

# group: FILTER BEAMS BY LEVELS
categories = Categories("OST_StructuralFraming")
all_elements_of_category = ElementsOfCategory(Category=categories)
level = Custom[Element.Level](element=all_elements_of_category)  # package Clockwork for Dynamo 2.x; Gets an element's level
name = Level.Name(level=level)
groupByKey = List.GroupByKey(list=all_elements_of_category, keys=name)
groupByKey_2 = List.GroupByKey(list=level, keys=name)
name_2 = Level.Name(level=level_to_create_marks)
eq = groupByKey_2.unique_keys == name_2
filterByBoolMask = List.FilterByBoolMask(list=groupByKey.groups, mask=eq)
getLocation = Element.GetLocation(element=all_elements_of_category)
groupByKey_3 = List.GroupByKey(list=getLocation, keys=name)
filterByBoolMask_2 = List.FilterByBoolMask(list=groupByKey_3.groups, mask=eq)

# group: GET BEAMS AXIS (X/Y)
flatten = List.Flatten(list=filterByBoolMask.in)
flatten_2 = List.Flatten(list=filterByBoolMask_2.in)
direction = Line.Direction(line=flatten_2)
X = Vector.X(vector=direction)
round = Math.Round(number=X)
code_block = CodeBlock { 0; }
eq_2 = round == code_block

XAxis = Vector.XAxis()
isParallel = Vector.IsParallel(vector=direction, other=XAxis)
groupByKey_4 = List.GroupByKey(list=flatten, keys=isParallel)

# group: FILTER BEAMS BY AXIS
groupByKey_5 = List.GroupByKey(list=flatten, keys=eq_2)
code_block_2 = CodeBlock(x=groupByKey_4.groups) { x[0]; x[1]; }
getLocation_2 = Element.GetLocation(element=code_block_2.out1)
startPoint = Curve.StartPoint(curve=getLocation_2)
Y = Point.Y(point=startPoint)
round_2 = Math.Round(number=Y)
getLocation_3 = Element.GetLocation(element=code_block_2.out0)
startPoint_2 = Curve.StartPoint(curve=getLocation_3)
X_2 = Point.X(point=startPoint_2)
round_3 = Math.Round(number=X_2)

# group: SORTING
sortByKey = List.SortByKey(list=code_block_2.out1, keys=round_2)
sortByKey_2 = List.SortByKey(list=code_block_2.out0, keys=round_3)

# group: MARK BEAMS BASED ON X AND Y AXIS
groupByKey_6 = List.GroupByKey(list=sortByKey.sorted_list, keys=sortByKey.sorted_keys)
groupByKey_7 = List.GroupByKey(list=sortByKey_2.sorted_list, keys=sortByKey_2.sorted_keys)
mark_beams_based_on_x_y_axis = CodeBlock(XBeams=groupByKey_6.groups, YBeams=groupByKey_7.groups, Mark=beam_mark)
# ---------- mark_beams_based_on_x_y_axis.designscript (10 lines) ----------
Count1 = List.Count(XBeams);
Count2 = List.Count(YBeams);

count1 = 1..Count1;
count2 = (1+Count1)..(Count1 + Count2);

Xmark = Mark + count1;
Ymark = Mark + count2;
Elements.Element.SetParameterByName(XBeams,"Mark",Xmark);
Elements.Element.SetParameterByName(YBeams,"Mark",Ymark);
# ----------------------------------------

# group: BEAMS MARKS BY AXIS
beams_x_axis = Watch(mark_beams_based_on_x_y_axis.Xmark)
beams_y_axis = Watch(mark_beams_based_on_x_y_axis.Ymark)

reverse = List.Reverse(list=groupByKey_7.groups)
python_script = Python(IN[0]=all_elements_of_category)  # frozen
# ---------- python_script.python (92 lines) ----------
# Load the Python Standard and DesignScript Libraries
import sys
import clr
clr.AddReference('ProtoGeometry')
from Autodesk.DesignScript.Geometry import Point as PT, Line as Crv

clr.AddReference("RevitNodes")
import Revit
clr.ImportExtensions(Revit.Elements)
clr.ImportExtensions(Revit.GeometryConversion)

clr.AddReference("RevitServices")
import RevitServices
from RevitServices.Persistence import DocumentManager 
from RevitServices.Transactions import TransactionManager 

clr.AddReference("RevitAPI")
from Autodesk.Revit.DB import *
from Autodesk.Revit.Creation.Document import NewFamilyInstance
from Autodesk.Revit.DB.Structure import *

clr.AddReference("RevitAPIUI")
from Autodesk.Revit.UI import *

doc = DocumentManager.Instance.CurrentDBDocument

elements = UnwrapElement(IN[0])

IDs = []

for elem in elements:
	start = IDs.append(elem.Location.Curve.GetEndPoint(0))
	end = IDs.append(elem.Location.Curve.GetEndPoint(1))

DS_Points = []

for point in IDs:
	DS_Points.append(point.ToPoint())
	
DS_Points = PT.PruneDuplicates(DS_Points)

newCrv = Crv.ByBestFitThroughPoints(DS_Points)

collector = FilteredElementCollector(doc)

type = Document.GetElement(doc, elements[0].GetTypeId())

def GetLevel(item):
	val = None
	if hasattr(item, "LevelId"): 
		val = item.Document.GetElement(item.LevelId)
		if val: return val
	if hasattr(item, "Level"):
		val = item.Level
		if val: return val
	if hasattr(item, "GenLevel"):
		val = item.GenLevel
		if val: return val
	if (item.GetType().ToString() in ("Autodesk.Revit.DB.Architecture.StairsRun", "Autodesk.Revit.DB.Architecture.StairsLanding")):
		item = item.GetStairs()
	if (item.GetType().ToString() == "Autodesk.Revit.DB.Architecture.Stairs"):
		try: return item.Document.GetElement(item.get_Parameter(BuiltInParameter.STAIRS_BASE_LEVEL_PARAM).AsElementId())
		except: pass
	if (item.GetType().ToString() == "Autodesk.Revit.DB.ExtrusionRoof"):
		try: return item.Document.GetElement(item.get_Parameter(BuiltInParameter.ROOF_CONSTRAINT_LEVEL_PARAM).AsElementId())
		except: pass
	if not val:
		try: return item.Document.GetElement(item.get_Parameter(BuiltInParameter.INSTANCE_REFERENCE_LEVEL_PARAM).AsElementId())
		except: 
			try: return item.Document.GetElement(item.get_Parameter(BuiltInParameter.INSTANCE_SCHEDULE_ONLY_LEVEL_PARAM).AsElementId())
			except: 
				try: return item.Document.GetElement(item.get_Parameter(BuiltInParameter.SCHEDULE_LEVEL_PARAM).AsElementId())
				except: return None


TransactionManager.Instance.EnsureInTransaction(doc)

if isinstance(elements, list):
	newBeam = doc.Create.NewFamilyInstance(newCrv.ToRevitType(), type, GetLevel(elements[0]), StructuralType.Beam)
else:
	newBeam = doc.Create.NewFamilyInstance(newCrv.ToRevitType(), type, GetLevel(elements), StructuralType.Beam)

if newBeam:
	for elems in elements:
		mark = elems.GetParameters("Mark")
		Document.Delete(doc,elems.Id)
else:
	pass

TransactionManager.Instance.TransactionTaskDone()

OUT = newBeam,mark
# ----------------------------------------
boolean = BoolSelector(true)
python_script_2 = Python(IN[0]=boolean)  # frozen
# ---------- python_script_2.python (55 lines) ----------
# Load the Python Standard and DesignScript Libraries
import sys
import clr
clr.AddReference('ProtoGeometry')
from Autodesk.DesignScript.Geometry import *

clr.AddReference("RevitNodes")
import Revit
clr.ImportExtensions(Revit.Elements)
clr.ImportExtensions(Revit.GeometryConversion)

clr.AddReference("RevitServices")
import RevitServices
from RevitServices.Persistence import DocumentManager 
from RevitServices.Transactions import TransactionManager 

clr.AddReference("RevitAPI")
from Autodesk.Revit.DB import *

clr.AddReference("RevitAPIUI")
from Autodesk.Revit.UI import *

doc = DocumentManager.Instance.CurrentDBDocument
uiapp = DocumentManager.Instance.CurrentUIApplication 
app = uiapp.Application 
uidoc = uiapp.ActiveUIDocument

class MySelectionFilter(Selection.ISelectionFilter):
	def __init__(self):
		pass
	def AllowElement(self, element):
		if element.Category.Name == "Structural Framing":
			return True
		else:
			return False
	def AllowReference(self, element):
		return False

refresh = IN[0]
beams = []


Sel_filter = MySelectionFilter()
obj_type = Selection.ObjectType.Element

if refresh:
	selection = uidoc.Selection.PickObjects(obj_type,Sel_filter,"Select Structural Framing Element")
	
	for elems in selection:
			beams.append(Document.GetElement(doc,elems))
else:
	beams.append("Please Set Toggle to True")
	beams = beams[0]
# Assign your output to the OUT variable.
OUT = beams
# ----------------------------------------
