# Dynamo graph Mark Columns by Location and Similarity (RVT2021).dyn (Dynamo 2.6.2.15705)
# packages: Rhythm 2021.7.3

# group: INPUTS
run_script = BoolSelector(true)  # graph input
categories = Categories("OST_StructuralColumns")  # graph input
levels = Levels("01 - FIRST FLOOR")  # graph input
level_filter_parameter = StringInput("Base Level")  # graph input
top_bottom = BoolSelector(true)  # graph input
mark_parameter_name = StringInput("Mark")  # graph input
column_mark_prefix = StringInput("C")  # graph input

ʳʰʸᵗʰᵐ_selection_pick = Rhythm.Revit.Selection.Selection.Pick(runIt=run_script, category=categories)
name = Element.Name(element=levels)
getParameterValueByName = Element.GetParameterValueByName(element=ʳʰʸᵗʰᵐ_selection_pick, parameterName=level_filter_parameter)
name_2 = Element.Name(element=getParameterValueByName)

# group: FILTER - Columns By Level
eq = name == name_2
filterByBoolMask = List.FilterByBoolMask(list=ʳʰʸᵗʰᵐ_selection_pick, mask=eq)

getLocation = Element.GetLocation(element=filterByBoolMask.in)
Y = Point.Y(point=getLocation)
code_block = CodeBlock { 2; }
round = Math.Round(number=Y, digits=code_block)
groupByKey = List.GroupByKey(list=filterByBoolMask.in, keys=round)
groupByKey_2 = List.GroupByKey(list=getLocation, keys=round)

# group: Y - (Bottom-Top)
sortByKey = List.SortByKey(list=groupByKey.groups, keys=groupByKey.unique_keys)
sortByKey_2 = List.SortByKey(list=groupByKey_2.groups, keys=groupByKey_2.unique_keys)
X = Point.X(point=sortByKey_2.sorted_list)
sortByKey_3 = List.SortByKey(list=sortByKey.sorted_list@L2, keys=X@L2)

# group: Y - (Top-Bottom)
reverse = List.Reverse(list=sortByKey.sorted_list)
reverse_2 = List.Reverse(list=sortByKey_2.sorted_list)
X_2 = Point.X(point=reverse_2)
sortByKey_4 = List.SortByKey(list=reverse@L2, keys=X_2@L2)

python_script = Python(IN[0]=sortByKey_4.sorted_list, IN[1]=sortByKey_3.sorted_list, IN[2]=top_bottom)
# ---------- python_script.python (21 lines) ----------
# Load the Python Standard and DesignScript Libraries
import sys
import clr
clr.AddReference('ProtoGeometry')
from Autodesk.DesignScript.Geometry import *

# The inputs to this node will be stored as a list in the IN variables.
dataA = IN[0]
dataB = IN[1]
BOOL = IN[2]

output = []

if BOOL == True:
	output = dataA
else:
	output = dataB


# Assign your output to the OUT variable.
OUT = output
# ----------------------------------------
count = List.Count(list=filterByBoolMask.in)
code_block_2 = CodeBlock(C=count) { 1..C; }

# group: OUTPUT
flatten = List.Flatten(list=python_script)
add = column_mark_prefix + code_block_2
setParameterByName = Element.SetParameterByName(element=flatten, parameterName=mark_parameter_name, value=add)

length = String.Length(str=name)
code_block_3 = CodeBlock(l=length) { c = 13; 1; l-c; }
