# Dynamo graph Mark Columns by Location and Similarity.dyn (Dynamo 2.12.1.8246)
# packages: Rhythm 2021.7.3

# group: INPUTS
run_script = BoolSelector(true)  # graph input
categories = Categories("OST_StructuralColumns")
levels = Levels("FOUNDATION LEVEL")  # graph input
level_filter_parameter = StringInput("Base Level")  # graph input
column_mark_prefix = StringInput("C")  # graph input

ʳʰʸᵗʰᵐ_selection_pick = Rhythm.Revit.Selection.Selection.Pick(runIt=run_script, category=categories)
name = Element.Name(element=levels)
getParameterValueByName = Element.GetParameterValueByName(element=ʳʰʸᵗʰᵐ_selection_pick, parameterName=level_filter_parameter)
name_2 = Element.Name(element=getParameterValueByName)
eq = name == name_2
filterByBoolMask = List.FilterByBoolMask(list=ʳʰʸᵗʰᵐ_selection_pick, mask=eq)
getLocation = Element.GetLocation(element=filterByBoolMask.in)
Y = Point.Y(point=getLocation)
code_block = CodeBlock { 2; }
round = Math.Round(number=Y, digits=code_block)
groupByKey = List.GroupByKey(list=filterByBoolMask.in, keys=round)
sortByKey = List.SortByKey(list=groupByKey.groups, keys=groupByKey.uniqueKeys)
groupByKey_2 = List.GroupByKey(list=getLocation, keys=round)
sortByKey_2 = List.SortByKey(list=groupByKey_2.groups, keys=groupByKey_2.uniqueKeys)
X = Point.X(point=sortByKey_2.sortedList)
sortByKey_3 = List.SortByKey(list=sortByKey.sortedList, keys=X, lacing=Longest)
flatten = List.Flatten(list=sortByKey_3.sortedList)
string = StringInput("Mark")
count = List.Count(list=filterByBoolMask.in)
code_block_2 = CodeBlock(C=count) { 1..C; }
add = column_mark_prefix + code_block_2
setParameterByName = Element.SetParameterByName(element=flatten, parameterName=string, value=add)
