# Dynamo graph Mark Pile Caps - Foundation Slab.dyn (Dynamo 2.6.2.15705)

string = StringInput("A1010130")
refresh = BoolSelector(false)
python_script = Python(IN[0]=string, IN[1]=refresh)
# ---------- python_script.python (38 lines) ----------
import sys
import clr
clr.AddReference('ProtoGeometry')
from Autodesk.DesignScript.Geometry import *

clr.AddReference("RevitNodes")
import Revit
clr.ImportExtensions(Revit.Elements)
clr.ImportExtensions(Revit.GeometryConversion)

clr.AddReference("RevitServices")
import RevitServices
from RevitServices.Persistence import DocumentManager 
from RevitServices.Transactions import TransactionManager 

clr.AddReference("RevitAPI")
from Autodesk.Revit.DB import *

clr.AddReference("RevitAPIUI")
from Autodesk.Revit.UI import *

doc = DocumentManager.Instance.CurrentDBDocument


FDNS = FilteredElementCollector(doc, doc.ActiveView.Id).OfCategory(BuiltInCategory.OST_StructuralFoundation).WhereElementIsNotElementType().ToElements()

TransactionManager.Instance.EnsureInTransaction(doc)
pileCaps = []
assemblyCode = IN[0]

for fdn in FDNS:
	fdnType = doc.GetElement(fdn.GetTypeId())
	AssCode = fdnType.LookupParameter("Assembly Code")
	if AssCode.AsString() == assemblyCode:
		pileCaps.append(fdn)
		

OUT = pileCaps
# ----------------------------------------
geometry = Element.Geometry(element=python_script)
flatten = List.Flatten(list=geometry)
area = Solid.Area(solid=flatten)
code_block = CodeBlock { 100000; }
div = area / code_block
round = Math.Round(number=div)
sortByKey = List.SortByKey(list=python_script, keys=round)
groupByKey = List.GroupByKey(list=sortByKey.sorted_list, keys=sortByKey.sorted_keys)
string_2 = StringInput("Mark")
string_3 = StringInput("A-PC")
count = List.Count(list=groupByKey.groups)
code_block_2 = CodeBlock(C=count) { 1..C; }
add = string_3 + code_block_2
setParameterByName = Element.SetParameterByName(element=groupByKey.groups, parameterName=string_2, value=add)
getParameterValueByName = Element.GetParameterValueByName(element=setParameterByName, parameterName=string_2)
code_block_3 = CodeBlock { 2; }
round_2 = Math.Round(number=area, digits=code_block_3)
