# Dynamo graph Mark Pile Caps-Structural Foundation.dyn (Dynamo 2.6.1.8786)

# group: INPUTS
left_right_bottom_top = BoolSelector(false)  # graph input
left_right_top_bottom = BoolSelector(true)  # graph input
right_left_top_bottom = BoolSelector(false)  # graph input
right_left_bottom_top = BoolSelector(false)  # graph input
refresh_script = BoolSelector(true)  # graph input
foundation_mark_prefix = StringInput("PC")  # graph input

python_script = Python(IN[0]=refresh_script)
# ---------- python_script.python (77 lines) ----------
import clr
import sys
sys.path.append('C:\Program Files (x86)\IronPython 2.7\Lib')

import System
from System import Array
from System.Collections.Generic import *
clr.AddReference('ProtoGeometry')
from Autodesk.DesignScript.Geometry import *

clr.AddReference("RevitNodes")
import Revit
clr.ImportExtensions(Revit.Elements)
clr.ImportExtensions(Revit.GeometryConversion)

clr.AddReference("RevitServices")
import RevitServices
from RevitServices.Persistence import DocumentManager 
from RevitServices.Transactions import TransactionManager 

clr.AddReference("RevitAPI")
from Autodesk.Revit.DB import *

clr.AddReference("RevitAPIUI")
from Autodesk.Revit.UI import *

doc = DocumentManager.Instance.CurrentDBDocument
uiapp = DocumentManager.Instance.CurrentUIApplication 
app = uiapp.Application 
uidoc = uiapp.ActiveUIDocument


TransactionManager.Instance.EnsureInTransaction(doc)

catFilter = ElementCategoryFilter(BuiltInCategory.OST_StructuralFoundation)

collector = FilteredElementCollector(doc,doc.ActiveView.Id)

foundation = collector.WherePasses(catFilter).WhereElementIsNotElementType().ToElements()

pilecaps = []
assemblyCodes = []
TypeMark = []
FDNType = []

for fdns in foundation:
	fdnType = doc.GetElement(fdns.GetTypeId())
	AssCode = fdnType.LookupParameter("Assembly Code")
	if AssCode.AsString() == "A1010130":
		pilecaps.append(fdns)
		TypeMark.append(fdnType.LookupParameter("Type Mark").AsString())
		FDNType.append(fdnType)
		
familyNames = []
typeNames = []

for fdn in FDNType:
	familyNames.append(fdn.LookupParameter("Family Name").AsString())

FDNType = [name for _,name in sorted(zip(familyNames,FDNType))]

for fdn in FDNType:
	typeNames.append(fdn.LookupParameter("Type Name").AsString())
	
familyNames = sorted(set(familyNames))

typeByGroup = []

for famName in familyNames:
	GroupByFamName = []
	for elem in FDNType:
		if elem.LookupParameter("Family Name").AsString() == famName:
			GroupByFamName.append(elem)
	typeByGroup.append(GroupByFamName)


OUT = typeNames, FDNType, pilecaps, doc.ActiveView,typeByGroup
# ----------------------------------------
code_block = CodeBlock(x=python_script) { x[0]; x[1]; x[2]; x[3]; x[4]; }
code_block_2 = CodeBlock(grouped=code_block.out4, ungrouped=code_block.out2) { grouped; ungrouped; }
number = DoubleInput(200)
groupByKey = List.GroupByKey(list=code_block.out1, keys=code_block.out0)
firstItem = List.FirstItem(list=groupByKey.groups@L2)
string = StringInput("Type Mark")
count = List.Count(list=firstItem)
code_block_3 = CodeBlock(C=count) { 1..C; }
string_from_object = FromObject(obj=code_block_3)
padding = DoubleInput(2)  # graph input
number_2 = DoubleInput(0)
string_from_object_2 = FromObject(obj=number_2)
padLeft = String.PadLeft(str=string_from_object, newWidth=padding, padChars=string_from_object_2)
add = foundation_mark_prefix + padLeft
setParameterByName = Element.SetParameterByName(element=firstItem, parameterName=string, value=add)
code_block_4 = CodeBlock { "Length"; }
getParameterValueByName = Element.GetParameterValueByName(element=setParameterByName, parameterName=code_block_4)
code_block_5 = CodeBlock(TagOffset=number, V=getParameterValueByName) { TagOffset + V/2; }
byCoordinates = Vector.ByCoordinates(y=code_block_5)
count_2 = List.Count(list=code_block_2.grouped@L2)
cycle = List.Cycle(list=byCoordinates, amount=count_2, lacing=Longest)
flatten = List.Flatten(list=cycle)
byElementAndOffset = Tag.ByElementAndOffset(view=code_block.out3, element=code_block_2.ungrouped, offset=flatten)
