# Dynamo graph Mark Piles by Location.dyn "Mark Columns by Location and Similarity" (Dynamo 2.6.1.8786)
# packages: Rhythm 2021.7.3

# group: INPUTS
run_script = BoolSelector(true)  # graph input
categories = Categories("OST_StructuralColumns")
levels = Levels("01 - GRD FLR")
level_filter_parameter = StringInput("Base Level")  # graph input
column_mark_prefix = StringInput("1C")  # graph input

ʳʰʸᵗʰᵐ_selection_pick = Rhythm.Revit.Selection.Selection.Pick(runIt=run_script, category=categories)
name = Element.Name(element=levels)
getParameterValueByName = Element.GetParameterValueByName(element=ʳʰʸᵗʰᵐ_selection_pick, parameterName=level_filter_parameter)
name_2 = Element.Name(element=getParameterValueByName)
eq = name == name_2
filterByBoolMask = List.FilterByBoolMask(list=ʳʰʸᵗʰᵐ_selection_pick, mask=eq)
getLocation = Element.GetLocation(element=filterByBoolMask.in)
Y = Point.Y(point=getLocation)
code_block = CodeBlock { 2; }
round = Math.Round(number=Y, digits=code_block)
groupByKey = List.GroupByKey(list=getLocation, keys=round)
sortByKey = List.SortByKey(list=groupByKey.groups, keys=groupByKey.unique_keys)
X = Point.X(point=sortByKey.sorted_list)
sortByKey_2 = List.SortByKey(list=sortByKey.sorted_list, keys=X, lacing=Longest)
groupByKey_2 = List.GroupByKey(list=filterByBoolMask.in, keys=round)
sortByKey_3 = List.SortByKey(list=groupByKey_2.groups, keys=groupByKey_2.unique_keys)
sortByKey_4 = List.SortByKey(list=sortByKey_3.sorted_list, keys=X, lacing=Longest)
flatten = List.Flatten(list=sortByKey_4.sorted_list)
string = StringInput("Mark")
count = List.Count(list=filterByBoolMask.in)
code_block_2 = CodeBlock(C=count) { 1..C; }
add = column_mark_prefix + code_block_2
setParameterByName = Element.SetParameterByName(element=flatten, parameterName=string, value=add)
