# Dynamo graph Dimension Element Center References to Grid.dyn (Dynamo 2.6.2.15705)
# packages: Genius Loci 2022.4.19

# group: INPUTS
refresh = BoolSelector(true)  # graph input
python_script = Python(IN[0]=refresh)
# ---------- python_script.python (331 lines) ----------
import sys
import clr
clr.AddReference("System.IO")
clr.AddReference("System.Reflection")
clr.AddReference("System.Threading")
clr.AddReference("System.Drawing")
clr.AddReference("System.Windows.Forms")
clr.AddReference("System")
import System.IO
import System.Reflection
import System.Threading
import System.Drawing
import System.Windows.Forms
from System.Threading import ApartmentState, Thread, ThreadStart
from System import Array, Object
from System.Collections.Generic import *

clr.AddReference("RevitServices")
import RevitServices
from RevitServices.Persistence import DocumentManager 
from RevitServices.Transactions import TransactionManager 

clr.AddReference("RevitAPI")
from Autodesk.Revit.DB import *
from Autodesk.Revit.Creation import ItemFactoryBase

clr.AddReference("RevitAPIUI")
from Autodesk.Revit.UI import *


def tolist(obj1):
	if hasattr(obj1,"__iter__"): return obj1
	else: return [obj1]

def hasInd(l1, i):
	try:
		l1[i]
		return  True
	except:
		return  False

class NameWrap(Object):
	def __init__(this, obj1, name1 = None):
		this.obj = obj1
		if obj1 == None: name1 = "null"
		if name1 == None and obj1 != None: this.name = obj1.ToString()
		else: this.name = name1
	def ToString(this):
		return this.name

class AutoDimension(System.Windows.Forms.Form):
    def __init__(this):
        this.Select_Category =  System.Windows.Forms.ComboBox()
        this.label1 =  System.Windows.Forms.Label()
        this.Dimension_Style =  System.Windows.Forms.ComboBox()
        this.label2 =  System.Windows.Forms.Label()
        this.GridDimOffset =  System.Windows.Forms.NumericUpDown()
        this.label3 =  System.Windows.Forms.Label()
        this.label4 =  System.Windows.Forms.Label()
        this.EdgeDimOffset =  System.Windows.Forms.NumericUpDown()
        this.button1 =  System.Windows.Forms.Button()
        this.button2 =  System.Windows.Forms.Button()
        this.label5 =  System.Windows.Forms.Label()
        this.label6 =  System.Windows.Forms.Label()
        this.SuspendLayout()
        #
        # Select_Category
        #
        this.Select_Category.FormattingEnabled = True
        this.Select_Category.Location =  System.Drawing.Point(156, 35)
        this.Select_Category.Name = "Select_Category"
        this.Select_Category.Size =  System.Drawing.Size(228, 21)
        this.Select_Category.TabIndex = 0
        #
        # label1
        #
        this.label1.AutoSize = True
        this.label1.Location =  System.Drawing.Point(32, 38)
        this.label1.Name = "label1"
        this.label1.Size =  System.Drawing.Size(82, 13)
        this.label1.TabIndex = 1
        this.label1.Text = "Select Category"
        this.label1.TextAlign = System.Drawing.ContentAlignment.MiddleCenter
        #
        # Dimension_Style
        #
        this.Dimension_Style.FormattingEnabled = True
        this.Dimension_Style.Location =  System.Drawing.Point(156, 77)
        this.Dimension_Style.Name = "Dimension_Style"
        this.Dimension_Style.Size =  System.Drawing.Size(228, 21)
        this.Dimension_Style.TabIndex = 0
        #
        # label2
        #
        this.label2.AutoSize = True
        this.label2.Location =  System.Drawing.Point(32, 80)
        this.label2.Name = "label2"
        this.label2.Size =  System.Drawing.Size(82, 13)
        this.label2.TabIndex = 1
        this.label2.Text = "Dimension Style"
        this.label2.TextAlign = System.Drawing.ContentAlignment.MiddleCenter
        #
        # GridDimOffset
        #
        this.GridDimOffset.Increment =  10
        this.GridDimOffset.Location =  System.Drawing.Point(156, 118)
        this.GridDimOffset.Maximum =  5000
        this.GridDimOffset.Minimum = 200
        this.GridDimOffset.Name = "GridDimOffset"
        this.GridDimOffset.Size =  System.Drawing.Size(89, 20)
        this.GridDimOffset.TabIndex = 2
        this.GridDimOffset.Value =  400
        #
        # label3
        #
        this.label3.AutoSize = True
        this.label3.Location =  System.Drawing.Point(32, 120)
        this.label3.Name = "label3"
        this.label3.Size =  System.Drawing.Size(109, 13)
        this.label3.TabIndex = 1
        this.label3.Text = "Grid Dimension Offset"
        this.label3.TextAlign = System.Drawing.ContentAlignment.MiddleCenter
        #
        # label4
        #
        this.label4.AutoSize = True
        this.label4.Location =  System.Drawing.Point(32, 161)
        this.label4.Name = "label4"
        this.label4.Size =  System.Drawing.Size(115, 13)
        this.label4.TabIndex = 1
        this.label4.Text = "Edge Dimension Offset"
        this.label4.TextAlign = System.Drawing.ContentAlignment.MiddleCenter
        #
        # EdgeDimOffset
        #
        this.EdgeDimOffset.Increment =  10
        this.EdgeDimOffset.Location =  System.Drawing.Point(156, 159)
        this.EdgeDimOffset.Maximum =  5000
        this.EdgeDimOffset.Minimum =  400
        this.EdgeDimOffset.Name = "EdgeDimOffset"
        this.EdgeDimOffset.Size =  System.Drawing.Size(89, 20)
        this.EdgeDimOffset.TabIndex = 2
        this.EdgeDimOffset.Value =  400
        #
        # button1
        #
        this.button1.BackColor = System.Drawing.Color.FromArgb(192, 192, 255)
        this.button1.Location =  System.Drawing.Point(297, 187)
        this.button1.Name = "button1"
        this.button1.Size =  System.Drawing.Size(75, 23)
        this.button1.TabIndex = 3
        this.button1.Text = "OK"
        this.button1.UseMnemonic = False
        this.button1.UseVisualStyleBackColor = False
        this.button1.DialogResult = System.Windows.Forms.DialogResult.OK
#        this.button1.Click += this.finish
        #
        # button2
        #
        this.button2.BackColor = System.Drawing.Color.FromArgb(255, 192, 192)
        this.button2.Location =  System.Drawing.Point(378, 187)
        this.button2.Name = "button2"
        this.button2.Size =  System.Drawing.Size(75, 23)
        this.button2.TabIndex = 3
        this.button2.Text = "Cancel"
        this.button2.UseVisualStyleBackColor = False
        this.button2.DialogResult = System.Windows.Forms.DialogResult.Cancel

        #
        # label5
        #
        this.label5.AutoSize = True
        this.label5.Location =  System.Drawing.Point(251, 120)
        this.label5.Name = "label5"
        this.label5.Size =  System.Drawing.Size(29, 13)
        this.label5.TabIndex = 1
        this.label5.Text = "(mm)"
        this.label5.TextAlign = System.Drawing.ContentAlignment.MiddleCenter
        #
        # label6
        #
        this.label6.AutoSize = True
        this.label6.Location =  System.Drawing.Point(251, 161)
        this.label6.Name = "label6"
        this.label6.Size =  System.Drawing.Size(29, 13)
        this.label6.TabIndex = 1
        this.label6.Text = "(mm)"
        this.label6.TextAlign = System.Drawing.ContentAlignment.MiddleCenter
        #
        # Form1
        #
        this.StartPosition = System.Windows.Forms.FormStartPosition.CenterScreen
        this.AutoScaleDimensions =  System.Drawing.SizeF(6, 13)
        this.AutoScaleMode = System.Windows.Forms.AutoScaleMode.Font
        this.BackColor = System.Drawing.SystemColors.ControlLight
        this.ClientSize =  System.Drawing.Size(463, 222)
        this.MaximumSize =   System.Drawing.Size(479, 261)
        this.MinimumSize =   System.Drawing.Size(479, 261)
        this.MaximizeBox = False
        this.MinimizeBox = False
        this.Controls.Add(this.button2)
        this.Controls.Add(this.button1)
        this.Controls.Add(this.EdgeDimOffset)
        this.Controls.Add(this.label4)
        this.Controls.Add(this.GridDimOffset)
        this.Controls.Add(this.label6)
        this.Controls.Add(this.label5)
        this.Controls.Add(this.label3)
        this.Controls.Add(this.label2)
        this.Controls.Add(this.label1)
        this.Controls.Add(this.Dimension_Style)
        this.Controls.Add(this.Select_Category)
        this.ForeColor = System.Drawing.SystemColors.ActiveCaptionText
        this.Name = "Form1"
        this.ShowIcon = False
        this.Text = "KennyStruct | Auto Dimension Element to Grid"
        this.TopMost = True
        this.ResumeLayout(False)
        this.PerformLayout()

	def add_range(this,CAT,DIM):
		this.Select_Category.Items.AddRange(CAT)
		this.Dimension_Style.Items.AddRange(DIM)

	def finish(this,sender,event):
		this.Finish = this.Select_Category.SelectedItem,this.Dimension_Stylethis.SelectedItem
		this.Close()

	def cancel(this,sender,event):
		this.Cancel = None
		this.Close()


UI = AutoDimension()


doc = DocumentManager.Instance.CurrentDBDocument
uiapp = DocumentManager.Instance.CurrentUIApplication 
app = uiapp.Application 
uidoc = uiapp.ActiveUIDocument


def tolist(obj1):
	if hasattr(obj1,"__iter__"): return obj1
	else: return [obj1]

def hasInd(l1, i):
	try:
		l1[i]
		return  True
	except:
		return  False
		
class NameWrap(Object):
	def __init__(this, obj1, name1 = None):
		this.obj = obj1
		if obj1 == None: name1 = "null"
		if name1 == None and obj1 != None: this.name = obj1.ToString()
		else: this.name = name1
	def ToString(this):
		return this.name


settings = doc.Settings

categories = settings.Categories

collector = FilteredElementCollector(doc).OfClass(DimensionType).ToElements()

dimensionTypes = []
dimNames = []

for dim in collector:
	if dim.FamilyName == "Linear Dimension Style" and dim.LookupParameter("Type Name").AsString() != "":
		dimensionTypes.append(dim)
		dimNames.append(dim.LookupParameter("Type Name").AsString())

dimensionTypes = tolist([dimType for _,dimType in sorted(zip(dimNames,dimensionTypes))])

dimNames = tolist(sorted(dimNames))

categoryNames = sorted([cat.Name for cat in categories if cat.AllowsBoundParameters])

for i in xrange(len(dimensionTypes)):
	name1 = None
	if hasInd(dimNames, i): name1 = dimNames[i]
	dimensionTypes[i] = NameWrap(dimensionTypes[i], name1)

cat_Array = Array[Object](categoryNames)
dim_Array = Array[Object](dimensionTypes)

UI.Select_Category.Items.AddRange(cat_Array)
UI.Dimension_Style.Items.AddRange(dim_Array)


UI.ShowDialog()

try:

	if UI.DialogResult.ToString() == "OK" and bool(UI.Select_Category.SelectedItem) != False:
	
		class MySelectionFilter(Selection.ISelectionFilter):
			def __init__(self):
				pass
			def AllowElement(self, element):
				if element.Category.Name == UI.Select_Category.SelectedItem:
					return True
				else:
					return False
			def AllowReference(self, element):
				return False
				
		message = "Please Select {} Elements in current view"
		
		TaskDialog.Show("Select Elements", message.format(UI.Select_Category.SelectedItem))
		Sel_filter = MySelectionFilter()
		obj_type = Selection.ObjectType.Element
		
		selection = []
		
		for elemRef in uidoc.Selection.PickObjects(obj_type,Sel_filter,"Select Element(s)"):
			selection.append(Document.GetElement(doc,elemRef))
			
		OUT = UI.Dimension_Style.SelectedItem.obj, float(UI.GridDimOffset.Value), float(UI.EdgeDimOffset.Value),selection
	
	elif UI.DialogResult.ToString() == "Cancel" or bool(UI.Select_Category.SelectedItem) == False or bool(UI.Dimension_Style.SelectedItem) == False:
		TaskDialog.Show("Auto Dimension Error", "Missing one or more data; Please fill up dialog box")
		OUT = "Missing one or more data; please fill up dialog box"

except Exception:
	sys.exit
# ----------------------------------------
code_block = CodeBlock(x=python_script) { dimStyle = x[0]; gridOffset = x[1]; edgeOffset = x[2]; elems = x[3]; }

# group: SELECTED ELEMENT LOCATIONS
getLocation = Element.GetLocation(element=code_block.elems)

YAxis = Vector.YAxis()
elementType = Element.ElementType(element=code_block.elems)
string = StringInput("Diameter")
getParameterValueByName = Element.GetParameterValueByName(element=elementType, parameterName=string)
code_block_2 = CodeBlock { 100; }
add = getParameterValueByName + code_block_2
translate = Geometry.Translate(geometry=getLocation, direction=YAxis, distance=add)
byStartPointEndPoint = Line.ByStartPointEndPoint(startPoint=getLocation, endPoint=translate)
XAxis = Vector.XAxis()
translate_2 = Geometry.Translate(geometry=byStartPointEndPoint, direction=XAxis, distance=add)
familyinstance_references = Custom[FamilyInstance References](familyInstance=code_block.elems)  # package Genius Loci; Returns all references and references names.
code_block_3 = CodeBlock()
# ---------- code_block_3.designscript (2 lines) ----------
["Center (Left/Right)",
"Center (Front/Back)"];
# ----------------------------------------
indexOf = List.IndexOf(list=familyinstance_references.ReferenceName@L2, element=code_block_3@L2, lacing=Longest)
getItemAtIndex = List.GetItemAtIndex(list=familyinstance_references.Reference@L2, index=indexOf@L2)
code_block_4 = CodeBlock { 0; 1; }

# group: X-REFERENCE - CENTER(FRONT/BACK)
getItemAtIndex_2 = List.GetItemAtIndex(list=getItemAtIndex@L2, index=code_block_4.out1)

# group: GRIDS
categories = Categories("OST_Grids")
all_elements_of_category = ElementsOfCategory(Category=categories)
curve = Grid.Curve(grid=all_elements_of_category)
type = Object.Type(obj=curve)
string_2 = StringInput("Line")
contains = String.Contains(str=type, searchFor=string_2)
filterByBoolMask = List.FilterByBoolMask(list=curve, mask=contains)
direction = Line.Direction(line=filterByBoolMask.in)

# group: X-GRID & REFERENCE
XAxis_2 = Vector.XAxis()
isParallel = Vector.IsParallel(vector=direction, other=XAxis_2)
filterByBoolMask_2 = List.FilterByBoolMask(list=all_elements_of_category, mask=isParallel)
filterByBoolMask_3 = List.FilterByBoolMask(list=filterByBoolMask.in, mask=isParallel)
distanceTo = Geometry.DistanceTo(geometry=filterByBoolMask_3.in, other=getLocation@L2, lacing=Longest)
transpose = List.Transpose(lists=distanceTo)
sortIndexByValue = List.SortIndexByValue(list=transpose)
firstItem = List.FirstItem(list=sortIndexByValue@L2)
getItemAtIndex_3 = List.GetItemAtIndex(list=filterByBoolMask_2.in, index=firstItem)
element_reference_python_script = Python(IN[0]=getItemAtIndex_3)
# ---------- element_reference_python_script.python (24 lines) ----------
import clr
clr.AddReference('RevitAPI')
import Autodesk
from Autodesk.Revit.DB import *

clr.AddReference("RevitServices")
import RevitServices
from RevitServices.Persistence import DocumentManager
doc = DocumentManager.Instance.CurrentDBDocument

elements = UnwrapElement(IN[0]) if isinstance(IN[0],list) else [UnwrapElement(IN[0])]

ref=[]
for element in elements:
	if isinstance (element, Autodesk.Revit.DB.Dimension):
		ref.append(element.References)
	elif isinstance (element, Autodesk.Revit.DB.ReferencePlane):
		ref.append(element.GetReference())
	elif isinstance (element, Autodesk.Revit.DB.Grid) and element.Document.Title != doc.Title :
		ref.append(element.Curve.Reference)
	else : ref.append(Reference(element))

if isinstance(IN[0], list): OUT = ref
else: OUT = ref[0]
# ----------------------------------------

# group: EXTRACT ELEMENTS FACES
faces = Element.Faces(element=code_block.elems)
code_block_5 = CodeBlock { 0.5; }
normalAtParameter = Surface.NormalAtParameter(surface=faces, u=code_block_5, v=code_block_5)
normalized = Vector.Normalized(vector=normalAtParameter)

# group: Surface Parallel to X Dimension
YAxis_2 = Vector.YAxis()
isParallel_2 = Vector.IsParallel(vector=normalized, other=YAxis_2)
filterByBoolMask_4 = List.FilterByBoolMask(list=faces, mask=isParallel_2)
surface_parallel_to_x = CodeBlock(X=filterByBoolMask_4.in) { X; }

# group: LINE Y
firstItem_2 = List.FirstItem(list=surface_parallel_to_x@L2)
code_block_6 = CodeBlock { 0; }
pointAtParameter = Surface.PointAtParameter(surface=firstItem_2, u=code_block_6, v=code_block_6)
reverse = Vector.Reverse(vector=YAxis_2)
code_block_7 = CodeBlock { 2000; }
byStartPointDirectionLength = Line.ByStartPointDirectionLength(startPoint=pointAtParameter, direction=reverse, length=code_block_7)
XAxis_3 = Vector.XAxis()
reverse_2 = Vector.Reverse(vector=XAxis_3)
translate_3 = Geometry.Translate(geometry=byStartPointDirectionLength, direction=reverse_2, distance=code_block.gridOffset)
code_block_8 = CodeBlock(Y=firstItem_2) { Y[0]; }

# group: Surface Parallel to Y Dimension
XAxis_4 = Vector.XAxis()
isParallel_3 = Vector.IsParallel(vector=normalized, other=XAxis_4)
filterByBoolMask_5 = List.FilterByBoolMask(list=faces, mask=isParallel_3)
surface_parallel_to_y = CodeBlock(Y=filterByBoolMask_5.in) { Y; }

# group: LINE X
firstItem_3 = List.FirstItem(list=surface_parallel_to_y@L2)
code_block_9 = CodeBlock { 0; }
pointAtParameter_2 = Surface.PointAtParameter(surface=firstItem_3, u=code_block_9, v=code_block_9)
code_block_10 = CodeBlock { 2000; }
byStartPointDirectionLength_2 = Line.ByStartPointDirectionLength(startPoint=pointAtParameter_2, direction=XAxis_4, length=code_block_10)
YAxis_3 = Vector.YAxis()
reverse_3 = Vector.Reverse(vector=YAxis_3)
translate_4 = Geometry.Translate(geometry=byStartPointDirectionLength_2, direction=reverse_3, distance=code_block.gridOffset)
code_block_11 = CodeBlock(X=surface_parallel_to_y) { X[0]; }

translate_5 = Geometry.Translate(geometry=getLocation, direction=XAxis, distance=add)
byStartPointEndPoint_2 = Line.ByStartPointEndPoint(startPoint=getLocation, endPoint=translate_5)
translate_6 = Geometry.Translate(geometry=byStartPointEndPoint_2, direction=YAxis, distance=add)

# group: Y-REFERENCE - CENTER(LEFT/RIGHT)
getItemAtIndex_4 = List.GetItemAtIndex(list=getItemAtIndex@L2, index=code_block_4.out0)

# group: Y-GRID & REFERENCE
YAxis_4 = Vector.YAxis()
isParallel_4 = Vector.IsParallel(vector=direction, other=YAxis_4)
filterByBoolMask_6 = List.FilterByBoolMask(list=all_elements_of_category, mask=isParallel_4)
filterByBoolMask_7 = List.FilterByBoolMask(list=filterByBoolMask.in, mask=isParallel_4)
distanceTo_2 = Geometry.DistanceTo(geometry=filterByBoolMask_7.in, other=getLocation@L2, lacing=Longest)

transpose_2 = List.Transpose(lists=distanceTo_2)

# group (continued): Y-GRID & REFERENCE
sortIndexByValue_2 = List.SortIndexByValue(list=transpose_2)
firstItem_4 = List.FirstItem(list=sortIndexByValue_2@L2)
getItemAtIndex_5 = List.GetItemAtIndex(list=filterByBoolMask_6.in, index=firstItem_4)
element_reference_python_script_2 = Python(IN[0]=getItemAtIndex_5)  # same code as element_reference_python_script

# group: DIMENSION TO GRIDS
python_script_2 = Python(IN[0]=getItemAtIndex_2, IN[1]=element_reference_python_script)
# ---------- python_script_2.python (24 lines) ----------
# Load the Python Standard and DesignScript Libraries
import sys
import clr
clr.AddReference('ProtoGeometry')
from Autodesk.DesignScript.Geometry import *

# The inputs to this node will be stored as a list in the IN variables.
listA = IN[0]
listB = IN[1]
# Place your code below this line
newList = []

for x,y in zip(listA,listB):
	listTemp = []
	listTemp.insert(0,x)
	listTemp.insert(1,y)
	newList.append(listTemp)





# Assign your output to the OUT variable.
OUT = newList
# ----------------------------------------
python_script_3 = Python(IN[0]=translate_2, IN[1]=python_script_2, IN[2]=refresh, IN[3]=code_block.dimStyle)
# ---------- python_script_3.python (51 lines) ----------
import clr
clr.AddReference('ProtoGeometry')
from Autodesk.DesignScript.Geometry import *

clr.AddReference("RevitNodes")
import Revit
clr.ImportExtensions(Revit.GeometryConversion)
from Revit import GeometryConversion as GeoConv

from Revit.Elements import *

clr.AddReference('RevitAPI')
from Autodesk.Revit.DB import *

clr.AddReference("RevitServices")
import RevitServices
from RevitServices.Persistence import DocumentManager
from RevitServices.Transactions import TransactionManager

doc = DocumentManager.Instance.CurrentDBDocument

lines = IN[0]
References=(IN[1])
dimType = IN[3]
dimTypes = FilteredElementCollector(doc).OfClass(DimensionType).ToElements()

DIMType = []

for dims in dimTypes:
	if dims.Id.IntegerValue == dimType.Id:
		DIMType.append(dims)

DIMENSION = []

opt=Options()
opt.ComputeReferences=True
opt.IncludeNonVisibleObjects=True
opt.View=doc.ActiveView

for line,refs in zip(lines,References):
	line = GeoConv.ProtoToRevitCurve.ToRevitType(line)
	elementsRef = ReferenceArray()
	for ref in refs:
		elementsRef.Append(ref)
		
	TransactionManager.Instance.EnsureInTransaction(doc)
	
	DIMENSION.append(doc.Create.NewDimension(doc.ActiveView, line, elementsRef, DIMType[0]))

	TransactionManager.Instance.TransactionTaskDone()		
OUT = DIMENSION
# ----------------------------------------
python_script_4 = Python(IN[0]=getItemAtIndex_4, IN[1]=element_reference_python_script_2)  # same code as python_script_2
python_script_5 = Python(IN[0]=translate_6, IN[1]=python_script_4, IN[2]=refresh, IN[3]=code_block.dimStyle)  # same code as python_script_3

# group: DIMENSION LINE
code_block_12 = CodeBlock(grid=code_block.gridOffset, surface=code_block.edgeOffset) { grid+surface; }
translate_7 = Geometry.Translate(geometry=byStartPointDirectionLength_2, direction=reverse_3, distance=code_block_12)
translate_8 = Geometry.Translate(geometry=byStartPointDirectionLength, direction=reverse_2, distance=code_block_12)

# group: Surface Reference
surface_reference_python_script = Python(IN[0]=filterByBoolMask_5.in)
# ---------- surface_reference_python_script.python (19 lines) ----------
import clr
clr.AddReference('RevitAPI')
#from Autodesk.Revit.DB import *


surfaces = UnwrapElement(IN[0]) if isinstance(IN[0],list) else [UnwrapElement(IN[0])]
results = []
for surface in surfaces:
	result = []
	for s in surface:
		try:
			reference = s.Tags.LookupTag("RevitFaceReference")
			result.append(reference)
		except:
			result.append(None)
	results.append(result)
	
if isinstance(IN[0], list): OUT = results
else: OUT = results[0]
# ----------------------------------------

# group: Surface Reference
surface_reference_python_script_2 = Python(IN[0]=filterByBoolMask_4.in)  # same code as surface_reference_python_script

# group: DIMENSION TO EDGES
python_script_6 = Python(IN[0]=translate_7, IN[1]=surface_reference_python_script, IN[2]=refresh, IN[3]=code_block.dimStyle)  # frozen
# ---------- python_script_6.python (52 lines) ----------
import clr
clr.AddReference('ProtoGeometry')
from Autodesk.DesignScript.Geometry import *

clr.AddReference("RevitNodes")
import Revit
clr.ImportExtensions(Revit.GeometryConversion)
from Revit import GeometryConversion as GeoConv

from Revit.Elements import *

clr.AddReference('RevitAPI')
from Autodesk.Revit.DB import *

clr.AddReference("RevitServices")
import RevitServices
from RevitServices.Persistence import DocumentManager
from RevitServices.Transactions import TransactionManager

doc = DocumentManager.Instance.CurrentDBDocument


lines = IN[0]
References=(IN[1])
dimType = IN[3]
dimTypes = FilteredElementCollector(doc).OfClass(DimensionType).ToElements()

DIMType = []

for dims in dimTypes:
	if dims.Id.IntegerValue == dimType.Id:
		DIMType.append(dims)

DIMENSION = []

opt=Options()
opt.ComputeReferences=True
opt.IncludeNonVisibleObjects=True
opt.View=doc.ActiveView

for line,refs in zip(lines,References):
	line = GeoConv.ProtoToRevitCurve.ToRevitType(line)
	elementsRef = ReferenceArray()
	for ref in refs:
		elementsRef.Append(ref)
		
	TransactionManager.Instance.EnsureInTransaction(doc)
	
	DIMENSION.append(doc.Create.NewDimension(doc.ActiveView, line, elementsRef, DIMType[0]))

	TransactionManager.Instance.TransactionTaskDone()		
OUT = DIMENSION
# ----------------------------------------
python_script_7 = Python(IN[0]=translate_8, IN[1]=surface_reference_python_script_2, IN[2]=refresh, IN[3]=code_block.dimStyle)  # frozen
# ---------- python_script_7.python (54 lines) ----------
import clr
clr.AddReference('ProtoGeometry')
from Autodesk.DesignScript.Geometry import *

clr.AddReference("RevitNodes")
import Revit
clr.ImportExtensions(Revit.GeometryConversion)
from Revit import GeometryConversion as GeoConv

from Revit.Elements import *

clr.AddReference('RevitAPI')
from Autodesk.Revit.DB import *

clr.AddReference("RevitServices")
import RevitServices
from RevitServices.Persistence import DocumentManager
from RevitServices.Transactions import TransactionManager

doc = DocumentManager.Instance.CurrentDBDocument

#line = GeoConv.ProtoToRevitCurve.ToRevitType(IN[0])

lines = IN[0]
References=(IN[1])
dimType = IN[3]
dimTypes = FilteredElementCollector(doc).OfClass(DimensionType).ToElements()

DIMType = []

for dims in dimTypes:
	if dims.Id.IntegerValue == dimType.Id:
		DIMType.append(dims)
		
DIMENSION = []

opt=Options()
opt.ComputeReferences=True
opt.IncludeNonVisibleObjects=True
opt.View=doc.ActiveView

for line,refs in zip(lines,References):
	line = GeoConv.ProtoToRevitCurve.ToRevitType(line)
	elementsRef = ReferenceArray()
	for ref in refs:
		elementsRef.Append(ref)
		
	TransactionManager.Instance.EnsureInTransaction(doc)
	
	DIMENSION.append(doc.Create.NewDimension(doc.ActiveView, line, elementsRef, DIMType[0]))

	TransactionManager.Instance.TransactionTaskDone()		

OUT = DIMENSION
# ----------------------------------------

element_reference = Custom[Element Reference]()  # package Genius Loci; Gets the reference of a geometric object or a dimension or a reference plane.; unwired: element
code_block_13 = CodeBlock(XGRIDS=filterByBoolMask_3.in, YGRIDS=filterByBoolMask_7.in) { XGRIDS; YGRIDS; }
