# Dynamo graph Extract Solid and Faces Geometry.dyn (Dynamo 2.6.1.8786)

boolean = BoolSelector(true)
python_script = Python(IN[0]=boolean)  # frozen
# ---------- python_script.python (149 lines) ----------
# Load the Python Standard and DesignScript Libraries
import sys
import clr
clr.AddReference('ProtoGeometry')
from Autodesk.DesignScript.Geometry import *

clr.AddReference("RevitNodes")
import Revit
clr.ImportExtensions(Revit.Elements)
clr.ImportExtensions(Revit.GeometryConversion)

clr.AddReference("RevitServices")
import RevitServices
from RevitServices.Persistence import DocumentManager 
from RevitServices.Transactions import TransactionManager 

clr.AddReference("RevitAPI")
from Autodesk.Revit.DB import *
from Autodesk.Revit.Creation import ItemFactoryBase

clr.AddReference("RevitAPIUI")
from Autodesk.Revit.UI import *

doc = DocumentManager.Instance.CurrentDBDocument
uiapp = DocumentManager.Instance.CurrentUIApplication 
app = uiapp.Application 
uidoc = uiapp.ActiveUIDocument

TransactionManager.Instance.EnsureInTransaction(doc)

options = Options()
options.ComputeReferences = True
options.View = doc.ActiveView

selection = uidoc.Selection
selectedIds = selection.GetElementIds()

geomElements = []

try:
	
	if len(selectedIds) == 0:
		TaskDialog.Show("Select Elements","You haven't selected any elements.")
	else:
		info = "Ids of selected elements in the document are: "
		for id in selectedIds:
			info += "\n" + (id.IntegerValue).ToString()
			elem = doc.GetElement(id)
			geomElem = elem.get_Geometry(options)
			
			for y in geomElem:
				if y.GetType() == GeometryInstance and bool(y.GetInstanceGeometry())==True:
					geoInstance = y.GetInstanceGeometry()
					for x in geoInstance:
						if x.GetType() == Solid and x.Volume !=0:
							geomElements.append(x)
							
				elif y.GetType() == Solid and y.Volume !=0:
					geomElements.append(y)
						
except Exception as E:
	TaskDialog.Show("Element Geometry", E.ToString())

RevitSolids = []
DynamoSolids = []
solidVolumes = []
RevitFaces = []
DynamoFaces = []

for geom in geomElements:
	RevitSolids.append(geom)
	DynamoSolids.append(geom.ToProtoType())
	solidVolumes.append(round(0.0283168 * geom.Volume,3))
	RevitFaces.append(geom.Faces)

for faceArray in RevitFaces:
	faces = []
	for face in faceArray:
		faces.append(face.ToProtoType()[0])
	DynamoFaces.append(faces)

XrefSurface = []
YrefSurface = []
XSurface = []
YSurface = []

for RevfaceList,DynfaceList in zip(RevitFaces,DynamoFaces):
	XrevFace = []
	YrevFace = []
	XdynFace = []
	YdynFace = []
	XFacePoint = []
	YFacePoint = []
	
	for Revface,Dynface in zip(RevfaceList,DynfaceList):
		if abs(round(Revface.FaceNormal.Normalize().DotProduct(XYZ.BasisX))) == 1:
			XdynFace.append(Dynface)
			XrevFace.append(Revface)
		elif abs(round(Revface.FaceNormal.Normalize().DotProduct(XYZ.BasisY))) == 1:
			YdynFace.append(Dynface)
			YrevFace.append(Revface)
					
	XSurface.append(XdynFace)
	YSurface.append(YdynFace)
	XrefSurface.append(XrevFace)
	YrefSurface.append(YrevFace)

xPoint = []
yPoint = []
xOffset = 500/304.8

LINEx = []
refers = []
# Get the Origin point for X face 
for i,xS in zip(range(0,XrefSurface.Count),XrefSurface):
	REFS = []
	for xRef in xS:
		LINE = []
		X = []
		Y = []
		pt = XrefSurface[i][0].Origin
		lineX = Line.CreateBound(pt,XYZ(pt.X+2,pt.Y,pt.Z)).CreateOffset(xOffset,XrefSurface[i][0].XVector)
		
		refArray = ReferenceArray()
		
		LINE.append(lineX)
		REFS.append(xRef.Reference)
		refArray.Append(xRef.Reference)
		X.append(pt.ToPoint())
		
	refers.append(REFS)
	xPoint.append(X)
	LINEx.append(LINE)


REFARRAY = ReferenceArray()

DIMLINE = LINEx[0][0]

REFARRAY.Append(refers[0][0])
REFARRAY.Append(refers[0][1])


DIM = doc.Create.NewDimension(doc.ActiveView, DIMLINE, REFARRAY)


TransactionManager.Instance.TransactionTaskDone()

OUT = xPoint,XSurface,LINEx,refers,DIM
# ----------------------------------------
python_script_2 = Python(IN[0]=boolean, IN[1]=boolean)  # frozen
# ---------- python_script_2.python (224 lines) ----------
import sys
import clr
clr.AddReference("System.IO")
clr.AddReference("System.Reflection")
clr.AddReference("System.Threading")
clr.AddReference("System.Drawing")
clr.AddReference("System.Windows.Forms")
clr.AddReference("System")
import System.IO
import System.Reflection
import System.Threading
import System.Drawing
import System.Windows.Forms
from System.Threading import ApartmentState, Thread, ThreadStart
from System import Array, Object
from System.Collections.Generic import *

def tolist(obj1):
	if hasattr(obj1,"__iter__"): return obj1
	else: return [obj1]

def hasInd(l1, i):
	try:
		l1[i]
		return  True
	except:
		return  False

class NameWrap(Object):
	def __init__(this, obj1, name1 = None):
		this.obj = obj1
		if obj1 == None: name1 = "null"
		if name1 == None and obj1 != None: this.name = obj1.ToString()
		else: this.name = name1
	def ToString(this):
		return this.name

class AutoDimension(System.Windows.Forms.Form):
    def __init__(this):
        this.Select_Category =  System.Windows.Forms.ComboBox()
        this.label1 =  System.Windows.Forms.Label()
        this.Dimension_Style =  System.Windows.Forms.ComboBox()
        this.label2 =  System.Windows.Forms.Label()
        this.GridDimOffset =  System.Windows.Forms.NumericUpDown()
        this.label3 =  System.Windows.Forms.Label()
        this.label4 =  System.Windows.Forms.Label()
        this.EdgeDimOffset =  System.Windows.Forms.NumericUpDown()
        this.button1 =  System.Windows.Forms.Button()
        this.button2 =  System.Windows.Forms.Button()
        this.label5 =  System.Windows.Forms.Label()
        this.label6 =  System.Windows.Forms.Label()
        this.SuspendLayout()
        #
        # Select_Category
        #
        this.Select_Category.FormattingEnabled = True
        this.Select_Category.Location =  System.Drawing.Point(156, 35)
        this.Select_Category.Name = "Select_Category"
        this.Select_Category.Size =  System.Drawing.Size(228, 21)
        this.Select_Category.TabIndex = 0
        #
        # label1
        #
        this.label1.AutoSize = True
        this.label1.Location =  System.Drawing.Point(32, 38)
        this.label1.Name = "label1"
        this.label1.Size =  System.Drawing.Size(82, 13)
        this.label1.TabIndex = 1
        this.label1.Text = "Select Category"
        this.label1.TextAlign = System.Drawing.ContentAlignment.MiddleCenter
        #
        # Dimension_Style
        #
        this.Dimension_Style.FormattingEnabled = True
        this.Dimension_Style.Location =  System.Drawing.Point(156, 77)
        this.Dimension_Style.Name = "Dimension_Style"
        this.Dimension_Style.Size =  System.Drawing.Size(228, 21)
        this.Dimension_Style.TabIndex = 0
        #
        # label2
        #
        this.label2.AutoSize = True
        this.label2.Location =  System.Drawing.Point(32, 80)
        this.label2.Name = "label2"
        this.label2.Size =  System.Drawing.Size(82, 13)
        this.label2.TabIndex = 1
        this.label2.Text = "Dimension Style"
        this.label2.TextAlign = System.Drawing.ContentAlignment.MiddleCenter
        #
        # GridDimOffset
        #
        this.GridDimOffset.Increment =  10
        this.GridDimOffset.Location =  System.Drawing.Point(156, 118)
        this.GridDimOffset.Maximum =  5000
        this.GridDimOffset.Minimum = 200
        this.GridDimOffset.Name = "GridDimOffset"
        this.GridDimOffset.Size =  System.Drawing.Size(89, 20)
        this.GridDimOffset.TabIndex = 2
        this.GridDimOffset.Value =  200
        #
        # label3
        #
        this.label3.AutoSize = True
        this.label3.Location =  System.Drawing.Point(32, 120)
        this.label3.Name = "label3"
        this.label3.Size =  System.Drawing.Size(109, 13)
        this.label3.TabIndex = 1
        this.label3.Text = "Grid Dimension Offset"
        this.label3.TextAlign = System.Drawing.ContentAlignment.MiddleCenter
        #
        # label4
        #
        this.label4.AutoSize = True
        this.label4.Location =  System.Drawing.Point(32, 161)
        this.label4.Name = "label4"
        this.label4.Size =  System.Drawing.Size(115, 13)
        this.label4.TabIndex = 1
        this.label4.Text = "Edge Dimension Offset"
        this.label4.TextAlign = System.Drawing.ContentAlignment.MiddleCenter
        #
        # EdgeDimOffset
        #
        this.EdgeDimOffset.Increment =  10
        this.EdgeDimOffset.Location =  System.Drawing.Point(156, 159)
        this.EdgeDimOffset.Maximum =  5000
        this.EdgeDimOffset.Minimum =  400
        this.EdgeDimOffset.Name = "EdgeDimOffset"
        this.EdgeDimOffset.Size =  System.Drawing.Size(89, 20)
        this.EdgeDimOffset.TabIndex = 2
        this.EdgeDimOffset.Value =  400
        #
        # button1
        #
        this.button1.BackColor = System.Drawing.Color.FromArgb(192, 192, 255)
        this.button1.Location =  System.Drawing.Point(297, 187)
        this.button1.Name = "button1"
        this.button1.Size =  System.Drawing.Size(75, 23)
        this.button1.TabIndex = 3
        this.button1.Text = "OK"
        this.button1.UseMnemonic = False
        this.button1.UseVisualStyleBackColor = False
        this.button1.DialogResult = System.Windows.Forms.DialogResult.OK
#        this.button1.Click += this.finish
        #
        # button2
        #
        this.button2.BackColor = System.Drawing.Color.FromArgb(255, 192, 192)
        this.button2.Location =  System.Drawing.Point(378, 187)
        this.button2.Name = "button2"
        this.button2.Size =  System.Drawing.Size(75, 23)
        this.button2.TabIndex = 3
        this.button2.Text = "Cancel"
        this.button2.UseVisualStyleBackColor = False
        this.button2.DialogResult = System.Windows.Forms.DialogResult.Cancel

        #
        # label5
        #
        this.label5.AutoSize = True
        this.label5.Location =  System.Drawing.Point(251, 120)
        this.label5.Name = "label5"
        this.label5.Size =  System.Drawing.Size(29, 13)
        this.label5.TabIndex = 1
        this.label5.Text = "(mm)"
        this.label5.TextAlign = System.Drawing.ContentAlignment.MiddleCenter
        #
        # label6
        #
        this.label6.AutoSize = True
        this.label6.Location =  System.Drawing.Point(251, 161)
        this.label6.Name = "label6"
        this.label6.Size =  System.Drawing.Size(29, 13)
        this.label6.TabIndex = 1
        this.label6.Text = "(mm)"
        this.label6.TextAlign = System.Drawing.ContentAlignment.MiddleCenter
        #
        # Form1
        #
        this.StartPosition = System.Windows.Forms.FormStartPosition.CenterScreen
        this.AutoScaleDimensions =  System.Drawing.SizeF(6, 13)
        this.AutoScaleMode = System.Windows.Forms.AutoScaleMode.Font
        this.BackColor = System.Drawing.SystemColors.ControlLight
        this.ClientSize =  System.Drawing.Size(463, 222)
        this.MaximumSize =   System.Drawing.Size(479, 261)
        this.MinimumSize =   System.Drawing.Size(479, 261)
        this.MaximizeBox = False
        this.MinimizeBox = False
        this.Controls.Add(this.button2)
        this.Controls.Add(this.button1)
        this.Controls.Add(this.EdgeDimOffset)
        this.Controls.Add(this.label4)
        this.Controls.Add(this.GridDimOffset)
        this.Controls.Add(this.label6)
        this.Controls.Add(this.label5)
        this.Controls.Add(this.label3)
        this.Controls.Add(this.label2)
        this.Controls.Add(this.label1)
        this.Controls.Add(this.Dimension_Style)
        this.Controls.Add(this.Select_Category)
        this.ForeColor = System.Drawing.SystemColors.ActiveCaptionText
        this.Name = "Form1"
        this.ShowIcon = False
        this.Text = "KennyStruct | Auto Dimension Element to Grid"
        this.TopMost = True
        this.ResumeLayout(False)
        this.PerformLayout()

	def add_range(this,CAT,DIM):
		this.Select_Category.Items.AddRange(CAT)
		this.Dimension_Style.Items.AddRange(DIM)

	def finish(this,sender,event):
		this.Finish = this.Select_Category.SelectedItem,this.Dimension_Stylethis.SelectedItem
		this.Close()

	def cancel(this,sender,event):
		this.Cancel = None
		this.Close()


form = AutoDimension()


OUT = AutoDimension()
# ----------------------------------------
python_script_3 = Python(IN[0]=python_script_2, IN[1]=boolean)
# ---------- python_script_3.python (127 lines) ----------
# Load the Python Standard and DesignScript Libraries
import sys
import clr
clr.AddReference('ProtoGeometry')
from Autodesk.DesignScript.Geometry import *

clr.AddReference("RevitNodes")
import Revit
clr.ImportExtensions(Revit.Elements)
clr.ImportExtensions(Revit.GeometryConversion)

clr.AddReference("RevitServices")
import RevitServices
from RevitServices.Persistence import DocumentManager 
from RevitServices.Transactions import TransactionManager 

clr.AddReference("RevitAPI")
from Autodesk.Revit.DB import *
from Autodesk.Revit.Creation import ItemFactoryBase

clr.AddReference("RevitAPIUI")
from Autodesk.Revit.UI import *

clr.AddReference("System")
from System import Array, Object


doc = DocumentManager.Instance.CurrentDBDocument
uiapp = DocumentManager.Instance.CurrentUIApplication 
app = uiapp.Application 
uidoc = uiapp.ActiveUIDocument


UI = IN[0]

def tolist(obj1):
	if hasattr(obj1,"__iter__"): return obj1
	else: return [obj1]

def hasInd(l1, i):
	try:
		l1[i]
		return  True
	except:
		return  False
		
class NameWrap(Object):
	def __init__(this, obj1, name1 = None):
		this.obj = obj1
		if obj1 == None: name1 = "null"
		if name1 == None and obj1 != None: this.name = obj1.ToString()
		else: this.name = name1
	def ToString(this):
		return this.name


settings = doc.Settings

categories = settings.Categories

collector = FilteredElementCollector(doc).OfClass(DimensionType).ToElements()

dimensionTypes = []
dimNames = []

for dim in collector:
	if dim.FamilyName == "Linear Dimension Style" and dim.LookupParameter("Type Name").AsString() != "":
		dimensionTypes.append(dim)
		dimNames.append(dim.LookupParameter("Type Name").AsString())

dimensionTypes = tolist([dimType for _,dimType in sorted(zip(dimNames,dimensionTypes))])

dimNames = tolist(sorted(dimNames))

categoryNames = sorted([cat.Name for cat in categories if cat.AllowsBoundParameters])

for i in xrange(len(dimensionTypes)):
	name1 = None
	if hasInd(dimNames, i): name1 = dimNames[i]
	dimensionTypes[i] = NameWrap(dimensionTypes[i], name1)

cat_Array = Array[Object](categoryNames)
dim_Array = Array[Object](dimensionTypes)

UI.Select_Category.Items.AddRange(cat_Array)
UI.Dimension_Style.Items.AddRange(dim_Array)


UI.ShowDialog()

if UI.DialogResult.ToString() == "OK" and bool(UI.Select_Category.SelectedItem) != False:

	class MySelectionFilter(Selection.ISelectionFilter):
		def __init__(self):
			pass
		def AllowElement(self, element):
			if element.Category.Name == UI.Select_Category.SelectedItem:
				return True
			else:
				return False
		def AllowReference(self, element):
			return False
			
	message = "Please Select {} Elements in current view"
	
	TaskDialog.Show("Select Elements", message.format(UI.Select_Category.SelectedItem))
	Sel_filter = MySelectionFilter()
	obj_type = Selection.ObjectType.Element
	
	selection = []
	
	for elemRef in uidoc.Selection.PickObjects(obj_type,Sel_filter,"Select Element(s)"):
		selection.append(Document.GetElement(doc,elemRef))
		
	OUT = UI.Dimension_Style.SelectedItem.obj, selection

elif UI.DialogResult.ToString() == "Cancel" or bool(UI.Select_Category.SelectedItem) == False or bool(UI.Dimension_Style.SelectedItem) == False:
	TaskDialog.Show("Auto Dimension Error", "Missing one or more data; Please fill up dialog box")
	OUT = "Missing one or more data; please fill up dialog box"





TransactionManager.Instance.EnsureInTransaction(doc)

TransactionManager.Instance.TransactionTaskDone()
# ----------------------------------------
code_block = CodeBlock(x=python_script_3) { x[0]; x[1]; }
python_script_4 = Python(IN[0]=boolean)
# ---------- python_script_4.python (326 lines) ----------
import sys
import clr
clr.AddReference("System.IO")
clr.AddReference("System.Reflection")
clr.AddReference("System.Threading")
clr.AddReference("System.Drawing")
clr.AddReference("System.Windows.Forms")
clr.AddReference("System")
import System.IO
import System.Reflection
import System.Threading
import System.Drawing
import System.Windows.Forms
from System.Threading import ApartmentState, Thread, ThreadStart
from System import Array, Object
from System.Collections.Generic import *

clr.AddReference("RevitServices")
import RevitServices
from RevitServices.Persistence import DocumentManager 
from RevitServices.Transactions import TransactionManager 

clr.AddReference("RevitAPI")
from Autodesk.Revit.DB import *
from Autodesk.Revit.Creation import ItemFactoryBase

clr.AddReference("RevitAPIUI")
from Autodesk.Revit.UI import *


def tolist(obj1):
	if hasattr(obj1,"__iter__"): return obj1
	else: return [obj1]

def hasInd(l1, i):
	try:
		l1[i]
		return  True
	except:
		return  False

class NameWrap(Object):
	def __init__(this, obj1, name1 = None):
		this.obj = obj1
		if obj1 == None: name1 = "null"
		if name1 == None and obj1 != None: this.name = obj1.ToString()
		else: this.name = name1
	def ToString(this):
		return this.name

class AutoDimension(System.Windows.Forms.Form):
    def __init__(this):
        this.Select_Category =  System.Windows.Forms.ComboBox()
        this.label1 =  System.Windows.Forms.Label()
        this.Dimension_Style =  System.Windows.Forms.ComboBox()
        this.label2 =  System.Windows.Forms.Label()
        this.GridDimOffset =  System.Windows.Forms.NumericUpDown()
        this.label3 =  System.Windows.Forms.Label()
        this.label4 =  System.Windows.Forms.Label()
        this.EdgeDimOffset =  System.Windows.Forms.NumericUpDown()
        this.button1 =  System.Windows.Forms.Button()
        this.button2 =  System.Windows.Forms.Button()
        this.label5 =  System.Windows.Forms.Label()
        this.label6 =  System.Windows.Forms.Label()
        this.SuspendLayout()
        #
        # Select_Category
        #
        this.Select_Category.FormattingEnabled = True
        this.Select_Category.Location =  System.Drawing.Point(156, 35)
        this.Select_Category.Name = "Select_Category"
        this.Select_Category.Size =  System.Drawing.Size(228, 21)
        this.Select_Category.TabIndex = 0
        #
        # label1
        #
        this.label1.AutoSize = True
        this.label1.Location =  System.Drawing.Point(32, 38)
        this.label1.Name = "label1"
        this.label1.Size =  System.Drawing.Size(82, 13)
        this.label1.TabIndex = 1
        this.label1.Text = "Select Category"
        this.label1.TextAlign = System.Drawing.ContentAlignment.MiddleCenter
        #
        # Dimension_Style
        #
        this.Dimension_Style.FormattingEnabled = True
        this.Dimension_Style.Location =  System.Drawing.Point(156, 77)
        this.Dimension_Style.Name = "Dimension_Style"
        this.Dimension_Style.Size =  System.Drawing.Size(228, 21)
        this.Dimension_Style.TabIndex = 0
        #
        # label2
        #
        this.label2.AutoSize = True
        this.label2.Location =  System.Drawing.Point(32, 80)
        this.label2.Name = "label2"
        this.label2.Size =  System.Drawing.Size(82, 13)
        this.label2.TabIndex = 1
        this.label2.Text = "Dimension Style"
        this.label2.TextAlign = System.Drawing.ContentAlignment.MiddleCenter
        #
        # GridDimOffset
        #
        this.GridDimOffset.Increment =  10
        this.GridDimOffset.Location =  System.Drawing.Point(156, 118)
        this.GridDimOffset.Maximum =  5000
        this.GridDimOffset.Minimum = 200
        this.GridDimOffset.Name = "GridDimOffset"
        this.GridDimOffset.Size =  System.Drawing.Size(89, 20)
        this.GridDimOffset.TabIndex = 2
        this.GridDimOffset.Value =  200
        #
        # label3
        #
        this.label3.AutoSize = True
        this.label3.Location =  System.Drawing.Point(32, 120)
        this.label3.Name = "label3"
        this.label3.Size =  System.Drawing.Size(109, 13)
        this.label3.TabIndex = 1
        this.label3.Text = "Grid Dimension Offset"
        this.label3.TextAlign = System.Drawing.ContentAlignment.MiddleCenter
        #
        # label4
        #
        this.label4.AutoSize = True
        this.label4.Location =  System.Drawing.Point(32, 161)
        this.label4.Name = "label4"
        this.label4.Size =  System.Drawing.Size(115, 13)
        this.label4.TabIndex = 1
        this.label4.Text = "Edge Dimension Offset"
        this.label4.TextAlign = System.Drawing.ContentAlignment.MiddleCenter
        #
        # EdgeDimOffset
        #
        this.EdgeDimOffset.Increment =  10
        this.EdgeDimOffset.Location =  System.Drawing.Point(156, 159)
        this.EdgeDimOffset.Maximum =  5000
        this.EdgeDimOffset.Minimum =  400
        this.EdgeDimOffset.Name = "EdgeDimOffset"
        this.EdgeDimOffset.Size =  System.Drawing.Size(89, 20)
        this.EdgeDimOffset.TabIndex = 2
        this.EdgeDimOffset.Value =  400
        #
        # button1
        #
        this.button1.BackColor = System.Drawing.Color.FromArgb(192, 192, 255)
        this.button1.Location =  System.Drawing.Point(297, 187)
        this.button1.Name = "button1"
        this.button1.Size =  System.Drawing.Size(75, 23)
        this.button1.TabIndex = 3
        this.button1.Text = "OK"
        this.button1.UseMnemonic = False
        this.button1.UseVisualStyleBackColor = False
        this.button1.DialogResult = System.Windows.Forms.DialogResult.OK
#        this.button1.Click += this.finish
        #
        # button2
        #
        this.button2.BackColor = System.Drawing.Color.FromArgb(255, 192, 192)
        this.button2.Location =  System.Drawing.Point(378, 187)
        this.button2.Name = "button2"
        this.button2.Size =  System.Drawing.Size(75, 23)
        this.button2.TabIndex = 3
        this.button2.Text = "Cancel"
        this.button2.UseVisualStyleBackColor = False
        this.button2.DialogResult = System.Windows.Forms.DialogResult.Cancel

        #
        # label5
        #
        this.label5.AutoSize = True
        this.label5.Location =  System.Drawing.Point(251, 120)
        this.label5.Name = "label5"
        this.label5.Size =  System.Drawing.Size(29, 13)
        this.label5.TabIndex = 1
        this.label5.Text = "(mm)"
        this.label5.TextAlign = System.Drawing.ContentAlignment.MiddleCenter
        #
        # label6
        #
        this.label6.AutoSize = True
        this.label6.Location =  System.Drawing.Point(251, 161)
        this.label6.Name = "label6"
        this.label6.Size =  System.Drawing.Size(29, 13)
        this.label6.TabIndex = 1
        this.label6.Text = "(mm)"
        this.label6.TextAlign = System.Drawing.ContentAlignment.MiddleCenter
        #
        # Form1
        #
        this.StartPosition = System.Windows.Forms.FormStartPosition.CenterScreen
        this.AutoScaleDimensions =  System.Drawing.SizeF(6, 13)
        this.AutoScaleMode = System.Windows.Forms.AutoScaleMode.Font
        this.BackColor = System.Drawing.SystemColors.ControlLight
        this.ClientSize =  System.Drawing.Size(463, 222)
        this.MaximumSize =   System.Drawing.Size(479, 261)
        this.MinimumSize =   System.Drawing.Size(479, 261)
        this.MaximizeBox = False
        this.MinimizeBox = False
        this.Controls.Add(this.button2)
        this.Controls.Add(this.button1)
        this.Controls.Add(this.EdgeDimOffset)
        this.Controls.Add(this.label4)
        this.Controls.Add(this.GridDimOffset)
        this.Controls.Add(this.label6)
        this.Controls.Add(this.label5)
        this.Controls.Add(this.label3)
        this.Controls.Add(this.label2)
        this.Controls.Add(this.label1)
        this.Controls.Add(this.Dimension_Style)
        this.Controls.Add(this.Select_Category)
        this.ForeColor = System.Drawing.SystemColors.ActiveCaptionText
        this.Name = "Form1"
        this.ShowIcon = False
        this.Text = "KennyStruct | Auto Dimension Element to Grid"
        this.TopMost = True
        this.ResumeLayout(False)
        this.PerformLayout()

	def add_range(this,CAT,DIM):
		this.Select_Category.Items.AddRange(CAT)
		this.Dimension_Style.Items.AddRange(DIM)

	def finish(this,sender,event):
		this.Finish = this.Select_Category.SelectedItem,this.Dimension_Stylethis.SelectedItem
		this.Close()

	def cancel(this,sender,event):
		this.Cancel = None
		this.Close()


UI = AutoDimension()


doc = DocumentManager.Instance.CurrentDBDocument
uiapp = DocumentManager.Instance.CurrentUIApplication 
app = uiapp.Application 
uidoc = uiapp.ActiveUIDocument


def tolist(obj1):
	if hasattr(obj1,"__iter__"): return obj1
	else: return [obj1]

def hasInd(l1, i):
	try:
		l1[i]
		return  True
	except:
		return  False
		
class NameWrap(Object):
	def __init__(this, obj1, name1 = None):
		this.obj = obj1
		if obj1 == None: name1 = "null"
		if name1 == None and obj1 != None: this.name = obj1.ToString()
		else: this.name = name1
	def ToString(this):
		return this.name


settings = doc.Settings

categories = settings.Categories

collector = FilteredElementCollector(doc).OfClass(DimensionType).ToElements()

dimensionTypes = []
dimNames = []

for dim in collector:
	if dim.FamilyName == "Linear Dimension Style" and dim.LookupParameter("Type Name").AsString() != "":
		dimensionTypes.append(dim)
		dimNames.append(dim.LookupParameter("Type Name").AsString())

dimensionTypes = tolist([dimType for _,dimType in sorted(zip(dimNames,dimensionTypes))])

dimNames = tolist(sorted(dimNames))

categoryNames = sorted([cat.Name for cat in categories if cat.AllowsBoundParameters])

for i in xrange(len(dimensionTypes)):
	name1 = None
	if hasInd(dimNames, i): name1 = dimNames[i]
	dimensionTypes[i] = NameWrap(dimensionTypes[i], name1)

cat_Array = Array[Object](categoryNames)
dim_Array = Array[Object](dimensionTypes)

UI.Select_Category.Items.AddRange(cat_Array)
UI.Dimension_Style.Items.AddRange(dim_Array)


UI.ShowDialog()

if UI.DialogResult.ToString() == "OK" and bool(UI.Select_Category.SelectedItem) != False:

	class MySelectionFilter(Selection.ISelectionFilter):
		def __init__(self):
			pass
		def AllowElement(self, element):
			if element.Category.Name == UI.Select_Category.SelectedItem:
				return True
			else:
				return False
		def AllowReference(self, element):
			return False
			
	message = "Please Select {} Elements in current view"
	
	TaskDialog.Show("Select Elements", message.format(UI.Select_Category.SelectedItem))
	Sel_filter = MySelectionFilter()
	obj_type = Selection.ObjectType.Element
	
	selection = []
	
	for elemRef in uidoc.Selection.PickObjects(obj_type,Sel_filter,"Select Element(s)"):
		selection.append(Document.GetElement(doc,elemRef))
		
	OUT = UI.Dimension_Style.SelectedItem.obj, selection

elif UI.DialogResult.ToString() == "Cancel" or bool(UI.Select_Category.SelectedItem) == False or bool(UI.Dimension_Style.SelectedItem) == False:
	TaskDialog.Show("Auto Dimension Error", "Missing one or more data; Please fill up dialog box")
	OUT = "Missing one or more data; please fill up dialog box"
# ----------------------------------------
