# Dynamo graph Pile Annotation Circle.dyn (Dynamo 2.6.2.15705)
# packages: KennyStruct Nodes 0.0.1

pile_annotation_family_type = FamilyTypes("EMMS-UFA - Pile Annotation Rotated RED:Red Circle")  # graph input
pin_annotation = BoolSelector(true)  # graph input
diameter_parameter_name = StringInput("Diameter")  # graph input
assembly_code = StringInput("A1020110")  # graph input
python_script = Python(IN[0]=pile_annotation_family_type, IN[1]=pin_annotation, IN[2]=diameter_parameter_name, IN[3]=assembly_code)  # frozen
# ---------- python_script.python (50 lines) ----------
# Load the Python Standard and DesignScript Libraries
import sys
import clr
clr.AddReference('ProtoGeometry')
from Autodesk.DesignScript.Geometry import *

clr.AddReference("RevitNodes")
import Revit
clr.ImportExtensions(Revit.Elements)
clr.ImportExtensions(Revit.GeometryConversion)

clr.AddReference("RevitServices")
import RevitServices
from RevitServices.Persistence import DocumentManager 
from RevitServices.Transactions import TransactionManager 

clr.AddReference("RevitAPI")
from Autodesk.Revit.DB import *

clr.AddReference("RevitAPIUI")
from Autodesk.Revit.UI import *

doc = DocumentManager.Instance.CurrentDBDocument

PileAnnoType = UnwrapElement(IN[0])

FDNS = FilteredElementCollector(doc,doc.ActiveView.Id).OfCategory(BuiltInCategory.OST_StructuralFoundation).WhereElementIsNotElementType().ToElements()

TransactionManager.Instance.EnsureInTransaction(doc)
piles = []
pileDiameter = IN[2]
assemblyCode = IN[3]

for fdn in FDNS:
	fdnType = doc.GetElement(fdn.GetTypeId())
	AssCode = fdnType.LookupParameter("Assembly Code")
	if AssCode.AsString() == assemblyCode:
		points = fdn.Location.Point
		piles.append(fdn)
		PileDiameter = fdnType.LookupParameter(pileDiameter).AsDouble()
		
		pileAnno = doc.Create.NewFamilyInstance(points,PileAnnoType,doc.ActiveView)
		
		pileAnno.LookupParameter("Diameter").Set(PileDiameter)
		
		pileAnno.Pinned = IN[1]

TransactionManager.Instance.TransactionTaskDone()

OUT = piles
# ----------------------------------------
activeView = Custom[ActiveView]()  # package KennyStruct Nodes; Get active view of current document
pile_annotation_family_type_2 = FamilyTypes("EMMS-UFA - Pile Annotation BLUE:Blue Circle")  # graph input
pile_installation_parameter_name = StringInput("KSD_Pile Installation")  # graph input
refresh_script = BoolSelector(true)  # graph input
python_script_2 = Python(IN[0]=pile_annotation_family_type, IN[1]=pin_annotation, IN[2]=diameter_parameter_name, IN[3]=assembly_code, IN[4]=pile_annotation_family_type_2, IN[5]=pile_installation_parameter_name, IN[6]=refresh_script)
# ---------- python_script_2.python (76 lines) ----------
# Load the Python Standard and DesignScript Libraries
import sys
import clr
clr.AddReference('ProtoGeometry')
from Autodesk.DesignScript.Geometry import *

clr.AddReference("RevitNodes")
import Revit
clr.ImportExtensions(Revit.Elements)
clr.ImportExtensions(Revit.GeometryConversion)

clr.AddReference("RevitServices")
import RevitServices
from RevitServices.Persistence import DocumentManager 
from RevitServices.Transactions import TransactionManager 

clr.AddReference("RevitAPI")
from Autodesk.Revit.DB import *

clr.AddReference("RevitAPIUI")
from Autodesk.Revit.UI import *

doc = DocumentManager.Instance.CurrentDBDocument

PileAnnoTypeA = UnwrapElement(IN[0])
PileAnnoTypeB = UnwrapElement(IN[4])

FDNS = FilteredElementCollector(doc,doc.ActiveView.Id).OfCategory(BuiltInCategory.OST_StructuralFoundation).WhereElementIsNotElementType().ToElements()

sharedParams = FilteredElementCollector(doc).OfClass(SharedParameterElement).ToElements()

pileInstallParam = None

for param in sharedParams:
	defintion = param.GetDefinition()
	if defintion.Name == "KSD_Pile Installation":
		pileInstallParam = param

paramGUID = pileInstallParam.GuidValue


TransactionManager.Instance.EnsureInTransaction(doc)
piles = []
pileDiameter = IN[2]
assemblyCode = IN[3]
installParamName = IN[5]

pileInstalled = []
pileNotInstalled = []

for fdn in FDNS:
	fdnType = doc.GetElement(fdn.GetTypeId())
	AssCode = fdnType.LookupParameter("Assembly Code")

	if AssCode.AsString() == assemblyCode:
		points = fdn.Location.Point
		piles.append(fdn)
		PileDiameter = fdnType.LookupParameter(pileDiameter).AsDouble()
		
		if fdnType.LookupParameter("Type Comments").AsString() == "600MM":
			pileInstalled.append(fdn)
			pileAnno = doc.Create.NewFamilyInstance(points,PileAnnoTypeA,doc.ActiveView)
			pileAnno.LookupParameter("Diameter").Set(PileDiameter)
			pileAnno.Pinned = IN[1]

		else:	
			pileAnno = doc.Create.NewFamilyInstance(points,PileAnnoTypeB,doc.ActiveView)
			pileAnno.LookupParameter("Diameter").Set(PileDiameter)
			pileAnno.Pinned = IN[1]
			pileNotInstalled.append(fdn)
			
TransactionManager.Instance.TransactionTaskDone()



OUT = pileInstalled, pileNotInstalled
# ----------------------------------------
code_block = CodeBlock(x=python_script_2) { x[0]; x[1]; }  # frozen
code_block_2 = CodeBlock { 600; }
byCoordinates = Vector.ByCoordinates(x=code_block_2, y=code_block_2)
byElementAndOffset = Tag.ByElementAndOffset(view=activeView, element=code_block.out1, offset=byCoordinates)
byElementAndOffset_2 = Tag.ByElementAndOffset(view=activeView, element=code_block.out0, offset=byCoordinates)
