# Dynamo graph Place Spot Coordinates.dyn (Dynamo 2.3.1.11775)
# packages: Clockwork for Dynamo 2.x 2.3.0, spring nodes 204.1.0

categories = Categories("OST_StructuralFoundation")
all_elements_of_category = ElementsOfCategory(Category=categories)
getLocation = Element.GetLocation(element=all_elements_of_category)
number_slider = DoubleSlider(0.8, range=0.1..3 step 0.1)
code_block = CodeBlock(d=number_slider) { d*1000; }
translate = Geometry.Translate(geometry=getLocation, xTranslation=code_block, yTranslation=code_block)
refresh_script = BoolSelector(false)
ꟿ_document_activeview = Custom[ꟿ Document.ActiveView](refresh=refresh_script)  # package spring nodes; Selects the current document's active view. Supports more view types than the built-in option. Will be depreciated once the bult in node works with all plan types.
byTwoPoints = Vector.ByTwoPoints(start=getLocation, end=translate)
boolean = BoolSelector(true)
byPoint = Custom[SpotCoordinate.ByPoint](point=translate, view=ꟿ_document_activeview, bend=byTwoPoints, end=byTwoPoints, hasLeader=boolean)  # package Clockwork for Dynamo 2.x; Places a spot coordinate at a given point in a given view. May not work in all view types.
