# Dynamo graph DynMaps Introduction.dyn (Dynamo 2.12.0.5650)
# packages: DynaMaps 2019.2.21, Data-Shapes 2022.2.96

topoPolySurface = LiveTopoMeshNodeModel()
roadsAsPolycurves = LiveRoadsAsPolyCurvesNodeModel(_ComboBoxValue="/primary/motorway/residential/road/secondary/tertiary/", comboBoxValue="/primary/motorway/residential/road/secondary/tertiary/")
code_block = CodeBlock { 7; }
roadsAsSurface = RoadsAsSurfaceNodeModel(Roads_PolyCurves=roadsAsPolycurves, Roads_Width=code_block)
projectRoadsOnTopo = ProjectRoadsOnTopoNodeModel(Topo_PolySurface=topoPolySurface, Roads_Surface=roadsAsSurface)
buildingFootPrintSurfaces = LiveFootPrintAsSurfaceNodeModel()
boolean = BoolSelector(true)
projectBuildingsOnTopo = ProjectBuildingsOnTopoNodeModel(FootPrint_Surfaces=buildingFootPrintSurfaces.Surfaces, Building_Elevations=buildingFootPrintSurfaces.Elevations, Topo_Poly=topoPolySurface, CropToTopo=boolean)
geomPreview = GeomPreviewNodeModel(Geometry=projectBuildingsOnTopo, SliderValue=255, rValue="255", gValue="148", bValue="67")
