# Dynamo graph Allow Joins at End for Beams.dyn (Dynamo 2.12.0.5650)

categories = Categories("OST_StructuralFraming")
all_elements_of_category = ElementsOfCategory(Category=categories)
python_script = Python(IN[0]=all_elements_of_category)  # IronPython2
# ---------- python_script.python (33 lines) ----------
import clr
clr.AddReference("RevitAPI")
import Autodesk
from Autodesk.Revit.DB import *
clr.AddReference("RevitServices")
import RevitServices
from RevitServices.Persistence import DocumentManager
from RevitServices.Transactions import TransactionManager
clr.AddReference("RevitNodes")
import Revit
clr.ImportExtensions(Revit.Elements)
#### End of General imports  ##### 
# Unwrap inputs
input = UnwrapElement( IN[0] )
elements = []
#force input into list
try:
    for e in input:
        if e.Category.Name == "Structural Framing":
            elements.append(e)
except:
    if input.Category.Name == "Structural Framing": 
        elements.append(input)
# Start Transaction
doc = DocumentManager.Instance.CurrentDBDocument
TransactionManager.Instance.EnsureInTransaction(doc)
for e in elements:
    Autodesk.Revit.DB.Structure.StructuralFramingUtils.AllowJoinAtEnd(e, 0)
    Autodesk.Revit.DB.Structure.StructuralFramingUtils.AllowJoinAtEnd(e, 1)
# End Transaction
TransactionManager.Instance.TransactionTaskDone()
# Wrap
OUT = elements
# ----------------------------------------
