# Dynamo graph Automate footing placement by Column Start Points.dyn (Dynamo 2.6.1.8786)
# packages: KennyStruct Nodes 0.0.1

footing_family_type = FamilyTypes("M_Footing-Rectangular:1500 x 1000 x 300mm")  # graph input
categories = Categories("OST_StructuralColumns")
select_column_element_type = DSModelElementSelection()  # nothing selected; graph input
allElementsofSelectedCategoryandType = Custom[AllElementsofSelectedCategoryandType](category=categories, element=select_column_element_type)  # package KennyStruct Nodes; Get all the elements of a particular category and selected type in Revit. To select a type, use the "Select Model Element" node or any node that helps you select an element in the Revit workspace
boolean = BoolSelector(true)
getColumnGeometry = Custom[GetColumnGeometry](Columns=allElementsofSelectedCategoryandType, ProjectElevation=boolean)  # package KennyStruct Nodes; Get all column associated geometries (curves, start and end points, rotations and column style)
byPoint = FamilyInstance.ByPoint(familyType=footing_family_type, point=getColumnGeometry.EndPoints)
setRotation = FamilyInstance.SetRotation(familyInstance=byPoint, degree=getColumnGeometry.Rotations)
