# Dynamo graph Beam System Beam Justification.dyn (Dynamo 2.6.1.8786)

boolean = BoolSelector(true)
python_script = Python(IN[0]=boolean)
# ---------- python_script.python (67 lines) ----------
import clr
import sys

import System
from System import Array
from System.Collections.Generic import *
clr.AddReference('ProtoGeometry')
from Autodesk.DesignScript.Geometry import *

clr.AddReference("RevitNodes")
import Revit
clr.ImportExtensions(Revit.Elements)
clr.ImportExtensions(Revit.GeometryConversion)

clr.AddReference("RevitServices")
import RevitServices
from RevitServices.Persistence import DocumentManager 
from RevitServices.Transactions import TransactionManager 

clr.AddReference("RevitAPI")
from Autodesk.Revit.DB import *

clr.AddReference("RevitAPIUI")
from Autodesk.Revit.UI import *

doc = DocumentManager.Instance.CurrentDBDocument
uiapp = DocumentManager.Instance.CurrentUIApplication 
app = uiapp.Application 
uidoc = uiapp.ActiveUIDocument

TransactionManager.Instance.EnsureInTransaction(doc)
def PickedBeamSystem():
	class MySelectionFilter(Selection.ISelectionFilter):
		def __init__(self):
			pass
		def AllowElement(self, element):
			if element.Category.Name == "Structural Beam Systems":
				return True
			else:
				return False
		def AllowReference(self, element):
			return False
	BeamSystems = []
	Sel_filter = MySelectionFilter()
	obj_type = Selection.ObjectType.Element
	selection = uidoc.Selection.PickObjects(obj_type,Sel_filter,"Select Beam System(s)")
	for elems in selection:
		BeamSystems.append(Document.GetElement(doc,elems))
	return BeamSystems

BeamSystems = PickedBeamSystem()
Beams = []

for beamSystem in BeamSystems:
	beamIds = beamSystem.GetBeamIds()
	for ids in beamIds:
		Beams.append(doc.GetElement(ids))

for beam in Beams:
	param = beam.LookupParameter("z Justification")
	param.Set(3)

TransactionManager.Instance.TransactionTaskDone()



OUT = Beams
# ----------------------------------------
string = StringInput("z Justification")
getParameterValueByName = Element.GetParameterValueByName(element=python_script, parameterName=string)
