# Dynamo graph Beams in Beam Sytems (Assign Mark Property).dyn (Dynamo 2.6.1.8786)
# packages: archi-lab.net 2022.210.2522, spring nodes 204.1.0

categories = Categories("OST_StructuralFramingSystem")
levels = Levels("1")
byCategoryAndLevel = archilab.Revit.Selection.Select.ByCategoryAndLevel(category=categories, level=levels, lacing=Longest)
current = Document.Current()
activeView = Document.ActiveView(document=current)
setParameterByName = Element.SetParameterByName()  # unwired: element, parameterName, value
boolean = BoolSelector(false)
ꟿ_document_activeview = Custom[ꟿ Document.ActiveView](refresh=boolean)  # package spring nodes; Selects the current document's active view. Supports more view types than the built-in option. Will be depreciated once the bult in node works with all plan types.
byCategoryAndView = archilab.Revit.Selection.Select.ByCategoryAndView(category=categories, view=ꟿ_document_activeview)
string = StringInput("Mark")
getParameterValueByName = Element.GetParameterValueByName(element=byCategoryAndView, parameterName=string)
sortByKey = List.SortByKey(list=byCategoryAndView, keys=getParameterValueByName)
python_script = Python(IN[0]=byCategoryAndView)
# ---------- python_script.python (30 lines) ----------
# Load the Python Standard and DesignScript Libraries
import sys
import clr
clr.AddReference('ProtoGeometry')
from Autodesk.DesignScript.Geometry import *

clr.AddReference("RevitServices")
import RevitServices
from RevitServices.Persistence import DocumentManager

clr.AddReference("RevitAPI")
clr.AddReference("RevitAPIUI")

import Autodesk
from Autodesk.Revit.DB import *
doc = DocumentManager.Instance.CurrentDBDocument

BSInView = UnwrapElement(IN[0])

beamID = []
L1 = []
for beamS in BSInView:
	beamID.append(beamS.GetBeamIds())
for id in beamID:
	L2 = []
	for i in id:
		L2.append(Document.GetElement(doc,i))
	L1.append(L2)

OUT = L1
# ----------------------------------------
sortByKey_2 = List.SortByKey(list=python_script, keys=getParameterValueByName)
