# Dynamo graph Change Sheet-View Name to Upper Case.dyn (Dynamo 2.0.3.8810)

categories = Categories(index=447)
all_elements_of_category = ElementsOfCategory(Category=categories)
isNull = Object.IsNull(obj=all_elements_of_category)
filterByBoolMask = List.FilterByBoolMask(list=all_elements_of_category, mask=isNull)
string = StringInput("Sheet Name")
name = Element.Name(element=filterByBoolMask.out)
toUpper = String.ToUpper(str=name)
setParameterByName = Element.SetParameterByName(element=filterByBoolMask.out, parameterName=string, value=toUpper)
