# Dynamo graph ChangeLevelBySelection.dyn (Dynamo 2.0.3.8810)

# group: REFERENCE LEVELS
remove_elements_from_level = Levels(index=1)  # graph input
move_elements_to_level = Levels(index=1)  # graph input

all_elements_at_level = ElementsAtLevel(Level=remove_elements_from_level)
code_block = CodeBlock { "Reference Level"; }
getParameterValueByName = Element.GetParameterValueByName(element=all_elements_at_level, parameterName=code_block)
code_block_2 = CodeBlock { ""; }
ne = getParameterValueByName != code_block_2
filterByBoolMask = List.FilterByBoolMask(list=all_elements_at_level, mask=ne)
code_block_3 = CodeBlock { "Level"; }
getParameterValueByName_2 = Element.GetParameterValueByName(element=filterByBoolMask.out, parameterName=code_block_3)
code_block_4 = CodeBlock { ""; }
ne_2 = getParameterValueByName_2 != code_block_4
filterByBoolMask_2 = List.FilterByBoolMask(list=filterByBoolMask.out, mask=ne_2)
code_block_5 = CodeBlock { "Level"; }
code_block_6 = CodeBlock { "Base Level"; }
getParameterValueByName_3 = Element.GetParameterValueByName(element=filterByBoolMask_2.out, parameterName=code_block_6)
ne_3 = getParameterValueByName_3 != code_block_4
filterByBoolMask_3 = List.FilterByBoolMask(list=filterByBoolMask_2.out, mask=ne_3)
code_block_7 = CodeBlock { "Base Constraint"; }
getParameterValueByName_4 = Element.GetParameterValueByName(element=filterByBoolMask_3.out, parameterName=code_block_7)
ne_4 = getParameterValueByName_4 != code_block_4
filterByBoolMask_4 = List.FilterByBoolMask(list=filterByBoolMask_3.out, mask=ne_4)

# group: EVALUATORS: UPDATING ELEMENT LEVELS
setParameterByName = Element.SetParameterByName(element=filterByBoolMask_2.in, parameterName=code_block_5, value=move_elements_to_level)
setParameterByName_2 = Element.SetParameterByName(element=filterByBoolMask.in, parameterName=code_block, value=move_elements_to_level)
setParameterByName_3 = Element.SetParameterByName(element=filterByBoolMask_4.in, parameterName=code_block_7, value=move_elements_to_level)
setParameterByName_4 = Element.SetParameterByName(element=filterByBoolMask_3.in, parameterName=code_block_6, value=move_elements_to_level)
