# Dynamo graph Column type assignment.dyn (Dynamo 2.12.1.8246)

sortByKey = List.SortByKey()  # unwired: list, keys
categories = Categories("OST_StructuralColumns")
all_elements_of_category = ElementsOfCategory(Category=categories)
getLocation = Element.GetLocation(element=all_elements_of_category)
Y = Point.Y(point=getLocation)
round = Math.Round(number=Y)
groupByKey = List.GroupByKey(list=getLocation, keys=round)
sortByKey_2 = List.SortByKey(list=groupByKey.groups, keys=groupByKey.uniqueKeys)
flatten = List.Flatten(list=sortByKey_2.sortedList)
X = Point.X(point=flatten)
round_2 = Math.Round(number=X)
groupByKey_2 = List.GroupByKey(list=flatten, keys=round_2)
count = List.Count(list=groupByKey_2.groups)
groupByKey_3 = List.GroupByKey(list=all_elements_of_category, keys=round)
sortByKey_3 = List.SortByKey(list=groupByKey_3.groups, keys=groupByKey.uniqueKeys)
flatten_2 = List.Flatten(list=sortByKey_3.sortedList)
groupByKey_4 = List.GroupByKey(list=flatten_2, keys=round_2)
code_block = CodeBlock(x=groupByKey_4.groups) { x[0]; }
getLocation_2 = Element.GetLocation(element=code_block)
X_2 = Point.X(point=getLocation)
round_3 = Math.Round(number=X_2)
sortByKey_4 = List.SortByKey(list=getLocation, keys=round_3)
X_3 = Point.X(point=sortByKey_4.sortedList)
round_4 = Math.Round(number=X_3)
sortByKey_5 = List.SortByKey(list=all_elements_of_category, keys=round_3)
Y_2 = Point.Y(point=sortByKey_4.sortedList)
round_5 = Math.Round(number=Y_2)
groupByKey_5 = List.GroupByKey(list=sortByKey_5.sortedList, keys=round_5)
groupByKey_6 = List.GroupByKey(list=sortByKey_4.sortedList, keys=round_5)
X_4 = Point.X(point=groupByKey_6.groups)
round_6 = Math.Round(number=X_4)
groupByKey_7 = List.GroupByKey(list=groupByKey_5.groups@L2, keys=round_6@L2)
string = StringInput("Mark")
getParameterValueByName = Element.GetParameterValueByName(element=groupByKey_7.groups, parameterName=string)
groupByKey_8 = List.GroupByKey(list=groupByKey_6.groups@L2, keys=round_6@L2)
watch = Watch(groupByKey_8.groups)
code_block_2 = CodeBlock { 0; }
removeItemAtIndex = List.RemoveItemAtIndex(list=groupByKey_7.groups@L2, indices=code_block_2)
string_2 = StringInput("KSD_Column Type")
getParameterValueByName_2 = Element.GetParameterValueByName(element=groupByKey_7.groups, parameterName=string_2)
firstItem = List.FirstItem(list=getParameterValueByName_2@L2)
setParameterByName = Element.SetParameterByName(element=removeItemAtIndex, parameterName=string_2, value=firstItem)
getParameterValueByName_3 = Element.GetParameterValueByName(element=removeItemAtIndex, parameterName=string)
