# Dynamo graph Copy Elements by Vector.dyn (Dynamo 2.0.3.8810)

run_script = BoolSelector(true)
select_category_to_copy = Categories()  # nothing selected; graph input
ʳʰʸᵗʰᵐ_selection_pick = Rhythm.Revit.Selection.Selection.Pick(runIt=run_script, category=select_category_to_copy)
x_vector_distance = DoubleInput(0)  # graph input
y_vector_distance = DoubleInput(0)  # graph input
z_vector_distance = DoubleInput(0)  # graph input
byCoordinates = Vector.ByCoordinates(x=x_vector_distance, y=y_vector_distance, z=z_vector_distance)
boolean = BoolSelector(true)
copyByVector = Custom[Element.CopyByVector](element=ʳʰʸᵗʰᵐ_selection_pick, vector=byCoordinates, rehostToClosestLevel=boolean)  # Copies an element or a list of elements by a given vector.
