# Dynamo graph Create Element Section Views.dyn (Dynamo 2.6.1.8786)

# group: INPUTS
refresh = BoolSelector(true)
offset = DoubleInput(250)

# group: SELECT BEAMS IN VIEW
python_script = Python(IN[0]=refresh)
# ---------- python_script.python (68 lines) ----------
#Created by KEHINDE AYOBADE
#FREE FOR US
#https://www.linkedin.com/notifications/
# Load the Python Standard and DesignScript Libraries
import sys
import clr
clr.AddReference('ProtoGeometry')
from Autodesk.DesignScript.Geometry import *

clr.AddReference("RevitNodes")
import Revit
clr.ImportExtensions(Revit.Elements)
clr.ImportExtensions(Revit.GeometryConversion)

clr.AddReference("RevitServices")
import RevitServices
from RevitServices.Persistence import DocumentManager 
from RevitServices.Transactions import TransactionManager 

clr.AddReference("RevitAPI")
from Autodesk.Revit.DB import *

clr.AddReference("RevitAPIUI")
from Autodesk.Revit.UI import *

doc = DocumentManager.Instance.CurrentDBDocument
uiapp = DocumentManager.Instance.CurrentUIApplication 
app = uiapp.Application 
uidoc = uiapp.ActiveUIDocument




def PickedBeams():
	class MySelectionFilter(Selection.ISelectionFilter):
		def __init__(self):
			pass
		def AllowElement(self, element):
			if element.Category.Name == "Structural Framing":
				return True
			else:
				return False
		def AllowReference(self, element):
			return False
	
	refresh = IN[0]
	beams = []
	
	
	Sel_filter = MySelectionFilter()
	obj_type = Selection.ObjectType.Element
	
	if refresh:
		selection = uidoc.Selection.PickObjects(obj_type,Sel_filter,"Select Structural Framing Element")
		
		for elems in selection:
				beams.append(Document.GetElement(doc,elems))
	else:
		beams.append("Please Set Toggle to True")
		beams = beams[0]
		
	return beams
	
Struct_beams = PickedBeams()


# Assign your output to the OUT variable.
OUT = Struct_beams
# ----------------------------------------

# group: PYTHON SCRIPT
string = StringInput("KSD - Cross Section")
code_block = CodeBlock { 500; }
python_script_2 = Python(IN[0]=python_script, IN[1]=string, IN[2]=code_block)  # frozen
# ---------- python_script_2.python (99 lines) ----------
#Created by KEHINDE AYOBADE
#FREE FOR USE
#https://www.linkedin.com/kehinde-ayobade


# Load the Python Standard and DesignScript Libraries
import sys
import clr
clr.AddReference('ProtoGeometry')
from Autodesk.DesignScript.Geometry import *

clr.AddReference("RevitNodes")
import Revit
clr.ImportExtensions(Revit.Elements)
clr.ImportExtensions(Revit.GeometryConversion)

clr.AddReference("RevitServices")
import RevitServices
from RevitServices.Persistence import DocumentManager 
from RevitServices.Transactions import TransactionManager 

clr.AddReference("RevitAPI")
from Autodesk.Revit.DB import *

clr.AddReference("RevitAPIUI")
from Autodesk.Revit.UI import *

doc = DocumentManager.Instance.CurrentDBDocument
uiapp = DocumentManager.Instance.CurrentUIApplication 
app = uiapp.Application 
uidoc = uiapp.ActiveUIDocument


def units(FeetsTomm):
	dut = DisplayUnitType.DUT_MILLIMETERS
	return UnitUtils.ConvertFromInternalUnits(FeetsTomm, dut)

def Funits(mmToFeets):
	dut = DisplayUnitType.DUT_MILLIMETERS
	return UnitUtils.ConvertToInternalUnits(mmToFeets, dut)

# wall selection
beams = UnwrapElement(IN[0])

if not isinstance(IN[0], list):
    beams = [beams]

sectionTypeName = IN[1]

offset = Funits(IN[2])

viewFamilyTypes = FilteredElementCollector(doc).OfClass(ViewFamilyType).ToElements()

ds = []
newSections = []
viewFamilyTypeId = []

for vf in viewFamilyTypes:
	if vf.get_Parameter(BuiltInParameter.SYMBOL_NAME_PARAM).AsString() == sectionTypeName:
		viewFamilyTypeId.append(vf.Id)

for beam in beams:
	beamCrv = beam.Location.Curve
	beamLen = beamCrv.Length
	beamHeight = Funits(float(Document.GetElement(doc,beam.GetTypeId()).GetParameters("h")[0].AsValueString()))
	beamId = beam.GetTypeId()
	beamMid = beamCrv.Evaluate(0.5,True)
	XbeamDir = beamCrv.Direction.Normalize()
	YbeamDir = XYZ.BasisZ
	ZbeamDir = YbeamDir.CrossProduct(XbeamDir)
	
	t = Transform.Identity
	t.Origin = beamMid
	t.BasisX = XbeamDir
	t.BasisY = YbeamDir
	t.BasisZ = ZbeamDir
	#Min and Max values
	Min = -beamLen/2
	Max = beamLen/2
	
	cs = CoordinateSystem.ByOriginVectors(beamMid.ToPoint(),XbeamDir.ToVector(),YbeamDir.ToVector(),ZbeamDir.ToVector())
	
	#MinPoint and MaxPoint 
	MinPoint = XYZ(Min,0,offset)
	MaxPoint = XYZ(Max,beamHeight,-offset)
	
	sectionBox = BoundingBoxXYZ()
	sectionBox.Transform = t
	sectionBox.Min = MinPoint # scope box bottom
	sectionBox.Max = MaxPoint # scope box top
	
	TransactionManager.Instance.EnsureInTransaction(doc)
	for SectTypeId in viewFamilyTypeId:
		newSection = ViewSection.CreateSection(doc, SectTypeId, sectionBox)
		newSections.append(newSection)
	
	TransactionManager.Instance.TransactionTaskDone()
	
OUT =  MinPoint,MaxPoint,newSections
# ----------------------------------------
code_block_2 = CodeBlock(len=python_script_2) { len*304.8; }

getLocation = Element.GetLocation(element=python_script)

# group: Origin
code_block_3 = CodeBlock { 0.5; }
pointAtParameter = Curve.PointAtParameter(curve=getLocation, param=code_block_3)

# group: HEIGHT
element_type_python_script = Python(IN[0]=python_script)
# ---------- element_type_python_script.python (35 lines) ----------
# Load the Python Standard and DesignScript Libraries
import sys
import clr
clr.AddReference('ProtoGeometry')
from Autodesk.DesignScript.Geometry import *

clr.AddReference("RevitNodes")
import Revit
clr.ImportExtensions(Revit.Elements)
clr.ImportExtensions(Revit.GeometryConversion)

clr.AddReference("RevitServices")
import RevitServices
from RevitServices.Persistence import DocumentManager 
from RevitServices.Transactions import TransactionManager 

clr.AddReference("RevitAPI")
from Autodesk.Revit.DB import *
from Autodesk.Revit.Creation.Document import NewFamilyInstance
from Autodesk.Revit.DB.Structure import *

clr.AddReference("RevitAPIUI")
from Autodesk.Revit.UI import *

doc = DocumentManager.Instance.CurrentDBDocument

elements = UnwrapElement(IN[0])

elemType = []

for elem in elements:
	elemType.append(Document.GetElement(doc, elem.GetTypeId()))

# Assign your output to the OUT variable.
OUT = elemType
# ----------------------------------------
code_block_4 = CodeBlock { "h"; }
getParameterValueByName = Element.GetParameterValueByName(element=element_type_python_script, parameterName=code_block_4)
round = Math.Round(number=getParameterValueByName)

code_block_5 = CodeBlock(h=round, offset=round) { h+offset; h+(2*offset); }

# group: MOVE DOWN THE ORIGIN
ZAxis = Vector.ZAxis()
reverse = Vector.Reverse(vector=ZAxis)
translate = Geometry.Translate(geometry=pointAtParameter, direction=reverse, distance=code_block_5.out0)

# group: X
direction = Line.Direction(line=getLocation)
normalized = Vector.Normalized(vector=direction)

# group: Y
ZAxis_2 = Vector.ZAxis()

# group: Z
cross = Vector.Cross(vector=normalized, cross=ZAxis_2)

byOriginVectors = CoordinateSystem.ByOriginVectors(origin=translate, xAxis=normalized, yAxis=ZAxis_2, zAxis=cross)

# group: LENGTH
length = Curve.Length(curve=getLocation)

# group: MIN & MAX POINT
code_block_6 = CodeBlock(offset=offset, length=length) { minPt = -offset-length/2; maxPt = offset+length/2; }
code_block_7 = CodeBlock { "b"; }
getParameterValueByName_2 = Element.GetParameterValueByName(element=element_type_python_script, parameterName=code_block_7)
round_2 = Math.Round(number=getParameterValueByName_2)
code_block_8 = CodeBlock(offset=offset, b=round_2) { -(offset+0.5*b); offset+0.5*b; }
byCoordinates = Point.ByCoordinates(x=code_block_6.minPt, z=code_block_8.out0)
byCoordinates_2 = Point.ByCoordinates(x=code_block_6.maxPt, y=code_block_5.out1, z=code_block_8.out1)

byCoordinateSystemMinPointMaxPoint = SectionView.ByCoordinateSystemMinPointMaxPoint(cs=byOriginVectors, minPoint=byCoordinates, maxPoint=byCoordinates_2)
