# Dynamo graph Delete View Name Prefix.dyn (Dynamo 2.0.3.8810)

categories = Categories(index=602)
all_elements_of_category = ElementsOfCategory(Category=categories)
isNull = Object.IsNull(obj=all_elements_of_category)
filterByBoolMask = List.FilterByBoolMask(list=all_elements_of_category, mask=isNull)
string = StringInput("Sheet Name")
name = Element.Name(element=filterByBoolMask.out)
toUpper = String.ToUpper(str=name)
setParameterByName = Element.SetParameterByName(element=filterByBoolMask.out, parameterName=string, value=toUpper)  # frozen
python_script = Python(IN[0]=toUpper)
# ---------- python_script.python (14 lines) ----------
# Enable Python support and load DesignScript library
import clr
clr.AddReference('ProtoGeometry')
from Autodesk.DesignScript.Geometry import *

# The inputs to this node will be stored as a list in the IN variables.
vNames = IN[0]
VFirst = []
for v in vNames:
	VFirst.append(v[0])
# Place your code below this line

# Assign your output to the OUT variable.
OUT = VFirst
# ----------------------------------------
toNumber = String.ToNumber(str=python_script)
isNull_2 = Object.IsNull(obj=toNumber)
filterByBoolMask_2 = List.FilterByBoolMask(list=filterByBoolMask.out, mask=isNull_2)
filterByBoolMask_3 = List.FilterByBoolMask(list=toUpper, mask=isNull_2)
string_2 = StringInput("3D")
startsWith = String.StartsWith(str=filterByBoolMask_3.out, searchFor=string_2)
filterByBoolMask_4 = List.FilterByBoolMask(list=filterByBoolMask_2.out, mask=startsWith)
string_3 = StringInput("Title on Sheet")
filterByBoolMask_5 = List.FilterByBoolMask(list=filterByBoolMask_3.out, mask=startsWith)
code_block = CodeBlock { 0; 7; }
remove = String.Remove(str=filterByBoolMask_5.out, startIndex=code_block.out0, count=code_block.out1)
setParameterByName_2 = Element.SetParameterByName(element=filterByBoolMask_4.out, parameterName=string_3, value=remove)
