# Dynamo graph Extract and Create Element Filters.dyn (Dynamo 2.0.3.8810)

views = Views(index=182)
filters = View.Filters(view=views)
name = Element.Name(element=filters)
code_block = CodeBlock { 0; 10; }
remove = String.Remove(str=name, startIndex=code_block.out0, count=code_block.out1)
number = DoubleInput(7)
line_patterns = LinePatterns()  # nothing selected
filterOverrides = archilab.Revit.Views.Views.FilterOverrides(view=views, parameterFilter=filters)
projectionLineColor = archilab.Revit.Elements.OverrideGraphicsSettings.ProjectionLineColor(overrideGraphicsSettings=filterOverrides)
create = Revit.LineStyle.Create(name=remove, weight=number, linePattern=line_patterns, color=projectionLineColor, lacing=Longest)
