# Dynamo graph Get Stair Volume.dyn (Dynamo 2.6.1.8786)

categories = Categories("OST_Stairs")
all_elements_of_category = ElementsOfCategory(Category=categories)
geometry = Element.Geometry(element=all_elements_of_category)
code_block = CodeBlock(x=geometry) { x[0..1]; x[2..5]; }
code_block_2 = CodeBlock(type2=code_block.out0) { type2; }
flatten = List.Flatten(list=code_block_2)
volume = Solid.Volume(solid=flatten)
code_block_3 = CodeBlock(volumes=volume) { Math.Sum(volumes); }
convert_between_units = DynamoConvert(code_block_3, MeasurementType="Volume", FromConversion="CubicMillimeter", ToConversion="CubicMeters")
stair_type_1 = Watch(convert_between_units)
code_block_4 = CodeBlock(type1=code_block.out1) { type1; }
flatten_2 = List.Flatten(list=code_block_4)
volume_2 = Solid.Volume(solid=flatten_2)
code_block_5 = CodeBlock(volumes=volume_2) { Math.Sum(volumes); }
convert_between_units_2 = DynamoConvert(code_block_5, MeasurementType="Volume", FromConversion="CubicMillimeter", ToConversion="CubicMeters")
stair_type_2 = Watch(convert_between_units_2)
