# Dynamo graph Get Warning Message and Failing Elements.dyn (Dynamo 2.3.1.11775)
# packages: archi-lab.net 2021.25.2621

refresh = BoolSelector(true)
python_script = Python(IN[0]=refresh)
# ---------- python_script.python (35 lines) ----------
# Made by Gavin Crump
# Free for use
# BIM Guru, www.bimguru.com.au

# Boilerplate text
import clr

clr.AddReference("RevitAPI")
from Autodesk.Revit.DB import *

clr.AddReference("RevitServices")
import RevitServices
from RevitServices.Persistence import DocumentManager

# Current doc/app/ui
doc = DocumentManager.Instance.CurrentDBDocument

warnings = Document.GetWarnings(doc)

refresh = IN[0]
failElems = []
elemsId = []
message = []

if refresh:
	for w in warnings:
		message.append(w.GetDescriptionText())
		elems = []
		for id in w.GetFailingElements():
			elems.append(Document.GetElement(doc, id))
			failElems.append(elems)
			OUT = message,failElems
else:
	OUT = "Please set toggle to True"
# Preparing output to Dynamo
# ----------------------------------------
code_block = CodeBlock(warning=python_script) { message = warning[0]; elements = warning[1]; }
code_block_2 = CodeBlock(x=code_block.message) { x[0]; }
eq = code_block_2 == code_block.message
filterByBoolMask = List.FilterByBoolMask(list=code_block.elements, mask=eq)
code_block_3 = CodeBlock { 1; }
getItemAtIndex = List.GetItemAtIndex(index=code_block_3)  # unwired: list
map = List.Map(list=filterByBoolMask.in, f_x=getItemAtIndex)
delete = archilab.Revit.Elements.Elements.Delete(element=map)
