# Dynamo graph Levels - Update Floor to FLoor Height increase.dyn (Dynamo 2.6.2.15705)

categories = Categories("OST_Levels")
all_elements_of_category = ElementsOfCategory(Category=categories)
string = StringInput("Elevation")
getParameterValueByName = Element.GetParameterValueByName(element=all_elements_of_category, parameterName=string)
sortByKey = List.SortByKey(list=all_elements_of_category, keys=getParameterValueByName)

# group: INPUTS
include_lowest_level = BoolSelector(false)  # graph input
addition_elevation_mm = DoubleInput(600)  # graph input

python_script = Python(IN[0]=getParameterValueByName, IN[1]=addition_elevation_mm)
# ---------- python_script.python (10 lines) ----------
# Place your code below this line
listA = IN[0]
elev = IN[1]
output = []

for i in range(len(listA)):
	output.append(i*elev)

# Assign your output to the OUT variable.
OUT = output
# ----------------------------------------
add = sortByKey.sorted_keys + python_script
code_block = CodeBlock { 0; }
firstItem = List.FirstItem(list=python_script)
add_2 = firstItem + addition_elevation_mm
replaceItemAtIndex = List.ReplaceItemAtIndex(list=add, index=code_block, item=add_2)
if_ = If(test=include_lowest_level, true=replaceItemAtIndex, false=add)
round = Math.Round(number=if_)
setParameterByName = Element.SetParameterByName(element=sortByKey.sorted_list, parameterName=string, value=round)
