# Dynamo graph Levels addtional elevation.dyn (Dynamo 2.6.2.15705)

categories = Categories("OST_Levels")
all_elements_of_category = ElementsOfCategory(Category=categories)
string = StringInput("Elevation")
getParameterValueByName = Element.GetParameterValueByName(element=all_elements_of_category, parameterName=string)
round = Math.Round(number=getParameterValueByName)
sortByKey = List.SortByKey(list=all_elements_of_category, keys=round)
addition_elevation_mm = DoubleInput(300)  # graph input
sub = sortByKey.sorted_keys - addition_elevation_mm
round_2 = Math.Round(number=sub)
setParameterByName = Element.SetParameterByName(element=sortByKey.sorted_list, parameterName=string, value=round_2)
count = List.Count(list=sortByKey.sorted_list)
removeItemAtIndex = List.RemoveItemAtIndex(list=sortByKey.sorted_keys, indices=count)
