# Dynamo graph Mark Beams by Level and Axis Location.dyn (Dynamo 2.6.1.8786)
# packages: Clockwork for Dynamo 2.x 2.3.0

# group: INPUTS
level_to_create_marks = Levels("01 - FIRST")  # graph input
beam_mark = StringInput("1B")  # graph input
n3d_preview_section_box = Views("3D - Dynamo Preview")  # "3D Preview - Section Box"; graph input

# group: FILTER BEAMS BY LEVELS
categories = Categories("OST_StructuralFraming")
all_elements_of_category = ElementsOfCategory(Category=categories)
level = Custom[Element.Level](element=all_elements_of_category)  # package Clockwork for Dynamo 2.x; Gets an element's level
name = Level.Name(level=level)
groupByKey = List.GroupByKey(list=all_elements_of_category, keys=name)
groupByKey_2 = List.GroupByKey(list=level, keys=name)
name_2 = Level.Name(level=level_to_create_marks)
eq = groupByKey_2.unique_keys == name_2
filterByBoolMask = List.FilterByBoolMask(list=groupByKey.groups, mask=eq)
getLocation = Element.GetLocation(element=all_elements_of_category)
groupByKey_3 = List.GroupByKey(list=getLocation, keys=name)
filterByBoolMask_2 = List.FilterByBoolMask(list=groupByKey_3.groups, mask=eq)

# group: GET BEAMS AXIS (X/Y)
flatten = List.Flatten(list=filterByBoolMask.in)
flatten_2 = List.Flatten(list=filterByBoolMask_2.in)
direction = Line.Direction(line=flatten_2)
X = Vector.X(vector=direction)
round = Math.Round(number=X)
code_block = CodeBlock { 0; }
eq_2 = round == code_block

# group: FILTER BEAMS BY AXIS
groupByKey_4 = List.GroupByKey(list=flatten, keys=eq_2)
code_block_2 = CodeBlock(x=groupByKey_4.groups) { x[0]; x[1]; }
getLocation_2 = Element.GetLocation(element=code_block_2.out1)
startPoint = Curve.StartPoint(curve=getLocation_2)
Y = Point.Y(point=startPoint)
round_2 = Math.Round(number=Y)
getLocation_3 = Element.GetLocation(element=code_block_2.out0)
startPoint_2 = Curve.StartPoint(curve=getLocation_3)
X_2 = Point.X(point=startPoint_2)
round_3 = Math.Round(number=X_2)

sortByKey = List.SortByKey(list=code_block_2.out1, keys=round_2)
sortByKey_2 = List.SortByKey(list=code_block_2.out0, keys=round_3)

# group: MARK BEAMS BASED ON X AND Y AXIS
groupByKey_5 = List.GroupByKey(list=sortByKey.sorted_list, keys=sortByKey.sorted_keys)
groupByKey_6 = List.GroupByKey(list=sortByKey_2.sorted_list, keys=sortByKey_2.sorted_keys)
mark_beams_based_on_x_y_axis = CodeBlock(XBeams=groupByKey_5.groups, YBeams=groupByKey_6.groups, Mark=beam_mark)
# ---------- mark_beams_based_on_x_y_axis.designscript (10 lines) ----------
Count1 = List.Count(XBeams);
Count2 = List.Count(YBeams);

count1 = 1..Count1;
count2 = (1+Count1)..(Count1 + Count2);

Xmark = Mark + count1;
Ymark = Mark + count2;
Elements.Element.SetParameterByName(XBeams,"Mark",Xmark);
Elements.Element.SetParameterByName(YBeams,"Mark",Ymark);
# ----------------------------------------

# group: BEAMS MARKS BY AXIS
beams_x_axis = Watch(mark_beams_based_on_x_y_axis.Xmark)
beams_y_axis = Watch(mark_beams_based_on_x_y_axis.Ymark)
