# Dynamo graph Merge Single Beam from Multiple Beams.dyn (Dynamo 2.12.1.8246)

refresh_script = BoolSelector(true)  # graph input
python_script = Python(IN[0]=refresh_script)  # IronPython2
# ---------- python_script.python (130 lines) ----------
#	Developed by KEHINDE AYOBADE
#	Free for Use, Kindly share with your network
#	For more Information about me, check my linkedIn profile below
#	Hold CTRL on your keyboard and clik the link
#	www.linkedin.com/in/kehinde-ayobade/

import sys
import clr
clr.AddReference('ProtoGeometry')
from Autodesk.DesignScript.Geometry import Point as PT, Line as Crv

clr.AddReference("RevitNodes")
import Revit
clr.ImportExtensions(Revit.Elements)
clr.ImportExtensions(Revit.GeometryConversion)

clr.AddReference("RevitServices")
import RevitServices
from RevitServices.Persistence import DocumentManager 
from RevitServices.Transactions import TransactionManager 

clr.AddReference("RevitAPI")
from Autodesk.Revit.DB import *
from Autodesk.Revit.Creation.Document import NewFamilyInstance
from Autodesk.Revit.DB.Structure import *

clr.AddReference("RevitAPIUI")
from Autodesk.Revit.UI import *

doc = DocumentManager.Instance.CurrentDBDocument
uiapp = DocumentManager.Instance.CurrentUIApplication 
app = uiapp.Application 
uidoc = uiapp.ActiveUIDocument

class MySelectionFilter(Selection.ISelectionFilter):
	def __init__(self):
		pass
	def AllowElement(self, element):
		if element.Category.Name == "Structural Framing":
			return True
		else:
			return False
	def AllowReference(self, element):
		return False

refresh = IN[0]
beams = []

Sel_filter = MySelectionFilter()
obj_type = Selection.ObjectType.Element

if refresh:

	selection = uidoc.Selection.PickObjects(obj_type,Sel_filter,"Select Structural Framing Element")
	
	for elems in selection:
		beams.append(Document.GetElement(doc,elems))
	
	elements = beams
	
	IDs = []
	
	for elem in elements:
		start = IDs.append(elem.Location.Curve.GetEndPoint(0))
		end = IDs.append(elem.Location.Curve.GetEndPoint(1))
	
	DS_Points = []
	
	for point in IDs:
		DS_Points.append(point.ToPoint())
		
	DS_Points = PT.PruneDuplicates(DS_Points)
	
	newCrv = Crv.ByBestFitThroughPoints(DS_Points)
	
	collector = FilteredElementCollector(doc)
	
	type = Document.GetElement(doc, elements[0].GetTypeId())
	
	def GetLevel(item):
		val = None
		if hasattr(item, "LevelId"): 
			val = item.Document.GetElement(item.LevelId)
			if val: return val
		if hasattr(item, "Level"):
			val = item.Level
			if val: return val
		if hasattr(item, "GenLevel"):
			val = item.GenLevel
			if val: return val
		if (item.GetType().ToString() in ("Autodesk.Revit.DB.Architecture.StairsRun", "Autodesk.Revit.DB.Architecture.StairsLanding")):
			item = item.GetStairs()
		if (item.GetType().ToString() == "Autodesk.Revit.DB.Architecture.Stairs"):
			try: return item.Document.GetElement(item.get_Parameter(BuiltInParameter.STAIRS_BASE_LEVEL_PARAM).AsElementId())
			except: pass
		if (item.GetType().ToString() == "Autodesk.Revit.DB.ExtrusionRoof"):
			try: return item.Document.GetElement(item.get_Parameter(BuiltInParameter.ROOF_CONSTRAINT_LEVEL_PARAM).AsElementId())
			except: pass
		if not val:
			try: return item.Document.GetElement(item.get_Parameter(BuiltInParameter.INSTANCE_REFERENCE_LEVEL_PARAM).AsElementId())
			except: 
				try: return item.Document.GetElement(item.get_Parameter(BuiltInParameter.INSTANCE_SCHEDULE_ONLY_LEVEL_PARAM).AsElementId())
				except: 
					try: return item.Document.GetElement(item.get_Parameter(BuiltInParameter.SCHEDULE_LEVEL_PARAM).AsElementId())
					except: return None
	
	
	TransactionManager.Instance.EnsureInTransaction(doc)
	
	if isinstance(elements, list):
		newBeam = doc.Create.NewFamilyInstance(newCrv.ToRevitType(), type, GetLevel(elements[0]), StructuralType.Beam)
		
		
	else:
		newBeam = doc.Create.NewFamilyInstance(newCrv.ToRevitType(), type, GetLevel(elements), StructuralType.Beam)
	
	if newBeam:
		for elems in elements:
			Document.Delete(doc,elems.Id)
		zOffset = newBeam.GetParameters("z Offset Value")
		zOffset[0].Set(0)
	else:
		pass
	
	TransactionManager.Instance.TransactionTaskDone()
	
	OUT = newBeam
	
else:
	OUT = TaskDialog.Show("Merge Beams","Script cannot work, please set toggle to True")
# ----------------------------------------
result = Watch(python_script)  # graph output
