# Dynamo graph Set Beam Offset and Justification.dyn (Dynamo 2.6.1.8786)

categories = Categories("OST_StructuralFraming")
all_elements_of_category = ElementsOfCategory(Category=categories)
string = StringInput("Start Level Offset")
string_2 = StringInput("End Level Offset")
string_3 = StringInput("z Offset Value")
string_4 = StringInput("z Justification")
join = List.Join(list0=string, list1=string_2, list2=string_3, list3=string_4)
getParameterValueByName = Element.GetParameterValueByName(element=all_elements_of_category, parameterName=join, lacing=CrossProduct)
number = DoubleInput(0)
setParameterByName = Element.SetParameterByName(element=all_elements_of_category, parameterName=join, value=number, lacing=CrossProduct)
setParameterByName_2 = Element.SetParameterByName()  # unwired: element, parameterName, value
setParameterByName_3 = Element.SetParameterByName(element=setParameterByName_2)  # unwired: parameterName, value
setParameterByName_4 = Element.SetParameterByName(element=setParameterByName_3)  # unwired: parameterName, value
