# Dynamo graph Set Beams Start-End Cutbacks.dyn (Dynamo 2.6.1.8786)

categories = Categories("OST_StructuralFraming")
all_elements_of_category = ElementsOfCategory(Category=categories)
name = Element.Name(element=all_elements_of_category)
groupByKey = List.GroupByKey(list=all_elements_of_category, keys=name)
select_beam_element_type = DSModelElementSelection()  # 1 picked in the model; graph input
name_2 = Element.Name(element=select_beam_element_type)
eq = name_2 == groupByKey.unique_keys
filterByBoolMask = List.FilterByBoolMask(list=groupByKey.groups, mask=eq)
code_block = CodeBlock(x=filterByBoolMask.in) { x[0]; }
string = StringInput("Start Join Cutback")
string_2 = StringInput("End Join Cutback")
start_join_cutback = DoubleInput(-50)  # graph input
end_join_cutback = DoubleInput(-50)  # graph input
code_block_2 = CodeBlock(s=string, e=string_2, Sn=start_join_cutback, En=end_join_cutback) { [s,e]; [Sn, En]; }
setParameterByName = Element.SetParameterByName(element=code_block, parameterName=code_block_2.out0@L2, value=code_block_2.out1@L2, lacing=Longest)
