# Dynamo graph Set Element Type Material.dyn (Dynamo 2.6.1.8786)
# packages: Structural Design 2021.9.23

boolean = BoolSelector(true)
pickElements = StructuralDesign.Model.Selection.PickElements(refresh=boolean)
getCategory = Element.GetCategory(element=pickElements)
all_elements_of_category = ElementsOfCategory(Category=getCategory)
code_block = CodeBlock(x=all_elements_of_category) { x[0]; }
name = Element.Name(element=code_block)
groupByKey = List.GroupByKey(list=code_block, keys=name)
name_2 = Element.Name(element=pickElements)
eq = name_2 == groupByKey.unique_keys  # lacing=Longest
filterByBoolMask = List.FilterByBoolMask(list=groupByKey.groups, mask=eq)
code_block_2 = CodeBlock(x=filterByBoolMask.in) { x[0]; x[0][0]; }
string = StringInput("Structural Material")
material_name = StringInput("Concrete, Cast-in-Place gray - Orange (PAC))")
byName = Material.ByName(name=material_name)
code_block_3 = CodeBlock(Parameter=string, Material_Name=byName) { Parameter; Material_Name; }
setParameterByName = Element.SetParameterByName(element=code_block_2.out0, parameterName=code_block_3.Parameter@L2, value=code_block_3.Material_Name@L2, lacing=Longest)
