# Dynamo graph Set Mark as Type Mark.dyn (Dynamo 2.6.1.8786)
# packages: archi-lab.net 2022.210.2522, KennyStruct Nodes 0.0.1

select_category = Categories("OST_StructuralFoundation")  # graph input
all_elements_of_category = ElementsOfCategory(Category=select_category)
type = archilab.Revit.Elements.Elements.Type(element=all_elements_of_category)
is_type_parameter = BoolSelector(false)  # graph input
if_Statement = Custom[If_Statement](Arg_A=type, Arg_B=all_elements_of_category, BOOL=is_type_parameter)  # package KennyStruct Nodes; If statement conditional. It takes in boolean and too arguments
parameter_to_copy_from = StringInput("Type Mark")  # graph input
getParameterValueByName = Element.GetParameterValueByName(element=if_Statement, parameterName=parameter_to_copy_from)
string = StringInput("")
eq = getParameterValueByName == string
filterByBoolMask = List.FilterByBoolMask(list=all_elements_of_category, mask=eq)
parameter_to_copy_to = StringInput("Mark")  # graph input
filterByBoolMask_2 = List.FilterByBoolMask(list=getParameterValueByName, mask=eq)
setParameterByName = Element.SetParameterByName(element=filterByBoolMask.out, parameterName=parameter_to_copy_to, value=filterByBoolMask_2.out)
