# Dynamo graph View Name To Title on Sheet.dyn (Dynamo 2.6.1.8786)
# packages: Data-Shapes 2022.2.96

python_script = Python()
# ---------- python_script.python (38 lines) ----------
#Developed by KEHINDE AYOBADE
#Folow the Link below to check me out on LinkedIn
#https://www.linkedin.com/in/kehinde-ayobade

import sys
import clr
clr.AddReference('ProtoGeometry')
from Autodesk.DesignScript.Geometry import *

clr.AddReference('RevitAPI')
from Autodesk.Revit.DB import Element
clr.AddReference('RevitServices')

import RevitServices
from RevitServices.Persistence import DocumentManager 
from RevitServices.Transactions import TransactionManager 

doc = DocumentManager.Instance.CurrentDBDocument
uiapp = DocumentManager.Instance.CurrentUIApplication 
app = uiapp.Application 
uidoc = uiapp.ActiveUIDocument

#parameterName = IN[1]
#elems = UnwrapElement(IN[0])

def get_parameter_value_by_name(element, parameterName):
	return element.LookupParameter(parameterName).ToString()
	
#Select elements from revit
selection = [doc.GetElement(x) for x in uidoc.Selection.GetElementIds()]

result = []
#Get parameter value from above function
for elem in selection:
	result.append(get_parameter_value_by_name(elem, parameterName))
	
# Assign your output to the OUT variable.
OUT = result
# ----------------------------------------
boolean = BoolSelector(true)
string = StringInput("SELECT VIEWS")
categories = Categories("OST_Views")
all_elements_of_category = ElementsOfCategory(Category=categories)
isNull = Object.IsNull(obj=all_elements_of_category)
filterByBoolMask = List.FilterByBoolMask(list=all_elements_of_category, mask=isNull)
name = Element.Name(element=filterByBoolMask.out)
listview_data = Custom[Listview Data](InputName=string, Keys=name, Values=filterByBoolMask.out)  # package Data-Shapes; Create data for ListView input in UI.MultiInputForm ++ . Check out www.data-shapes.net for more infos.
multipleinputform = Custom[MultipleInputForm ++](Logo_optional=boolean, Inputs=listview_data, Toggle=boolean)  # package Data-Shapes; Create a form with multiple inputs. see www.data-shapes.net for tutorials and infos!
flatten = List.Flatten(list=multipleinputform.User_Inputs)
string_2 = StringInput("Title on Sheet")
string_3 = StringInput("View Name")
getParameterValueByName = Element.GetParameterValueByName(element=flatten, parameterName=string_3)
setParameterByName = Element.SetParameterByName(element=flatten, parameterName=string_2, value=getParameterValueByName)
