# Dynamo graph Topography_solid_layers_020.dyn (Dynamo 2.6.1.8786)

# group: PLEASE READ BEFORE YOU START ● NAME: Creating solid topography with layers ● DESCRIPTION: https://vschugr.notion.site/Solid-state-topography-part-2-08c5f264bbf148d088bbf2022e9cfcd7 ● EXECUTION ORDER: 1. Select the path to the family template "Metric Generic Model". Something like this: C:\ProgramData\Autodesk\RVT 2019\Family Templates\.... 2. Run the script. Revit will prompt you to select one or more topographies. Select the topographies in the project and click "Finish". 3. View the results of the script. 4. To restart the script, toggle the Yes/No toggle switch and click "Run" in Dynamo. This restart will restart the script, but not the wall sampling. This is done to save time when you search the best gradient in your facade. 5. In order to re-select the walls, toggle the "Restarting curtain walls selection" toggle switch below. ● COMMENTS: If there are any problems, please email me on Linkedin ● CLIENT: WORLD ● SECTIONS: Arch ● SOFTWARE: Revit 2019.1 + ● DYNAMO: Dynamo 2.0.3
# note: Developer:
# Vsevolod Chugreev
# vschugr@gmail.com
# www.linkedin.com/in/vschugr/

# group: Restart
restart = BoolSelector(true)

# group: Select the path to the family template "Metric Generic Model" Something like this: C:\ProgramData\Autodesk\RVT 2019\Family Templates\Russian\Метрическая система, типовая модель
file_path = Filename("..\..\..\..\..\..\..\..\ProgramData\Autodesk\RVT 2021\Family Templates\English\Metric Generic Model.rft")

# group: Select the level that will be assigned to the elements Select the level that will be assigned to the elements
levels = Levels("Level 1")

# group: List of material names and thicknesses (m)
code_block = CodeBlock()
# ---------- code_block.designscript (9 lines) ----------
["Natural stone",0.06];
["Bedding layer",1.03];
["Foundation layer",0.55];
["Fill material",1.45];
["Naturstein",1.06];
["Bettungsschicht",1.03];
["Fundationsschicht",1.25];
["Füllmaterial",1.45];
["Stone",3.0];
# ----------------------------------------

# group: Don't forget to close empty slots!
list_create = List.Create(item0=code_block.out0, item1=code_block.out1, item2=code_block.out2, item3=code_block.out3, item4=code_block.out4, item5=code_block.out5, item6=code_block.out6, item7=code_block.out7, item8=code_block.out8)

# group: Enable this option if you want the layer to be created not by creating a family, but by creating a floor and adding points to this floor
on_off = BoolSelector(false)
floor_types = FloorTypes("Generic 150mm")

# group: Script Settings
interface = Python(IN[0]=restart)
# ---------- interface.python (86 lines) ----------
import clr
import sys
pyt_path = r'C:\Program Files (x86)\IronPython 2.7\Lib'
sys.path.append(pyt_path)
import os
import webbrowser
import unicodedata
import copy	

clr.AddReference('System.Windows.Forms')
clr.AddReference('System.Drawing')
clr.AddReference('System.Windows.Forms.DataVisualization')


clr.AddReference("DSCoreNodes")
import DSCore as DS

import System.Drawing
import System.Windows.Forms

from System.Drawing import  Point , Size , Graphics, Bitmap, Image, Font, FontStyle, Icon, Color, Region , Rectangle , ContentAlignment
from System.Windows.Forms import Button,Label,ListView,Form,CheckState


clr.AddReference("RevitAPI")
from Autodesk.Revit.DB import FilteredElementCollector,BuiltInParameter,RevitLinkInstance,Level,ElementLevelFilter,Document,BuiltInCategory,Category

from Autodesk.Revit.DB.Plumbing import Pipe


clr.AddReference("RevitAPIUI")
from Autodesk.Revit.UI.Selection import Selection,ObjectType,ISelectionFilter
from Autodesk.Revit.UI import TaskDialog



#from Autodesk.Revit.UI import *

clr.AddReference("RevitServices")
import RevitServices
from RevitServices.Persistence import DocumentManager
from RevitServices.Transactions import TransactionManager
doc = DocumentManager.Instance.CurrentDBDocument
uiapp = DocumentManager.Instance.CurrentUIApplication
app = uiapp.Application
uidoc = DocumentManager.Instance.CurrentUIApplication.ActiveUIDocument
doc = DocumentManager.Instance.CurrentDBDocument





class CustomISelectionFilter(ISelectionFilter):

	def __init__(self, categoryIds):
		self.CategoryIds = categoryIds
		
	def AllowElement(self, e):
		
		if e.Category.Id in self.CategoryIds:
			return True
		else:
			return False
	def AllowReference(self, ref, point):
		return true


def __interface__():

	
	
	categories = [BuiltInCategory.OST_Topography]
	
		
	catergoryIds = [Category.GetCategory(doc,c).Id for c in categories]
	TaskDialog.Show("Hi!","Select one or more topographies in Revit and click 'Finish'")
	try:	
		elements = [doc.GetElement(ref) for ref in uidoc.Selection.PickObjects(ObjectType.Element,CustomISelectionFilter(catergoryIds))]	
	except:
		return []
	

	return elements

x = __interface__()
OUT = x
# ----------------------------------------
settings = Python(IN[0]=interface, IN[1]=file_path, IN[2]=levels, IN[3]=list_create, IN[4]=on_off, IN[5]=floor_types)
# ---------- settings.python (27 lines) ----------
import clr
import sys
sys.path.append(r'C:\Program Files (x86)\IronPython 2.7\Lib')
import random

clr.AddReference("RevitAPI")
from Autodesk.Revit.DB import *

class ScriptSettings():

	def __init__(self):

		self.Topographies = UnwrapElement(IN[0])
		self.FamilyTemplatePath = IN[1]
		self.Level = UnwrapElement(IN[2])
		
		self.MaterialData = IN[3]
		self.Clean = True
		self.ByFloor = IN[4]
		
		self.FloorType = UnwrapElement(IN[5])
		

		
x = ScriptSettings()		
		
OUT = x
# ----------------------------------------
code = Python(IN[0]=settings)
# ---------- code.python (880 lines) ----------
import clr

import sys
sys.path.append(r'C:\Program Files (x86)\IronPython 2.7\Lib')

clr.AddReference('ProtoGeometry')
import Autodesk.DesignScript.Geometry as DG

clr.AddReference("DSCoreNodes")
import DSCore as DS

clr.AddReference("RevitNodes")
import Revit.Elements as DR

import Revit
clr.ImportExtensions(Revit.Elements)
clr.ImportExtensions(Revit.GeometryConversion)
#
clr.AddReference("RevitAPI")
from Autodesk.Revit.DB import *
from Autodesk.Revit.DB.Mechanical import *
from Autodesk.Revit.DB.Structure import *
clr.AddReference("RevitAPIUI")
from Autodesk.Revit.UI import *

clr.AddReference("RevitServices")
import RevitServices
from RevitServices.Persistence import DocumentManager
from RevitServices.Transactions import TransactionManager
doc = DocumentManager.Instance.CurrentDBDocument
uiapp = DocumentManager.Instance.CurrentUIApplication
app = uiapp.Application
uidoc = DocumentManager.Instance.CurrentUIApplication.ActiveUIDocument
doc = DocumentManager.Instance.CurrentDBDocument

import System
from System import Array as CArray
clr.AddReference("System")
from System.Collections.Generic import List as CList
from System.Collections.Generic import Dictionary

import time
import math
import copy
import string
import datetime
import random
import os
import shutil


def Visualize(geometryOrList):

	def Convert(geometry):

		lst =[]

		if geometry is None:
			lst.append(None)

		elif geometry.GetType() == Solid:

			edges = [e.AsCurve().ToProtoType() for e in  geometry.Edges]
			lst.append(edges)

		elif isinstance(geometry, Face):

			for loop in geometry.EdgeLoops:
				for edge in loop:
					lst.append(edge.AsCurve().ToProtoType())

		elif geometry.GetType() == BoundingBoxXYZ:

			minp,maxp = geometry.Min, geometry.Max

			p1 = minp
			p2 = XYZ(minp.X, maxp.Y, minp.Z)
			p3 = XYZ(maxp.X, maxp.Y, minp.Z)
			p4 = XYZ(maxp.X, minp.Y, minp.Z)

			points = [p1,p2,p3,p4]

			curves = CList[Curve]([Line.CreateBound(points[i-1],points[i]) for i in range(len(points))])
			curveLoop = CurveLoop.Create(curves)
			curveLoopList = CList[CurveLoop]([curveLoop])

			solid = GeometryCreationUtilities.CreateExtrusionGeometry(curveLoopList, XYZ.BasisZ, math.fabs(maxp.Z - minp.Z) )

			edges = [e.AsCurve().ToProtoType() for e in  solid.Edges]

			lst.append(edges)

		elif geometry.GetType() == XYZ:

			lst.append(geometry.ToPoint())

		elif isinstance(geometry, Curve):

			lst.append(geometry.ToProtoType())

		return lst

	def Go_into(geometryOrList, lst):

		if hasattr(geometryOrList, "__iter__"):
			sublist = []
			for gol in geometryOrList:
				res = Go_into(gol,sublist)
				sublist.append(res)
			return sublist
		else:
			geometryList = Convert(geometryOrList)
			return geometryList

	lst = Go_into(geometryOrList,[])
	return lst


def RebuildLoop(curves,minAngle,tolerance):


	def Compare(curve1,curve2):

		v1 = curve1.ComputeDerivatives(1,True).BasisX
		v2= curve2.ComputeDerivatives(0,True).BasisX
		p11 = curve1.Evaluate(0, True)
		p12 = curve1.Evaluate(1, True)

		pmid = curve1.Evaluate(0.5, True)

		p21 = curve2.Evaluate(0, True)
		p22 = curve2.Evaluate(1, True)

		if v1.AngleTo(v2) < math.radians(minAngle) and p12.DistanceTo(p21)< tolerance/304.8:
			return p11,p22,pmid
		else:
			return None
	i = 0
	while i< len(curves):
		com = Compare(curves[i-1],curves[i])
		if com is None:
			i += 1
		else:
			if com[0] == Arc:
				curves[i-1] = Arc.Create(com[0],com[1],com[2])
			else:
				curves[i-1] = Line.CreateBound(com[0],com[1])
			del curves[i]
	return curves


def BakeGeometryAsFamilyInstance(solids,name,materialName,familyTemplatePath,color,level):

	#familyPath = "C:\ProgramData\Autodesk\RVT 2019\Family Templates\Russian\Метрическая система, типовая модель"

	class NewFolder():

		def __init__(self):

			dataPath = os.getenv('APPDATA')

			dirPath = dataPath + "//Dynamograph"
			try:
				os.mkdir(dirPath)
			except:
				pass

			self.Path = dirPath

		def Delete(self):

			shutil.rmtree(self.Path)

	geoElements = []

	class FamOpt1(IFamilyLoadOptions):
		def __init__(self):
			pass
		def OnFamilyFound(self,familyInUse, overwriteParameterValues):
			return True
		def OnSharedFamilyFound(self,familyInUse, source, overwriteParameterValues):
			return True

	folder = NewFolder()
	folderPath = folder.Path

	saveAsOpt = SaveAsOptions()
	saveAsOpt.OverwriteExistingFile = True

	TransactionManager.Instance.ForceCloseTransaction()
	famDoc = doc.Application.NewFamilyDocument(familyTemplatePath)
	TransactionManager.Instance.EnsureInTransaction(famDoc)

	materialId = Material.Create(famDoc,materialName)
	material = famDoc.GetElement(materialId)
	material.Color = color


	f = famDoc.OwnerFamily
	f.FamilyCategory = Category.GetCategory(doc,BuiltInCategory.OST_StructuralFoundation)
	#Color(random.random()*255,random.random()*255,random.random()*255)

	for solid in solids:
		try:
			freeForm = FreeFormElement.Create(famDoc, solid)
			freeForm.get_Parameter(BuiltInParameter.MATERIAL_ID_PARAM).Set(materialId)
		except:
			pass
	TransactionManager.Instance.ForceCloseTransaction()

	
	famDoc.SaveAs(folderPath +"\\"+name+".rfa", saveAsOpt)
	family1 = famDoc.LoadFamily(doc, FamOpt1() )

	famDoc.Close(False)

	symbols = family1.GetFamilySymbolIds().GetEnumerator()
	symbols.MoveNext()
	symbol1 = doc.GetElement(symbols.Current)

	t1 = TransactionManager.Instance
	t1.EnsureInTransaction(doc)
	if not symbol1.IsActive:
		symbol1.Activate()

	familyInstance = doc.Create.NewFamilyInstance(XYZ(0,0,0), symbol1,level, StructuralType.NonStructural)

	
	TransactionManager.ForceCloseTransaction(t1)

	folder.Delete()

	return familyInstance

def GetHorizontalLoopsBySolid(solid,up):

	faces = list(solid.Faces)

	if up:
		filteredFaces = [f for f in faces if f.ComputeNormal(UV(0,0)).Normalize().Z > 0.99]
	else:
		filteredFaces = [f for f in faces if f.ComputeNormal(UV(0,0)).Normalize().Z < -0.99]

	filteredFaces.sort(key = lambda x:x.Area)
	filteredFace = filteredFaces[-1]

	loops = list(filteredFace.GetEdgesAsCurveLoops())
	loops = GetExternalAndInternalLoops(loops)
	return loops

def GetExternalAndInternalLoops(loops):

	xx,yy,zz = [],[],[]
	for l in loops:
		for c in l:
			for p in c.Tessellate():
				xx.append(p.X)
				yy.append(p.Y)
				zz.append(p.Z)

	point = XYZ(min(xx),min(yy),min(zz))

	minDist = 9999999
	index = 0
	for i,loop in enumerate(loops):
		for curve in loop:
			d = curve.Distance(point)
			if d < minDist:
				minDist = d
				index = i

	outLoop = loops.pop(index)
	return outLoop,loops

def BoundingBoxByGeometry(geometry):
	
	if geometry.GetType() == Solid:
		box = geometry.GetBoundingBox()
		origin = box.Transform.Origin
		box.Min = box.Min.Add(origin)
		box.Max = box.Max.Add(origin)

	elif isinstance(geometry,Curve):
		points = curve.Tesselate()	
		x,y,z = [p.X for p in points],[p.Y for p in points],[p.Z for p in points]
		box = BoundingBoxXYZ()
		box.Max =  XYZ(max(x),max(y),max(z))
		box.Min = XYZ(min(x),min(y),min(z))	
		
	return box

def TryToUnite(solids):
	if len(solids) == 1:
		return solids
	solid0 = list(solids).pop(0)#
	bop = BooleanOperationsType.Union
	report = []
	for s in solids:
		result = BooleanOperation(solid0, s, bop)
		if result is None:
			report.append(s)
		else:
			solid0 = result
	return [solid0]+report


def BooleanOperation(solid1, solid2, bop):

	try:
		result = BooleanOperationsUtils.ExecuteBooleanOperation(solid1, solid2, bop)
	except:
		return None
	if result.Volume > 0:
		return result
	else:
		return None

def SolidByBoundingBox(bb):

	maxp = bb.Max
	minp = bb.Min
	height = maxp.Z - minp.Z

	p1 = XYZ(minp.X,maxp.Y,minp.Z)
	p2 = XYZ(maxp.X,maxp.Y,minp.Z)
	p3 = XYZ(maxp.X,minp.Y,minp.Z)
	points = [minp,p1,p2,p3]

	lines = CList[Curve]()
	for j in range(len(points)):

		lines.Add(Line.CreateBound(points[j-1],points[j]))

	loop = CurveLoop.Create(lines)
	loopList = CList[CurveLoop]([loop])
	solid = GeometryCreationUtilities.CreateExtrusionGeometry(loopList,XYZ(0,0,1),height)
	return solid

def GroupAndSortCurves(curves):

	groups = []
	k = 0.1/304.8

	while len(curves) !=0:

		groups.append([curves.pop(0)])
		oldLen = 0

		while oldLen != len(curves):

			oldLen = len(curves)

			i = 0
			while i<len(curves):

				pg0 = groups[-1][0].GetEndPoint(0)
				pg1 = groups[-1][-1].GetEndPoint(1)

				p0 = curves[i].GetEndPoint(0)
				p1 = curves[i].GetEndPoint(1)

				if pg0.DistanceTo(p0) < k:
					groups[-1].insert(0,curves.pop(i).CreateReversed())

				elif pg1.DistanceTo(p0) < k:
					groups[-1].append(curves.pop(i))

				elif pg1.DistanceTo(p1) < k:
					groups[-1].append(curves.pop(i).CreateReversed())

				elif pg0.DistanceTo(p1) < k:
					groups[-1].insert(0,curves.pop(i))

				else:
					i+=1


	return groups



def GetTriangles(topography):

	opt = Options()
	geometryList  = topography.get_Geometry(opt)

	mesh = None
	for g in geometryList:
		if g.GetType() == Mesh:
			mesh = g
			break

	if mesh is None:
		return None

	triangles = [mesh.get_Triangle(i) for i in range(mesh.NumTriangles)]
	return triangles


def GetOutCurvesByByTopography(topography):

	opt = Options()
	geometryList  = topography.get_Geometry(opt)

	mesh = None
	for g in geometryList:
		if g.GetType() == Mesh:
			mesh = g
			break
	if mesh is None:
		return None

	triangles = mesh.NumTriangles
	solidOpt = SolidCurveIntersectionOptions()

	lines = []
	for i in range(mesh.NumTriangles):

		triangle = mesh.get_Triangle(i)
		points = [triangle.Vertex[0],triangle.Vertex[1],triangle.Vertex[2]]

		for j in range(len(points)):

			try:
				line = Line.CreateBound(points[j-1],points[j])
			except:
				continue

			lines.append(line)

	# Delete lines that have adjacent lines

	i = 0
	while i<len(lines)-1:
		j = i+1
		lonely = True
		p1 = lines[i].Evaluate(0.5,True)
		while j<len(lines):
			p2 = lines[j].Evaluate(0.5,True)
			if p1.DistanceTo(p2)<1/304.8:
				lonely = False
				del lines[j]
				break
			else:
				j+=1
		if lonely:
			i+=1
		else:
			del lines[i]


	return lines


class TriangleElement():

	def __init__(self,triangle,selfIndex):

		points = [triangle.Vertex[0],triangle.Vertex[1],triangle.Vertex[2]]

		lines,edgePoints = [],[]
		for i in range(len(points)):

			try:
				lines.append(Line.CreateBound(points[i-1],points[i]))
			except:
				continue
			edgePoints.append(points[i].Add(points[i-1]).Multiply(0.5))

		x,y,z = sum([p.X for p in points])/3,sum([p.Y for p in points])/3,sum([p.Z for p in points])/3

		self.Triangle = triangle
		self.SelfIndex = selfIndex
		self.ParentIndex = 0

		self.Middle = XYZ(x,y,z )
		self.Middle0 = XYZ(x,y,0)
		self.Points = points
		self.Lines = lines
		self.EdgePoints = edgePoints
		self.Solid = None
		self.Branch = None

		self.Generation = None
		self.Tree = None
		self.NumberOfChildren = 0

	def TryToAdopt(self,parent,maxNumberOfChildren,maxTreeSize):

		c1 = parent.Tree.Size >= maxTreeSize
		c2 = parent.NumberOfChildren >= maxNumberOfChildren
		if c1 or c2:
			return False

		i = 0
		while i < len(parent.EdgePoints):
			j = 0
			while j < len(self.EdgePoints):
				if parent.EdgePoints[i].IsAlmostEqualTo(self.EdgePoints[j]):
					del parent.EdgePoints[i]
					del self.EdgePoints[j]
					return True
				j+=1
			i+=1
		return False

	def InheritProperties(self,parent):

		self.Generation = Generation(parent.Generation.Number + 1)
		self.Tree = parent.Tree
		self.ParentIndex = parent.SelfIndex
		self.BirthNumber = parent.NumberOfChildren

		try:
			line = Line.CreateBound(self.Middle,parent.Middle)
		except:
			line = None

		self.Branch = line
		parent.NumberOfChildren += 1
		self.Tree.Size += 1
		self.Generation.Size +=1

	def Extrude(self,deep):

		lines = CList[Curve](self.Lines)

		try:
			loop = CurveLoop.Create(lines)
			loopList = CList[CurveLoop]([loop])
			solid = GeometryCreationUtilities.CreateExtrusionGeometry(loopList,XYZ(0,0,-1),deep)
			self.Solid = solid
			return solid
		except:
			return None
			
		

class Tree():

	def __init__(self,number):
	
		self.Number = number
		self.NumberOfGenerations = 1
		self.Generations = []
		self.Size = 0

class Generation():

	def __init__(self,number):
	
		self.Elements = []
		self.Number = number
		self.Size = 0

def LinkTriangleElements(triangleElements,startIndexes,maxNumberOfChildren, maxTreeSize):

	indexes = range(len(triangleElements))

	children,parents,treeNumber = [],[],0
	while len(indexes)>0: # This cycle occurs until all parents in a generation have found all of their children

		if len(children) == 0: #birth of new tree

			startIndexes.sort()
			startIndexes.reverse()

			for i in startIndexes:

				child = triangleElements[indexes.pop(i)]
				child.ParentIndex = None
				child.Tree = Tree(treeNumber)

				child.Generation = Generation(0)
				child.Tree.Size = 1
				children.append(child)
				treeNumber += 1

			startIndexes = [0]


		if len(parents) == 0: #If there are no more parents left to find children, children become parents


			parents = children

			children = []

		i = 0
		while i < len(parents):

			birth = False
			j = 0
			while j < len(indexes):

				result = triangleElements[indexes[j]].TryToAdopt(parents[i],maxNumberOfChildren,maxTreeSize)

				if result:
					birth = True

					child = triangleElements[indexes.pop(j)]
					child.InheritProperties(parents[i])

					children.append(child)
					break #Each parent has the right to assign only one child in one iteration. Otherwise, the development of the trees will be uneven.

				else:
					j+=1

			if birth == False:
				parents.pop(i) #If the parent has not found any new connections in a new iteration, there is no point in checking it further

			else:
				i+=1

	return triangleElements



def CleanDuplicatedLines(lines):

	i = 0
	while i<len(lines)-1:
		j = i+1
		p1 = lines[i].Evaluate(0.5,True)
		while j<len(lines):
			p2 = lines[j].Evaluate(0.5,True)
			if p1.DistanceTo(p2)<1/304.8:
				del lines[j]
				break
			else:
				j+=1
		i+=1

	return lines


def CreateFloorByCurves(floorCurves,openingLoops,level,floorType):


	arr = CurveArray()
	for curve in floorCurves:
		arr.Append(curve)

	newFloor = None
	try:
		newFloor = doc.Create.NewFloor( arr, floorType, level, False )
	except:
		return None

	doc.Regenerate()

	for curves in openingLoops:
		arr2 = CurveArray()
		for curve in curves:
			arr2.Append(curve)

		try:
			opening = doc.Create.NewOpening( newFloor, arr2, True)
		except:
			pass
	return newFloor

def SortedGroups(values,keys,group = True):

	data = list(zip(values,keys))
	data.sort(key = lambda x:x[1])

	if not group:
		return [dd[0] for dd in data],[dd[1] for dd in data]

	data.reverse()
	dd = data.pop()
	groups,uniqueKeys = [[dd[0]]],[dd[1]]
	while len(data)!=0:
		dd = data.pop()
		if dd[1] == uniqueKeys[-1]:
			groups[-1].append(dd[0])
		else:
			groups.append([dd[0]])
			uniqueKeys.append(dd[1])


	return groups,uniqueKeys

def __maincode__():
	

	# 1. Receiving data and displaying warnings when problems occur
	settings = IN[0]

	if len(settings.Topographies)== 0:
		return "You did not select any topography or cancel the operation"

	if "ProtoCore.DSASM.StackValue" ==  str(settings.MaterialData) :
		return "Please close the extra empty slots on the 'List.Create' nodes"

	opt = Options()
	topographies = settings.Topographies
	materialData = settings.MaterialData

	# 2. Mode 1: Creating layers by points
	
	if settings.ByFloor:

		for topography in topographies:
			lines = GetOutCurvesByByTopography(topography)

			nullLines = []

			for l in lines:

				p1 = l.GetEndPoint(0)
				p2 = l.GetEndPoint(1)
				p01 = XYZ(p1.X,p1.Y,0)
				p02 = XYZ(p2.X,p2.Y,0)
				nullLines.append(Line.CreateBound(p01,p02))

			groups = GroupAndSortCurves(nullLines)

			for i in range(len(groups)):

				groups[i] = RebuildLoop(groups[i], 1/304.8, 0.01)

			floorCurves = groups.pop(0)
			TransactionManager.Instance.EnsureInTransaction(doc)

			floor = CreateFloorByCurves(floorCurves,groups,settings.Level,settings.FloorType)

			if floor is None:
				return "The mistake of creating a floor. Try another method "
			doc.Regenerate()

			editor = floor.SlabShapeEditor
			editor.Enable()
			for point in topography.GetPoints():
				editor.DrawPoint(point)


			TransactionManager.Instance.TransactionTaskDone()
			return floor

	
	# 3. Cleaning the model out the old elements

	TransactionManager.Instance.EnsureInTransaction(doc)
	if settings.Clean:

		topographyIds = [str(t.Id) for t in topographies]
		topoIds = []
		for topography in topographies:

			id = topography.Id
			topoIds.append(str(id))

		families = FilteredElementCollector(doc).OfClass(Family).ToElements()
		toDelete = CList[ElementId]()

		for family in families:
			familyName = family.Name
		
			for topoId in topographyIds:
				
				if topoId in familyName:
					toDelete.Add(family.Id)
					break
				
		doc.Delete(toDelete)
		doc.Regenerate()

	TransactionManager.Instance.TransactionTaskDone()

	# 3. Mode 2: Creating layers by familyInstance
	# 4. Creating a list of transforms
	transforms = []
	z = 0
	for md in materialData:
	
		transform = Transform.CreateTranslation(XYZ(0,0,z))
		transforms.append(transform)
		z -= md[1]*1000/304.8



	elements = []

	for i,topography in enumerate(topographies):


		# 5. Obtaining  triangles of topography
		
		triangles = GetTriangles(topography)
		random.shuffle(triangles)
		# Creating containers for clustering triangles
		triangleElements = [TriangleElement(triangle,i) for i,triangle in enumerate(triangles)]

		# Clustering of triangles
		sqr = int(len(triangleElements)**(0.5))
		startIndexes = range(len(triangleElements))[:sqr]
		triangleElements = LinkTriangleElements(triangleElements,startIndexes,2, 99999)
		groupedTriangleElements = SortedGroups(triangleElements,[e.Tree.Number for e in triangleElements])[0]


		# Creating solids and uniting them
		topographySquare = topography.get_Parameter(BuiltInParameter.SURFACE_AREA).AsDouble()


		
		for j,md in enumerate(materialData):

			globalSolidList = []
			topographyVolume = topographySquare*md[1]
			
			
			for group in groupedTriangleElements:

				solidList = []

				for triangleElement in group:

					solid = triangleElement.Extrude(md[1]*1000/304.8)
					solidList.append(solid)
					

				if len(solidList)>1:

					solidList = TryToUnite(solidList)

				globalSolidList.extend(solidList)

			globalSolidList = TryToUnite(globalSolidList)

			# Moving the solids to the level of their layer

			for i in range(len(globalSolidList)):
				try:
					globalSolidList[i] = SolidUtils.CreateTransformed(globalSolidList[i],transforms[j])
				except:
					pass


			maxZforSolid = max([BoundingBoxByGeometry(s).Max.Z for s in globalSolidList if s is not None])
			#return box

			#return Visualize(globalSolidList)

			# Creating materials and names
			name = materialData[j][0]+"_"+str(materialData[j][1])+"_layer_number-"+str(j+1)+"_topoId-"+str(topography.Id)
			path = settings.FamilyTemplatePath
			color = Color(random.random()*255,random.random()*255,random.random()*255)

			#Creating a family and family instance
			element = BakeGeometryAsFamilyInstance(globalSolidList,name,materialData[j][0],path,color,settings.Level)
			maxZforElement = element.get_BoundingBox(None).Max.Z

			# Set parameter for family instance
			TransactionManager.Instance.EnsureInTransaction(doc)
			
			topographyVolume = round(topographyVolume*(304.8**2)/(1000**2),2)
			element.get_Parameter(BuiltInParameter.ALL_MODEL_INSTANCE_COMMENTS).Set("Volume: "+str(topographyVolume)+" m3")
			element.get_Parameter(BuiltInParameter.FLOOR_HEIGHTABOVELEVEL_PARAM).Set(maxZforSolid-maxZforElement)
			
			
			TransactionManager.Instance.EnsureInTransaction(doc)
			elements.append(element)

			doc.Regenerate()

	return elements
	




timeStart = time.time()
#TransactionManager.Instance.EnsureInTransaction(doc)
report = __maincode__()
#TransactionManager.Instance.TransactionTaskDone()
sumTime = time.time() - timeStart
OUT = "Time: " + str(sumTime),report
# ----------------------------------------

# group: Report
watch = Watch(code)
