# Dynamo graph Glazing Bin Packing (New Sheet).dyn (Dynamo 2.3.1.11775)
# packages: Miscellany 1.2.0, Data-Shapes 2022.2.96, Clockwork for Dynamo 2.x 2.3.0, Crumple 2021.8.17, bimorphNodes 4.0.9, archi-lab.net 2021.25.2621, Synthesize toolkit 11.7.3

# group: INPUTS
stock_1_width_a = DoubleInput(6)  # graph input
stock_2_width_b = DoubleInput(6)  # graph input
stock_1_height_a = DoubleInput(8)  # graph input
stock_2_height_b = DoubleInput(8)  # graph input
code_block = CodeBlock(W1=stock_1_width_a, W2=stock_2_width_b, H1=stock_1_height_a, H2=stock_2_height_b) { [W1,W2]; [H1,H2]; }
specified_no_of_stock_glazings = IntegerSlider(15, range=0..100 step 1)  # graph input
run_script = BoolSelector(true)  # graph input
stock_glazing_spacing_ft = DoubleSlider(3, range=0..10 step 0.1)  # graph input
flip_revit_curves_placement = BoolSelector(true)
new_drafting_view_name = StringInput("Stock-Cut Sheet")  # graph input
new_drafting_view_scale = DoubleInput(30)  # graph input
stock_sheet_line_style = LineStyleUi("Panel Stock Glazing Line")  # graph input

# group: STOCK GLAZING/CONTAINER
glazing_stock_size_w_h = CodeBlock(W=code_block.out0, H=code_block.out1) { ID = 0; L = 1; area = W*H; 1; }
container = Miscellany.ContainerPacking.Entities.Container.Container(id=glazing_stock_size_w_h.ID, length=glazing_stock_size_w_h.L, width=code_block.out0, height=code_block.out1)
cycle = List.Cycle(list=container, amount=specified_no_of_stock_glazings)
width = Miscellany.ContainerPacking.Entities.Container.Width(container=cycle)
count = List.Count(list=width)
height = Miscellany.ContainerPacking.Entities.Container.Height(container=cycle)
code_block_2 = CodeBlock(n=count, X=width, Z=height) { C = n-1; zeros = DSCore.List.Cycle(0,n); [zeros,X[0..C],X[0..C],zeros]; [zeros,zeros,Z,Z]; }
transpose = List.Transpose(lists=code_block_2.out2)
transpose_2 = List.Transpose(lists=code_block_2.out3)
byCoordinates = Point.ByCoordinates(x=transpose, z=transpose_2)
byCornerPoints = Rectangle.ByCornerPoints(points=byCoordinates)
code_block_3 = CodeBlock(L=width, s=stock_glazing_spacing_ft) { L+s; }
sumcumulative = Custom[© SumCumulative](numbers=code_block_3)  # package Crumple; Continuously adds a list of numbers together, returning a list of the values in sequence.
code_block_4 = CodeBlock(n=count, L=sumcumulative) { r = 0..n-2; q = 1..n-1; [0,L[r]]; }
flatten = List.Flatten(list=code_block_4.out2)

# group: ALL SCHEDULES IN DOCUMENT
schedulesbytype = Custom[© SchedulesByType](refresh=run_script)  # package Crumple; Returns all schedules in the model, separated into key and non-key schedules.
name = Element.Name(element=schedulesbytype.schedules)

# group: SELECT SCHEDULES TO READ FROM
string = StringInput("Curtain Panel Schedules")
string_2 = StringInput("Finish")
string_3 = StringInput("Select Schedules")
listview_data = Custom[Listview Data](InputName=string_3, Keys=name, Values=schedulesbytype.schedules)  # package Data-Shapes; Create data for ListView input in UI.MultiInputForm ++ . Check out www.data-shapes.net for more infos.
string_4 = StringInput("Cancel")
multipleinputform = Custom[MultipleInputForm ++](Description_optional=string, Logo_optional=run_script, ButtonText_optional=string_2, Inputs=listview_data, Toggle=run_script, CancelButtonText_optional=string_4)  # package Data-Shapes; Create a form with multiple inputs. see www.data-shapes.net for tutorials and infos!

# group: CONVERT SCHEDULE TO LIST
code_block_5 = CodeBlock(x=multipleinputform.User_Inputs) { x[0]; }
boolean = BoolSelector(false)
getData = Revit.Schedule.GetData(scheduleView=code_block_5, removeHeading=boolean, refresh=run_script)
transpose_3 = List.Transpose()  # unwired: lists
map = List.Map(list=getData, f_x=transpose_3)

# group: PANEL - QUANTITY
code_block_6 = CodeBlock { 1; }
flatten_2 = List.Flatten(list=map, amt=code_block_6)
height_parameter_name = StringInput("QTY")  # graph input
contains = List.Contains(list=map@L2, item=height_parameter_name, lacing=Longest)
filterByBoolMask = List.FilterByBoolMask(list=flatten_2, mask=contains)
code_block_7 = CodeBlock { 0; }
removeItemAtIndex = List.RemoveItemAtIndex(indices=code_block_7)  # unwired: list
map_2 = List.Map(list=filterByBoolMask.in, f_x=removeItemAtIndex)
boolean_2 = BoolSelector(false)
allIndicesOf = List.AllIndicesOf(list=contains@L2, item=boolean_2)
getItemAtIndex = List.GetItemAtIndex(list=flatten_2@L2, index=allIndicesOf@L2)

# group: PANEL - HEIGHT (SF)
code_block_8 = CodeBlock { 1; }
flatten_3 = List.Flatten(list=map, amt=code_block_8)
height_parameter_name_2 = StringInput("LENGTH")  # graph input
contains_2 = List.Contains(list=map@L2, item=height_parameter_name_2, lacing=Longest)
filterByBoolMask_2 = List.FilterByBoolMask(list=flatten_3, mask=contains_2)
code_block_9 = CodeBlock { 0; }
removeItemAtIndex_2 = List.RemoveItemAtIndex(indices=code_block_9)  # unwired: list
map_3 = List.Map(list=filterByBoolMask_2.in, f_x=removeItemAtIndex_2)

# group: REMOVE EMPTY ROW DATA
code_block_10 = CodeBlock { ""; }
eq = _ == code_block_10  # unwired: x
map_4 = List.Map(list=map_3, f_x=eq)
boolean_3 = BoolSelector(false)
allIndicesOf_2 = List.AllIndicesOf(list=map_4@L2, item=boolean_3)
getItemAtIndex_2 = List.GetItemAtIndex(list=map_3@L2, index=allIndicesOf_2@L2)
filterByBoolMask_3 = List.FilterByBoolMask(list=map_3, mask=map_4)

# group: REMOVE EMPTY ROW DATA
getItemAtIndex_3 = List.GetItemAtIndex(list=map_2@L2, index=allIndicesOf_2@L2)
code_block_11 = CodeBlock { ""; }
eq_2 = _ == code_block_11  # unwired: x
map_5 = List.Map(list=map_2, f_x=eq_2)

# group: PANEL - WIDTH (SF)
code_block_12 = CodeBlock { 1; }
flatten_4 = List.Flatten(list=map, amt=code_block_12)
width_parameter_name = StringInput("GLAZING WIDTH")  # graph input
contains_3 = List.Contains(list=map@L2, item=width_parameter_name, lacing=Longest)
filterByBoolMask_4 = List.FilterByBoolMask(list=flatten_4, mask=contains_3)
code_block_13 = CodeBlock { 0; }
removeItemAtIndex_3 = List.RemoveItemAtIndex(indices=code_block_13)  # unwired: list
map_6 = List.Map(list=filterByBoolMask_4.in, f_x=removeItemAtIndex_3)

# group: REMOVE EMPTY ROW DATA
getItemAtIndex_4 = List.GetItemAtIndex(list=map_6@L2, index=allIndicesOf_2@L2)
code_block_14 = CodeBlock { ""; }
eq_3 = _ == code_block_14  # unwired: x
map_7 = List.Map(list=map_6, f_x=eq_3)
filterByBoolMask_5 = List.FilterByBoolMask(list=map_6, mask=map_7)

# group: W,H Combination
python_script = Python(IN[0]=getItemAtIndex_4, IN[1]=getItemAtIndex_2)
# ---------- python_script.python (23 lines) ----------
# Load the Python Standard and DesignScript Libraries
import clr
import sys
sys.path.append(r'C:\Program Files (x86)\IronPython 2.7\Lib')
clr.AddReference('ProtoGeometry')
from Autodesk.DesignScript.Geometry import *

clr.AddReference('RevitServices')
import RevitServices
from RevitServices.Persistence import DocumentManager
from RevitServices.Transactions import TransactionManager

width = IN[0]
height = IN[1]

result = []

for n in range(len(width)):
	comb = zip(width[n],height[n])
	result.append(comb)

		
OUT = result
# ----------------------------------------

# group: PANEL - AREA (SF)
code_block_15 = CodeBlock { 1; }
flatten_5 = List.Flatten(list=map, amt=code_block_15)
area_parameter_name = StringInput("AREA")  # graph input
contains_4 = List.Contains(list=map@L2, item=area_parameter_name, lacing=Longest)
filterByBoolMask_6 = List.FilterByBoolMask(list=flatten_5, mask=contains_4)
code_block_16 = CodeBlock { 0; }
removeItemAtIndex_4 = List.RemoveItemAtIndex(indices=code_block_16)  # unwired: list
map_8 = List.Map(list=filterByBoolMask_6.in, f_x=removeItemAtIndex_4)

# group: REMOVE EMPTY ROW DATA
code_block_17 = CodeBlock { ""; }
eq_4 = _ == code_block_17  # unwired: x
map_9 = List.Map(list=map_8, f_x=eq_4)
filterByBoolMask_7 = List.FilterByBoolMask(list=map_8, mask=map_9)
boolean_4 = BoolSelector(false)
allIndicesOf_3 = List.AllIndicesOf(list=map_9@L2, item=boolean_4)

# group: GROUP PANELS WITH MATCHING AREAS
code_block_18 = CodeBlock { 1; }
groupByKey = List.GroupByKey(list=filterByBoolMask_7.out@L2, keys=filterByBoolMask_7.out@L2)
count_2 = List.Count(list=groupByKey.groups@L2)
count_3 = List.Count(list=count_2)
code_block_19 = CodeBlock(count=count_3) { 1..count; }
flatten_6 = List.Flatten(list=code_block_19)
cycle_2 = List.Cycle(list=flatten_6, amount=count_2, lacing=Longest)
flatten_7 = List.Flatten(list=cycle_2, amt=code_block_18)

# group: SPECIFY PANEL ITEM TO BE PACKED IN CONTAINER/STOCK GLAZING
flatten_8 = List.Flatten(list=getItemAtIndex_3, amt=code_block_18)
toNumber = String.ToNumber(str=flatten_8)
code_block_20 = CodeBlock { 1; }
count_4 = List.Count(list=getItemAtIndex_2@L2)
sum = Math.Sum(values=count_4)
panel_depth_l_quantity = List.Cycle(list=code_block_20, amount=sum)
flatten_9 = List.Flatten(list=python_script, amt=code_block_18)
code_block_21 = CodeBlock { W = 0; H = 1; }
getItemAtIndex_5 = List.GetItemAtIndex(index=code_block_21.W)  # unwired: list
panel_widths_w = Map(list=flatten_9, f_x=getItemAtIndex_5)
toNumber_2 = String.ToNumber(str=panel_widths_w)
getItemAtIndex_6 = List.GetItemAtIndex(index=code_block_21.H)  # unwired: list
panel_heights_h = Map(list=flatten_9, f_x=getItemAtIndex_6)
toNumber_3 = String.ToNumber(str=panel_heights_h)

count_5 = List.Count(list=toNumber)
code_block_22 = CodeBlock(c=count_5) { 0..c-1; }

# group (continued): SPECIFY PANEL ITEM TO BE PACKED IN CONTAINER/STOCK GLAZING
item = Miscellany.ContainerPacking.Entities.Item.Item(id=code_block_22, dim1=panel_depth_l_quantity, dim2=toNumber_2, dim3=toNumber_3, quantity=toNumber)

# group: BIN-PACK PANELS INTO CONTAINERS
packContainers = Miscellany.ContainerPacking.PackingService.PackContainers(containers=cycle@L2, itemsToPack=item)
volume = Miscellany.ContainerPacking.Entities.Item.Volume(item=item)
groupByKey_2 = List.GroupByKey(list=item, keys=volume)

# group: GET PACKING RESULT DATA
count_6 = List.Count(list=packContainers.packedItems@L3)
code_block_23 = CodeBlock(x=count_6) { x[0]; }
count_7 = List.Count(list=item)
flatten_10 = List.Flatten(list=packContainers.packedItems)
count_8 = List.Count(list=flatten_10)
flatten_11 = List.Flatten(list=packContainers.unpackedItems)
count_9 = List.Count(list=flatten_11)

# group: PACKING RESULT
quantity_of_stock_glazing = Watch(code_block_23)  # "Quantity of Stock Glazing Required"; graph output
total_cut_sheets_to_pack = Watch(count_7)
total_cut_sheets_packed = Watch(count_8)  # graph output
total_cut_sheets_unpacked = Watch(count_9)  # graph output

# group: STOCK GLAZING
takeItems = List.TakeItems(list=byCornerPoints, amount=quantity_of_stock_glazing)
XAxis = Vector.XAxis()
code_block_24 = CodeBlock(range=flatten, n=quantity_of_stock_glazing) { range[0..n-1]; }
translate = Geometry.Translate(geometry=takeItems, direction=XAxis, distance=code_block_24)
geompreview_stock_glazing = GeomPreviewNodeModel(Geometry=translate, SliderValue=225.07, rValue="95", gValue="49", bValue="255")

# group: LOWER BOUND VALUE CALCULATION
flatten_12 = List.Flatten(list=filterByBoolMask_7.out)
toNumber_4 = String.ToNumber(str=flatten_12)
sum_2 = Math.Sum(values=toNumber_4)
code_block_25 = CodeBlock(TotalArea=sum_2, StockArea=glazing_stock_size_w_h.area) { LowerBound = TotalArea/StockArea; Math.Round(LowerBound,0); }
lower_bound_stock_quantity = Watch(code_block_25.out1)  # graph output

# group: CONDITION TO CHOOSE THE STOCK QUANTITY
count_10 = List.Count(list=byCornerPoints)
le = count_10 <= quantity_of_stock_glazing
if_ = If(test=le, true=count_10, false=quantity_of_stock_glazing)

# group: PACK COORDINATES
coordX = Miscellany.ContainerPacking.Entities.Item.CoordY(item=packContainers.packedItems@L2)  # "Item.CoordX"
coordZ = Miscellany.ContainerPacking.Entities.Item.CoordZ(item=packContainers.packedItems@L2)

# group: PACK DIMENSIONS
packDimX = Miscellany.ContainerPacking.Entities.Item.PackDimY(item=packContainers.packedItems@L2)  # "Item.PackDimX"
packDimZ = Miscellany.ContainerPacking.Entities.Item.PackDimZ(item=packContainers.packedItems@L2)

# group: PACKED ITEM ID
string_5 = StringInput("P")
packed_item_id = Miscellany.ContainerPacking.Entities.Item.ID(item=packContainers.packedItems@L2)
add = string_5 + packed_item_id

code_block_26 = CodeBlock { 0; }

# group: PACK CUT SHEETS INTO GLAZING
add_2 = coordX + packDimX
add_3 = coordZ + packDimZ
code_block_27 = CodeBlock(n=if_, x=coordX, xb=add_2, z=coordZ, zb=add_3) { C = n-1; [x[0..C],xb[0..C],xb[0..C],x[0..C]]; [z[0..C],z[0..C],zb[0..C],zb[0..C]]; }
python_script_2 = Python(IN[0]=code_block_27.out1)
# ---------- python_script_2.python (19 lines) ----------
# Load the Python Standard and DesignScript Libraries
import sys
import clr
clr.AddReference('ProtoGeometry')
from Autodesk.DesignScript.Geometry import *

# The inputs to this node will be stored as a list in the IN variables.
LIST = IN[0]

# Place your code below this line
A = LIST[0]
B = LIST[1]
C = LIST[2]
D = LIST[3]


T_LIST = zip(LIST[0],LIST[1],LIST[2],LIST[3])

OUT = T_LIST
# ----------------------------------------
transpose_4 = List.Transpose()  # unwired: lists
map_10 = List.Map(list=python_script_2, f_x=transpose_4)
python_script_3 = Python(IN[0]=code_block_27.out2)  # same code as python_script_2
map_11 = List.Map(list=python_script_3, f_x=transpose_4)
byCoordinates_2 = Point.ByCoordinates(x=map_10, z=map_11, lacing=Longest)
byCornerPoints_2 = Rectangle.ByCornerPoints(points=byCoordinates_2)
XAxis_2 = Vector.XAxis()
code_block_28 = CodeBlock(range=flatten, n=quantity_of_stock_glazing) { range[0..n-1]; }
translate_2 = Geometry.Translate(geometry=byCornerPoints_2, direction=XAxis_2, distance=code_block_28)
byPatch = Surface.ByPatch(closedCurve=translate_2)
sumcumulative_2 = Custom[© SumCumulative](numbers=add_2, pad=code_block_26, lacing=Longest)

# group: CALCULATE WASTE IN SQUARE FEET
byPatch_2 = Surface.ByPatch(closedCurve=translate)
area = Surface.Area(surface=byPatch_2)
area_2 = Surface.Area(surface=byPatch)
sum_3 = Math.Sum(values=area_2)
sub = area - sum_3
round = Math.Round(number=sub)
string_from_object = FromObject(obj=round)
number = DoubleInput(0)
round_2 = Math.Round(number=round, digits=number)

# group: SEND CUT SHEETS LINES AND TEXT NOTE DATA TO REVIT
count_11 = List.Count(list=byPatch_2)  # frozen
code_block_29 = CodeBlock(count=count_11, s=byPatch_2) { c = (count-1)/2; s[c]; 0.5; 1; }
pointAtParameter = Surface.PointAtParameter(surface=code_block_29.out1, u=code_block_29.out3, v=code_block_29.out2)
XAxis_3 = Vector.XAxis()
number_2 = DoubleInput(-90)
number_3 = DoubleInput(90)
if_2 = If(test=flip_revit_curves_placement, true=number_2, false=number_3)
rotate = Geometry.Rotate(geometry=translate_2, origin=pointAtParameter, axis=XAxis_3, degrees=if_2)
geompreview_stock_glazing_2 = GeomPreviewNodeModel(Geometry=rotate, SliderValue=255, rValue="99", gValue="104", bValue="255")
byName = DraftingView.ByName(name=new_drafting_view_name)  # frozen
setScale = View.SetScale(view=byName, scale=new_drafting_view_scale)
string_6 = StringInput("Center")
explode = Geometry.Explode(geometry=rotate)
flatten_13 = List.Flatten(list=explode)
byCurve = Custom[DetailCurve.ByCurve+](curve=flatten_13, view=setScale)  # package Clockwork for Dynamo 2.x; Creates a detail line based on a given curve. Unlike the OOTB node it can also draw circles.
byPatch_3 = Surface.ByPatch(closedCurve=rotate)
code_block_30 = CodeBlock { 0.5; }
pointAtParameter_2 = Surface.PointAtParameter(surface=byPatch_3, u=code_block_30, v=code_block_30)
string_from_object_2 = FromObject(obj=add)
byLocation = TextNote.ByLocation(view=setScale, location=pointAtParameter_2, text=string_from_object_2, alignment=string_6)

# group: STOCK GLAZING TEXT NOTE ON WASTE
rotate_2 = Geometry.Rotate(geometry=translate, origin=pointAtParameter, axis=XAxis_3, degrees=if_2)
explode_2 = Geometry.Explode(geometry=rotate_2)
byCurve_2 = Custom[DetailCurve.ByCurve+](curve=explode_2, view=setScale)
string_7 = StringInput("Line Style")
setParameterByName = Element.SetParameterByName(element=byCurve_2, parameterName=string_7, value=stock_sheet_line_style)
patch = Curve.Patch(curve=rotate_2)
code_block_31 = CodeBlock { 0; 0.5; }
pointAtParameter_3 = Surface.PointAtParameter(surface=patch, u=code_block_31.out1, v=code_block_31.out0)
YAxis = Vector.YAxis()
reverse = Vector.Reverse(vector=YAxis)
number_4 = DoubleInput(1)
translate_3 = Geometry.Translate(geometry=pointAtParameter_3, direction=reverse, distance=number_4)
python_script_4 = Python(IN[0]=round_2)
# ---------- python_script_4.python (16 lines) ----------
# Load the Python Standard and DesignScript Libraries
import sys
import clr
clr.AddReference('ProtoGeometry')
from Autodesk.DesignScript.Geometry import *

# The inputs to this node will be stored as a list in the IN variables.
data = IN[0]

result = []
for i in data:
	result.append(str(i))
# Place your code below this line

# Assign your output to the OUT variable.
OUT = result
# ----------------------------------------
code_block_32 = CodeBlock { "No"; " SF"; "0.0 SF"; " Waste"; }
add_4 = python_script_4 + code_block_32.out1
eq_5 = _ == code_block_32.out2  # unwired: x
replaceByCondition = Replace(item=add_4, replaceWith=code_block_32.out0, condition=eq_5)
add_5 = replaceByCondition + code_block_32.out3
byLocation_2 = TextNote.ByLocation(view=setScale, location=translate_3, text=add_5, alignment=string_6)

# group: OUTPUT DATA
code_block_33 = CodeBlock { "Total Cut Sheets Packed"; "Total Cut Sheets UnPacked"; "Quantity of Stock Glazing Required"; "Total Stock Waste"; }
sum_4 = Math.Sum(values=round_2)
python_script_5 = Python(IN[0]=code_block_33.out0, IN[1]=code_block_33.out1, IN[2]=code_block_33.out2, IN[3]=code_block_33.out3, IN[4]=total_cut_sheets_packed, IN[5]=total_cut_sheets_unpacked, IN[6]=quantity_of_stock_glazing, IN[7]=sum_4)
# ---------- python_script_5.python (13 lines) ----------
# Load the Python Standard and DesignScript Libraries
import sys
import clr
clr.AddReference('ProtoGeometry')
from Autodesk.DesignScript.Geometry import *

# The inputs to this node will be stored as a list in the IN variables.
A = str(IN[0]) + " = " + str(IN[4])
B = str(IN[1]) + " = " + str(IN[5])
C = str(IN[2]) + " = " + str(IN[6])
D = str(IN[3]) + " = " + str(IN[7]) + "SF"

OUT = A,B,C,D
# ----------------------------------------

# group: STOCK GLAZING TEXT NOTE PACKING DETAILS
code_block_34 = CodeBlock(S=patch) { S[0]; 0; 1; }
pointAtParameter_4 = Surface.PointAtParameter(surface=code_block_34.out0, u=code_block_34.out1, v=code_block_34.out2)
YAxis_2 = Vector.YAxis()
code_block_35 = CodeBlock { 4; 6; }
count_12 = List.Count(list=python_script_5)
code_block_36 = CodeBlock(start=code_block_35.out0, step=count_12) { start..start*1.5..#step; }
translate_4 = Geometry.Translate(geometry=pointAtParameter_4, direction=YAxis_2, distance=code_block_36)
string_8 = StringInput("Left")
byLocation_3 = TextNote.ByLocation(view=setScale, location=translate_4, text=python_script_5, alignment=string_8)

# group: PIN ELEMENTS IN REVIT
join = List.Join(list0=setParameterByName, list1=byLocation_2, list2=byCurve, list3=byLocation, list4=byLocation_3)
pin_elements = BoolSelector(true)
setPinnedStatus = Custom[RH.Element.SetPinnedStatus](VARelement=join, VARBool=pin_elements)  # package Synthesize toolkit; Will set the element to either pinned or not pinned. True is pinned, false is unpinned. For multiple elements use List.Map

# group: TRANSFORM PACKED GLAZING GEOMETRY TO PLANE/COORDINATE SYSTEM
explode_3 = Geometry.Explode(geometry=translate_2)
byPatch_4 = Surface.ByPatch(closedCurve=translate_2)
code_block_37 = CodeBlock(s=byPatch_4) { s[0][0]; 0.5; }
pointAtParameter_5 = Surface.PointAtParameter(surface=code_block_37.out0, u=code_block_37.out1, v=code_block_37.out1)
normalAtPoint = Surface.NormalAtPoint(surface=code_block_37.out0, point=pointAtParameter_5)

# group: KENNY_STRUCT NODE EXPANDED
boolean_5 = BoolSelector(true)
view_plane = Python(IN[0]=setScale)
# ---------- view_plane.python (23 lines) ----------
import clr
clr.AddReference('RevitAPI')
from Autodesk.Revit.DB import *

clr.AddReference("RevitNodes")
import Revit
clr.ImportExtensions(Revit.GeometryConversion)

clr.AddReference('ProtoGeometry')
from Autodesk.DesignScript.Geometry import *

def ViewPlane(view):
	if hasattr(view, "ViewDirection") and hasattr(view, "Origin"):
		o = view.Origin
		n = view.ViewDirection
		if o and n: return Plane.ByOriginNormal(o.ToPoint(), n.ToVector())
		else: return None
	else: return None

views = UnwrapElement(IN[0])

if isinstance(IN[0], list): OUT = [ViewPlane(x) for x in views]
else: OUT = ViewPlane(views)
# ----------------------------------------
byPlane = CoordinateSystem.ByPlane(plane=view_plane)
origin = Plane.Origin(plane=view_plane)
XAxis_4 = Vector.XAxis()
YAxis_3 = Vector.YAxis()
ZAxis = Vector.ZAxis()
list_create = List.Create(item0=XAxis_4, item1=YAxis_3, item2=ZAxis)
X = Vector.X(vector=normalAtPoint)
round_3 = Math.Round(number=X)
normal = Plane.Normal(plane=view_plane)
X_2 = Vector.X(vector=normal)
round_4 = Math.Round(number=X_2)
eq_6 = round_3 == round_4
Y = Vector.Y(vector=normalAtPoint)
round_5 = Math.Round(number=Y)
Y_2 = Vector.Y(vector=normal)
round_6 = Math.Round(number=Y_2)
eq_7 = round_5 == round_6
Z = Vector.Z(vector=normalAtPoint)
round_7 = Math.Round(number=Z)
Z_2 = Vector.Z(vector=normal)
round_8 = Math.Round(number=Z_2)
eq_8 = round_7 == round_8
list_create_2 = List.Create(item0=eq_6, item1=eq_7, item2=eq_8)
filterByBoolMask_8 = List.FilterByBoolMask(list=list_create, mask=list_create_2)
reverse_2 = Vector.Reverse(vector=filterByBoolMask_8.in)
if_3 = If(test=flip_revit_curves_placement, true=reverse_2, false=filterByBoolMask_8.in)
angleWithVector = Vector.AngleWithVector(vector=normal, otherVector=normalAtPoint)
rotate_3 = CoordinateSystem.Rotate(coordinateSystem=byPlane, origin=origin, axis=if_3, degrees=angleWithVector)
transform = Geometry.Transform(geometry=explode_3, cs=rotate_3, lacing=Longest)
rotate_4 = Geometry.Rotate(geometry=explode_3, origin=origin, axis=if_3, degrees=angleWithVector, lacing=Longest)
if_4 = If(test=boolean_5, true=transform, false=rotate_4)
code_block_38 = CodeBlock(CurveInView=if_4) { CurveInView; }

# group: TRANSFORM CURVES TO SELECTED DRAFTING VIEW
byJoinedCurves = PolyCurve.ByJoinedCurves()  # unwired: curves
map_12 = List.Map(list=if_4, f_x=byJoinedCurves)
byPatch_5 = Surface.ByPatch(closedCurve=map_12)
count_13 = List.Count(list=byPatch_5@L2)
code_block_39 = CodeBlock(count=count_13) { 125..255..#count; }
byARGB = Color.ByARGB(r=code_block_39, g=code_block_39, b=code_block_39, lacing=Shortest)
code_block_40 = CodeBlock(count=count_13) { (0..1..#count); }
color_range = ColorRange(colors=byARGB, indices=code_block_40, value=code_block_40)
byGeometryColor = Modifiers.GeometryColor.ByGeometryColor(geometry=byPatch_5, color=color_range, lacing=Longest)

# group: PANEL - TYPE MARK
height_parameter_name_3 = StringInput("Type Mark")  # graph input
contains_5 = List.Contains(list=map@L2, item=height_parameter_name_3, lacing=Longest)
boolean_6 = BoolSelector(false)
allIndicesOf_4 = List.AllIndicesOf(list=contains_5@L2, item=boolean_6)
code_block_41 = CodeBlock { 1; }
flatten_14 = List.Flatten(list=map, amt=code_block_41)
filterByBoolMask_9 = List.FilterByBoolMask(list=flatten_14, mask=contains_5)
code_block_42 = CodeBlock { 0; }
removeItemAtIndex_5 = List.RemoveItemAtIndex(indices=code_block_42)  # unwired: list
map_13 = List.Map(list=filterByBoolMask_9.in, f_x=removeItemAtIndex_5)

sum_5 = Math.Sum(values=toNumber)
cycle_3 = List.Cycle(list=code_block_22, amount=toNumber, lacing=Longest)
code_block_43 = CodeBlock { 1; }
flatten_15 = List.Flatten(list=packContainers.packedItems)
count_14 = List.Count(list=flatten_15)
code_block_44 = CodeBlock { '-'; }

# group: PANEL - TYPE
code_block_45 = CodeBlock { 1; }
flatten_16 = List.Flatten(list=map, amt=code_block_45)
height_parameter_name_4 = StringInput("TYPE")  # graph input
contains_6 = List.Contains(list=map@L2, item=height_parameter_name_4, lacing=Longest)
filterByBoolMask_10 = List.FilterByBoolMask(list=flatten_16, mask=contains_6)
code_block_46 = CodeBlock { 0; }
removeItemAtIndex_6 = List.RemoveItemAtIndex(indices=code_block_46)  # unwired: list
map_14 = List.Map(list=filterByBoolMask_10.in, f_x=removeItemAtIndex_6)

# group: TYPE MARKS
concat = String.Concat(string1=code_block_44)  # unwired: string0, string2
getItemAtIndex_7 = List.GetItemAtIndex(list=map_13@L2, index=allIndicesOf_2@L2)
flatten_17 = List.Flatten(list=getItemAtIndex_7)
getItemAtIndex_8 = List.GetItemAtIndex(list=map_14@L2, index=allIndicesOf_2@L2)
flatten_18 = List.Flatten(list=getItemAtIndex_8)
combine = List.Combine(comb=concat, list1=flatten_17, list2=flatten_18)

cycle_4 = List.Cycle(list=combine, amount=toNumber, lacing=Longest)
flatten_19 = List.Flatten(list=cycle_4)
string_from_object_3 = FromObject(obj=code_block_22)
byKeysValues = DesignScript.Builtin.Dictionary.ByKeysValues(keys=string_from_object_3, values=combine)
flatten_20 = List.Flatten(list=byKeysValues)
ID = Miscellany.ContainerPacking.Entities.Item.ID(item=packContainers.packedItems)
code_block_47 = CodeBlock { 1; }
flatten_21 = List.Flatten(list=ID, amt=code_block_47)
string_from_object_4 = FromObject(obj=flatten_21)
valueAtKey = DesignScript.Builtin.Dictionary.ValueAtKey(dictionary=byKeysValues, key=string_from_object_4)
