# Dynamo graph Glazing Bin Packing (Rectangle Sheets).dyn (Dynamo 2.3.1.11775)
# packages: Miscellany 1.2.0, Crumple 2021.8.17, bimorphNodes 4.0.9, Data-Shapes 2022.2.96, archi-lab.net 2021.25.2621, Clockwork for Dynamo 2.x 2.3.0, Synthesize toolkit 11.7.3

# group: INPUTS
run_script = BoolSelector(true)  # graph input
feet_true_inches_false = BoolSelector(true)  # graph input
stock_1_width_a_ft = DoubleInput(6)  # graph input
stock_2_width_b_ft = DoubleInput(6)  # graph input
stock_1_height_a_ft = DoubleInput(8)  # graph input
stock_2_height_b_ft = DoubleInput(8)  # graph input
code_block = CodeBlock(W1=stock_1_width_a_ft, W2=stock_2_width_b_ft, H1=stock_1_height_a_ft, H2=stock_2_height_b_ft) { [W1,W2]; [H1,H2]; }
specified_no_of_stock_glazings = IntegerSlider(15, range=0..100 step 1)  # graph input
stock_glazing_spacing_ft = DoubleSlider(0.5, range=0..10 step 0.1)  # graph input
number_of_columns = IntegerSlider(5, range=1..10 step 1)  # graph input
flip_cut_sheet_placement = BoolSelector(true)  # graph input
new_drafting_view_name = StringInput("CUT GLAZING - ")  # graph input
new_drafting_view_scale = DoubleInput(35)  # graph input
select_filled_region_type = FilledRegionTypes("Diagonal_up")  # graph input
identity_marks_instance = StringInput("Mark")  # "Identity marks Instance Parameter"; graph input
select_tag_family_to_use = FamilyTypes("Tag - Mark:Tag - Mark")  # graph input
stock_sheet_line_style = LineStyleUi("RED DASHED")  # graph input
pin_elements_in_revit = BoolSelector(true)  # graph input

# group: ALL SCHEDULES IN DOCUMENT
schedulesbytype = Custom[© SchedulesByType](refresh=run_script)  # package Crumple; Returns all schedules in the model, separated into key and non-key schedules.
name = Element.Name(element=schedulesbytype.schedules)

# group: SELECT SCHEDULES TO READ FROM
string = StringInput("Glazing Schedules")
string_2 = StringInput("Finish")
string_3 = StringInput("Select Schedules")
listview_data = Custom[Listview Data](InputName=string_3, Keys=name, Values=schedulesbytype.schedules)  # package Data-Shapes; Create data for ListView input in UI.MultiInputForm ++ . Check out www.data-shapes.net for more infos.
string_4 = StringInput("Cancel")
multipleinputform = Custom[MultipleInputForm ++](Description_optional=string, Logo_optional=run_script, ButtonText_optional=string_2, Inputs=listview_data, Toggle=run_script, CancelButtonText_optional=string_4)  # package Data-Shapes; Create a form with multiple inputs. see www.data-shapes.net for tutorials and infos!

# group: CONVERT SCHEDULE TO LIST
code_block_2 = CodeBlock(x=multipleinputform.User_Inputs) { x[0]; }
boolean = BoolSelector(false)
getData = Revit.Schedule.GetData(scheduleView=code_block_2, removeHeading=boolean, refresh=run_script)
transpose = List.Transpose()  # unwired: lists
map = List.Map(list=getData, f_x=transpose)

# group: PANEL - AREA (SF)
code_block_3 = CodeBlock { 1; }
flatten = List.Flatten(list=map, amt=code_block_3)
area_parameter_name = StringInput("AREA")
contains = List.Contains(list=map@L2, item=area_parameter_name, lacing=Longest)
filterByBoolMask = List.FilterByBoolMask(list=flatten, mask=contains)
code_block_4 = CodeBlock { 0; }
removeItemAtIndex = List.RemoveItemAtIndex(indices=code_block_4)  # unwired: list
map_2 = List.Map(list=filterByBoolMask.in, f_x=removeItemAtIndex)

# group: PANEL - HEIGHT (SF)
code_block_5 = CodeBlock { 1; }
flatten_2 = List.Flatten(list=map, amt=code_block_5)
height_parameter_name = StringInput("LENGTH")  # graph input
contains_2 = List.Contains(list=map@L2, item=height_parameter_name, lacing=Longest)
filterByBoolMask_2 = List.FilterByBoolMask(list=flatten_2, mask=contains_2)
code_block_6 = CodeBlock { 0; }
removeItemAtIndex_2 = List.RemoveItemAtIndex(indices=code_block_6)  # unwired: list
map_3 = List.Map(list=filterByBoolMask_2.in, f_x=removeItemAtIndex_2)

# group: REMOVE EMPTY ROW DATA
code_block_7 = CodeBlock { ""; }
eq = _ == code_block_7  # unwired: x
map_4 = List.Map(list=map_3, f_x=eq)
boolean_2 = BoolSelector(false)
allIndicesOf = List.AllIndicesOf(list=map_4@L2, item=boolean_2)

# group: PANEL - QUANTITY
code_block_8 = CodeBlock { 1; }
flatten_3 = List.Flatten(list=map, amt=code_block_8)
quantity_parameter_name = StringInput("QUANTITY")  # graph input
contains_3 = List.Contains(list=map@L2, item=quantity_parameter_name, lacing=Longest)
filterByBoolMask_3 = List.FilterByBoolMask(list=flatten_3, mask=contains_3)
code_block_9 = CodeBlock { 0; }
removeItemAtIndex_3 = List.RemoveItemAtIndex(indices=code_block_9)  # unwired: list
map_5 = List.Map(list=filterByBoolMask_3.in, f_x=removeItemAtIndex_3)
boolean_3 = BoolSelector(false)
allIndicesOf_2 = List.AllIndicesOf(list=contains_3@L2, item=boolean_3)

# group: PANEL - WIDTH (SF)
code_block_10 = CodeBlock { 1; }
flatten_4 = List.Flatten(list=map, amt=code_block_10)
width_parameter_name = StringInput("GLAZING WIDTH")  # graph input
contains_4 = List.Contains(list=map@L2, item=width_parameter_name, lacing=Longest)
filterByBoolMask_4 = List.FilterByBoolMask(list=flatten_4, mask=contains_4)
code_block_11 = CodeBlock { 0; }
removeItemAtIndex_4 = List.RemoveItemAtIndex(indices=code_block_11)  # unwired: list
map_6 = List.Map(list=filterByBoolMask_4.in, f_x=removeItemAtIndex_4)

# group: REMOVE EMPTY ROW DATA
getItemAtIndex = List.GetItemAtIndex(list=map_2@L2, index=allIndicesOf@L2)
getItemAtIndex_2 = List.GetItemAtIndex(list=map_5@L2, index=allIndicesOf@L2)
getItemAtIndex_3 = List.GetItemAtIndex(list=map_3@L2, index=allIndicesOf@L2)
getItemAtIndex_4 = List.GetItemAtIndex(list=map_6@L2, index=allIndicesOf@L2)

# group: GROUP PANELS WITH MATCHING AREAS
groupByKey = List.GroupByKey(list=getItemAtIndex@L2, keys=getItemAtIndex@L2)
count = List.Count(list=groupByKey.groups@L2)
count_2 = List.Count(list=count)
code_block_12 = CodeBlock(count=count_2) { 1..count; }
flatten_5 = List.Flatten(list=code_block_12)
cycle = List.Cycle(list=flatten_5, amount=count, lacing=Longest)

# group: W,H Combination
python_script = Python(IN[0]=getItemAtIndex_4, IN[1]=getItemAtIndex_3)
# ---------- python_script.python (23 lines) ----------
# Load the Python Standard and DesignScript Libraries
import clr
import sys
sys.path.append(r'C:\Program Files (x86)\IronPython 2.7\Lib')
clr.AddReference('ProtoGeometry')
from Autodesk.DesignScript.Geometry import *

clr.AddReference('RevitServices')
import RevitServices
from RevitServices.Persistence import DocumentManager
from RevitServices.Transactions import TransactionManager

width = IN[0]
height = IN[1]

result = []

for n in range(len(width)):
	comb = zip(width[n],height[n])
	result.append(comb)

		
OUT = result
# ----------------------------------------

# group: FEET OR INCHES CONVERSION CHOICE
feet = DoubleInput(12)
inches = DoubleInput(1)
if_ = If(test=feet_true_inches_false, true=feet, false=inches)
code_block_13 = CodeBlock(x=code_block.out0, conv=if_, y=code_block.out1) { x*conv; y*conv; }
code_block_14 = CodeBlock(x=stock_glazing_spacing_ft, conv=if_) { x*conv; }

# group: SPECIFY PANEL ITEM & ITEM ID TO BE PACKED IN CONTAINER/STOCK GLAZING
code_block_15 = CodeBlock { 1; }
flatten_6 = List.Flatten(list=getItemAtIndex_2, amt=code_block_15)
toNumber = String.ToNumber(str=flatten_6)
count_3 = List.Count(list=toNumber)
code_block_16 = CodeBlock(c=count_3) { 0..c-1; }
code_block_17 = CodeBlock { 1; }
count_4 = List.Count(list=getItemAtIndex_3@L2)
sum = Math.Sum(values=count_4)
panel_depth_l_quantity = List.Cycle(list=code_block_17, amount=sum)
flatten_7 = List.Flatten(list=python_script, amt=code_block_15)
code_block_18 = CodeBlock { W = 0; H = 1; }
getItemAtIndex_5 = List.GetItemAtIndex(index=code_block_18.W)  # unwired: list
panel_widths_w = Map(list=flatten_7, f_x=getItemAtIndex_5)
toNumber_2 = String.ToNumber(str=panel_widths_w)
getItemAtIndex_6 = List.GetItemAtIndex(index=code_block_18.H)  # unwired: list
panel_heights_h = Map(list=flatten_7, f_x=getItemAtIndex_6)
toNumber_3 = String.ToNumber(str=panel_heights_h)
code_block_19 = CodeBlock(x=toNumber_2, conv=if_, y=toNumber_3) { x*conv; y*conv; }
item = Miscellany.ContainerPacking.Entities.Item.Item(id=code_block_16, dim1=panel_depth_l_quantity, dim2=code_block_19.out0, dim3=code_block_19.out1, quantity=toNumber)

# group: STOCK GLAZING/CONTAINER
glazing_stock_size_w_h = CodeBlock(W=code_block_13.out0, H=code_block_13.out1) { ID = 0; L = 1; area = W*H; 1; }
container = Miscellany.ContainerPacking.Entities.Container.Container(id=glazing_stock_size_w_h.ID, length=glazing_stock_size_w_h.L, width=code_block_13.out0, height=code_block_13.out1)
cycle_2 = List.Cycle(list=container, amount=specified_no_of_stock_glazings)
width = Miscellany.ContainerPacking.Entities.Container.Width(container=cycle_2)
count_5 = List.Count(list=width)
height = Miscellany.ContainerPacking.Entities.Container.Height(container=cycle_2)
code_block_20 = CodeBlock(n=count_5, X=width, Z=height) { C = n-1; zeros = DSCore.List.Cycle(0,n); [zeros,X[0..C],X[0..C],zeros]; [zeros,zeros,Z,Z]; }
transpose_2 = List.Transpose(lists=code_block_20.out2)
transpose_3 = List.Transpose(lists=code_block_20.out3)
byCoordinates = Point.ByCoordinates(x=transpose_2, z=transpose_3)
byCornerPoints = Rectangle.ByCornerPoints(points=byCoordinates)
code_block_21 = CodeBlock(L=width, s=code_block_14) { L+s; }
sumcumulative = Custom[© SumCumulative](numbers=code_block_21)  # package Crumple; Continuously adds a list of numbers together, returning a list of the values in sequence.
code_block_22 = CodeBlock(n=count_5, L=sumcumulative) { r = 0..n-2; q = 1..n-1; [0,L[r]]; }
flatten_8 = List.Flatten(list=code_block_22.out2)

# group: BIN-PACK PANELS INTO CONTAINERS
packContainers = Miscellany.ContainerPacking.PackingService.PackContainers(containers=cycle_2@L2, itemsToPack=item)

# group: GET PACKING RESULT DATA
count_6 = List.Count(list=item)
count_7 = List.Count(list=packContainers.packedItems@L3)
code_block_23 = CodeBlock(x=count_7) { x[0]; }
flatten_9 = List.Flatten(list=packContainers.packedItems)
count_8 = List.Count(list=flatten_9)
flatten_10 = List.Flatten(list=packContainers.unpackedItems)
count_9 = List.Count(list=flatten_10)

# group: PACKING RESULT
total_cut_sheets_to_pack = Watch(count_6)
quantity_of_stock_glazing = Watch(code_block_23)  # "Quantity of Stock Glazing Required"; graph output
total_cut_sheets_packed = Watch(count_8)  # graph output
total_cut_sheets_unpacked = Watch(count_9)  # graph output

# group: STOCK GLAZING
takeItems = List.TakeItems(list=byCornerPoints, amount=quantity_of_stock_glazing)
code_block_24 = CodeBlock(range=flatten_8, n=quantity_of_stock_glazing) { range[0..n-1]; }
XAxis = Vector.XAxis()
translate = Geometry.Translate(geometry=takeItems, direction=XAxis, distance=code_block_24)

# group: STOCK SHEET GEOMETRY BY COLUMNS AND ROWS
takeItems_2 = List.TakeItems(list=code_block_24, amount=number_of_columns)
chop = List.Chop(list=code_block_24, lengths=number_of_columns)
count_10 = List.Count(list=chop@L2)
takeItems_3 = List.TakeItems(list=takeItems_2, amount=count_10)
count_11 = List.Count(list=takeItems_3)
code_block_25 = CodeBlock(space=code_block_14, z=code_block_13.out1) { space + z[0]; }
code_block_26 = CodeBlock(c=count_11, z=code_block_25) { 0..#c..z; }
code_block_27 = CodeBlock(x=takeItems_3, z=code_block_26) { x*1; z*-1; }
translate_2 = Geometry.Translate(geometry=takeItems, xTranslation=code_block_27.out0, zTranslation=code_block_27.out1)

# group: CONDITION TO CHOOSE THE STOCK QUANTITY
count_12 = List.Count(list=byCornerPoints)
le = count_12 <= quantity_of_stock_glazing
if_2 = If(test=le, true=count_12, false=quantity_of_stock_glazing)

# group: PACK COORDINATES
coordX = Miscellany.ContainerPacking.Entities.Item.CoordY(item=packContainers.packedItems@L2)  # "Item.CoordX"
coordZ = Miscellany.ContainerPacking.Entities.Item.CoordZ(item=packContainers.packedItems@L2)

# group: PACK DIMENSIONS
packDimX = Miscellany.ContainerPacking.Entities.Item.PackDimY(item=packContainers.packedItems@L2)  # "Item.PackDimX"
packDimZ = Miscellany.ContainerPacking.Entities.Item.PackDimZ(item=packContainers.packedItems@L2)

# group: PACK CUT SHEETS INTO GLAZING
add = coordX + packDimX
add_2 = coordZ + packDimZ
code_block_28 = CodeBlock(n=if_2, x=coordX, xb=add, z=coordZ, zb=add_2) { C = n-1; [x[0..C],xb[0..C],xb[0..C],x[0..C]]; [z[0..C],z[0..C],zb[0..C],zb[0..C]]; }
python_script_2 = Python(IN[0]=code_block_28.out1)
# ---------- python_script_2.python (19 lines) ----------
# Load the Python Standard and DesignScript Libraries
import sys
import clr
clr.AddReference('ProtoGeometry')
from Autodesk.DesignScript.Geometry import *

# The inputs to this node will be stored as a list in the IN variables.
LIST = IN[0]

# Place your code below this line
A = LIST[0]
B = LIST[1]
C = LIST[2]
D = LIST[3]


T_LIST = zip(LIST[0],LIST[1],LIST[2],LIST[3])

OUT = T_LIST
# ----------------------------------------
transpose_4 = List.Transpose()  # unwired: lists
map_7 = List.Map(list=python_script_2, f_x=transpose_4)
python_script_3 = Python(IN[0]=code_block_28.out2)  # same code as python_script_2
map_8 = List.Map(list=python_script_3, f_x=transpose_4)
byCoordinates_2 = Point.ByCoordinates(x=map_7, z=map_8, lacing=Longest)
byCornerPoints_2 = Rectangle.ByCornerPoints(points=byCoordinates_2)
XAxis_2 = Vector.XAxis()
code_block_29 = CodeBlock(range=flatten_8, n=quantity_of_stock_glazing) { range[0..n-1]; }
translate_3 = Geometry.Translate(geometry=byCornerPoints_2, direction=XAxis_2, distance=code_block_29)

# group: CUT SHEET GEOMETRY BY COLUMNS AND ROWS
takeItems_4 = List.TakeItems(list=code_block_24, amount=number_of_columns)
chop_2 = List.Chop(list=code_block_24, lengths=number_of_columns)
count_13 = List.Count(list=chop_2@L2)
takeItems_5 = List.TakeItems(list=takeItems_4, amount=count_13)
flatten_11 = List.Flatten(list=takeItems_5)
count_14 = List.Count(list=takeItems_5)
code_block_30 = CodeBlock(space=code_block_14, z=code_block_13.out1) { space + z[0]; }
code_block_31 = CodeBlock(c=count_14, z=code_block_30) { 0..#c..z; }
cycle_3 = List.Cycle(list=code_block_31, amount=count_10, lacing=Shortest)
flatten_12 = List.Flatten(list=cycle_3)
code_block_32 = CodeBlock(x=flatten_11, z=flatten_12) { x*1; z*-1; }
translate_4 = Geometry.Translate(geometry=byCornerPoints_2, xTranslation=code_block_32.out0, zTranslation=code_block_32.out1)

# group: CALCULATE WASTE IN SQUARE FEET
byPatch = Surface.ByPatch(closedCurve=translate_2)
area = Surface.Area(surface=byPatch)
flatten_13 = List.Flatten(list=area)
byPatch_2 = Surface.ByPatch(closedCurve=translate_4)
area_2 = Surface.Area(surface=byPatch_2)
sum_2 = Math.Sum(values=area_2)
sub = flatten_13 - sum_2
code_block_33 = CodeBlock(x=sub) { x/(12*12); }
number = DoubleInput(2)
round = Math.Round(number=code_block_33, digits=number)

# group: TRANSFORM PACKED GLAZING GEOMETRY TO PLANE/COORDINATE SYSTEM
byPatch_3 = Surface.ByPatch(closedCurve=translate_4)
code_block_34 = CodeBlock(s=byPatch_3) { s[0][0]; 0.5; }
pointAtParameter = Surface.PointAtParameter(surface=code_block_34.out0, u=code_block_34.out1, v=code_block_34.out1)
normalAtPoint = Surface.NormalAtPoint(surface=code_block_34.out0, point=pointAtParameter)
explode = Geometry.Explode(geometry=translate_4)

# group: PANEL - TYPE MARK
type_mark_parameter_name = StringInput("LOCATION")  # graph input
contains_5 = List.Contains(list=map@L2, item=type_mark_parameter_name, lacing=Longest)
boolean_4 = BoolSelector(false)
allIndicesOf_3 = List.AllIndicesOf(list=contains_5@L2, item=boolean_4)
code_block_35 = CodeBlock { 1; }
flatten_14 = List.Flatten(list=map, amt=code_block_35)
filterByBoolMask_5 = List.FilterByBoolMask(list=flatten_14, mask=contains_5)
code_block_36 = CodeBlock { 0; }
removeItemAtIndex_5 = List.RemoveItemAtIndex(indices=code_block_36)  # unwired: list
map_9 = List.Map(list=filterByBoolMask_5.in, f_x=removeItemAtIndex_5)

# group: PANEL - TYPE
code_block_37 = CodeBlock { 1; }
flatten_15 = List.Flatten(list=map, amt=code_block_37)
type_parameter_name = StringInput("TYPE")  # graph input
contains_6 = List.Contains(list=map@L2, item=type_parameter_name, lacing=Longest)
filterByBoolMask_6 = List.FilterByBoolMask(list=flatten_15, mask=contains_6)
code_block_38 = CodeBlock { 0; }
removeItemAtIndex_6 = List.RemoveItemAtIndex(indices=code_block_38)  # unwired: list
map_10 = List.Map(list=filterByBoolMask_6.in, f_x=removeItemAtIndex_6)

# group: TYPE MARKS
code_block_39 = CodeBlock { '-'; }
concat = String.Concat(string1=code_block_39)  # unwired: string0, string2
getItemAtIndex_7 = List.GetItemAtIndex(list=map_9@L2, index=allIndicesOf@L2)
flatten_16 = List.Flatten(list=getItemAtIndex_7)
getItemAtIndex_8 = List.GetItemAtIndex(list=map_10@L2, index=allIndicesOf@L2)
flatten_17 = List.Flatten(list=getItemAtIndex_8)
combine = List.Combine(comb=concat, list1=flatten_16, list2=flatten_17)

# group: PACKED SHEETS IDENTITY MARKS
string_from_object = FromObject(obj=code_block_16)
byKeysValues = DesignScript.Builtin.Dictionary.ByKeysValues(keys=string_from_object, values=combine)
ID = Miscellany.ContainerPacking.Entities.Item.ID(item=packContainers.packedItems)
code_block_40 = CodeBlock { 1; }
flatten_18 = List.Flatten(list=ID, amt=code_block_40)
string_from_object_2 = FromObject(obj=flatten_18)
valueAtKey = DesignScript.Builtin.Dictionary.ValueAtKey(dictionary=byKeysValues, key=string_from_object_2)

# group: SEND CUT SHEETS LINES AND IDENTITY MARK TEXT NOTE DATA TO REVIT
string_5 = StringInput("Center")
count_15 = List.Count(list=byPatch)
code_block_41 = CodeBlock(count=count_15, s=byPatch) { c = (count-1)/2; s[c]; 0.5; 1; }
pointAtParameter_2 = Surface.PointAtParameter(surface=code_block_41.out1, u=code_block_41.out3, v=code_block_41.out2)
XAxis_3 = Vector.XAxis()
number_2 = DoubleInput(-90)
number_3 = DoubleInput(90)
if_3 = If(test=flip_cut_sheet_placement, true=number_2, false=number_3)
byName = DraftingView.ByName(name=new_drafting_view_name)
setScale = View.SetScale(view=byName, scale=new_drafting_view_scale)
rotate = Geometry.Rotate(geometry=translate_4, origin=pointAtParameter_2, axis=XAxis_3, degrees=if_3, lacing=Longest)
explode_2 = Geometry.Explode(geometry=rotate)
byCurves = FilledRegion.ByCurves(view=setScale, boundary=explode_2, regionType=select_filled_region_type)
setParameterByName = Element.SetParameterByName(element=byCurves, parameterName=identity_marks_instance, value=valueAtKey)
byPatch_4 = Surface.ByPatch(closedCurve=rotate)
code_block_42 = CodeBlock { 0.5; }
pointAtParameter_3 = Surface.PointAtParameter(surface=byPatch_4, u=code_block_42, v=code_block_42)
byElementAndLocation = Tag.ByElementAndLocation(view=setScale, element=setParameterByName, location=pointAtParameter_3)
string_6 = StringInput("Type")
setParameterByName_2 = Element.SetParameterByName(element=byElementAndLocation, parameterName=string_6, value=select_tag_family_to_use)
python_script_bring_elements = Python()  # "Python Script: Bring Elements Front"; frozen; unwired: IN[0]
# ---------- python_script_bring_elements.python (34 lines) ----------
# Load the Python Standard and DesignScript Libraries
import sys
import clr
clr.AddReference('ProtoGeometry')
from Autodesk.DesignScript.Geometry import *

clr.AddReference("RevitServices")
import RevitServices
from RevitServices.Persistence import DocumentManager 
from RevitServices.Transactions import TransactionManager 

clr.AddReference("RevitAPI")
from Autodesk.Revit.DB.DetailElementOrderUtils import BringToFront
from Autodesk.Revit.DB import Document as DOC

doc = DocumentManager.Instance.CurrentDBDocument

FRegions = UnwrapElement(IN[0])

TransactionManager.Instance.EnsureInTransaction(doc)

def DFront(ELEMS):
	newELEMS = BringToFront(doc, doc.ActiveView, ELEMS.Id)
	return newELEMS

ToFront = []

for elem in FRegions:
	DFront(elem)
	ToFront.append(elem)
	
TransactionManager.Instance.TransactionTaskDone()

OUT = ToFront
# ----------------------------------------
flatten_19 = List.Flatten(list=setParameterByName)

# group: STOCK GLAZING TEXT NOTE ON WASTE
rotate_2 = Geometry.Rotate(geometry=translate_2, origin=pointAtParameter_2, axis=XAxis_3, degrees=if_3, lacing=Longest)
patch = Curve.Patch(curve=rotate_2)
code_block_43 = CodeBlock { 0; 0.5; }
pointAtParameter_4 = Surface.PointAtParameter(surface=patch, u=code_block_43.out1, v=code_block_43.out0)
YAxis = Vector.YAxis()
reverse = Vector.Reverse(vector=YAxis)
number_4 = DoubleInput(1)
code_block_44 = CodeBlock(x=number_4, conv=if_) { x*conv; }
translate_5 = Geometry.Translate(geometry=pointAtParameter_4, direction=reverse, distance=code_block_44)
python_script_4 = Python(IN[0]=round)
# ---------- python_script_4.python (16 lines) ----------
# Load the Python Standard and DesignScript Libraries
import sys
import clr
clr.AddReference('ProtoGeometry')
from Autodesk.DesignScript.Geometry import *

# The inputs to this node will be stored as a list in the IN variables.
data = IN[0]

result = []
for i in data:
	result.append(str(i))
# Place your code below this line

# Assign your output to the OUT variable.
OUT = result
# ----------------------------------------
code_block_45 = CodeBlock { "No"; " SF"; "0.0 SF"; " Waste"; }
add_3 = python_script_4 + code_block_45.out1
eq_2 = _ == code_block_45.out2  # unwired: x
replaceByCondition = Replace(item=add_3, replaceWith=code_block_45.out0, condition=eq_2)
add_4 = replaceByCondition + code_block_45.out3
explode_3 = Geometry.Explode(geometry=rotate_2)
byCurve = Custom[DetailCurve.ByCurve+](curve=explode_3, view=setScale)  # package Clockwork for Dynamo 2.x; Creates a detail line based on a given curve. Unlike the OOTB node it can also draw circles.
string_7 = StringInput("Line Style")
setParameterByName_3 = Element.SetParameterByName(element=byCurve, parameterName=string_7, value=stock_sheet_line_style)

code_block_46 = CodeBlock {  }

# group: PREVIEW
color_palette = ColorPalette({R: 0, G: 0, B: 139, A: 255})
byGeometryColor = Modifiers.GeometryColor.ByGeometryColor(geometry=rotate, color=color_palette)

# group: OUTPUT DATA
code_block_47 = CodeBlock { "Total Cut Sheets Packed"; "Total Cut Sheets not Packed"; "Quantity of Stock Glazing Required"; "Total Stock Waste"; }
sum_3 = Math.Sum(values=round)
python_script_5 = Python(IN[0]=code_block_47.out0, IN[1]=code_block_47.out1, IN[2]=code_block_47.out2, IN[3]=code_block_47.out3, IN[4]=total_cut_sheets_packed, IN[5]=total_cut_sheets_unpacked, IN[6]=quantity_of_stock_glazing, IN[7]=sum_3)
# ---------- python_script_5.python (13 lines) ----------
# Load the Python Standard and DesignScript Libraries
import sys
import clr
clr.AddReference('ProtoGeometry')
from Autodesk.DesignScript.Geometry import *

# The inputs to this node will be stored as a list in the IN variables.
A = str(IN[0]) + " = " + str(IN[4])
B = str(IN[1]) + " = " + str(IN[5])
C = str(IN[2]) + " = " + str(IN[6])
D = str(IN[3]) + " = " + str(IN[7]) + "SF"

OUT = A,B,C,D
# ----------------------------------------

# group: STOCK GLAZING TEXT NOTE PACKING DETAILS
code_block_48 = CodeBlock(S=patch) { S[0][0]; 0; 1; }
pointAtParameter_5 = Surface.PointAtParameter(surface=code_block_48.out0, u=code_block_48.out1, v=code_block_48.out2)
YAxis_2 = Vector.YAxis()
code_block_49 = CodeBlock(space=stock_glazing_spacing_ft) { 2*space; }
count_16 = List.Count(list=python_script_5)
code_block_50 = CodeBlock(start=code_block_49, step=count_16) { start..start*4..#step; }
code_block_51 = CodeBlock(x=code_block_50, conv=if_) { x*conv; }
translate_6 = Geometry.Translate(geometry=pointAtParameter_5, direction=YAxis_2, distance=code_block_51)
string_8 = StringInput("Left")
byLocation = TextNote.ByLocation(view=setScale, location=translate_6, text=python_script_5, alignment=string_8)

# group: OPEN VIEW AND PIN ELEMENTS IN REVIT
join = List.Join(list0=setParameterByName_3, list1=flatten_19, list2=byLocation)
setPinnedStatus = Custom[RH.Element.SetPinnedStatus](VARelement=join, VARBool=pin_elements_in_revit)  # package Synthesize toolkit; Will set the element to either pinned or not pinned. True is pinned, false is unpinned. For multiple elements use List.Map
passthrough = Custom[Passthrough](passThrough=byName, waitFor=setPinnedStatus)  # package Clockwork for Dynamo 2.x; Forces a sequential order of execution. The node wired into the output of the Passthrough node will be executed *after* the node wired into the waitFor input (e.g. important for some Revit operations). The value of the passThrough input will be passed on to the node wired into the output port of the Passthrough node.
python_script_open_view = Python(IN[0]=passthrough)
# ---------- python_script_open_view.python (29 lines) ----------
# Load the Python Standard and DesignScript Libraries
import sys
import clr
clr.AddReference('ProtoGeometry')
from Autodesk.DesignScript.Geometry import *

clr.AddReference("RevitServices")
import RevitServices
from RevitServices.Persistence import DocumentManager 
from RevitServices.Transactions import TransactionManager 

clr.AddReference("RevitAPI")
from Autodesk.Revit.DB.DetailElementOrderUtils import BringToFront
from Autodesk.Revit.DB import Document as DOC


clr.AddReference("RevitAPIUI")
from Autodesk.Revit.UI.UIDocument import ActiveView

doc = DocumentManager.Instance.CurrentDBDocument
uidoc = DocumentManager.Instance.CurrentUIDocument

TransactionManager.Instance.EnsureInTransaction(doc)
TransactionManager.Instance.ForceCloseTransaction()

view = UnwrapElement(IN[0])
uidoc.RequestViewChange(view)

OUT = 'Active View is ' + doc.ActiveView.Name.ToString()
# ----------------------------------------
