# Dynamo graph Adjust Elements Between Categories.dyn (Dynamo 2.3.1.11775)
# packages: Autodesk Analytical Modeling 2020 Dynamo 1.0.54, Structural Design 2021.1.22

# group: Input
run_script = BoolSelector(true)
pickElements = StructuralDesign.Model.Selection.PickElements(refresh=run_script)
start_from_default_analytical = BoolSelector(false)  # "Start from default analytical model"; graph input
snap_elements_to_levels = BoolSelector(false)  # graph input
force_tolerance_to_change = BoolSelector(false)  # graph input
adjust_elements_within_category = BoolSelector(true)  # graph input

# group: Vizualization
visualizeRevitElements = Dynamo4AM.Visualization.Preview.VisualizeRevitElements(elements=pickElements)
vizualization = List.Create(item0=visualizeRevitElements.elements, item1=visualizeRevitElements.geometry)

vizualization_2 = CodeBlock(vizualization=vizualization) { vizualization; }
vizualization_3 = CodeBlock(vizualization=vizualization_2) { vizualization; }
vizualization_4 = CodeBlock(vizualization=vizualization_3) { vizualization; }

# group: Reset Analytical Model to Center
clearIfTrue = Dynamo4AM.Utilities.FilterElements.ClearIfTrue(obj=pickElements, boolean=start_from_default_analytical)
clearIfFalse = Dynamo4AM.Utilities.FilterElements.ClearIfFalse(obj=pickElements, boolean=start_from_default_analytical)
resetElementAnalyticalModel = Dynamo4AM.Translation.TranslationNodes.ResetElementAnalyticalModel(elements=clearIfFalse)
join = List.Join(list0=clearIfTrue, list1=resetElementAnalyticalModel)

snap_elements_to_levels_2 = Object.Identity(obj=snap_elements_to_levels)

# group: Snap Elements to Levels
clearIfTrue_2 = Dynamo4AM.Utilities.FilterElements.ClearIfTrue(obj=join, boolean=snap_elements_to_levels_2)
clearIfFalse_2 = Dynamo4AM.Utilities.FilterElements.ClearIfFalse(obj=join, boolean=snap_elements_to_levels_2)
snapToLevels = Dynamo4AM.Translation.TranslationNodes.SnapToLevels(elements=clearIfFalse_2)
join_2 = List.Join(list0=clearIfTrue_2, list1=snapToLevels)

priority_elements = DropDown("Floors")
priority_elements_2 = DropDown("Columns")
priority_elements_3 = DropDown("Framing")
priorities = List.Create(item0=priority_elements, item1=priority_elements_2, item2=priority_elements_3)
priorities_2 = Object.Identity(obj=priorities)

# group: Tolerance Interface
userInterface = Dynamo4AM.ToleranceInput.Tolerance.UserInterface(forceToleranceChange=force_tolerance_to_change)
tolerance = List.Create(item0=userInterface.tolerance, item1=userInterface.IsRelative)

tolerance_2 = Object.Identity(obj=tolerance)

# group: Free Adjustment, adjusting 2nd category to 1st category
identity = Object.Identity(obj=join_2)
priorities_3 = CodeBlock(Priorities=priorities_2) { Priorities[1]; Priorities[0]; }
filters_pickelementsofcategory = Dynamo4AM.Definition.Filters.PickElementsOfCategory(selection=identity, elementCategory=priorities_3.out0)  # "Filters.PickElementsOfCategory (2nd)"
filters_pickelementsofcategory_2 = Dynamo4AM.Definition.Filters.PickElementsOfCategory(selection=identity, elementCategory=priorities_3.out1)  # "Filters.PickElementsOfCategory (1st)"
tolerance_3 = CodeBlock(tolerance=tolerance_2) { tolerance[0]; tolerance[1]; }
translationnodes = Dynamo4AM.Translation.TranslationNodes.TranslateSlavesToMasters(slaves=filters_pickelementsofcategory, masters=filters_pickelementsofcategory_2, tolerance=tolerance_3.out0, isRelative=tolerance_3.out1)  # "TranslationNodes.TranslateSlavesToMasters (2nd To 1st)"

priorities_4 = Object.Identity(obj=priorities_2)
tolerance_4 = Object.Identity(obj=tolerance_2)

# group: Free Adjustment, adjusting 3rd category to 2nd category
identity_2 = Object.Identity(obj=translationnodes)
priorities_5 = CodeBlock(Priorities=priorities_4) { Priorities[2]; Priorities[1]; }
filters_pickelementsofcategory_3 = Dynamo4AM.Definition.Filters.PickElementsOfCategory(selection=identity_2, elementCategory=priorities_5.out0)  # "Filters.PickElementsOfCategory (3rd)"
filters_pickelementsofcategory_4 = Dynamo4AM.Definition.Filters.PickElementsOfCategory(selection=identity_2, elementCategory=priorities_5.out1)  # "Filters.PickElementsOfCategory (2nd)"
tolerance_5 = CodeBlock(tolerance=tolerance_4) { tolerance[0]; tolerance[1]; }
translationnodes_2 = Dynamo4AM.Translation.TranslationNodes.TranslateSlavesToMasters(slaves=filters_pickelementsofcategory_3, masters=filters_pickelementsofcategory_4, tolerance=tolerance_5.out0, isRelative=tolerance_5.out1)  # "TranslationNodes.TranslateSlavesToMasters (3rd To 2nd)"

priorities_6 = Object.Identity(obj=priorities_4)
tolerance_6 = Object.Identity(obj=tolerance_4)

# group: Free Adjustment, adjusting 3rd category to 1st category
identity_3 = Object.Identity(obj=translationnodes_2)
priorities_7 = CodeBlock(Priorities=priorities_6) { Priorities[2]; Priorities[0]; }
filters_pickelementsofcategory_5 = Dynamo4AM.Definition.Filters.PickElementsOfCategory(selection=identity_3, elementCategory=priorities_7.out0)  # "Filters.PickElementsOfCategory (3rd)"
filters_pickelementsofcategory_6 = Dynamo4AM.Definition.Filters.PickElementsOfCategory(selection=identity_3, elementCategory=priorities_7.out1)  # "Filters.PickElementsOfCategory (1st)"
tolerance_7 = CodeBlock(tolerance=tolerance_6) { tolerance[0]; tolerance[1]; }
translationnodes_3 = Dynamo4AM.Translation.TranslationNodes.TranslateSlavesToMasters(slaves=filters_pickelementsofcategory_5, masters=filters_pickelementsofcategory_6, tolerance=tolerance_7.out0, isRelative=tolerance_7.out1)  # "TranslationNodes.TranslateSlavesToMasters (3rd To 2nd)"

adjust_elements_within_category_2 = Object.Identity(obj=adjust_elements_within_category)
tolerance_8 = Object.Identity(obj=tolerance_6)

# group: Adjust elements within category
clearIfTrue_3 = Dynamo4AM.Utilities.FilterElements.ClearIfTrue(obj=translationnodes_3, boolean=adjust_elements_within_category_2)
clearIfFalse_3 = Dynamo4AM.Utilities.FilterElements.ClearIfFalse(obj=translationnodes_3, boolean=adjust_elements_within_category_2)
tolerance_9 = CodeBlock(tolerance=tolerance_8) { tolerance[0]; tolerance[1]; }
adjustElementsWithinCategory = Dynamo4AM.Translation.TranslationNodes.AdjustElementsWithinCategory(elements=clearIfFalse_3, tolerance=tolerance_9.out0, isRelative=tolerance_9.out1)
join_3 = List.Join(list0=clearIfTrue_3, list1=adjustElementsWithinCategory)

# group: Vizualization
tolerance_10 = CodeBlock(vizualization=vizualization_4) { vizualization[0]; vizualization[1]; }
isEmpty = List.IsEmpty(list=join_3)
clearIfTrue_4 = Dynamo4AM.Utilities.FilterElements.ClearIfTrue(obj=tolerance_10.out0, boolean=isEmpty)
visualizeChangesInRevitElements = Dynamo4AM.Visualization.Preview.VisualizeChangesInRevitElements(elements=clearIfTrue_4, geometry=tolerance_10.out1)
getGreyColor = Dynamo4AM.Visualization.Preview.GetGreyColor()
byGeometryColor = Modifiers.GeometryColor.ByGeometryColor(geometry=visualizeChangesInRevitElements.unchangedGeometry, color=getGreyColor)
getRedColor = Dynamo4AM.Visualization.Preview.GetRedColor()
byGeometryColor_2 = Modifiers.GeometryColor.ByGeometryColor(geometry=visualizeChangesInRevitElements.initialGeometry, color=getRedColor)
getGreenColor = Dynamo4AM.Visualization.Preview.GetGreenColor()
byGeometryColor_3 = Modifiers.GeometryColor.ByGeometryColor(geometry=visualizeChangesInRevitElements.transformedGeometry, color=getGreenColor)
getBlueColor = Dynamo4AM.Visualization.Preview.GetBlueColor()
byGeometryColor_4 = Modifiers.GeometryColor.ByGeometryColor(geometry=visualizeChangesInRevitElements.transformationVectors, color=getBlueColor)
