# Dynamo graph Adjust Elements Within Category Only.dyn (Dynamo 2.3.1.11775)
# packages: Autodesk Analytical Modeling 2020 Dynamo 1.0.54

# group: Input Data
select_model_elements = DSModelElementsSelection()  # 345 picked in the model; graph input
start_from_default_analytical = BoolSelector(false)  # "Start from default analytical model"; graph input
snap_elements_to_levels = BoolSelector(false)  # graph input
force_tolerance_to_change = BoolSelector(false)  # graph input
userInterface = Dynamo4AM.ToleranceInput.Tolerance.UserInterface(forceToleranceChange=force_tolerance_to_change)

# group: Reset Analytical Model to Center
clearIfTrue = Dynamo4AM.Utilities.FilterElements.ClearIfTrue(obj=select_model_elements, boolean=start_from_default_analytical)
clearIfFalse = Dynamo4AM.Utilities.FilterElements.ClearIfFalse(obj=select_model_elements, boolean=start_from_default_analytical)
resetElementAnalyticalModel = Dynamo4AM.Translation.TranslationNodes.ResetElementAnalyticalModel(elements=clearIfFalse)
join = List.Join(list0=clearIfTrue, list1=resetElementAnalyticalModel)

# group: Snap Elements to Levels
clearIfTrue_2 = Dynamo4AM.Utilities.FilterElements.ClearIfTrue(obj=join, boolean=snap_elements_to_levels)
clearIfFalse_2 = Dynamo4AM.Utilities.FilterElements.ClearIfFalse(obj=join, boolean=snap_elements_to_levels)
snapToLevels = Dynamo4AM.Translation.TranslationNodes.SnapToLevels(elements=clearIfFalse_2)
join_2 = List.Join(list0=clearIfTrue_2, list1=snapToLevels)

# group: Self-adjusting
adjustElementsWithinCategory = Dynamo4AM.Translation.TranslationNodes.AdjustElementsWithinCategory(elements=join_2, tolerance=userInterface.tolerance, isRelative=userInterface.IsRelative)
