# Dynamo graph Beam Projection Line alignment.dyn (Dynamo 2.6.1.8786)

boolean = BoolSelector(true)
python_script = Python(IN[0]=boolean)
# ---------- python_script.python (56 lines) ----------
import clr
import sys

import System
from System import Array
from System.Collections.Generic import *
clr.AddReference('ProtoGeometry')
from Autodesk.DesignScript.Geometry import *

clr.AddReference("RevitNodes")
import Revit
clr.ImportExtensions(Revit.Elements)
clr.ImportExtensions(Revit.GeometryConversion)

clr.AddReference("RevitServices")
import RevitServices
from RevitServices.Persistence import DocumentManager 
from RevitServices.Transactions import TransactionManager 

clr.AddReference("RevitAPI")
from Autodesk.Revit.DB import *

clr.AddReference("RevitAPIUI")
from Autodesk.Revit.UI import *

from Autodesk.Revit.DB.Structure import *

doc = DocumentManager.Instance.CurrentDBDocument
uiapp = DocumentManager.Instance.CurrentUIApplication 
app = uiapp.Application 
uidoc = uiapp.ActiveUIDocument

TransactionManager.Instance.EnsureInTransaction(doc)

beams = FilteredElementCollector(doc).OfCategory(BuiltInCategory.OST_StructuralFraming).WhereElementIsNotElementType().ToElements()

BeamsAnalyticalModel = []
Beams = []

for beam in beams:
	if beam.GetAnalyticalModel().IsEnabled():
		BeamsAnalyticalModel.append(beam.GetAnalyticalModel())
		Beams.append(beam)
		
BeamAM = []
try:
	for AM in BeamsAnalyticalModel:
		BeamAM.append(AM.LookupParameter("Start Alignment Method").AsInteger())
		AM.LookupParameter("Start Alignment Method").Set(1)
		AM.LookupParameter("End Alignment Method").Set(1)
except:
	pass
		
TransactionManager.Instance.TransactionTaskDone()

OUT = BeamAM
# ----------------------------------------
