# Dynamo graph Analytical Adjust Beam Elements.dyn (Dynamo 2.6.1.8786)
# packages: Autodesk Analytical Modeling 2021 Dynamo 1.0.2

string = StringInput("End y Projection")
string_2 = StringInput("Start Alignment Method")
code_block = CodeBlock { 1; }
setParameterByName = Element.SetParameterByName(parameterName=string_2, value=code_block)  # unwired: element
string_3 = StringInput("End Alignment Method")
setParameterByName_2 = Element.SetParameterByName(element=setParameterByName, parameterName=string_3, value=code_block)
string_4 = StringInput("Start y Projection")
getParameterValueByName = Element.GetParameterValueByName(element=setParameterByName, parameterName=string_4)
select_model_elements = DSModelElementsSelection()  # 913 picked in the model
getAnalyticalElement = Dynamo4AM.Utilities.FilterElements.GetAnalyticalElement(obj=select_model_elements)
boolean = BoolSelector(false)
clean = List.Clean(list=getAnalyticalElement, preserveIndices=boolean)

# group: COLUMNS
isColumn = Dynamo4AM.Utilities.FilterElements.IsColumn(obj=clean)
filterByBoolMask = List.FilterByBoolMask(list=clean, mask=isColumn)

boolean_2 = BoolSelector(true)
userInterface = Dynamo4AM.ToleranceInput.Tolerance.UserInterface(forceToleranceChange=boolean_2)
adjustElementsWithinCategory = Dynamo4AM.Translation.TranslationNodes.AdjustElementsWithinCategory(elements=filterByBoolMask.in, tolerance=userInterface.tolerance)  # frozen
code_block_2 = CodeBlock { 1; }
setParameterByName_3 = Element.SetParameterByName(value=code_block_2)  # unwired: element, parameterName
string_5 = StringInput("Top Alignment Method")

# group: FLOORS
isFloor = Dynamo4AM.Utilities.FilterElements.IsFloor(obj=clean)
filterByBoolMask_2 = List.FilterByBoolMask(list=clean, mask=isFloor)

# group: WALLS
isWall = Dynamo4AM.Utilities.FilterElements.IsWall(obj=clean)
filterByBoolMask_3 = List.FilterByBoolMask(list=clean, mask=isWall)

translateSecondariesToPrimaries = Dynamo4AM.Translation.TranslationNodes.TranslateSecondariesToPrimaries(secondaries=filterByBoolMask_2.in, primaries=filterByBoolMask_3.in, tolerance=userInterface.tolerance, isRelative=userInterface.IsRelative)  # frozen

# group: FRAMING
isFraming = Dynamo4AM.Utilities.FilterElements.IsFraming(obj=clean)
filterByBoolMask_4 = List.FilterByBoolMask(list=clean, mask=isFraming)

# group: ADJUST ELEMENT
adjustElementsWithinCategory_2 = Dynamo4AM.Translation.TranslationNodes.AdjustElementsWithinCategory(elements=filterByBoolMask_4.in, tolerance=userInterface.tolerance, isRelative=userInterface.IsRelative)

translateSecondariesToPrimaries_2 = Dynamo4AM.Translation.TranslationNodes.TranslateSecondariesToPrimaries(secondaries=adjustElementsWithinCategory_2, primaries=filterByBoolMask.in, tolerance=userInterface.tolerance, isRelative=userInterface.IsRelative)
