# Dynamo graph Analytical Adjust Elements between Categories (2020).dyn (Dynamo 2.3.1.11775)
# packages: Autodesk Analytical Modeling 2021 Dynamo 1.0.2

select_model_elements = DSModelElementsSelection()  # 345 picked in the model
getAnalyticalElement = Dynamo4AM.Utilities.FilterElements.GetAnalyticalElement(obj=select_model_elements)
boolean = BoolSelector(false)
clean = List.Clean(list=getAnalyticalElement, preserveIndices=boolean)

# group: FRAMING
isFraming = Dynamo4AM.Utilities.FilterElements.IsFraming(obj=clean)
filterByBoolMask = List.FilterByBoolMask(list=clean, mask=isFraming)

# group: COLUMNS
isColumn = Dynamo4AM.Utilities.FilterElements.IsColumn(obj=clean)
filterByBoolMask_2 = List.FilterByBoolMask(list=clean, mask=isColumn)

boolean_2 = BoolSelector(true)
userInterface = Dynamo4AM.ToleranceInput.Tolerance.UserInterface(forceToleranceChange=boolean_2)

# group: FLOORS
isFloor = Dynamo4AM.Utilities.FilterElements.IsFloor(obj=clean)
filterByBoolMask_3 = List.FilterByBoolMask(list=clean, mask=isFloor)

# group: WALL
isWall = Dynamo4AM.Utilities.FilterElements.IsWall(obj=clean)
filterByBoolMask_4 = List.FilterByBoolMask(list=clean, mask=isWall)

# group: ADJUST ELEMENT
boolean_3 = BoolSelector(true)
adjustElementsWithinCategory = Dynamo4AM.Translation.TranslationNodes.AdjustElementsWithinCategory(elements=filterByBoolMask_2.in, tolerance=userInterface.tolerance, isRelative=boolean_3)
boolean_4 = BoolSelector(true)
translateSecondariesToPrimaries = Dynamo4AM.Translation.TranslationNodes.TranslateSecondariesToPrimaries(secondaries=filterByBoolMask.in, primaries=adjustElementsWithinCategory, tolerance=userInterface.tolerance, isRelative=boolean_4)
translateSecondariesToPrimaries_2 = Dynamo4AM.Translation.TranslationNodes.TranslateSecondariesToPrimaries(secondaries=filterByBoolMask_3.in, primaries=filterByBoolMask_4.in, tolerance=userInterface.tolerance, isRelative=boolean_4)

visualizeRevitElements = Dynamo4AM.Visualization.Preview.VisualizeRevitElements(elements=getAnalyticalElement)
snapToLevels = Dynamo4AM.Translation.TranslationNodes.SnapToLevels()  # unwired: elements
