# Dynamo graph Wall Opening for Pipes_3.dyn (Dynamo 2.3.0.5885)
# packages: archi-lab.net 2021.25.2621, bimorphNodes 3.0.3, spring nodes 204.1.0, Data-Shapes 2021.2.92, Genius Loci 2021.1.20

document_category = Categories("OST_Walls")  # graph input
all_elements_of_category = ElementsOfCategory(Category=document_category)
string = StringInput("Select Revit Link")
boolean = BoolSelector(true)
string_2 = StringInput("Finish")
string_3 = StringInput("Link Instance")
getDocuments = archilab.Revit.Selection.Select.GetDocuments()
dropdown_data = Custom[DropDown Data](InputName=string_3, Keys=getDocuments.Link_Name, Values=getDocuments.Link_Instance)  # package Data-Shapes; Create data for DropDown input in UI.MultiInputForm ++ . Check out www.data-shapes.net for more infos.
string_4 = StringInput("Cancel")
multipleinputform = Custom[MultipleInputForm ++](Description_optional=string, Logo_optional=boolean, ButtonText_optional=string_2, Inputs=dropdown_data, Toggle=boolean, CancelButtonText_optional=string_4)  # package Data-Shapes; Create a form with multiple inputs. see www.data-shapes.net for tutorials and infos!
revit_link_category = Categories("OST_PipeCurves")  # graph input
ofCategory = Revit.LinkElement.OfCategory(linkInstance=multipleinputform.User_Inputs, Category=revit_link_category)
element = Revit.LinkElement.Element(linkElement=ofCategory)

# group: STREAMLINE SCRIPT TO SINGLE WALL SELECTION
multiple_walls_true_all_walls = BoolSelector(true)  # "Multiple Walls (True), All Walls (False)"; graph input
select_model_elements_of = Custom[Select Model Elements of Category](Categories=document_category, Toggle=multiple_walls_true_all_walls)  # package Data-Shapes; Allows to perform a manual selection with a category filter.
python_script = Python(IN[0]=multiple_walls_true_all_walls, IN[1]=select_model_elements_of, IN[2]=all_elements_of_category)
# ---------- python_script.python (23 lines) ----------
# Load the Python Standard and DesignScript Libraries
import sys
import clr
clr.AddReference('ProtoGeometry')
from Autodesk.DesignScript.Geometry import *

# The inputs to this node will be stored as a list in the IN variables.
dataEnteringNode = IN

bool = IN[0]
single = IN[1]
multiple = IN[2]

output = []
# Place your code below this line
if bool == True:
	output.append(single)
elif bool == False:
	output.append(multiple)


# Assign your output to the OUT variable.
OUT = output
# ----------------------------------------
flatten = List.Flatten(list=python_script)
getDocuments_2 = archilab.Revit.Selection.Select.GetDocuments()
getsurroundingelements_in = Custom[GetSurroundingElements in Document](element=select_model_elements_of, ElementCheck=element, docOrRevitLinkInstance=getDocuments_2.Link_Instance)  # package Genius Loci; Get Surrounding Elements by Categories, group them as List. Tolerance distance available in linked document. Based on a SteamNodes node
flatten_2 = List.Flatten(list=getsurroundingelements_in)
string_from_object = FromObject(obj=flatten_2)
string_from_object_2 = FromObject(obj=element)
flatten_3 = List.Flatten(list=string_from_object_2)
uniqueItems = List.UniqueItems(list=flatten_3)
allIndicesOf = List.AllIndicesOf(list=string_from_object, item=uniqueItems)
flatten_4 = List.Flatten(list=allIndicesOf)
getItemAtIndex = List.GetItemAtIndex(list=flatten_2, index=flatten_4)
flatten_5 = List.Flatten(list=element)
python_script_2 = Python(IN[0]=multiple_walls_true_all_walls, IN[1]=getItemAtIndex, IN[2]=flatten_5)  # same code as python_script
flatten_6 = List.Flatten(list=python_script_2)

# group: GET ALL INTERSECTION BETWEEN PIPES AND WALLS; AND THEIR LOCATION
geometry = Element.Geometry(element=flatten)
flatten_7 = List.Flatten(list=geometry)
geometry_2 = Element.Geometry(element=flatten_6)
flatten_8 = List.Flatten(list=geometry_2)
intersect = Geometry.Intersect(geometry=flatten_7, other=flatten_8, lacing=CrossProduct)
flatten_9 = List.Flatten(list=intersect)
centroid = Solid.Centroid(solid=flatten_9)

# group: Get the intersected Walls in order
boundingBox = Geometry.BoundingBox(geometry=geometry)
flatten_10 = List.Flatten(list=boundingBox)
contains = BoundingBox.Contains(boundingBox=flatten_10, point=centroid, lacing=CrossProduct)
transpose = List.Transpose(lists=contains)
boolean_2 = BoolSelector(true)
indexOf = List.IndexOf(element=boolean_2)  # unwired: list
map = List.Map(list=transpose, f_x=indexOf)
getItemAtIndex_2 = List.GetItemAtIndex(list=flatten, index=map)

opening_family_types = FamilyTypes("Wall opening - Circle:Circle")  # graph input
flatten_11 = List.Flatten(list=flatten_6)
boundingBox_2 = Geometry.BoundingBox(geometry=flatten_8)
contains_2 = BoundingBox.Contains(boundingBox=boundingBox_2, point=centroid, lacing=CrossProduct)
transpose_2 = List.Transpose(lists=contains_2)
boolean_3 = BoolSelector(true)
indexOf_2 = List.IndexOf(element=boolean_3)  # unwired: list
map_2 = List.Map(list=transpose_2, f_x=indexOf_2)
getItemAtIndex_3 = List.GetItemAtIndex(list=flatten_11, index=map_2)
pipe_size_parameter_name = StringInput("Diameter")  # graph input
getParameterValueByName = Element.GetParameterValueByName(element=getItemAtIndex_3, parameterName=pipe_size_parameter_name)
opening_scale_factor = DoubleInput(2)  # graph input
mul = getParameterValueByName * opening_scale_factor
opening_height_modifier = DoubleInput(2)  # graph input
code_block = CodeBlock(size=mul, factor=opening_height_modifier) { a = size-(size/factor); b = -a; }
translate = Geometry.Translate(geometry=centroid, zTranslation=code_block.b)
ꟿ_familyinstance_byhostandpoint = Custom[ꟿ FamilyInstance.ByHostAndPoint](host=getItemAtIndex_2, type=opening_family_types, point=translate)  # package spring nodes; Creates hosted family instances(doors/windows) at the specified points. You can feed either a single family type or a unique type for each instance.
opening_size_parameter_name = StringInput("Size")  # graph input
setParameterByName = Element.SetParameterByName(element=ꟿ_familyinstance_byhostandpoint, parameterName=opening_size_parameter_name, value=mul)
