# Dynamo graph Element View Generation.dyn (Dynamo 1.3.0.875)

# group: DESCRIPTION
# note: DYNAMO FILE NAME
# Element View Generation.dyn
# note: ASSOCIATED REVIT FILE(S)
# Element View Generation.rvt
# note: AUTHOR(S)
# Dieter Vermeulen (Autodesk)
# note: DESCRIPTION
# With this script it is possible to automatically create aligned section views on selected elements.
# In this script it is already set up for Structural Framing and Structural Columns.
# Necessary inputs are:
# Revit Elements: this to detect the solid.centroid. The views are oriented to that point
# X- and Y-vectors : to get the direction of the section plane. Traditionally these vectors are taken from the location lines of linear objects. You might replace this with a selected edge for instance.
# note: DYNAMO VERSION
# 1.2.1.3083
# note: WORKING REVIT VERSION(S)
# 2017
# note: REQUIRED DYNAMO PACKAGES
# BIM4Struc.Productivity

# group: Structural Columns
categories = Categories("StructuralColumns")
all_elements_of_category = ElementsOfCategory(categories)

# note: Placeholder for the elements, so you can add simply a new input method for selecting the elements.
code_block = CodeBlock(elements=all_elements_of_category) { elements; }

# group: Get local principal vectors and combine them
boolean = BoolSelector(false)
# note: Get the insertion base point and the local XYZ vectors of the structural column. The column can be either vertical or slanted.
localCoordinateSystem = Custom[Element.LocalCoordinateSystem](element=code_block)  # Get the insertion point and local axes of an element.
reverse = Vector.Reverse(localCoordinateSystem.Xvector)
# note: FLIP SECTION ?
if_ = If(test=boolean, true=reverse, false=localCoordinateSystem.Xvector)
# note: Combine the vectors in a way that will define the Section view crop region orientation.
# 0 = Cross section
# 1 = Front view
# 2 = Side view
x_vectors_list_join = List.Join(if_, if_, localCoordinateSystem.Yvector)
y_vectors_list_join = List.Join(localCoordinateSystem.Yvector, localCoordinateSystem.Zvector, localCoordinateSystem.Zvector)

# group: BOUNDARY OFFSETS
offset_around_element_number = DoubleSlider(500, range=0..2000 step 100)  # "Offset around element / Number Slider"
view_depth_number_slider = DoubleSlider(1000, range=50..2000 step 100)

# group: Definition of the view names
code_block_2 = CodeBlock { "Mark"; }
getParameterValueByName = Element.GetParameterValueByName(element=code_block, parameterName=code_block_2)
code_block_3 = CodeBlock(Suffix=getParameterValueByName) { "Cross - " + Suffix; }
code_block_4 = CodeBlock(Suffix=getParameterValueByName) { "Front - " + Suffix; }
code_block_5 = CodeBlock(Suffix=getParameterValueByName) { "Side - " + Suffix; }
y_vector_list_create = List.Create(code_block_3, code_block_4, code_block_5)
flatten = Flatten(y_vector_list_create)

# group: Views Center Point (auxiliary)
code_block_6 = CodeBlock { 1000; }
translate = Geometry.Translate(geometry=localCoordinateSystem.InsertionPoint, direction=localCoordinateSystem.Zvector, distance=code_block_6)
count = List.Count(y_vector_list_create)
# note: Create sublists of elements, so it fits with the number of view types that need to be generated.
# Alternatively you could choose different view center points for each view type to be created. In this case the same point is used for the three view types.
cycle = List.Cycle(list=translate, amount=count)

# group: Element subsets
count_2 = List.Count(y_vector_list_create)
# note: Create sublists of elements, so it fits with the number of view types that need to be generated.
cycle_2 = List.Cycle(list=code_block, amount=count_2)

create_element_view = Custom[Create Element View](Xvector=x_vectors_list_join, Yvector=y_vectors_list_join, CropRegionOffset=offset_around_element_number, ViewDepth=view_depth_number_slider, CSPoint=cycle, RevitElements=cycle_2, Viewname=flatten)  # This node makes it possible to automatically create aligned section views on selected elements. Necessary inputs are: Revit Elements: this to detect the solid.centroid. The views are oriented to that point. X-vectors and Y-vectors to get the direction of the section plane. Traditionally these vectors are taken from the location lines of linear objects or facing directions of generic elements (i.e. doors). You might replace this with the vector of a selected edge for instance.

# group: Structural Framing
categories_2 = Categories("StructuralFraming")
all_elements_of_category_2 = ElementsOfCategory(categories_2)
select_model_elements = DSModelElementsSelection()  # 7 picked in the model

# group: Views Center Point (solid centroid)
solids = Element.Solids(cycle_2)
flatten_2 = Flatten(solids)
centroid = Solid.Centroid(flatten_2)

code_block_7 = CodeBlock(elements=select_model_elements) { elements; }

# group: Get local principal vectors and combine them
boolean_2 = BoolSelector(true)
# note: Get the insertion base point and the local XYZ vectors of the structural framing. Use the ChooseSide input to select the start or end point of the beam.
localCoordinateSystem_2 = Custom[StructuralFraming.LocalCoordinateSystem](element=code_block_7, ChooseSide=boolean_2)  # Get the insertion point and local axes of a structural framing.

code_block_8 = CodeBlock(vec=localCoordinateSystem_2.Yvector) { vec; }

# group: Structural Framing - Cross Sections
boolean_3 = BoolSelector(false)
reverse_2 = Vector.Reverse(code_block_8)
# note: FLIP SECTION ?
if_2 = If(test=boolean_3, true=reverse_2, false=code_block_8)
code_block_9 = CodeBlock { CropRegionOffset = 500; ViewDepth=1000; }
# note: DEFINITION OF THE VIEW CENTER
location = StructuralFraming.Location(code_block_7)
code_block_10 = CodeBlock { 1000; }
# note: Create sublists of elements, so it fits with the number of view types that need to be generated.
# Alternatively you could choose different view center points for each view type to be created. In this case the same point is used for the three view types.
pointAtSegmentLength = Curve.PointAtSegmentLength(curve=location, segmentLength=code_block_10)
code_block_11 = CodeBlock { "Mark"; }
# note: DEFINITION OF THE VIEW NAME
getParameterValueByName_2 = Element.GetParameterValueByName(element=code_block_7, parameterName=code_block_11)
code_block_12 = CodeBlock(Suffix=getParameterValueByName_2) { "Cross - " + Suffix; }
create_element_view_2 = Custom[Create Element View](Xvector=if_2, Yvector=localCoordinateSystem_2.Zvector, CropRegionOffset=code_block_9.CropRegionOffset, ViewDepth=code_block_9.ViewDepth, CSPoint=pointAtSegmentLength, RevitElements=code_block_7, Viewname=code_block_12)

# group: Structural Framing - Top Views
boolean_4 = BoolSelector(false)
code_block_13 = CodeBlock(vec=localCoordinateSystem_2.Xvector) { vec; }
reverse_3 = Vector.Reverse(code_block_13)
# note: FLIP SECTION ?
if_3 = If(test=boolean_4, true=reverse_3, false=code_block_13)
code_block_14 = CodeBlock { CropRegionOffset = 500; ViewDepth=1000; }
# note: DEFINITION OF THE VIEW CENTER
solids_2 = Element.Solids(code_block_7)
flatten_3 = Flatten(solids_2)
centroid_2 = Solid.Centroid(flatten_3)
code_block_15 = CodeBlock { "Mark"; }
# note: DEFINITION OF THE VIEW NAME
getParameterValueByName_3 = Element.GetParameterValueByName(element=code_block_7, parameterName=code_block_15)
code_block_16 = CodeBlock(Suffix=getParameterValueByName_3) { "Top - " + Suffix; }
create_element_view_3 = Custom[Create Element View](Xvector=if_3, Yvector=localCoordinateSystem_2.Yvector, CropRegionOffset=code_block_14.CropRegionOffset, ViewDepth=code_block_14.ViewDepth, CSPoint=centroid_2, RevitElements=code_block_7, Viewname=code_block_16)

# group: Structural Framing - Front Views
boolean_5 = BoolSelector(false)
code_block_17 = CodeBlock(vec=localCoordinateSystem_2.Xvector) { vec; }
reverse_4 = Vector.Reverse(code_block_17)
# note: FLIP SECTION ?
if_4 = If(test=boolean_5, true=reverse_4, false=code_block_17)
code_block_18 = CodeBlock { CropRegionOffset = 500; ViewDepth=1000; }
# note: DEFINITION OF THE VIEW CENTER
solids_3 = Element.Solids(code_block_7)
flatten_4 = Flatten(solids_3)
centroid_3 = Solid.Centroid(flatten_4)
code_block_19 = CodeBlock { "Mark"; }
# note: DEFINITION OF THE VIEW NAME
getParameterValueByName_4 = Element.GetParameterValueByName(element=code_block_7, parameterName=code_block_19)
code_block_20 = CodeBlock(Suffix=getParameterValueByName_4) { "Front - " + Suffix; }
create_element_view_4 = Custom[Create Element View](Xvector=if_4, Yvector=localCoordinateSystem_2.Zvector, CropRegionOffset=code_block_18.CropRegionOffset, ViewDepth=code_block_18.ViewDepth, CSPoint=centroid_3, RevitElements=code_block_7, Viewname=code_block_20)

# group: Generic Models
select_model_elements_2 = DSModelElementsSelection()  # 2 picked in the model

code_block_21 = CodeBlock(elements=select_model_elements_2) { elements; }

# group: Get local principal vectors and combine them
boolean_6 = BoolSelector(false)
# note: Get the insertion base point and the local XYZ vectors of the structural column. The column can be either vertical or slanted.
localCoordinateSystem_3 = Custom[Element.LocalCoordinateSystem](element=code_block_21)
reverse_5 = Vector.Reverse(localCoordinateSystem_3.Xvector)
# note: FLIP SECTION ?
if_5 = If(test=boolean_6, true=reverse_5, false=localCoordinateSystem_3.Xvector)
# note: Combine the vectors in a way that will define the Section view crop region orientation.
# 0 = Cross section
# 1 = Front view
# 2 = Side view
x_vectors_list_join_2 = List.Join(if_5, if_5, localCoordinateSystem_3.Yvector)
y_vectors_list_join_2 = List.Join(localCoordinateSystem_3.Yvector, localCoordinateSystem_3.Zvector, localCoordinateSystem_3.Zvector)

# group: Definition of the view names
code_block_22 = CodeBlock { "Mark"; }
getParameterValueByName_5 = Element.GetParameterValueByName(element=code_block_21, parameterName=code_block_22)
code_block_23 = CodeBlock(Suffix=getParameterValueByName_5) { "Cross - " + Suffix; }
code_block_24 = CodeBlock(Suffix=getParameterValueByName_5) { "Front - " + Suffix; }
code_block_25 = CodeBlock(Suffix=getParameterValueByName_5) { "Side - " + Suffix; }
y_vector_list_create_2 = List.Create(code_block_23, code_block_24, code_block_25)
flatten_5 = Flatten(y_vector_list_create_2)

# group: Element subsets
count_3 = List.Count(y_vector_list_create_2)
# note: Create sublists of elements, so it fits with the number of view types that need to be generated.
cycle_3 = List.Cycle(list=code_block_21, amount=count_3)

# group: Views Center Point (solid centroid)
solids_4 = Element.Solids(cycle_3)
flatten_6 = Flatten(solids_4)
centroid_4 = Solid.Centroid(flatten_6)

create_element_view_5 = Custom[Create Element View](Xvector=x_vectors_list_join_2, Yvector=y_vectors_list_join_2, CropRegionOffset=offset_around_element_number, ViewDepth=view_depth_number_slider, CSPoint=centroid_4, RevitElements=cycle_3, Viewname=flatten_5)
code_block_26 = CodeBlock { 1000; }
vector_visualizer = Custom[Vector Visualizer](origin=localCoordinateSystem_3.InsertionPoint, Xvector=localCoordinateSystem_3.Xvector, Yvector=localCoordinateSystem_3.Yvector, Zvector=localCoordinateSystem_3.Zvector, LineLength=code_block_26)  # Visualize XYZ vectors with RGB colored lines in the Dynamo canvas

# group: Doors
categories_3 = Categories("Doors")
all_elements_of_category_3 = ElementsOfCategory(categories_3)

code_block_27 = CodeBlock(elements=all_elements_of_category_3) { elements; }

# group: Get local principal vectors and combine them
boolean_7 = BoolSelector(false)
# note: Get the insertion base point and the local XYZ vectors of the structural column. The column can be either vertical or slanted.
localCoordinateSystem_4 = Custom[Element.LocalCoordinateSystem](element=code_block_27)
reverse_6 = Vector.Reverse(localCoordinateSystem_4.Xvector)
# note: FLIP SECTION ?
if_6 = If(test=boolean_7, true=reverse_6, false=localCoordinateSystem_4.Xvector)
# note: Combine the vectors in a way that will define the Section view crop region orientation.
# 0 = Cross section
# 1 = Front view
# 2 = Side view
x_vectors_list_join_3 = List.Join(if_6, if_6, localCoordinateSystem_4.Yvector)
y_vectors_list_join_3 = List.Join(localCoordinateSystem_4.Yvector, localCoordinateSystem_4.Zvector, localCoordinateSystem_4.Zvector)

# group: Definition of the view names
code_block_28 = CodeBlock { "Mark"; }
getParameterValueByName_6 = Element.GetParameterValueByName(element=code_block_27, parameterName=code_block_28)
code_block_29 = CodeBlock(Suffix=getParameterValueByName_6) { "Cross - " + Suffix; }
code_block_30 = CodeBlock(Suffix=getParameterValueByName_6) { "Front - " + Suffix; }
code_block_31 = CodeBlock(Suffix=getParameterValueByName_6) { "Side - " + Suffix; }
y_vector_list_create_3 = List.Create(code_block_29, code_block_30, code_block_31)
flatten_7 = Flatten(y_vector_list_create_3)

# group: Views Center Point (auxiliary)
code_block_32 = CodeBlock { 1000; }
translate_2 = Geometry.Translate(geometry=localCoordinateSystem_4.InsertionPoint, direction=localCoordinateSystem_4.Zvector, distance=code_block_32)
count_4 = List.Count(y_vector_list_create_3)
# note: Create sublists of elements, so it fits with the number of view types that need to be generated.
# Alternatively you could choose different view center points for each view type to be created. In this case the same point is used for the three view types.
cycle_4 = List.Cycle(list=translate_2, amount=count_4)

# group: Element subsets
count_5 = List.Count(y_vector_list_create_3)
# note: Create sublists of elements, so it fits with the number of view types that need to be generated.
cycle_5 = List.Cycle(list=code_block_27, amount=count_5)

create_element_view_6 = Custom[Create Element View](Xvector=x_vectors_list_join_3, Yvector=y_vectors_list_join_3, CropRegionOffset=offset_around_element_number, ViewDepth=view_depth_number_slider, CSPoint=cycle_4, RevitElements=cycle_5, Viewname=flatten_7)

# group: Visualization
geometry = Element.Geometry(code_block_27)
code_block_33 = CodeBlock { 1000; }
vector_visualizer_2 = Custom[Vector Visualizer](origin=localCoordinateSystem_4.InsertionPoint, Xvector=localCoordinateSystem_4.Xvector, Yvector=localCoordinateSystem_4.Yvector, Zvector=localCoordinateSystem_4.Zvector, LineLength=code_block_33)
