# Dynamo graph Assign View Templates.dyn (Dynamo 2.6.1.8786)
# packages: Modelical 2.2.19, Data-Shapes 2022.2.96, GenerativeDesign 1.3.1

code_block = CodeBlock { "VIEW TEMPLATES"; "VIEWS"; }
python_script = Python()
# ---------- python_script.python (60 lines) ----------
import clr
clr.AddReference('ProtoGeometry')
from Autodesk.DesignScript.Geometry import *

# Import DocumentManager and TransactionManager
clr.AddReference("RevitServices")
import RevitServices
from RevitServices.Persistence import DocumentManager
from RevitServices.Transactions import TransactionManager

# Import RevitAPI
clr.AddReference("RevitAPI")
import Autodesk
from Autodesk.Revit.DB import *

doc = DocumentManager.Instance.CurrentDBDocument

#The inputs to this node will be stored as a list in the IN variable.

collector = FilteredElementCollector(doc).OfClass(View)

templateList = []
AllViews = []
for i in collector:
	if i.ViewType.ToString() != "ThreeD":
		AllViews.append(i)
		if i.IsTemplate == True:	
			templateList.append(i)

VTType = []
for tview in templateList:
	if tview.ViewType.ToString() != "ThreeD":
		VTType.append(tview.ViewType.ToString())

ViewType = []
for view in AllViews:
	Vstring = view.ViewType.ToString()
	if Vstring != "ThreeD" and Vstring != "Schedule" and Vstring != "DrawingSheet" and Vstring != "ProjectBrowser" and Vstring != "SystemBrowser" and Vstring != "ColumnSchedule":
		ViewType.append(Vstring)


def GroupByKeys(Keys,Values):
	Unique_Keys = list(set(Keys))
	combination = zip(Keys,Values)
	Groups = []
	for key in Unique_Keys:
		ThisGroup = []
		for combo in combination:
			if combo[0] == key:
				ThisGroup.append(combo[1])
		Groups.append(ThisGroup)
	return Unique_Keys, Groups
	
Key_TemplateTypes = GroupByKeys(VTType,templateList)[0]		
Group_Templates = GroupByKeys(VTType,templateList)[1]
Key_Views = GroupByKeys(ViewType,AllViews)[0]
Group_Views = GroupByKeys(ViewType,AllViews)[1]

OUT = Key_Views,Group_Views,Key_TemplateTypes,Group_Templates
#ViewType,AllViews,Unique_Types,groups#combined,thisgroup
# ----------------------------------------
code_block_2 = CodeBlock(x=python_script) { Viewtypes = x[0]; ViewGroups = x[1]; TemplateTypes = x[2]; Templates = x[3]; }
flatten = List.Flatten(list=code_block_2.Templates)
name = Element.Name(element=flatten)
listview_data = Custom[Listview Data](InputName=code_block.out0, Keys=name, Values=flatten)  # package Data-Shapes; Create data for ListView input in UI.MultiInputForm ++ . Check out www.data-shapes.net for more infos.
python_script_2 = Python()
# ---------- python_script_2.python (65 lines) ----------
import clr
clr.AddReference('ProtoGeometry')
from Autodesk.DesignScript.Geometry import *

# Import DocumentManager and TransactionManager
clr.AddReference("RevitServices")
import RevitServices
from RevitServices.Persistence import DocumentManager
from RevitServices.Transactions import TransactionManager

# Import RevitAPI
clr.AddReference("RevitAPI")
import Autodesk
from Autodesk.Revit.DB import *

doc = DocumentManager.Instance.CurrentDBDocument

#The inputs to this node will be stored as a list in the IN variable.

collector = FilteredElementCollector(doc).OfClass(View)

templateList = []
AllViews = []
for i in collector:
	if i.ViewType.ToString() != None:
		AllViews.append(i)
		if i.IsTemplate == True:	
			templateList.append(i)

VTType = []
for tview in templateList:
	if tview.ViewType.ToString() != None:
		VTType.append(tview.ViewType.ToString())

ViewType = []
for view in AllViews:
	Vstring = view.ViewType.ToString()
	if Vstring != "Schedule" and Vstring != "DrawingSheet" and Vstring != "ProjectBrowser" and Vstring != "SystemBrowser" and Vstring != "ColumnSchedule":
		ViewType.append(Vstring)

threeD = []
for c in collector:
	if c.ViewType.ToString() == "ThreeD":	
		threeD.append(c)


def GroupByKeys(Keys,Values):
	Unique_Keys = list(set(Keys))
	combination = zip(Keys,Values)
	Groups = []
	for key in Unique_Keys:
		ThisGroup = []
		for combo in combination:
			if combo[0] == key:
				ThisGroup.append(combo[1])
		Groups.append(ThisGroup)
	return Unique_Keys, Groups
	
Key_TemplateTypes = GroupByKeys(VTType,templateList)[0]		
Group_Templates = GroupByKeys(VTType,templateList)[1]
Key_Views = GroupByKeys(ViewType,AllViews)[0]
Group_Views = GroupByKeys(ViewType,AllViews)[1]

OUT = threeD
#ViewType,AllViews,Unique_Types,groups#combined,thisgroup
# ----------------------------------------
boolean = BoolSelector(false)
clean = List.Clean(list=python_script_2, preserveIndices=boolean)
code_block_3 = CodeBlock(x=clean) { [x]; }
join = List.Join(list0=code_block_2.ViewGroups, list1=code_block_3)
boolean_2 = BoolSelector(false)
treeview_input = Custom[TreeView input](InputName=code_block.out1, Data=join, FirstItemIsTitle=boolean_2)  # package Data-Shapes; Create a TreeView input for UI.MultipleInputForm ++ . Check out www.data-shapes.net for more infos and tips!
join_2 = List.Join(list0=listview_data, list1=treeview_input)
boolean_3 = BoolSelector(true)
multipleinputform = Custom[MultipleInputForm ++](Inputs=join_2, Toggle=boolean_3)  # package Data-Shapes; Create a form with multiple inputs. see www.data-shapes.net for tutorials and infos!
code_block_4 = CodeBlock(result=multipleinputform.User_Inputs) { views = result[1]; }
gate = Data.Gate(false, code_block_4)
string = StringInput("PAC - 3D COLUMN REBARS")
applyViewTemplate = Custom[ApplyViewTemplate](views=gate, TempNames=string)  # package Modelical; Apply ViewTemplate(s) to selected view(s).
name_2 = Element.Name()  # unwired: element
watch = Watch(code_block_2.Viewtypes)
watch_2 = Watch(code_block_2.ViewGroups)
code_block_5 = CodeBlock { "View Category"; "COLUMNS"; }
setParameterByName = Element.SetParameterByName(element=code_block_4, parameterName=code_block_5.out0, value=code_block_5.out1)
gate_2 = Data.Gate(true)  # unwired: arg0
