# Dynamo graph Create Beam Elevation Views.dyn (Dynamo 2.12.0.5650)

# group: PYTHON SCRIPT
section_type_name = StringInput("KSD - Cross Section")
code_block = CodeBlock { 100; }
python_script = Python(IN[0]=section_type_name, IN[1]=code_block)  # IronPython2
# ---------- python_script.python (135 lines) ----------
#Created by KEHINDE AYOBADE
#FREE FOR USE
#https://www.linkedin.com/kehinde-ayobade

import sys
import clr
clr.AddReference('ProtoGeometry')
from Autodesk.DesignScript.Geometry import *

clr.AddReference("RevitNodes")
import Revit
clr.ImportExtensions(Revit.Elements)
clr.ImportExtensions(Revit.GeometryConversion)

clr.AddReference("RevitServices")
import RevitServices
from RevitServices.Persistence import DocumentManager 
from RevitServices.Transactions import TransactionManager 

clr.AddReference("RevitAPI")
from Autodesk.Revit.DB import *

clr.AddReference("RevitAPIUI")
from Autodesk.Revit.UI import *

doc = DocumentManager.Instance.CurrentDBDocument
uiapp = DocumentManager.Instance.CurrentUIApplication 
app = uiapp.Application 
uidoc = uiapp.ActiveUIDocument

def PickedBeams():
	class MySelectionFilter(Selection.ISelectionFilter):
		def __init__(self):
			pass
		def AllowElement(self, element):
			if element.Category.Name == "Structural Framing":
				return True
			else:
				return False
		def AllowReference(self, element):
			return False
	
	refresh = True
	beams = []
	
	
	Sel_filter = MySelectionFilter()
	obj_type = Selection.ObjectType.Element
	
	if refresh:
		selection = uidoc.Selection.PickObjects(obj_type,Sel_filter,"Select Structural Framing Element")
		
		for elems in selection:
				beams.append(Document.GetElement(doc,elems))
	else:
		beams.append("Please Set Toggle to True")
		beams = beams[0]
		
	return beams
	
Struct_beams = PickedBeams()

# wall selection
beams = Struct_beams

if not isinstance(beams, list):
    beams = [beams]

sectionTypeName = IN[0]

feet = 304.8

offset = (IN[1])/feet

viewFamilyTypes = FilteredElementCollector(doc).OfClass(ViewFamilyType).ToElements()

ds = []
newSections = []
viewFamilyTypeId = []

for vf in viewFamilyTypes:
	if vf.get_Parameter(BuiltInParameter.SYMBOL_NAME_PARAM).AsString() == sectionTypeName:
		viewFamilyTypeId.append(vf.Id)

for beam in beams:
	beamCrv = beam.Location.Curve
	beamLen = beamCrv.Length
	beamHeight = float(Document.GetElement(doc,beam.GetTypeId()).GetParameters("h")[0].AsValueString())/feet
	beamWidth = float(Document.GetElement(doc,beam.GetTypeId()).GetParameters("b")[0].AsValueString())/feet
	beamId = beam.GetTypeId()
	beamMid = beamCrv.Evaluate(0.5,True)
	XbeamDir = beamCrv.Direction.Normalize()
	YbeamDir = XYZ.BasisZ
	ZbeamDir = XbeamDir.CrossProduct(YbeamDir)
	
	#Min and Max values
	Min = -beamLen/2
	Max = beamLen/2
	
	cs = CoordinateSystem.ByOriginVectors(beamMid.ToPoint(),XbeamDir.ToVector(),YbeamDir.ToVector(),ZbeamDir.ToVector())
	
	#MinPoint and MaxPoint 
	MinPoint = XYZ(Min-offset,-beamHeight-offset,-offset-0.5*beamWidth)
	MaxPoint = XYZ(Max+offset,offset,offset+0.5*beamWidth)
		
	t = Transform.Identity
	t.Origin = beamMid
	t.BasisX = XbeamDir
	t.BasisY = YbeamDir
	t.BasisZ = ZbeamDir
	
	sectionBox = BoundingBoxXYZ();
	sectionBox.Transform = t
	sectionBox.Min = MinPoint # scope box bottom
	sectionBox.Max = MaxPoint # scope box top
#	
	TransactionManager.Instance.EnsureInTransaction(doc)
	for SectTypeId in viewFamilyTypeId:
		newSection = ViewSection.CreateSection(doc, SectTypeId, sectionBox)
		newSections.append(newSection)
	TransactionManager.Instance.TransactionTaskDone()
	
	TransactionManager.Instance.EnsureInTransaction(doc)
	TransactionManager.Instance.ForceCloseTransaction()
	
	view = newSections
	uidoc.RequestViewChange(view[0])
	
	success = []
	if doc.ActiveView.Name != view[0].Name:
		success.append('Active View is ' + view[0].Name.ToString())
	else:
		success.append('Active View is ' + doc.ActiveView.Name.ToString())

OUT =  success[-1]
# ----------------------------------------
