# Dynamo graph Create Beam Section Views.dyn (Dynamo 2.12.0.5650)
# packages: BIM4Struc.Productivity 2.2.2, archi-lab.net 2022.210.2522

refresh = BoolSelector(true)  # graph input
python_script = Python(IN[0]=refresh)  # IronPython2
# ---------- python_script.python (55 lines) ----------
# Load the Python Standard and DesignScript Libraries
import sys
import clr
clr.AddReference('ProtoGeometry')
from Autodesk.DesignScript.Geometry import *

clr.AddReference("RevitNodes")
import Revit
clr.ImportExtensions(Revit.Elements)
clr.ImportExtensions(Revit.GeometryConversion)

clr.AddReference("RevitServices")
import RevitServices
from RevitServices.Persistence import DocumentManager 
from RevitServices.Transactions import TransactionManager 

clr.AddReference("RevitAPI")
from Autodesk.Revit.DB import *

clr.AddReference("RevitAPIUI")
from Autodesk.Revit.UI import *

doc = DocumentManager.Instance.CurrentDBDocument
uiapp = DocumentManager.Instance.CurrentUIApplication 
app = uiapp.Application 
uidoc = uiapp.ActiveUIDocument

class MySelectionFilter(Selection.ISelectionFilter):
	def __init__(self):
		pass
	def AllowElement(self, element):
		if element.Category.Name == "Structural Framing":
			return True
		else:
			return False
	def AllowReference(self, element):
		return False

refresh = IN[0]
beams = []


Sel_filter = MySelectionFilter()
obj_type = Selection.ObjectType.Element

if refresh:
	selection = uidoc.Selection.PickObjects(obj_type,Sel_filter,"Select Structural Framing Element")
	
	for elems in selection:
			beams.append(Document.GetElement(doc,elems))
else:
	beams.append("Please Set Toggle to True")
	beams = beams[0]
# Assign your output to the OUT variable.
OUT = beams
# ----------------------------------------
getLocation = Element.GetLocation(element=python_script)
direction = Line.Direction(line=getLocation)
ZAxis = Vector.ZAxis()
crop_region_offset_mm = DoubleInput(450)  # graph input
view_depth_mm = DoubleInput(1000)  # graph input
code_block = CodeBlock { 0.5; }
pointAtParameter = Curve.PointAtParameter(curve=getLocation, param=code_block)
string = StringInput("Mark")
getParameterValueByName = Element.GetParameterValueByName(element=python_script, parameterName=string)
code_block_2 = CodeBlock(mark=getParameterValueByName) { "BEAM" + " " + mark; }
groupByKey = List.GroupByKey(list=python_script, keys=code_block_2)
firstItem = List.FirstItem()  # unwired: list
map = List.Map(list=groupByKey.groups, f_x=firstItem)
count = List.Count(list=groupByKey.groups@L2)
python_script_2 = Python(IN[0]=groupByKey.uniqueKeys, IN[1]=count)  # IronPython2
# ---------- python_script_2.python (21 lines) ----------
# Load the Python Standard and DesignScript Libraries
import sys
import clr
clr.AddReference('ProtoGeometry')
from Autodesk.DesignScript.Geometry import *

# The inputs to this node will be stored as a list in the IN variables.
txt = IN[0]
qty = IN[1]

sect_name = []

for x,y in zip(txt,qty):
	mults = "({} Nos. Thus)"
	sect_name.append(x+" " + mults.format(str(y)))


# Place your code below this line

# Assign your output to the OUT variable.
OUT = sect_name
# ----------------------------------------
create_element_view = Custom[Create Element View](Xvector=direction, Yvector=ZAxis, CropRegionOffset=crop_region_offset_mm, ViewDepth=view_depth_mm, CSPoint=pointAtParameter, RevitElements=map, Viewname=python_script_2)  # package BIM4Struc.Productivity; This node makes it possible to automatically create aligned section views on selected elements. Necessary inputs are: Revit Elements: this to detect the solid.centroid. The views are oriented to that point. X-vectors and Y-vectors to get the direction of the section plane. Traditionally these vectors are taken from the location lines of linear objects or facing directions of generic elements (i.e. doors). You might replace this with the vector of a selected edge for instance.
view_template_to_assign = ViewTemplatesUi("KSD - BEAM REBAR ELEVATION (Scale 25)")  # graph input
setViewTemplate = archilab.Revit.Views.Views.SetViewTemplate(view=create_element_view, viewTemplate=view_template_to_assign)
string_2 = StringInput("Crop Region Visible")
code_block_3 = CodeBlock { 0; }
setParameterByName = Element.SetParameterByName(element=setViewTemplate, parameterName=string_2, value=code_block_3, lacing=Longest)
code_block_4 = CodeBlock(x=setParameterByName) { x[0]; }
python_script_3 = Python(IN[0]=code_block_4)  # IronPython2; graph output
# ---------- python_script_3.python (35 lines) ----------
# Load the Python Standard and DesignScript Libraries
import sys
import clr
clr.AddReference('ProtoGeometry')
from Autodesk.DesignScript.Geometry import *

clr.AddReference("RevitServices")
import RevitServices
from RevitServices.Persistence import DocumentManager 
from RevitServices.Transactions import TransactionManager 

clr.AddReference("RevitAPI")
from Autodesk.Revit.DB.DetailElementOrderUtils import BringToFront
from Autodesk.Revit.DB import Document as DOC


clr.AddReference("RevitAPIUI")
from Autodesk.Revit.UI.UIDocument import ActiveView

doc = DocumentManager.Instance.CurrentDBDocument
uidoc = DocumentManager.Instance.CurrentUIDocument

TransactionManager.Instance.EnsureInTransaction(doc)
TransactionManager.Instance.ForceCloseTransaction()

view = UnwrapElement(IN[0])
uidoc.RequestViewChange(view)

success = []
if doc.ActiveView.Name != view.Name:
	success.append('Active View is ' + doc.ActiveView.Name.ToString())
else:
	success.append('Active View is ' + view.Name.ToString())

OUT = success[-1]
# ----------------------------------------
