# Dynamo graph Create Element Section Views.dyn (Dynamo 2.12.0.5650)
# packages: archi-lab.net 2022.210.2522

# group: INPUTS
refresh = BoolSelector(true)
offset = DoubleInput(250)

# group: SELECT BEAMS IN VIEW
python_script = Python(IN[0]=refresh)  # IronPython2
# ---------- python_script.python (68 lines) ----------
#Created by KEHINDE AYOBADE
#FREE FOR US
#https://www.linkedin.com/notifications/
# Load the Python Standard and DesignScript Libraries
import sys
import clr
clr.AddReference('ProtoGeometry')
from Autodesk.DesignScript.Geometry import *

clr.AddReference("RevitNodes")
import Revit
clr.ImportExtensions(Revit.Elements)
clr.ImportExtensions(Revit.GeometryConversion)

clr.AddReference("RevitServices")
import RevitServices
from RevitServices.Persistence import DocumentManager 
from RevitServices.Transactions import TransactionManager 

clr.AddReference("RevitAPI")
from Autodesk.Revit.DB import *

clr.AddReference("RevitAPIUI")
from Autodesk.Revit.UI import *

doc = DocumentManager.Instance.CurrentDBDocument
uiapp = DocumentManager.Instance.CurrentUIApplication 
app = uiapp.Application 
uidoc = uiapp.ActiveUIDocument




def PickedBeams():
	class MySelectionFilter(Selection.ISelectionFilter):
		def __init__(self):
			pass
		def AllowElement(self, element):
			if element.Category.Name == "Structural Framing":
				return True
			else:
				return False
		def AllowReference(self, element):
			return False
	
	refresh = IN[0]
	beams = []
	
	
	Sel_filter = MySelectionFilter()
	obj_type = Selection.ObjectType.Element
	
	if refresh:
		selection = uidoc.Selection.PickObjects(obj_type,Sel_filter,"Select Structural Framing Element")
		
		for elems in selection:
				beams.append(Document.GetElement(doc,elems))
	else:
		beams.append("Please Set Toggle to True")
		beams = beams[0]
		
	return beams
	
Struct_beams = PickedBeams()


# Assign your output to the OUT variable.
OUT = Struct_beams
# ----------------------------------------

# group: PYTHON SCRIPT
string = StringInput("KSD - Cross Section")
code_block = CodeBlock { 200; }
python_script_2 = Python(IN[0]=python_script, IN[1]=string, IN[2]=code_block)  # IronPython2
# ---------- python_script_2.python (100 lines) ----------
#Created by KEHINDE AYOBADE
#FREE FOR USE
#https://www.linkedin.com/kehinde-ayobade

import sys
import clr
clr.AddReference('ProtoGeometry')
from Autodesk.DesignScript.Geometry import *

clr.AddReference("RevitNodes")
import Revit
clr.ImportExtensions(Revit.Elements)
clr.ImportExtensions(Revit.GeometryConversion)

clr.AddReference("RevitServices")
import RevitServices
from RevitServices.Persistence import DocumentManager 
from RevitServices.Transactions import TransactionManager 

clr.AddReference("RevitAPI")
from Autodesk.Revit.DB import *

clr.AddReference("RevitAPIUI")
from Autodesk.Revit.UI import *

doc = DocumentManager.Instance.CurrentDBDocument
uiapp = DocumentManager.Instance.CurrentUIApplication 
app = uiapp.Application 
uidoc = uiapp.ActiveUIDocument


# wall selection
beams = UnwrapElement(IN[0])

if not isinstance(IN[0], list):
    beams = [beams]

sectionTypeName = IN[1]

feet = 304.8

offset = (IN[2])/feet

viewFamilyTypes = FilteredElementCollector(doc).OfClass(ViewFamilyType).ToElements()

ds = []
newSections = []
viewFamilyTypeId = []

for vf in viewFamilyTypes:
	if vf.get_Parameter(BuiltInParameter.SYMBOL_NAME_PARAM).AsString() == sectionTypeName:
		viewFamilyTypeId.append(vf.Id)

for beam in beams:
	beamCrv = beam.Location.Curve
	beamLen = beamCrv.Length
	beamHeight = float(Document.GetElement(doc,beam.GetTypeId()).GetParameters("h")[0].AsValueString())/feet
	beamWidth = float(Document.GetElement(doc,beam.GetTypeId()).GetParameters("b")[0].AsValueString())/feet
	beamId = beam.GetTypeId()
	beamMid = beamCrv.Evaluate(0.5,True)
	XbeamDir = beamCrv.Direction.Normalize()
	YbeamDir = XYZ.BasisZ
	ZbeamDir = XbeamDir.CrossProduct(YbeamDir)
	
	
	#Min and Max values
	Min = -beamLen/2
	Max = beamLen/2
	
	cs = CoordinateSystem.ByOriginVectors(beamMid.ToPoint(),XbeamDir.ToVector(),YbeamDir.ToVector(),ZbeamDir.ToVector())
	
	#MinPoint and MaxPoint 
	MinPoint = XYZ(Min-offset,-beamHeight-offset,-offset-0.5*beamWidth)
	MaxPoint = XYZ(Max+offset,offset,offset+0.5*beamWidth)
	
	View3Dcollector = FilteredElementCollector(doc)
	View3Dcollector = View3Dcollector.OfClass(View3D)
	View3Dcollector = View3Dcollector.WhereElementIsNotElementType()
	for view in View3Dcollector.ToElements():
		if view.Name == "{3D}":
			view
	
	t = Transform.Identity
	t.Origin = beamMid
	t.BasisX = XbeamDir
	t.BasisY = YbeamDir
	t.BasisZ = ZbeamDir
	
	sectionBox = BoundingBoxXYZ();
	sectionBox.Transform = t
	sectionBox.Min = MinPoint # scope box bottom
	sectionBox.Max = MaxPoint # scope box top
#	
	TransactionManager.Instance.EnsureInTransaction(doc)
	for SectTypeId in viewFamilyTypeId:
		newSection = ViewSection.CreateSection(doc, SectTypeId, sectionBox)
		newSections.append(newSection)
	TransactionManager.Instance.TransactionTaskDone()
	
OUT =  newSections
# ----------------------------------------
code_block_2 = CodeBlock { len*304.8; }  # unwired: len

getLocation = Element.GetLocation(element=python_script)

# group: Origin
code_block_3 = CodeBlock { 0.5; }
pointAtParameter = Curve.PointAtParameter(curve=getLocation, param=code_block_3)

# group: HEIGHT
element_type_python_script = Python(IN[0]=python_script)  # IronPython2
# ---------- element_type_python_script.python (35 lines) ----------
# Load the Python Standard and DesignScript Libraries
import sys
import clr
clr.AddReference('ProtoGeometry')
from Autodesk.DesignScript.Geometry import *

clr.AddReference("RevitNodes")
import Revit
clr.ImportExtensions(Revit.Elements)
clr.ImportExtensions(Revit.GeometryConversion)

clr.AddReference("RevitServices")
import RevitServices
from RevitServices.Persistence import DocumentManager 
from RevitServices.Transactions import TransactionManager 

clr.AddReference("RevitAPI")
from Autodesk.Revit.DB import *
from Autodesk.Revit.Creation.Document import NewFamilyInstance
from Autodesk.Revit.DB.Structure import *

clr.AddReference("RevitAPIUI")
from Autodesk.Revit.UI import *

doc = DocumentManager.Instance.CurrentDBDocument

elements = UnwrapElement(IN[0])

elemType = []

for elem in elements:
	elemType.append(Document.GetElement(doc, elem.GetTypeId()))

# Assign your output to the OUT variable.
OUT = elemType
# ----------------------------------------
code_block_4 = CodeBlock { "h"; }
getParameterValueByName = Element.GetParameterValueByName(element=element_type_python_script, parameterName=code_block_4)
round = Math.Round(number=getParameterValueByName)

code_block_5 = CodeBlock(h=round, offset=round) { h+offset; h+(2*offset); }

# group: MOVE DOWN THE ORIGIN
ZAxis = Vector.ZAxis()
reverse = Vector.Reverse(vector=ZAxis)
translate = Geometry.Translate(geometry=pointAtParameter, direction=reverse, distance=code_block_5.out0)

# group: X
direction = Line.Direction(line=getLocation)
normalized = Vector.Normalized(vector=direction)

# group: Y
ZAxis_2 = Vector.ZAxis()

# group: Z
cross = Vector.Cross(vector=normalized, cross=ZAxis_2)

byOriginVectors = CoordinateSystem.ByOriginVectors(origin=translate, xAxis=normalized, yAxis=ZAxis_2, zAxis=cross)
string_2 = StringInput("Mark")
getParameterValueByName_2 = Element.GetParameterValueByName(element=python_script, parameterName=string_2)
sortByKey = List.SortByKey(list=byOriginVectors, keys=getParameterValueByName_2)
groupByKey = List.GroupByKey(list=sortByKey.sortedList, keys=sortByKey.sortedKeys)
firstItem = List.FirstItem()  # unwired: list
map = List.Map(list=groupByKey.groups, function=firstItem)

# group: LENGTH
length = Curve.Length(curve=getLocation)

# group: MIN & MAX POINT
code_block_6 = CodeBlock(offset=offset, length=length) { minPt = -offset-length/2; maxPt = offset+length/2; }
code_block_7 = CodeBlock { "b"; }
getParameterValueByName_3 = Element.GetParameterValueByName(element=element_type_python_script, parameterName=code_block_7)
round_2 = Math.Round(number=getParameterValueByName_3)
code_block_8 = CodeBlock(offset=offset, b=round_2) { -(offset+0.5*b); offset+0.5*b; }
byCoordinates = Point.ByCoordinates(x=code_block_6.minPt, z=code_block_8.out0)
byCoordinates_2 = Point.ByCoordinates(x=code_block_6.maxPt, y=code_block_5.out1, z=code_block_8.out1)

sortByKey_2 = List.SortByKey(list=byCoordinates, keys=getParameterValueByName_2)
groupByKey_2 = List.GroupByKey(list=sortByKey_2.sortedList, keys=sortByKey_2.sortedKeys)
map_2 = List.Map(list=groupByKey_2.groups, function=firstItem)
sortByKey_3 = List.SortByKey(list=byCoordinates_2, keys=getParameterValueByName_2)
groupByKey_3 = List.GroupByKey(list=sortByKey_3.sortedList, keys=sortByKey_3.sortedKeys)
map_3 = List.Map(list=groupByKey_3.groups, function=firstItem)
byCoordinateSystemMinPointMaxPoint = SectionView.ByCoordinateSystemMinPointMaxPoint(cs=map, minPoint=map_2, maxPoint=map_3)  # frozen
string_3 = StringInput("View Name")
code_block_9 = CodeBlock(mark=getParameterValueByName_2) { "BEAM" + " " + mark; }
sortByKey_4 = List.SortByKey(list=code_block_9, keys=getParameterValueByName_2)
groupByKey_4 = List.GroupByKey(list=sortByKey_4.sortedList, keys=sortByKey_4.sortedKeys)
map_4 = List.Map(list=groupByKey_4.groups, function=firstItem)
count = List.Count(list=groupByKey_4.groups@L2)
python_script_3 = Python(IN[0]=map_4, IN[1]=count)  # IronPython2
# ---------- python_script_3.python (21 lines) ----------
# Load the Python Standard and DesignScript Libraries
import sys
import clr
clr.AddReference('ProtoGeometry')
from Autodesk.DesignScript.Geometry import *

# The inputs to this node will be stored as a list in the IN variables.
txt = IN[0]
qty = IN[1]

sect_name = []

for x,y in zip(txt,qty):
	mults = "({} Nos. Thus)"
	sect_name.append(x+" " + mults.format(str(y)))


# Place your code below this line

# Assign your output to the OUT variable.
OUT = sect_name
# ----------------------------------------
setParameterByName = Element.SetParameterByName(element=byCoordinateSystemMinPointMaxPoint, parameterName=string_3, value=python_script_3)
string_4 = StringInput("Crop Region Visible")
code_block_10 = CodeBlock { 0; }
setParameterByName_2 = Element.SetParameterByName(element=setParameterByName, parameterName=string_4, value=code_block_10, lacing=Longest)
apply_view_template = ViewTemplatesUi("KSD - BEAM REBAR ELEVATION (Scale 25)")  # graph input
setViewTemplate = archilab.Revit.Views.Views.SetViewTemplate(view=setParameterByName_2, viewTemplate=apply_view_template)
shuffle = List.Shuffle(list=setViewTemplate)
code_block_11 = CodeBlock(X=shuffle) { X[0]; }
python_script_4 = Python(IN[0]=code_block_11)  # IronPython2
# ---------- python_script_4.python (35 lines) ----------
# Load the Python Standard and DesignScript Libraries
import sys
import clr
clr.AddReference('ProtoGeometry')
from Autodesk.DesignScript.Geometry import *

clr.AddReference("RevitServices")
import RevitServices
from RevitServices.Persistence import DocumentManager 
from RevitServices.Transactions import TransactionManager 

clr.AddReference("RevitAPI")
from Autodesk.Revit.DB.DetailElementOrderUtils import BringToFront
from Autodesk.Revit.DB import Document as DOC


clr.AddReference("RevitAPIUI")
from Autodesk.Revit.UI.UIDocument import ActiveView

doc = DocumentManager.Instance.CurrentDBDocument
uidoc = DocumentManager.Instance.CurrentUIDocument

TransactionManager.Instance.EnsureInTransaction(doc)
TransactionManager.Instance.ForceCloseTransaction()

view = UnwrapElement(IN[0])
uidoc.RequestViewChange(view)

success = []
if doc.ActiveView.Name != view.Name:
	success.append('Active View is ' + doc.ActiveView.Name.ToString())
else:
	success.append('Active View is ' + view.Name.ToString())

OUT = success[-1]
# ----------------------------------------
python_script_5 = Python(IN[1]=string, IN[2]=code_block)  # IronPython2; frozen; unwired: IN[0]
# ---------- python_script_5.python (94 lines) ----------
import clr

clr.AddReference('RevitServices')
import RevitServices

clr.AddReference("RevitAPI")
from Autodesk.Revit.DB import UnitUtils, FilteredElementCollector, ViewFamilyType, BuiltInParameter, XYZ, Transform, BoundingBoxXYZ, ViewSection

from RevitServices.Persistence import DocumentManager
from RevitServices.Transactions import TransactionManager

doc =  DocumentManager.Instance.CurrentDBDocument

#def units(mmToFeets):
#	dut = DisplayUnitType.DUT_MILLIMETERS
#	return UnitUtils.ConvertToInternalUnits(mmToFeets, dut)

# wall selection
walls = UnwrapElement(IN[0])

# Check if an input data is a list
if not isinstance(IN[0], list):
    walls = [walls]

# user section type name
sectionTypeName = IN[1]

units = 304.8
# user offset (crop region = far clip)
offset = IN[2]/units

# filtering user section type name (id)
viewFamilyTypes = FilteredElementCollector(doc).OfClass(ViewFamilyType).ToElements()

for vf in viewFamilyTypes:
	if vf.get_Parameter(BuiltInParameter.SYMBOL_NAME_PARAM).AsString() == sectionTypeName:
		viewFamilyTypeId = vf.Id

newSections = []
for wall in walls:
    def builtInParam(wallParam):
        return float(wall.get_Parameter(wallParam).AsValueString())/units

    # Determine section box
    lc = wall.Location
    line = lc.Curve

    p = line.GetEndPoint(0)
    q = line.GetEndPoint(1)
    v = q - p

    bb = wall.get_BoundingBox(None)
    minZ = bb.Min.Z
    maxZ = bb.Max.Z

    w = v.GetLength()
    h = maxZ - minZ
    d = wall.WallType.Width
    wallBaseOffset = builtInParam(BuiltInParameter.WALL_BASE_OFFSET)
    wallUnconnectedHeight = builtInParam(BuiltInParameter.WALL_USER_HEIGHT_PARAM)

    # XYZ(min/max section line length, min/max height of the section box, min/max far clip)
    min = XYZ(-0.5*w - offset, wallBaseOffset - offset, - offset - 0.5*d)
    max = XYZ(0.5*w + offset, wallBaseOffset + wallUnconnectedHeight + offset, offset + 0.5*d)

    # factor for direction of section view
    if p.X > q.X or (p.X == q.X and p.Y < q.Y): fc = 1
    else: fc = -1

    midpoint = p + 0.5*v
    walldir = fc*v.Normalize()
    up = XYZ.BasisZ
    viewdir = walldir.CrossProduct(up)

    t = Transform.Identity
    t.Origin = midpoint
    t.BasisX = walldir
    t.BasisY = up
    t.BasisZ = viewdir

    sectionBox = BoundingBoxXYZ()
    sectionBox.Transform = t
    sectionBox.Min = min # scope box bottom
    sectionBox.Max = max # scope box top

    # Create wall section view
    TransactionManager.Instance.EnsureInTransaction(doc)

    newSection = ViewSection.CreateSection(doc, viewFamilyTypeId, sectionBox)
    newSections.append(newSection)

    TransactionManager.Instance.TransactionTaskDone()

OUT = newSections,min,max
# ----------------------------------------
