# Dynamo graph Create Wall Elevation Views.dyn (Dynamo 2.6.1.8786)

section_type_name = StringInput("KSD - Cross Section")
offset = DoubleInput(350)
python_script = Python(IN[0]=section_type_name, IN[1]=offset)
# ---------- python_script.python (138 lines) ----------
import clr
import sys
sys.path.append('C:\Program Files (x86)\IronPython 2.7\Lib')

import System
from System import Array
from System.Collections.Generic import *
clr.AddReference('ProtoGeometry')
from Autodesk.DesignScript.Geometry import *

clr.AddReference("RevitNodes")
import Revit
clr.ImportExtensions(Revit.Elements)
clr.ImportExtensions(Revit.GeometryConversion)

clr.AddReference("RevitServices")
import RevitServices
from RevitServices.Persistence import DocumentManager 
from RevitServices.Transactions import TransactionManager 

clr.AddReference("RevitAPI")
from Autodesk.Revit.DB import *

clr.AddReference("RevitAPIUI")
from Autodesk.Revit.UI import *

doc = DocumentManager.Instance.CurrentDBDocument
uiapp = DocumentManager.Instance.CurrentUIApplication 
app = uiapp.Application 
uidoc = uiapp.ActiveUIDocument

def units(mmToFeets):
	dut = DisplayUnitType.DUT_MILLIMETERS
	return UnitUtils.ConvertToInternalUnits(mmToFeets, dut)

def PickedWalls():
	class MySelectionFilter(Selection.ISelectionFilter):
		def __init__(self):
			pass
		def AllowElement(self, element):
			if element.Category.Name == "Walls":
				return True
			else:
				return False
		def AllowReference(self, element):
			return False

	walls = []


	Sel_filter = MySelectionFilter()
	obj_type = Selection.ObjectType.Element

	selection = uidoc.Selection.PickObjects(obj_type,Sel_filter,"Select Wall(s)")

	for elems in selection:
			walls.append(Document.GetElement(doc,elems))
	return walls

walls = PickedWalls()


# wall selection
#walls = UnwrapElement(IN[0])

# Check if an input data is a list
if not isinstance(walls, list):
    walls = [walls]

# user section type name
sectionTypeName = IN[0]

# user offset (crop region = far clip)
offset = units(IN[1])

# filtering user section type name (id)
viewFamilyTypes = FilteredElementCollector(doc).OfClass(ViewFamilyType).ToElements()

for vf in viewFamilyTypes:
	if vf.get_Parameter(BuiltInParameter.SYMBOL_NAME_PARAM).AsString() == sectionTypeName:
		viewFamilyTypeId = vf.Id

newSections = []
for wall in walls:
    def builtInParam(wallParam):
        return units(float(wall.get_Parameter(wallParam).AsValueString()))

    # Determine section box
    lc = wall.Location
    line = lc.Curve

    p = line.GetEndPoint(0)
    q = line.GetEndPoint(1)
    v = q - p

    bb = wall.get_BoundingBox(None)
    minZ = bb.Min.Z
    maxZ = bb.Max.Z

    w = v.GetLength()
    h = maxZ - minZ
    d = wall.WallType.Width
    wallBaseOffset = builtInParam(BuiltInParameter.WALL_BASE_OFFSET)
    wallUnconnectedHeight = builtInParam(BuiltInParameter.WALL_USER_HEIGHT_PARAM)

    # XYZ(min/max section line length, min/max height of the section box, min/max far clip)
    min = XYZ(-0.5*w - offset, wallBaseOffset - offset, - offset - 0.5*d)
    max = XYZ(0.5*w + offset, wallBaseOffset + wallUnconnectedHeight + offset, offset + 0.5*d)

    # factor for direction of section view
    if p.X > q.X or (p.X == q.X and p.Y < q.Y): fc = 1
    else: fc = -1

    midpoint = p + 0.5*v
    walldir = fc*v.Normalize()
    up = XYZ.BasisZ
    viewdir = walldir.CrossProduct(up)

    t = Transform.Identity
    t.Origin = midpoint
    t.BasisX = walldir
    t.BasisY = up
    t.BasisZ = viewdir

    sectionBox = BoundingBoxXYZ()
    sectionBox.Transform = t
    sectionBox.Min = min # scope box bottom
    sectionBox.Max = max # scope box top

    # Create wall section view
    TransactionManager.Instance.EnsureInTransaction(doc)

    newSection = ViewSection.CreateSection(doc, viewFamilyTypeId, sectionBox)
    newSections.append(newSection)

    TransactionManager.Instance.TransactionTaskDone()

OUT = newSections
# ----------------------------------------
