# Dynamo graph Place Family Instance by Point and View.dyn (Dynamo 2.6.1.8786)

string = StringInput("Pick a point after you close the dialog")
string_2 = StringInput("Please Pick a Point in Revit")
show_dialog = BoolSelector(false)  # graph input
python_script = Python(IN[0]=string, IN[1]=string_2, IN[2]=show_dialog)
# ---------- python_script.python (32 lines) ----------
# Load the Python Standard and DesignScript Libraries
import sys
import clr
clr.AddReference('ProtoGeometry')
from Autodesk.DesignScript.Geometry import *

clr.AddReference("RevitNodes")
import Revit
clr.ImportExtensions(Revit.Elements)
clr.ImportExtensions(Revit.GeometryConversion)

clr.AddReference("RevitAPI")
from Autodesk.Revit.DB import Point as RPT
from Autodesk.Revit.DB.Events import *

clr.AddReference("RevitAPIUI")
from Autodesk.Revit.UI import TaskDialog

clr.AddReference("RevitServices")
from RevitServices.Persistence import DocumentManager 
from RevitServices.Transactions import TransactionManager 

doc = DocumentManager.Instance.CurrentDBDocument
uidoc = DocumentManager.Instance.CurrentUIApplication.ActiveUIDocument

if IN[2]:
	TaskDialog.Show("Pick Point Dialog", IN[0])

pt = uidoc.Selection.PickPoint(IN[1])

# Assign your output to the OUT variable.
OUT = pt.ToPoint()
# ----------------------------------------
list_create = List.Create(item0=python_script)
family_type_to_place = FamilyTypes("KSD - U-Bar:KSD - U-Bar")  # graph input
python_script_2 = Python(IN[0]=list_create, IN[1]=family_type_to_place)
# ---------- python_script_2.python (31 lines) ----------
import clr
clr.AddReference('RevitAPI')
from Autodesk.Revit.DB import *

clr.AddReference("RevitNodes")
import Revit
clr.ImportExtensions(Revit.Elements)
clr.ImportExtensions(Revit.GeometryConversion)

clr.AddReference("RevitServices")
import RevitServices
from RevitServices.Persistence import DocumentManager
from RevitServices.Transactions import TransactionManager

doc = DocumentManager.Instance.CurrentDBDocument
points = UnwrapElement(IN[0])
famtype = UnwrapElement(IN[1])
#lvl = UnwrapElement(IN[2])
elementlist = list()
counter = 0

TransactionManager.Instance.EnsureInTransaction(doc)
# make sure familysymbol is active
if famtype.IsActive == False:
	famtype.Activate()
	doc.Regenerate()
for point in points:
	newobj = doc.Create.NewFamilyInstance(point.ToXyz(),famtype,doc.ActiveView)
	elementlist.append(newobj.ToDSType(False))
TransactionManager.Instance.TransactionTaskDone()
OUT = elementlist
# ----------------------------------------
