# Dynamo graph Place View on Sheet by Point.dyn (Dynamo 2.6.1.8786)
# packages: Rhythm 2021.4.2, Data-Shapes 2022.2.96

# group: INPUTS
run_script = BoolSelector(true)  # graph input
use_task_dialog = BoolSelector(false)  # graph input
select_sheet = Sheets("S101 : LAYOUTS")  # graph input

code_block = CodeBlock { "Finish"; "Cancel"; }
string = StringInput("Select Sheet")
python_script = Python()
# ---------- python_script.python (35 lines) ----------
import clr
clr.AddReference('ProtoGeometry')
from Autodesk.DesignScript.Geometry import *

# Import DocumentManager and TransactionManager
clr.AddReference("RevitServices")
import RevitServices
from RevitServices.Persistence import DocumentManager
from RevitServices.Transactions import TransactionManager

# Import RevitAPI
clr.AddReference("RevitAPI")
import Autodesk
from Autodesk.Revit.DB import *

doc = DocumentManager.Instance.CurrentDBDocument

#The inputs to this node will be stored as a list in the IN variable.

collector = FilteredElementCollector(doc).OfCategory(BuiltInCategory.OST_Sheets).WhereElementIsNotElementType().ToElements()

sheets = []
sheetNames = []
sheetNo = []

for sheet in collector:
	sheets.append(sheet)
	sheetNames.append(sheet.Name)
	sheetNo.append(sheet.SheetNumber)

sheetOUT = []
for x,y in zip(sheetNo,sheetNames):
	sheetOUT.append(x + " - " + y)
	
OUT = sheets,sheetOUT
# ----------------------------------------
code_block_2 = CodeBlock(x=python_script) { x[0]; x[1]; }
dropdown_data = Custom[DropDown Data](InputName=string, Keys=code_block_2.out1, Values=code_block_2.out0)  # package Data-Shapes; Create data for DropDown input in UI.MultiInputForm ++ . Check out www.data-shapes.net for more infos.
code_block_3 = CodeBlock { "Select Views"; }
python_script_2 = Python()
# ---------- python_script_2.python (32 lines) ----------
import clr
clr.AddReference('ProtoGeometry')
from Autodesk.DesignScript.Geometry import *

# Import DocumentManager and TransactionManager
clr.AddReference("RevitServices")
import RevitServices
from RevitServices.Persistence import DocumentManager
from RevitServices.Transactions import TransactionManager

# Import RevitAPI
clr.AddReference("RevitAPI")
import Autodesk
from Autodesk.Revit.DB import *

doc = DocumentManager.Instance.CurrentDBDocument

#The inputs to this node will be stored as a list in the IN variable.

collector = FilteredElementCollector(doc).OfClass(View)

Nontemplate = []
ViewsName = []
VTypeName = []
for i in collector:
	if i.ViewType.ToString() != "SystemBrowser" and i.ViewType.ToString() != "ThreeD" and i.ViewType.ToString() != "ProjectBrowser" and i.ViewType.ToString() != "DrawingSheet":
		if i.IsTemplate == False:	
			Nontemplate.append(i)
			ViewsName.append(i.Name)
			VTypeName.append(i.ViewType.ToString())
			
OUT = Nontemplate,ViewsName,VTypeName
# ----------------------------------------
code_block_4 = CodeBlock(x=python_script_2) { x[0]; x[1]; x[2]; }
groupByKey = List.GroupByKey(list=code_block_4.out1, keys=code_block_4.out2)
flatten = List.Flatten(list=groupByKey.groups)
groupByKey_2 = List.GroupByKey(list=code_block_4.out0, keys=code_block_4.out2)
flatten_2 = List.Flatten(list=groupByKey_2.groups)
listview_data = Custom[Listview Data](InputName=code_block_3, Keys=flatten, Values=flatten_2)  # package Data-Shapes; Create data for ListView input in UI.MultiInputForm ++ . Check out www.data-shapes.net for more infos.
join = List.Join(list0=dropdown_data, list1=listview_data)
multipleinputform = Custom[MultipleInputForm ++](Logo_optional=run_script, ButtonText_optional=code_block.out0, Inputs=join, Toggle=run_script, CancelButtonText_optional=code_block.out1)  # package Data-Shapes; Create a form with multiple inputs. see www.data-shapes.net for tutorials and infos!
code_block_5 = CodeBlock(y=multipleinputform.User_Inputs) { y[0]; y[1]; }
string_2 = StringInput("Pick a point after you close the dialog")
string_3 = StringInput("Please Pick a Point in Revit")
python_script_3 = Python(IN[0]=string_2, IN[1]=string_3, IN[2]=use_task_dialog)
# ---------- python_script_3.python (32 lines) ----------
# Load the Python Standard and DesignScript Libraries
import sys
import clr
clr.AddReference('ProtoGeometry')
from Autodesk.DesignScript.Geometry import *

clr.AddReference("RevitNodes")
import Revit
clr.ImportExtensions(Revit.Elements)
clr.ImportExtensions(Revit.GeometryConversion)

clr.AddReference("RevitAPI")
from Autodesk.Revit.DB import Point as RPT
from Autodesk.Revit.DB.Events import *

clr.AddReference("RevitAPIUI")
from Autodesk.Revit.UI import TaskDialog

clr.AddReference("RevitServices")
from RevitServices.Persistence import DocumentManager 
from RevitServices.Transactions import TransactionManager 

doc = DocumentManager.Instance.CurrentDBDocument
uidoc = DocumentManager.Instance.CurrentUIApplication.ActiveUIDocument

if IN[2]:
	TaskDialog.Show("Pick Point Dialog", IN[0])

pt = uidoc.Selection.PickPoint(IN[1])

# Assign your output to the OUT variable.
OUT = pt.ToPoint()
# ----------------------------------------
ʳʰʸᵗʰᵐ_viewport_create = Rhythm.Revit.Elements.Viewport.Create(sheet=code_block_5.out0, view=code_block_5.out1, location=python_script_3)
