# Dynamo graph Renumber Sheets.dyn (Dynamo 2.6.1.8786)

boolean = BoolSelector(true)
python_script = Python(IN[0]=boolean)
# ---------- python_script.python (42 lines) ----------
import clr


clr.AddReference("RevitServices")
import RevitServices
from RevitServices.Persistence import DocumentManager 
from RevitServices.Transactions import TransactionManager 


clr.AddReference("RevitAPI")
from Autodesk.Revit.DB import *

doc = DocumentManager.Instance.CurrentDBDocument

TransactionManager.Instance.EnsureInTransaction(doc)

collector = FilteredElementCollector(doc)
sheets = collector.OfClass(ViewSheet).ToElements()

sheetNos = []

for sheet in sheets:
	sheetNos.append(sheet.SheetNumber)

midSheetNos = []	
newSheetNos = []

for x in range(len(sheetNos)):
	if len(str(x)) == 1:
		x = "0" + str(x)
		y = "11" + str(x)
	else:
		pass
	newSheetNos.append("S" + str(x))
	
#for sheet in sheets:
#	for newNos in newSheetNos:
#		sheet.GetParameters("Sheet Number")[0].Set(newNos)
		
TransactionManager.Instance.TransactionTaskDone()

OUT = sheets,sheetNos,newSheetNos,{"sheets":sheets, "numbers":sheetNos}
# ----------------------------------------
code_block = CodeBlock(s=python_script) { sheets = s[0]; sheetNumbers = s[1]; newSheetNumbers = s[2]; }
sheetNumber = Sheet.SheetNumber(sheet=code_block.sheets)
sortByKey = List.SortByKey(list=sheetNumber, keys=code_block.sheetNumbers)
string = StringInput("Sheet Number")
setParameterByName = Element.SetParameterByName(element=sortByKey.sorted_list, parameterName=string, value=code_block.newSheetNumbers)  # frozen
sortByKey_2 = List.SortByKey()  # unwired: list, keys
categories = Categories("OST_Sheets")
all_elements_of_category = ElementsOfCategory(Category=categories)
