# Dynamo graph 01 - FOUNDATION SHARED COORDINATES.dyn (Dynamo 2.6.1.8786)

refresh_script = BoolSelector(false)
python_script_ui_form = Python(IN[0]=refresh_script)
# ---------- python_script_ui_form.python (226 lines) ----------
#	Developed by KEHINDE AYOBADE
#	Currently for Private Use

import sys
import clr
clr.AddReference("System.IO")
clr.AddReference("System.Reflection")
clr.AddReference("System.Threading")
clr.AddReference("System.Drawing")
clr.AddReference("System.Windows.Forms")
clr.AddReference("System")
import System.IO
import System.Reflection
import System.Threading
import System.Drawing
import System.Windows.Forms
from System.Threading import ApartmentState, Thread, ThreadStart
from System import Array, Object
from System.Collections.Generic import *
from System.Windows.Forms import Application


def tolist(obj1):
	if hasattr(obj1,"__iter__"): return obj1
	else: return [obj1]


class PileCoordinates(System.Windows.Forms.Form):

	def __init__(this):
		this.groupBox1 =   System.Windows.Forms.GroupBox()
		this.label5 =   System.Windows.Forms.Label()
		this.label2 =   System.Windows.Forms.Label()
		this.label1 =   System.Windows.Forms.Label()
		this.comboBox1 =   System.Windows.Forms.ComboBox()
		this.button1 =   System.Windows.Forms.Button()
		this.button2 =   System.Windows.Forms.Button()
		this.label3 =   System.Windows.Forms.Label()
		this.comboBox2 =   System.Windows.Forms.ComboBox()
		this.comboBox3 =   System.Windows.Forms.ComboBox()
		this.label4 =   System.Windows.Forms.Label()
		this.groupBox1.SuspendLayout()
		this.SuspendLayout()
		#
		# groupBox1
		#
		this.groupBox1.Controls.Add(this.label5)
		this.groupBox1.Controls.Add(this.label2)
		this.groupBox1.Controls.Add(this.label1)
		this.groupBox1.Controls.Add(this.comboBox3)
		this.groupBox1.Controls.Add(this.comboBox2)
		this.groupBox1.Controls.Add(this.comboBox1)
		this.groupBox1.FlatStyle = System.Windows.Forms.FlatStyle.Popup
		this.groupBox1.Font =   System.Drawing.Font("Calibri", 12, System.Drawing.FontStyle.Regular)
		this.groupBox1.ImeMode = System.Windows.Forms.ImeMode.On
		this.groupBox1.Location =   System.Drawing.Point(29, 32)
		this.groupBox1.Margin =   System.Windows.Forms.Padding(4)
		this.groupBox1.Name = "groupBox1"
		this.groupBox1.Padding =   System.Windows.Forms.Padding(4)
		this.groupBox1.Size =   System.Drawing.Size(385, 237)
		this.groupBox1.TabIndex = 0
		this.groupBox1.TabStop = False
		this.groupBox1.Text = "Parameters"
		#
		# label5
		#
		this.label5.AutoSize =  True
		this.label5.Font =   System.Drawing.Font("Calibri", 11.25, System.Drawing.FontStyle.Regular)
		this.label5.Location =   System.Drawing.Point(8, 188)
		this.label5.Margin =   System.Windows.Forms.Padding(4, 0, 4, 0)
		this.label5.Name = "label5"
		this.label5.Size =   System.Drawing.Size(85, 18)
		this.label5.TabIndex = 1
		this.label5.Text = "Elevation (Z)"
		#
		# label2
		#
		this.label2.AutoSize =  True
		this.label2.Font =   System.Drawing.Font("Calibri", 11.25, System.Drawing.FontStyle.Regular)
		this.label2.Location =   System.Drawing.Point(8, 121)
		this.label2.Margin =   System.Windows.Forms.Padding(4, 0, 4, 0)
		this.label2.Name = "label2"
		this.label2.Size =   System.Drawing.Size(118, 18)
		this.label2.TabIndex = 1
		this.label2.Text = "Northings (N/S/Y)"
		#
		# label1
		#
		this.label1.AutoSize =  True
		this.label1.Font =   System.Drawing.Font("Calibri", 11.25, System.Drawing.FontStyle.Regular)
		this.label1.Location =   System.Drawing.Point(8, 51)
		this.label1.Margin =   System.Windows.Forms.Padding(4, 0, 4, 0)
		this.label1.Name = "label1"
		this.label1.Size =   System.Drawing.Size(110, 18)
		this.label1.TabIndex = 1
		this.label1.Text = "Eastings (E/W/X)"
		#
		# comboBox1
		#
		this.comboBox1.FormattingEnabled =  True
		this.comboBox1.Location =   System.Drawing.Point(139, 47)
		this.comboBox1.Margin =   System.Windows.Forms.Padding(4)
		this.comboBox1.Name = "Eastings"
		this.comboBox1.Size =   System.Drawing.Size(207, 27)
		this.comboBox1.TabIndex = 0
		this.comboBox1.AutoCompleteMode = System.Windows.Forms.AutoCompleteMode.SuggestAppend
		this.comboBox1.DropDownStyle = System.Windows.Forms.ComboBoxStyle.DropDownList

		#
		# button1
		#
		this.button1.BackColor = System.Drawing.Color.Gainsboro
		this.button1.Font =   System.Drawing.Font("Calibri", 12, System.Drawing.FontStyle.Regular)
		this.button1.Location =   System.Drawing.Point(440, 41)
		this.button1.Margin =   System.Windows.Forms.Padding(4)
		this.button1.Name = "button1"
		this.button1.Size =   System.Drawing.Size(122, 34)
		this.button1.TabIndex = 1
		this.button1.Text = "OK"
		this.button1.Click += this.finish
		this.button1.UseVisualStyleBackColor = False
		#
		# button2
		#
		this.button2.BackColor = System.Drawing.Color.Gainsboro
		this.button2.Font =   System.Drawing.Font("Calibri", 12, System.Drawing.FontStyle.Regular)
		this.button2.Location =   System.Drawing.Point(440, 92)
		this.button2.Margin =   System.Windows.Forms.Padding(4)
		this.button2.Name = "button2"
		this.button2.Size =   System.Drawing.Size(122, 34)
		this.button2.TabIndex = 1
		this.button2.Text = "Cancel"
		this.button2.Click += this.cancel
		this.button2.UseVisualStyleBackColor = False
		#
		# label3
		#
		this.label3.AutoSize =  True
		this.label3.Font =   System.Drawing.Font("Calibri", 9, System.Drawing.FontStyle.Regular)
		this.label3.Location =   System.Drawing.Point(443, 295)
		this.label3.Name = "label3"
		this.label3.Size =   System.Drawing.Size(119, 14)
		this.label3.TabIndex = 2
		this.label3.Text = "(C) Kehinde Ayobade"
		#
		# comboBox2
		#
		this.comboBox2.FormattingEnabled =  True
		this.comboBox2.Location =   System.Drawing.Point(139, 117)
		this.comboBox2.Margin =   System.Windows.Forms.Padding(4)
		this.comboBox2.Name = "Northings"
		this.comboBox2.Size =   System.Drawing.Size(207, 27)
		this.comboBox2.TabIndex = 0
		this.comboBox2.AutoCompleteMode = System.Windows.Forms.AutoCompleteMode.SuggestAppend
		this.comboBox2.DropDownStyle = System.Windows.Forms.ComboBoxStyle.DropDownList

		#
		# comboBox3
		#
		this.comboBox3.FormattingEnabled =  True
		this.comboBox3.Location =   System.Drawing.Point(139, 184)
		this.comboBox3.Margin =   System.Windows.Forms.Padding(4)
		this.comboBox3.Name = "Elevations"
		this.comboBox3.Size =   System.Drawing.Size(207, 27)
		this.comboBox3.TabIndex = 0
		this.comboBox3.AutoCompleteMode = System.Windows.Forms.AutoCompleteMode.SuggestAppend
		this.comboBox3.DropDownStyle = System.Windows.Forms.ComboBoxStyle.DropDownList

		#
		# label4
		#
		this.label4.AutoSize =  True
		this.label4.Font =   System.Drawing.Font("Calibri", 9, System.Drawing.FontStyle.Regular)
		this.label4.Location =   System.Drawing.Point(26, 283)
		this.label4.Name = "label4"
		this.label4.Size =   System.Drawing.Size(202, 28)
		this.label4.TabIndex = 3
		this.label4.Text = "NB: Please note that this works for\r\nonly structural foundations category"
		#
		# Form1
		#
		this.AcceptButton = this.button1
		this.AutoScaleDimensions =   System.Drawing.SizeF(8, 18)
		this.AutoScaleMode = System.Windows.Forms.AutoScaleMode.Font
		this.CancelButton = this.button2
		this.ClientSize =   System.Drawing.Size(599, 364)
		this.Controls.Add(this.label4)
		this.Controls.Add(this.label3)
		this.Controls.Add(this.button2)
		this.Controls.Add(this.button1)
		this.Controls.Add(this.groupBox1)
		this.Font =   System.Drawing.Font("Calibri", 11.25, System.Drawing.FontStyle.Regular)
		this.FormBorderStyle = System.Windows.Forms.FormBorderStyle.FixedSingle
		this.Margin =   System.Windows.Forms.Padding(3, 4, 3, 4)
		this.MaximizeBox = False
		this.MaximumSize =   System.Drawing.Size(599, 364)
		this.MinimizeBox = False
		this.MinimumSize =   System.Drawing.Size(599, 364)
		this.Name = "Form1"
		this.ShowIcon = False
		this.StartPosition = System.Windows.Forms.FormStartPosition.CenterScreen
		this.Text = "FOUNDATION COORDINATES"
		this.groupBox1.ResumeLayout(False)
		this.groupBox1.PerformLayout()
		this.ResumeLayout(False)
		this.PerformLayout()

	def add_range(this,LST):
		this.comboBox1.Items.AddRange(LST)
		this.comboBox2.Items.AddRange(LST)
		this.comboBox3.Items.AddRange(LST)

	def finish(this,sender,event):
		this.Finish = this.comboBox1.SelectedItem,this.comboBox2.SelectedItem,this.comboBox3.SelectedItem
		this.Close()

	def cancel(this,sender,event):
		this.Cancel = None
		this.Close()

form = PileCoordinates()

#Application.Run(form)


OUT = PileCoordinates()
# ----------------------------------------
python_script_command = Python(IN[0]=python_script_ui_form)
# ---------- python_script_command.python (135 lines) ----------
import sys
import clr
clr.AddReference("System.IO")
clr.AddReference("System.Reflection")
clr.AddReference("System.Threading")
clr.AddReference("System.Drawing")
clr.AddReference("System.Windows.Forms")
clr.AddReference("System")
import System.IO
import System.Reflection
import System.Threading
import System.Drawing
import System.Windows.Forms
from System.Threading import ApartmentState, Thread, ThreadStart
from System import Array, Object
from System.Collections.Generic import *
from System.Windows.Forms import Application


clr.AddReference("RevitNodes")
import Revit
clr.ImportExtensions(Revit.Elements)
clr.ImportExtensions(Revit.GeometryConversion)

clr.AddReference("RevitServices")
import RevitServices
from RevitServices.Persistence import DocumentManager 
from RevitServices.Transactions import TransactionManager 

clr.AddReference("RevitAPI")
from Autodesk.Revit.DB import *

clr.AddReference("RevitAPIUI")
from Autodesk.Revit.UI import *

UI_form = IN[0]

doc = DocumentManager.Instance.CurrentDBDocument
uiapp = DocumentManager.Instance.CurrentUIApplication 
app = uiapp.Application 
uidoc = uiapp.ActiveUIDocument

RevitViews = FilteredElementCollector(doc).OfClass(View).ToElements()
viewTemplates = []
TemplateNames = []

catFilter = ElementCategoryFilter(BuiltInCategory.OST_StructuralFoundation)
collector = FilteredElementCollector(doc)

documentSettings = doc.Settings
CatGroups = documentSettings.Categories

FdnELems = collector.WherePasses(catFilter).WhereElementIsNotElementType().ToElements()

locations = []
positions = []
ProjectLocation = doc.ActiveProjectLocation

xCoord = []
yCoord = []
zCoord = []

acceptElems = []

for elem in FdnELems:
	if doc.GetElement(elem.GetTypeId()).LookupParameter("Assembly Code").AsString() == "A1020110" and hasattr(elem.Location, "Point"):
		locations.append(elem.Location.Point)
		positions = ProjectLocation.GetProjectPosition(elem.Location.Point)
		#for pos in Positions:
		xCoord.append(positions.EastWest)
		yCoord.append(positions.NorthSouth)
		zCoord.append(positions.Elevation)
		
		acceptElems.append(elem)


#pSet = [elems.Parameters for elems in FdnELems]
AllCategories = []
AllParameters = []
AllParaInfo = []

for c in CatGroups:
	if c.AllowsBoundParameters:
		AllCategories.append(c.Name)

#for elem in FdnELems:
for para in FdnELems[0].Parameters:
	AllParameters.append(para.ToString())
	AllParaInfo.append(para.Definition.Name)
	
AllParameters = [parameter for _,parameter in sorted(zip(AllParaInfo,AllParameters))]
AllParaInfo = sorted(AllParaInfo)

#print(sorted(AllParaInfo))
LST = AllParaInfo
LST_array = Array[Object](LST)
UI_form.add_range(LST_array)

#Application.Run(UI_form)

UI_form.ShowDialog()

try:
	try:
		if UI_form.Finish != None:
			X_Easting = UI_form.Finish[0]
			Y_Northing = UI_form.Finish[1]
			Z_Elevation = UI_form.Finish[2]
			OUT = "Run Complete",acceptElems
		elif UI_form.Finish[0] == None:
			OUT = "Failed, no Inputs",acceptElems
	except: 
		UI_form.Cancel or UI_form.Finish
		OUT = "Run Complete",acceptElems
except Exception:
	UI_form.Close()
	OUT = "Failed, no Inputs",acceptElems

#Application.Exit()


transaction = Transaction(doc, 'Coordinates')
transaction.Start()

try:
	for elem,xData,yData,zData in zip(FdnELems,xCoord,yCoord,zCoord):
		X_Data = elem.GetParameters(X_Easting)
		for newX in X_Data: newX.Set(xData)
		Y_Data = elem.GetParameters(Y_Northing)
		for newY in Y_Data: newY.Set(yData)
		Z_Data = elem.GetParameters(Z_Elevation)
		for newZ in Z_Data: newZ.Set(zData)
except:
	pass
transaction.Commit()
# ----------------------------------------
