# Dynamo graph Beam - Marks.dyn (Dynamo 2.6.1.8786)

# group: INPUTS
vertical_beams_l_r = BoolSelector(true)
refresh_script = BoolSelector(true)  # graph input
beammark_prefix = StringInput("1B")  # graph input
start_number = DoubleInput(1)  # graph input
start_with_horizontal_beams = BoolSelector(true)
horizontal_beams_b_t = BoolSelector(true)

# group: BEAM SELECTION AND FILTERING
beam_ui_selection = Python(IN[0]=refresh_script)
# ---------- beam_ui_selection.python (51 lines) ----------
# Load the Python Standard and DesignScript Libraries
import sys
import clr
clr.AddReference('ProtoGeometry')
from Autodesk.DesignScript.Geometry import *

clr.AddReference("RevitNodes")
import Revit
clr.ImportExtensions(Revit.Elements)
clr.ImportExtensions(Revit.GeometryConversion)

clr.AddReference("RevitServices")
import RevitServices
from RevitServices.Persistence import DocumentManager 
from RevitServices.Transactions import TransactionManager 

clr.AddReference("RevitAPI")
from Autodesk.Revit.DB import *

clr.AddReference("RevitAPIUI")
from Autodesk.Revit.UI import *

doc = DocumentManager.Instance.CurrentDBDocument
uiapp = DocumentManager.Instance.CurrentUIApplication 
app = uiapp.Application 
uidoc = uiapp.ActiveUIDocument

class MySelectionFilter(Selection.ISelectionFilter):
	def __init__(self):
		pass
	def AllowElement(self, element):
		if element.Category.Name == "Structural Framing":
			return True
		else:
			return False
	def AllowReference(self, element):
		return False

refresh = IN[0]
beams = []


Sel_filter = MySelectionFilter()
obj_type = Selection.ObjectType.Element

selection = uidoc.Selection.PickObjects(obj_type,Sel_filter,"Select Structural Framing Element")

for elems in selection:
		beams.append(Document.GetElement(doc,elems))
# Assign your output to the OUT variable.
OUT = beams
# ----------------------------------------
getLocation = Element.GetLocation(element=beam_ui_selection)
direction = Line.Direction(line=getLocation)
XAxis = Vector.XAxis()
angleWithVector = Vector.AngleWithVector(vector=direction, otherVector=XAxis)
code_block = CodeBlock { 45; 135; }
ge = angleWithVector >= code_block.out0
le = angleWithVector <= code_block.out1
and_ = ge && le
filterByBoolMask = List.FilterByBoolMask(list=beam_ui_selection, mask=and_)
code_block_2 = CodeBlock { 0.5; }

# group: VERTICAL BEAMS
vertical_structuralframing = StructuralFraming.Location(structuralFraming=filterByBoolMask.in)
pointAtParameter = Curve.PointAtParameter(curve=vertical_structuralframing, param=code_block_2)
X = Point.X(point=pointAtParameter)
sortByKey = List.SortByKey(list=filterByBoolMask.in, keys=X)
sortByKey_2 = List.SortByKey(list=pointAtParameter, keys=X)
code_block_3 = CodeBlock { 1; }
round = Math.Round(number=sortByKey_2.sorted_keys, digits=code_block_3)
groupByKey = List.GroupByKey(list=sortByKey.sorted_list, keys=round)
reverse = List.Reverse()  # unwired: list
map = List.Map(list=groupByKey.groups, f_x=reverse)
flatten = List.Flatten(list=map)
reverse_2 = List.Reverse(list=flatten)
if_ = If(test=vertical_beams_l_r, true=flatten, false=reverse_2)
string = StringInput("Mark")

# group: HORIZONTAL BEAMS
horizontal_structuralframing = StructuralFraming.Location(structuralFraming=filterByBoolMask.out)
pointAtParameter_2 = Curve.PointAtParameter(curve=horizontal_structuralframing, param=code_block_2)
Y = Point.Y(point=pointAtParameter_2)
sortByKey_3 = List.SortByKey(list=filterByBoolMask.out, keys=Y)
sortByKey_4 = List.SortByKey(list=filterByBoolMask.out, keys=Y)
round_2 = Math.Round(number=sortByKey_3.sorted_keys, digits=code_block_3)
groupByKey_2 = List.GroupByKey(list=sortByKey_4.sorted_list, keys=round_2)
reverse_3 = List.Reverse()  # unwired: list
map_2 = List.Map(list=groupByKey_2.groups, f_x=reverse_3)
flatten_2 = List.Flatten(list=map_2)
reverse_4 = List.Reverse(list=flatten_2)
if_2 = If(test=horizontal_beams_b_t, true=sortByKey_3.sorted_list, false=reverse_4)
string_2 = StringInput("Mark")

# group: SPLIT MARKS BASED ON WHICH BEAM STARTS
count = List.Count(list=beam_ui_selection)
code_block_4 = CodeBlock(start=start_number, C=count) { start..C; }
add = beammark_prefix + code_block_4
count_2 = List.Count(list=if_2)
count_3 = List.Count(list=if_)
python_script = Python(IN[0]=add, IN[1]=start_with_horizontal_beams, IN[2]=count_2, IN[3]=count_3)
# ---------- python_script.python (16 lines) ----------
bMarks = IN[0]
hBool = IN[1]
hCount = IN[2]
vCount = IN[3]

hMarks = []
vMarks = []

if hBool:
	hMarks = bMarks[:hCount]
	vMarks = bMarks[hCount:]
else:
	hMarks = bMarks[vCount:]
	vMarks = bMarks[:vCount]

OUT = hMarks, vMarks
# ----------------------------------------
code_block_5 = CodeBlock(BM=python_script) { XBeams = BM[0]; YBeams = BM[1]; }

# group (continued): VERTICAL BEAMS
setParameterByName = Element.SetParameterByName(element=if_, parameterName=string, value=code_block_5.YBeams)

# group (continued): HORIZONTAL BEAMS
setParameterByName_2 = Element.SetParameterByName(element=if_2, parameterName=string_2, value=code_block_5.XBeams)
