# Dynamo graph Coordinates to Excel.dyn (Dynamo 2.6.1.8786)
# packages: Rhythm 2021.7.3

boolean = BoolSelector(false)
category = Categories("OST_StructuralFoundation")  # graph input
ʳʰʸᵗʰᵐ_selection_pick = Rhythm.Revit.Selection.Selection.Pick(runIt=boolean, category=category)
x_parameter_name = StringInput("Easting")  # graph input

# group: Unit factor of 1 is used for input into parameters of storage type double. This is because numbers can readily be formatted with units or multiplied via calculated parameters in Revit schedules. Also because input into length parameters expects default units used.
digits = IntegerSlider(3, range=0..8 step 1)  # graph input
unit_factor_for_input_into_text = DoubleInput(0.001)  # "Unit factor for input into Text parameters only (default is for mm to m)"; graph input

getLocation = Element.GetLocation(element=ʳʰʸᵗʰᵐ_selection_pick)
X = Point.X(point=getLocation)
Y = Point.Y(point=getLocation)
Z = Point.Z(point=getLocation)
python_script = Python(IN[0]=X, IN[1]=Y, IN[2]=Z)
# ---------- python_script.python (53 lines) ----------
import clr
import sys

clr.AddReference('RevitAPI')
from Autodesk.Revit.DB import *
from Autodesk.Revit.DB.Structure import *
clr.AddReference('RevitAPIUI')
from Autodesk.Revit.UI import *

clr.AddReference('ProtoGeometry')
from Autodesk.DesignScript.Geometry import *

clr.AddReference('System')
from System.Collections.Generic import List
clr.AddReference('RevitNodes')
import Revit
#clr.ImportExtensions(Revit.GeometryConversion) DO NOT USE
#clr.ImportExtensions(Revit.Elements) DO NOT USE
clr.AddReference('RevitServices')
import RevitServices
from RevitServices.Persistence import DocumentManager
from RevitServices.Transactions import TransactionManager

doc = DocumentManager.Instance.CurrentDBDocument
uidoc=DocumentManager.Instance.CurrentUIApplication.ActiveUIDocument

# The inputs to this node will be stored as a list in the IN variables.
dataEnteringNode = IN

XL = IN[0]
YL = IN[1]
ZL = IN[2]

newXYZ = XYZ(XL[0],YL[0],ZL[0])

def conv_coords(X,Y,Z):
	XYZin = XYZ(X / 304.8,Y / 304.8,Z / 304.8) #XYZ converted to ft (internal Revit units)
	Pos = doc.ActiveProjectLocation.GetProjectPosition(XYZin)
	outpos = XYZ(Pos.EastWest, Pos.NorthSouth, Pos.Elevation)
	return outpos

OutList = []
for C in range(0, XL.Count):
	XYZ1 = conv_coords(XL[C],YL[C],ZL[C])
	Xmm = XYZ1.X * 304.8
	Ymm = XYZ1.Y * 304.8
	Zmm = XYZ1.Z * 304.8
	XYZ2 = XYZ(Xmm,Ymm,Zmm)
	Pt = Point.ByCoordinates(Xmm,Ymm,Zmm)
	OutList.append(Pt)
	
		
OUT = OutList,doc.ActiveProjectLocation.GetProjectPosition(newXYZ)
# ----------------------------------------
X_2 = Point.X(point=python_script)
mul = X_2 * unit_factor_for_input_into_text
round = Math.Round(number=mul, digits=digits)
python_script_2 = Python(IN[0]=digits, IN[1]=round)
# ---------- python_script_2.python (26 lines) ----------
# Load the Python Standard and DesignScript Libraries
import sys
import clr

clr.AddReference('System')
import System.Text

clr.AddReference('ProtoGeometry')
from Autodesk.DesignScript.Geometry import *

# The inputs to this node will be stored as a list in the IN variables.
dataEnteringNode = IN

def Prec(Val,Digits):
	D = float(Val)
	P = "F" + str(Digits)
	return D.ToString(P)

OutList = []
for C in range(0, IN[1].Count):
	J = IN[1]
	#G = J[C]
	
	OutList.append(Prec(J[C], IN[0]))

OUT = OutList
# ----------------------------------------
y_parameter_name = StringInput("Northing")  # graph input
Y_2 = Point.Y(point=python_script)
mul_2 = Y_2 * unit_factor_for_input_into_text
round_2 = Math.Round(number=mul_2, digits=digits)
python_script_3 = Python(IN[0]=digits, IN[1]=round_2)  # same code as python_script_2
z_parameter_name = StringInput("Cut Off")  # graph input
Z_2 = Point.Z(point=python_script)
mul_3 = Z_2 * unit_factor_for_input_into_text
round_3 = Math.Round(number=mul_3, digits=digits)
python_script_4 = Python(IN[0]=digits, IN[1]=round_3)
# ---------- python_script_4.python (25 lines) ----------
# Load the Python Standard and DesignScript Libraries
import sys
import clr

clr.AddReference('System')
import System.Text

clr.AddReference('ProtoGeometry')
from Autodesk.DesignScript.Geometry import *

# The inputs to this node will be stored as a list in the IN variables.
dataEnteringNode = IN

def Prec(Val,Digits):
	D = float(Val)
	P = "F" + str(Digits)
	return D.ToString(P)

OutList = []
for C in range(0, IN[1].Count):
	J = IN[1]
	
	OutList.append(Prec(J[C], IN[0]))

OUT = OutList
# ----------------------------------------

# group: Used to detect string/double storage type on the param and set accordingly
RPT_PSet = Custom[RPT_PSet](StringValue=python_script_2, element=ʳʰʸᵗʰᵐ_selection_pick, ParameterName=x_parameter_name, DoubleValue=X_2)  # frozen
RPT_PSet_2 = Custom[RPT_PSet](StringValue=python_script_3, element=ʳʰʸᵗʰᵐ_selection_pick, ParameterName=y_parameter_name, DoubleValue=Y_2)  # frozen
RPT_PSet_3 = Custom[RPT_PSet](StringValue=python_script_4, element=ʳʰʸᵗʰᵐ_selection_pick, ParameterName=z_parameter_name, DoubleValue=Z_2)  # frozen

setParameterByName = Element.SetParameterByName(element=ʳʰʸᵗʰᵐ_selection_pick, parameterName=x_parameter_name, value=RPT_PSet)
setParameterByName_2 = Element.SetParameterByName(element=ʳʰʸᵗʰᵐ_selection_pick, parameterName=y_parameter_name, value=RPT_PSet_2)
setParameterByName_3 = Element.SetParameterByName(element=ʳʰʸᵗʰᵐ_selection_pick, parameterName=z_parameter_name, value=RPT_PSet_3)
familyName = StringInput("Footing-Rectangular")  # graph input
typeName = StringInput("1800 x 1200 x 450mm")  # graph input
byFamilyNameAndTypeName = FamilyType.ByFamilyNameAndTypeName(familyName=familyName, typeName=typeName)
byFamilyType = FamilyInstance.ByFamilyType(familyType=byFamilyNameAndTypeName)
getCategory = Element.GetCategory(element=byFamilyType)
equals = List.Equals(objectA=getCategory, objectB=category, lacing=Longest)
filterByBoolMask = List.FilterByBoolMask(list=byFamilyType, mask=equals)
export_excel = BoolSelector(false)  # graph input; graph output
file_path = Filename(".\Text.xlsx")  # graph input
code_block = CodeBlock { null; }
if_ = If(test=export_excel, true=file_path, false=code_block)
code_block_2 = CodeBlock { "Coords"; 0; true; }
addItemToFront = List.AddItemToFront(item=x_parameter_name, list=python_script_2)
addItemToFront_2 = List.AddItemToFront(item=y_parameter_name, list=python_script_3)
addItemToFront_3 = List.AddItemToFront(item=z_parameter_name, list=python_script_4)
list_create = List.Create(item0=addItemToFront, item1=addItemToFront_2, item2=addItemToFront_3)
transpose = List.Transpose(lists=list_create)
exportExcel = Data.ExportExcel(filePath=if_, sheetName=code_block_2.out0, startRow=code_block_2.out1, startCol=code_block_2.out1, data=transpose, overWrite=code_block_2.out2)  # frozen
