# Dynamo graph Pile Foundation - World Coordinates.dyn (Dynamo 2.6.1.8786)

categories = Categories("OST_StructuralFoundation")
all_elements_of_category = ElementsOfCategory(Category=categories)
location = FamilyInstance.Location(familyInstance=all_elements_of_category)
watch = Watch(location)
basePoint = Coordinates.BasePoint()
byOrigin = CoordinateSystem.ByOrigin(origin=basePoint)
identity = CoordinateSystem.Identity()
transform = Geometry.Transform(geometry=location, fromCoordinateSystem=byOrigin, contextCoordinateSystem=identity)
x_coordinates = StringInput("X_Coordinate (E/W)")
surveyPoint = Coordinates.SurveyPoint()
byOrigin_2 = CoordinateSystem.ByOrigin(origin=surveyPoint)
transform_2 = Geometry.Transform(geometry=location, fromCoordinateSystem=byOrigin_2, contextCoordinateSystem=identity)
X = Point.X(point=transform_2)
setParameterByName = Element.SetParameterByName(element=all_elements_of_category, parameterName=x_coordinates, value=X)  # frozen
y_coordinates = StringInput("Y_Coordinate (N/S)")
Y = Point.Y(point=transform_2)
setParameterByName_2 = Element.SetParameterByName(element=all_elements_of_category, parameterName=y_coordinates, value=Y)  # frozen
watch_2 = Watch(basePoint)
watch_3 = Watch(surveyPoint)
sub = _ - _  # unwired: x, y
byCoordinates = Point.ByCoordinates()
asVector = Point.AsVector(point=byCoordinates)
asVector_2 = Point.AsVector(point=surveyPoint)
subtract = Vector.Subtract(vector=asVector, vectorToSubtract=asVector_2)
