# Dynamo graph Create Levels and Name.dyn (Dynamo 2.6.1.8786)

refresh_script = BoolSelector(true)  # graph input
python_script_ui = Python(IN[0]=refresh_script)
# ---------- python_script_ui.python (124 lines) ----------
import sys
import clr
clr.AddReference("System.IO")
clr.AddReference("System.Reflection")
clr.AddReference("System.Threading")
clr.AddReference("System.Drawing")
clr.AddReference("System.Windows.Forms")
clr.AddReference("System")
import System.IO
import System.Reflection
import System.Threading
import System.Drawing
import System.Windows.Forms
from System.Threading import ApartmentState, Thread, ThreadStart
from System import Array, Object
from System.Collections.Generic import *

class CreateLevels(System.Windows.Forms.Form):
	def __init__(this):
		#FORM
		this.ClientSize =   System.Drawing.Size(300, 300)
		this.MaximizeBox = False
		this.MaximumSize =   System.Drawing.Size(300, 300)
		this.MinimizeBox = False
		this.MinimumSize =   System.Drawing.Size(300, 300)
		this.Name = "Create Levels"
		this.ShowIcon = False
		this.Text = "KennySTRUCT | CREATE LEVELS"
		this.StartPosition = System.Windows.Forms.FormStartPosition.CenterScreen
		
		# START NUMBER - INPUT
		this.label1 =   System.Windows.Forms.Label()
		this.label1.AutoSize = True
		this.label1.Location =   System.Drawing.Point(20, 40)
		this.label1.Name = "StartNumberLabel"
		this.label1.Size =   System.Drawing.Size(60, 13)
		this.label1.TabIndex = 3
		this.label1.Text = "Start Level Number\n(e.g 1,2,3...)"
		
		this.text1 = System.Windows.Forms.TextBox()
		this.text1.Name = "StartNumberText"
		this.text1.Size	= System.Drawing.Size(120,100)
		this.text1.Location = System.Drawing.Point(140, 40)
		this.text1.Text = "1"

		# NUMBER OF LEVELS - INPUT
		this.label2 =   System.Windows.Forms.Label()
		this.label2.AutoSize = True
		this.label2.Location =   System.Drawing.Point(20, 80)
		this.label2.Name = "NumberOfLevelsLabel"
		this.label2.Size =   System.Drawing.Size(60, 13)
		this.label2.TabIndex = 3
		this.label2.Text = "Number of Levels\n(e.g 1,2,3...)"
		
		this.text2 = System.Windows.Forms.TextBox()
		this.text2.Name = "NumberOfLevelsText"
		this.text2.Size	= System.Drawing.Size(120,100)
		this.text2.Location = System.Drawing.Point(140, 80)
		this.text2.Text = "5"

		# START ELEVATION - INPUT
		this.label3 =   System.Windows.Forms.Label()
		this.label3.AutoSize = True
		this.label3.Location =   System.Drawing.Point(20, 120)
		this.label3.Name = "StartElevationLabel"
		this.label3.Size =   System.Drawing.Size(60, 13)
		this.label3.TabIndex = 3
		this.label3.Text = "Start Elevation\n(mm)"
		
		this.text3 = System.Windows.Forms.TextBox()
		this.text3.Name = "StartElevationText"
		this.text3.Size	= System.Drawing.Size(120,100)
		this.text3.Location = System.Drawing.Point(140, 120)
		this.text3.Text = "3000"

		# NAME SUFFIX - INPUT
		this.label4 =   System.Windows.Forms.Label()
		this.label4.AutoSize = True
		this.label4.Location =   System.Drawing.Point(20, 160)
		this.label4.Name = "LevelSuffix"
		this.label4.Size =   System.Drawing.Size(60, 13)
		this.label4.TabIndex = 3
		this.label4.Text = "Level Suffix\n(e.g Level, Floor...)"
		
		this.text4 = System.Windows.Forms.TextBox()
		this.text4.Name = "StartElevationText"
		this.text4.Size	= System.Drawing.Size(120,100)
		this.text4.Location = System.Drawing.Point(140, 160)
		this.text4.Text = "FLOOR"

		# OKAY & CANCEL BUTTONS
		this.OK_Button =  System.Windows.Forms.Button()
		this.OK_Button.Location =  System.Drawing.Point(23, 210)
		this.OK_Button.Name = "OK_Button"
		this.OK_Button.Size =  System.Drawing.Size(80, 23)
		this.OK_Button.TabIndex = 6
		this.OK_Button.Text = "OK"
		this.OK_Button.DialogResult = System.Windows.Forms.DialogResult.OK
		
		this.Cancel =  System.Windows.Forms.Button()
		this.Cancel.Location =  System.Drawing.Point(110, 210)
		this.Cancel.Name = "Cancel_Button"
		this.Cancel.Size =  System.Drawing.Size(80, 23)
		this.Cancel.TabIndex = 6
		this.Cancel.Text = "Cancel"
		this.Cancel.DialogResult = System.Windows.Forms.DialogResult.Cancel
		
		
		this.Controls.Add(this.label1)
		this.Controls.Add(this.text1)
		this.Controls.Add(this.label2)
		this.Controls.Add(this.text2)
		this.Controls.Add(this.label3)
		this.Controls.Add(this.text3)
		this.Controls.Add(this.label4)
		this.Controls.Add(this.text4)
		this.Controls.Add(this.OK_Button)
		this.Controls.Add(this.Cancel)
		

# Place your code below this line

# Assign your output to the OUT variable.
OUT = CreateLevels()
# ----------------------------------------
# note: Developed by Kehinde Ayobade
python_script_command = Python(IN[0]=refresh_script, IN[1]=python_script_ui)
# ---------- python_script_command.python (105 lines) ----------
# Load the Python Standard and DesignScript Libraries
import sys
import clr
clr.AddReference('ProtoGeometry')
from Autodesk.DesignScript.Geometry import *

clr.AddReference("RevitServices")
import RevitServices
from RevitServices.Persistence import DocumentManager 
from RevitServices.Transactions import TransactionManager 

clr.AddReference("RevitAPI")
from Autodesk.Revit.DB import *

clr.AddReference("RevitAPIUI")
from Autodesk.Revit.UI import *

clr.AddReference("System.Windows.Forms")
import System.Windows.Forms as FORMS

clr.AddReference("System.Windows")
import System.Windows 

doc = DocumentManager.Instance.CurrentDBDocument
uiapp = DocumentManager.Instance.CurrentUIApplication 
app = uiapp.Application 
uidoc = uiapp.ActiveUIDocument

UI_Form = IN[1]

UI_Form.ShowDialog()

class MySelectionFilter(Selection.ISelectionFilter):
	def __init__(self):
		pass
	def AllowElement(self, element):
		if element.Category.Name == "Levels":
			return True
		else:
			return False
	def AllowReference(self, element):
		return False

def ordinal(value):
    try:
        value = int(value)
    except ValueError:
        return value

    if value % 100//10 != 1:
        if value % 10 == 1:
            ordval = u"%d%s" % (value, "st")
        elif value % 10 == 2:
            ordval = u"%d%s" % (value, "nd")
        elif value % 10 == 3:
            ordval = u"%d%s" % (value, "rd")
        else:
            ordval = u"%d%s" % (value, "th")
    else:
        ordval = u"%d%s" % (value, "th")

    return ordval
    

TransactionManager.Instance.EnsureInTransaction(doc)

try:

	if UI_Form.DialogResult.ToString() == "OK":
		FORMS.MessageBox.Show("Please select Reference Level\nfrom which you want to create new levels","Select Level")
	
		levelSelection  = uidoc.Selection.PickObject(Selection.ObjectType.Element, MySelectionFilter(), "Select Reference Level")
		
		reflevel = Document.GetElement(doc,levelSelection)
		
		sartNum = int(UI_Form.text1.Text)
		numOfLevels = int(UI_Form.text2.Text)
		elevation = int(UI_Form.text3.Text)
		suffix = UI_Form.text4.Text
		newLevels = []
		ordinals = []
		
		startElev = int(reflevel.Elevation*304.8 + elevation)
		
		test = []
		for i in range(startElev,startElev + numOfLevels*elevation,elevation):
			test.append(i)
			
		
		for nums in range(sartNum,sartNum+numOfLevels):
			ordinals.append(ordinal(nums))
		
		for name,elevs in zip(ordinals,range(startElev,startElev + numOfLevels*elevation,elevation)):
			newlevel = Level.Create(doc,elevs/304.8)
			newlevel.Name = name + " " + suffix
			newLevels.append(newlevel)
		
		OUT = ordinals
	else:
		sys.exit
except Exception  or NameError or EOFError as E:
	FORMS.MessageBox.Show(E.ToString(), "Error", FORMS.MessageBoxButtons(0), FORMS.MessageBoxIcon.Error)
	
	sys.exit
TransactionManager.Instance.TransactionTaskDone()
# ----------------------------------------
