# Dynamo graph Picture to Geometry.dyn (Dynamo 2.12.1.8246)

# group: IMPORT IMAGE
image_file_path = Filename("..\..\..\..\..\..\..\Dropbox\KS DIGITAL INNOVATIIONS\15 - PROJECTS\VICTORIA IKEDE\CSHARP PROJECT\configurator-1.1\resources\patterns\Ashlar.png")  # frozen
file_from_path = FileObject(path=image_file_path)
readFromFile = Image.ReadFromFile(file=file_from_path)
watch_image = WatchImageCore(image=readFromFile)
dimensions = Image.Dimensions(image=watch_image)

# group: COMBINE POINTS, BRIGHTNESS AND COLORS TO CREATE CIRCLES
pixel_samples = IntegerSlider(100, range=10..200 step 5)
code_block = CodeBlock(pixelW=dimensions.width, pixelH=dimensions.height, xSamples=pixel_samples) { pixelW; pixelH; xSamples; ySamples = Math.Round((pixelH/pixelW)*xSamples); pixelH/pixelW; }
pixels = Image.Pixels(image=watch_image, xSamples=code_block.ySamples, ySamples=code_block.xSamples)
brightness = Color.Brightness(color=pixels)
code_block_2 = CodeBlock(b=brightness) { 1-b; }
flatten = List.Flatten(list=code_block_2)
code_block_3 = CodeBlock { 0.125; }
sequence = Sequence(amount=code_block.xSamples, step=code_block_3)
sequence_2 = Sequence(amount=code_block.ySamples, step=code_block_3)
byCoordinates = Point.ByCoordinates(x=sequence, y=sequence_2, lacing=CrossProduct)
flatten_2 = List.Flatten(list=byCoordinates)
flatten_3 = List.Flatten(list=pixels)
python_script = Python(IN[0]=flatten, IN[1]=flatten_2, IN[2]=flatten_3)  # IronPython2
# ---------- python_script.python (20 lines) ----------
# Load the Python Standard and DesignScript Libraries
import sys
import clr
clr.AddReference('ProtoGeometry')
from Autodesk.DesignScript.Geometry import *

# The inputs to this node will be stored as a list in the IN variables.
points = IN[0]
bright = IN[1]
colors = IN[2]
output = []

for x,y,z in zip(bright,points,colors):
	if y!=0 and y!= 1:
		output.append([x,y,z])

# Place your code below this line

# Assign your output to the OUT variable.
OUT = output
# ----------------------------------------
code_block_4 = CodeBlock { 0; 1; 2; }
getItemAtIndex = List.GetItemAtIndex(list=python_script@L2, index=code_block_4.out0)
getItemAtIndex_2 = List.GetItemAtIndex(list=python_script@L2, index=code_block_4.out1)
code_block_5 = CodeBlock(b=getItemAtIndex_2, c=code_block_3) { b*(c/2); }
byCenterPointRadius = Circle.ByCenterPointRadius(centerPoint=getItemAtIndex, radius=code_block_5)  # frozen
byPatch = Surface.ByPatch(closedCurve=byCenterPointRadius)
getItemAtIndex_3 = List.GetItemAtIndex(list=python_script@L2, index=code_block_4.out2)
byGeometryColor = Modifiers.GeometryColor.ByGeometryColor(geometry=byPatch, color=getItemAtIndex_3)

select_model_elements_by = DSModelElementsByCategorySelection(index=486)  # "Select Model Elements By Category"; 1 picked in the model
finishBoundary = Room.FinishBoundary(room=select_model_elements_by)
startPoint = Curve.StartPoint(curve=finishBoundary)
flatten_4 = List.Flatten(list=startPoint)
byPoints = Polygon.ByPoints(points=flatten_4)
tile_size_h_mm = DoubleSlider(300, range=0..1000 step 5)
code_block_6 = CodeBlock(x=tile_size_h_mm) { -x; }
offset = Curve.Offset(curve=byPoints, distance=code_block_6)
byPatch_2 = Surface.ByPatch(closedCurve=offset)
pixel_samples_2 = IntegerSlider(100, range=10..200 step 5)

# group: COMBINE POINTS, BRIGHTNESS AND COLORS TO CREATE CIRCLES
boolean = BoolSelector(false)
code_block_7 = CodeBlock(pixelW=dimensions.width, pixelH=dimensions.height, xSamples=pixel_samples_2) { pixelW; pixelH; xSamples; ySamples = Math.Round((pixelH/pixelW)*xSamples); pixelH/pixelW; }
code_block_8 = CodeBlock(num=code_block_7.xSamples) { 0..1..#num; }
code_block_9 = CodeBlock(num=code_block_7.ySamples) { 0..1..#num; }
pointAtParameter = Surface.PointAtParameter(surface=byPatch_2, u=code_block_8, v=code_block_9, lacing=CrossProduct)
flatten_5 = List.Flatten(list=pointAtParameter)
pixels_2 = Image.Pixels(image=watch_image, xSamples=code_block_7.ySamples, ySamples=code_block_7.xSamples)
brightness_2 = Color.Brightness(color=pixels_2)
code_block_10 = CodeBlock(b=brightness_2) { 1-b; }
flatten_6 = List.Flatten(list=code_block_10)
flatten_7 = List.Flatten(list=pixels_2)
python_script_2 = Python(IN[0]=flatten_6, IN[1]=flatten_5, IN[2]=flatten_7)  # IronPython2; same code as python_script
code_block_11 = CodeBlock { 0; 1; 2; }
getItemAtIndex_4 = List.GetItemAtIndex(list=python_script_2@L2, index=code_block_11.out0)
if_ = RefactoredIf(test=boolean, true=flatten_5, false=getItemAtIndex_4)
minimumItem = List.MinimumItem(list=flatten_6)
maximumItem = List.MaximumItem(list=flatten_6)
getItemAtIndex_5 = List.GetItemAtIndex(list=python_script_2@L2, index=code_block_11.out1)
code_block_12 = CodeBlock { 1.5; 2.5; }
mapTo = Math.MapTo(rangeMin=minimumItem, rangeMax=maximumItem, inputValue=getItemAtIndex_5, targetRangeMin=code_block_12.out0, targetRangeMax=code_block_12.out1)
if_2 = RefactoredIf(test=boolean, true=mapTo, false=getItemAtIndex_5)
code_block_13 = CodeBlock { 0.125; }
code_block_14 = CodeBlock(b=if_2, c=code_block_13) { b*(c/2); }
byCenterPointRadius_2 = Circle.ByCenterPointRadius(centerPoint=if_, radius=code_block_14)
byPatch_3 = Surface.ByPatch(closedCurve=byCenterPointRadius_2)  # frozen
getItemAtIndex_6 = List.GetItemAtIndex(list=python_script_2@L2, index=code_block_11.out2)
if_3 = RefactoredIf(test=boolean, true=flatten_7, false=getItemAtIndex_6)
byGeometryColor_2 = Modifiers.GeometryColor.ByGeometryColor(geometry=byPatch_3, color=if_3)

code_block_15 = CodeBlock { 0; 1; }

# group: TILE SIZE INPUT
tile_size_h_mm_2 = DoubleSlider(550, range=0..1000 step 50)
tile_size_w_mm = DoubleSlider(600, range=0..1000 step 50)

code_block_16 = CodeBlock { 0.5; }

# group: RECTANGULAR GRIDS
code_block_17 = CodeBlock()  # frozen; unwired: pts
# ---------- code_block_17.designscript (11 lines) ----------
t4 = DSCore.List.ShiftIndices(pts@-2<1>, -1);
t6 = DSCore.List.ShiftIndices(pts, -1);
t7 = DSCore.List.ShiftIndices(t6@-2<1>, -1);
t8 = [pts, t4, t7, t6];
t9 = DSCore.List.Transpose(t8);
t10 = DSCore.List.Transpose(t9@-3<1>);
t11 = DSCore.List.Reverse(t10);
t12 = DSCore.List.RestOfItems(t11);
t13 = DSCore.List.Reverse(t12@-3<1>);
t14 = DSCore.List.RestOfItems(t13@-3<1>);
surface1 = Surface.ByPerimeterPoints(t14);
# ----------------------------------------
boolean_2 = BoolSelector(true)

# group: HORIZONTAL TILE GRIDS = 600mm TILE
getIsoline = Surface.GetIsoline(surface=byPatch_2, isoDirection=code_block_15.out0)
length = Curve.Length(curve=getIsoline)
addItemToEnd = List.AddItemToEnd(item=length)  # unwired: list
code_block_18 = CodeBlock(CrvLngth=length, TileSize=tile_size_w_mm) { 0..CrvLngth..TileSize; }
parameterAtSegmentLength = Curve.ParameterAtSegmentLength(curve=getIsoline, segmentLength=code_block_18)
code_block_19 = CodeBlock { 0; 1; }
remapRange = Math.RemapRange(numbers=parameterAtSegmentLength, newMin=code_block_19.out0, newMax=code_block_19.out1)

# group: VERTICAL TILE GRIDS = 600mm TILE
getIsoline_2 = Surface.GetIsoline(surface=byPatch_2, isoDirection=code_block_15.out1)
length_2 = Curve.Length(curve=getIsoline_2)
code_block_20 = CodeBlock(CrvLngth=length_2, TileSize=tile_size_h_mm_2) { 0..CrvLngth..TileSize; }
addItemToEnd_2 = List.AddItemToEnd(item=length_2, list=code_block_20)
parameterAtSegmentLength_2 = Curve.ParameterAtSegmentLength(curve=getIsoline_2, segmentLength=addItemToEnd_2)
code_block_21 = CodeBlock { 0; 1; }
remapRange_2 = Math.RemapRange(numbers=parameterAtSegmentLength_2, newMin=code_block_21.out0, newMax=code_block_21.out1)
getIsoline_3 = Surface.GetIsoline(surface=byPatch_2, isoDirection=code_block_15.out1, parameter=remapRange)

# group (continued): HORIZONTAL TILE GRIDS = 600mm TILE
getIsoline_4 = Surface.GetIsoline(surface=byPatch_2, isoDirection=code_block_15.out0, parameter=remapRange_2)

# group (continued): RECTANGULAR GRIDS
pointAtParameter_2 = Surface.PointAtParameter(surface=byPatch_2, u=remapRange, v=remapRange_2, lacing=CrossProduct)
python_script_create_quad_points = Python(IN[0]=pointAtParameter_2, IN[1]=boolean_2)  # IronPython2
# ---------- python_script_create_quad_points.python (15 lines) ----------
pts, ccw = IN
OUT = []

for i in xrange(len(pts) - 1):
	for j in xrange(len(pts[0]) - 1):
		if ccw:
			OUT.append([pts[i][j],
						pts[i][j+1],
						pts[i+1][j+1],
						pts[i+1][j]])
		else:
			OUT.append([pts[i][j],
						pts[i+1][j],
						pts[i+1][j+1],
						pts[i][j+1]])
# ----------------------------------------
byPerimeterPoints = Surface.ByPerimeterPoints(points=python_script_create_quad_points)

pointAtParameter_3 = Surface.PointAtParameter(surface=byPerimeterPoints, u=code_block_16, v=code_block_16)
