# Dynamo graph Copy Linked Elements Instances.dyn (Dynamo 2.3.1.11775)
# packages: Rhythm 2021.4.2, archi-lab.net 2021.25.2621, Genius Loci 2021.7.30, spring nodes 204.1.0, Data-Shapes 2022.2.96

getDocuments = archilab.Revit.Selection.Select.GetDocuments()
boolean = BoolSelector(true)
ꟿ_selectlinkedelements = Custom[ꟿ SelectLinkedElements](refresh=boolean)  # package spring nodes; Select the linked instance first, followed by the elements. To finish the selection, press Finish. If your selection fails, just press escape or Cancel. To refresh the node, connect a boolean switch node.
ʳʰʸᵗʰᵐ_documents = Rhythm.Revit.Application.Documents.CopyElementsFromLinkedDocument(sourceDocument=getDocuments.Link_Doc, sourceInstance=getDocuments.Link_Instance, elements=ꟿ_selectlinkedelements.elements)
select_linked_element = Custom[Select Linked Element]()  # frozen; package Genius Loci; Selects the linked elements.
ꟿ_selectlinkedelementsinorder = Custom[ꟿ SelectLinkedElementsInOrder]()  # package spring nodes; Select the linked instance first. Then select multiple elements from the Revit document in the desired order. Hit ESC to stop picking. To refresh the node, connect a boolean switch node.
selectlinkedelement_s_data = Custom[SelectLinkedElement(s) Data]()  # package Data-Shapes; Create a button input for UI.MultipleInputForm++ that allows to select elements in à linked document. See www.data-shapes.net for more infos!
boolean_2 = BoolSelector(true)
multipleinputform = Custom[MultipleInputForm ++](Inputs=selectlinkedelement_s_data, Toggle=boolean_2)  # package Data-Shapes; Create a form with multiple inputs. see www.data-shapes.net for tutorials and infos!
flatten = List.Flatten(list=multipleinputform.User_Inputs)
ʳʰʸᵗʰᵐ_documents_2 = Rhythm.Revit.Application.Documents.CopyElementsFromDocument(sourceDocument=getDocuments.Link_Doc, elements=ꟿ_selectlinkedelements.elements)
