# Dynamo graph Copy Linked Elements into Document.dyn (Dynamo 2.6.1.8786)
# packages: Data-Shapes 2022.2.96, spring nodes 204.1.0, archi-lab.net 2022.210.2522, bimorphNodes 4.0.9

getDocuments = archilab.Revit.Selection.Select.GetDocuments()

# group: COPY ELEMENTS FROM LINK INTO DOCUMENT
string = StringInput("Select Revit Link")
run_script = BoolSelector(true)  # graph input
string_2 = StringInput("Finish")
string_3 = StringInput("Link Instance")
dropdown_data = Custom[DropDown Data](InputName=string_3, Keys=getDocuments.Link_Name, Values=getDocuments.Link_Instance)  # package Data-Shapes
string_4 = StringInput("Cancel")
multipleinputform = Custom[MultipleInputForm ++](Description_optional=string, Logo_optional=run_script, ButtonText_optional=string_2, Inputs=dropdown_data, Toggle=run_script, CancelButtonText_optional=string_4)  # package Data-Shapes
category_to_copy = Categories("OST_Stairs")  # graph input

ofCategory = Revit.LinkElement.OfCategory(linkInstance=multipleinputform.User_Inputs, category=category_to_copy)

# group (continued): COPY ELEMENTS FROM LINK INTO DOCUMENT
ꟿ_document_copyfromlinkinstance = Custom[ꟿ Document.CopyFromLinkInstance](LinkInstance=multipleinputform.User_Inputs, element=ofCategory)  # package spring nodes
isNull = Object.IsNull(obj=ꟿ_document_copyfromlinkinstance)

name = Category.Name(category=category_to_copy)

# group (continued): COPY ELEMENTS FROM LINK INTO DOCUMENT
python_script = Python(IN[0]=isNull, IN[1]=name)
# ---------- python_script.python (48 lines) ----------
import sys
import clr
clr.AddReference('ProtoGeometry')
clr.AddReference('RevitNodes')
clr.AddReference('RevitAPI')
from Autodesk.DesignScript.Geometry import *
from Revit.Elements import *
from Autodesk.Revit.DB import *
# The inputs to this node will be stored as a list in the IN variables.
Null_Rooms = IN[0]
# define a function to flatten the list
def flatten_list(_2d_list):
	flat_list = []
	for	element in _2d_list:
		if type(element) is list:
			#If element is of type list, iterate through the sublist
			for item in element:
				flat_list.append(item)
		else:
			flat_list.append(element)
	return flat_list

a = flatten_list(Null_Rooms)
element_type = []
for i in a:
	element_type.append(type(i))
# interate through lists to create unique sets
def unique(list1):
	#insert the list to the set
	list_set = set(list1)
	#convert the set to the list
	unique_list = list(list_set)
	UNQ = []
	for x in unique_list:
		UNQ.append(x),
	return UNQ

room_nulls = unique(a)
#Set a note that rooms have been copied into the documents
success = []
category_name = IN[1]
success_note = "SUCCESSFUL \n{} {} were copied into the document"
failure_note = "FAILED \nNo {} were copied"
if room_nulls[0] == False:
	success.append(success_note.format(str(len(a)), category_name))
else:
	success.append(failure_note.format(category_name))
OUT = success[0]
# ----------------------------------------

# group: OUTPUT STATUS
script_status = Watch(python_script)  # graph output
