# Dynamo graph Get Elements Room_Space (Linked Model).dyn (Dynamo 2.3.0.5885)
# packages: bimorphNodes 3.0.3, archi-lab.net 2021.25.2621, Data-Shapes 2021.2.92

# group: (GET DATA FROM LINKED MODEL WITH ROOMS/SPACES)
category_to_check_rooms_spaces = Categories("OST_LightingFixtures")  # graph input
all_elements_of_category = ElementsOfCategory(Category=category_to_check_rooms_spaces)
string = StringInput("Select Revit Link")
string_2 = StringInput("Finish")
string_3 = StringInput("Revit Link")
getDocuments = archilab.Revit.Selection.Select.GetDocuments()
dropdown_data = Custom[DropDown Data](InputName=string_3, Keys=getDocuments.Link_Name, Values=getDocuments.Link_Instance)  # package Data-Shapes; Create data for DropDown input in UI.MultiInputForm ++ . Check out www.data-shapes.net for more infos.
run_script = BoolSelector(true)  # graph input
string_4 = StringInput("Cancel")
multipleinputform = Custom[MultipleInputForm ++](Description_optional=string, ButtonText_optional=string_2, Inputs=dropdown_data, Toggle=run_script, CancelButtonText_optional=string_4)  # package Data-Shapes; Create a form with multiple inputs. see www.data-shapes.net for tutorials and infos!
rooms_true_spaces_false = BoolSelector(false)  # graph input
categories = Categories("OST_Rooms")
categories_2 = Categories("OST_MEPSpaces")
if_ = If(test=rooms_true_spaces_false, true=categories, false=categories_2)
ofCategory = Revit.LinkElement.OfCategory(linkInstance=multipleinputform.User_Inputs, Category=if_)
code_block = CodeBlock(x=ofCategory) { x[0]; }
element = Revit.LinkElement.Element(linkElement=code_block)
elements_in_space = Custom[Elements in Space](element=all_elements_of_category, space=element)  # package archi-lab.net; This node will take an input of Spaces and Elements and attempt to group all elements by Room that it is located in. For elements that are placed by Line and not a Point, a mid point of line will be used to determine location.

# group: FILTER OUT ELEMENTS WITHOUT A ROOM/SPACE
isEmpty = List.IsEmpty(list=elements_in_space, lacing=CrossProduct)
boolean = BoolSelector(false)
allIndicesOf = List.AllIndicesOf(list=isEmpty, item=boolean)
getItemAtIndex = List.GetItemAtIndex(list=elements_in_space, index=allIndicesOf)
name = Room.Name(room=element)

# group: SET PARAMETERS FOR ROOM NAME AND MARK
string_5 = StringInput("Mark")
count = List.Count(list=getItemAtIndex@L2)
code_block_2 = CodeBlock(num=count) { 1..num; }
string_from_object = FromObject(obj=code_block_2)
setParameterByName = Element.SetParameterByName(element=getItemAtIndex, parameterName=string_5, value=string_from_object)
room_space_parameter_name = StringInput("ReferenceID_1_Room Name")  # graph input
getItemAtIndex_2 = List.GetItemAtIndex(list=name, index=allIndicesOf)
setParameterByName_2 = Element.SetParameterByName(element=setParameterByName, parameterName=room_space_parameter_name, value=getItemAtIndex_2)
