# Dynamo graph Get elements in room.dyn (Dynamo 2.3.0.5885)
# packages: archi-lab.net 2021.25.2621, Rhythm 2021.4.2, bimorphNodes 3.0.3

rooms_spaces = BoolSelector(false)

# group: METHOD 1
categories = Categories("OST_LightingFixtures")  # frozen
all_elements_of_category = ElementsOfCategory(Category=categories)
ʳʰʸᵗʰᵐ_familyinstances_room = Rhythm.Revit.Elements.FamilyInstances.Room(instance=all_elements_of_category)
ʳʰʸᵗʰᵐ_familyinstances_space = Rhythm.Revit.Elements.FamilyInstances.Space(instance=all_elements_of_category)
if_ = If(test=rooms_spaces, true=ʳʰʸᵗʰᵐ_familyinstances_room, false=ʳʰʸᵗʰᵐ_familyinstances_space)
name = Element.Name(element=if_)
groupByKey = List.GroupByKey(list=all_elements_of_category, keys=name)
string = StringInput("ReferenceID_1_Room Name")
setParameterByName = Element.SetParameterByName(element=groupByKey.groups, parameterName=string, value=groupByKey.unique_keys)  # frozen

# group: METHOD 2
categories_2 = Categories("OST_Rooms")  # frozen
categories_3 = Categories("OST_MEPSpaces")  # frozen
if_2 = If(test=rooms_spaces, true=categories_2, false=categories_3)
all_elements_of_category_2 = ElementsOfCategory(Category=if_2)
elements_in_room = Custom[Elements in Room](elements=all_elements_of_category, rooms=all_elements_of_category_2)  # package archi-lab.net; This node will check if any of the elements are inside any of the supplied rooms.
elements_in_space = Custom[Elements in Space](element=all_elements_of_category, space=all_elements_of_category_2)  # package archi-lab.net; This node will take an input of Spaces and Elements and attempt to group all elements by Room that it is located in. For elements that are placed by Line and not a Point, a mid point of line will be used to determine location.
if_3 = If(test=rooms_spaces, true=elements_in_room, false=elements_in_space)
name_2 = Element.Name(element=if_3)
ʳʰʸᵗʰᵐ_familyinstances_room_2 = Rhythm.Revit.Elements.FamilyInstances.Room(instance=elements_in_room)
ʳʰʸᵗʰᵐ_familyinstances_space_2 = Rhythm.Revit.Elements.FamilyInstances.Space(instance=elements_in_space)
if_4 = If(test=rooms_spaces, true=ʳʰʸᵗʰᵐ_familyinstances_room_2, false=ʳʰʸᵗʰᵐ_familyinstances_space_2)
name_3 = Room.Name(room=if_4)

# group: METHOD 3 (LINKED MODEL WITH ROOMS/SPACES)
elements_in_room_2 = Custom[Elements in Room]()  # unwired: elements, rooms
name_4 = Element.Name()  # unwired: element
ʳʰʸᵗʰᵐ_familyinstances_room_3 = Rhythm.Revit.Elements.FamilyInstances.Room()  # unwired: instance
categories_4 = Categories("OST_LightingFixtures")
all_elements_of_category_3 = ElementsOfCategory(Category=categories_4)
getDocuments = archilab.Revit.Selection.Select.GetDocuments()
categories_5 = Categories("OST_MEPSpaces")
ofCategory = Revit.LinkElement.OfCategory(linkInstance=getDocuments.Link_Instance, Category=categories_5)
code_block = CodeBlock(x=ofCategory) { x[0]; }
element = Revit.LinkElement.Element(linkElement=code_block)
elements_in_space_2 = Custom[Elements in Space](element=all_elements_of_category_3, space=element)

code_block_2 = CodeBlock {  }
if_5 = If()  # unwired: test, true, false
isEmpty = List.IsEmpty(list=elements_in_space_2, lacing=CrossProduct)
boolean = BoolSelector(false)
allIndicesOf = List.AllIndicesOf(list=isEmpty, item=boolean)
getItemAtIndex = List.GetItemAtIndex(list=elements_in_space_2, index=allIndicesOf)
string_2 = StringInput("Mark")
count = List.Count(list=getItemAtIndex@L2)
code_block_3 = CodeBlock(num=count) { 1..num; }
string_from_object = FromObject(obj=code_block_3)
setParameterByName_2 = Element.SetParameterByName(element=getItemAtIndex, parameterName=string_2, value=string_from_object)
string_3 = StringInput("ReferenceID_1_Room Name")
name_5 = Room.Name(room=element)
getItemAtIndex_2 = List.GetItemAtIndex(list=name_5, index=allIndicesOf)
setParameterByName_3 = Element.SetParameterByName(element=setParameterByName_2, parameterName=string_3, value=getItemAtIndex_2)
