# Dynamo graph Shared Parameter Lighting Fixtures_3.dyn "Shared Parameter Lighting Fixtures_2" (Dynamo 2.0.4.12684)

# group: EXTRACT LIGHTING FIXTURES ELEMENTS BASED ON CATEGORY
select_category = Categories(index=249)  # graph input
views = Views(index=6)
all_elements_of_category = ElementsOfCategory(Category=select_category)
elementType = Element.ElementType(element=all_elements_of_category)
uniqueItems = List.UniqueItems(list=elementType)
all_elements_of_family_type = ElementsOfFamilyType(Family_Type=uniqueItems)
flatten = List.Flatten(list=all_elements_of_family_type)
temporarilyIsolateElement = Custom[View.TemporarilyIsolateElement](view=views, element=flatten)  # Temporarily isolates elements in the given view

# group: CREATE SHARED PARAMETERS
parameter_1 = StringInput("ReferenceID_1")  # graph input
parameter_2 = StringInput("ReferenceID_2")  # graph input
parameter_3 = StringInput("ReferenceID_1_Room Name")  # graph input
code_block = CodeBlock(a=parameter_1, b=parameter_2, c=parameter_3) { [a, b, c]; }
string = StringInput("LIGHTING CODES")
select_parameter_type = ParameterType(index=124)
select_builtin_parameter_group = BuiltInParameterGroup(index=52)
boolean = BoolSelector(true)
createSharedParameter = Parameter.CreateSharedParameter(parameterName=code_block, groupName=string, type=select_parameter_type, group=select_builtin_parameter_group, instance=boolean, categoryList=select_category, lacing=CrossProduct)

# group: INTERACTIVE SELECTION OF LIGHTING FIXTURE FAMILY TYPES
name = Element.Name(element=temporarilyIsolateElement.element)
string_2 = StringInput("LIGHTING FIXTURES PARAMETERS")
populate_shared_parameters_data = BoolSelector(true)  # graph input
string_3 = StringInput("Finish")
string_4 = StringInput("Lighting Fixtures")
uniqueItems_2 = List.UniqueItems(list=name)
dropdown_data = Custom[DropDown Data](InputName=string_4, Keys=uniqueItems_2, Values=uniqueItems_2)  # Create data for DropDown input in UI.MultiInputForm ++ . Check out www.data-shapes.net for more infos.
code_block_2 = CodeBlock { ["code 1", "code 2"]; }
select_excel_file = Filename(".\Lighting_fixtures.xlsx")  # graph input
file_from_path = FileObject(path=select_excel_file)
sheet_name = StringInput("Sheet1")
string_5 = StringInput("Mark Prefix")
string_6 = StringInput("Cancel")
number_slider = DoubleSlider(500, range=400..1000 step 1)

read = EPPlus.ExcelReader.ExcelFile.Read(file=file_from_path, sheetName=sheet_name)

# group (continued): INTERACTIVE SELECTION OF LIGHTING FIXTURE FAMILY TYPES
dropdown_data_2 = Custom[DropDown Data](InputName=code_block_2, Keys=read, Values=read)

# group: ALPHABETHS IN SEQUENCE
count = List.Count(list=uniqueItems_2)
boolean_2 = BoolSelector(true)
byNumber = Custom[AlphabeticalSequence.ByNumber](n=count, upperCase=boolean_2)  # Creates a list of the first N letters of the alphabet (where 1 = A, 2 = B, ... , 27 = AA, 28 = AB etc.).

# group (continued): INTERACTIVE SELECTION OF LIGHTING FIXTURE FAMILY TYPES
dropdown_data_3 = Custom[DropDown Data](InputName=string_5, Keys=byNumber, Values=byNumber)
join = List.Join(list0=dropdown_data, list1=dropdown_data_2, list2=dropdown_data_3)
multipleinputform = Custom[MultipleInputForm ++](Description_optional=string_2, Logo_optional=populate_shared_parameters_data, ButtonText_optional=string_3, Inputs=join, Toggle=populate_shared_parameters_data, CancelButtonText_optional=string_6, Width_optional=number_slider)  # Create a form with multiple inputs. see www.data-shapes.net for tutorials and infos!

# group: TYPE CONDITIONALS
code_block_3 = CodeBlock(x=multipleinputform.User_Inputs) { x[0]; x[1]; x[2]; x[3]; }
python_script = Python(IN[0]=name, IN[1]=code_block_3.out0)
# ---------- python_script.python (20 lines) ----------
# Load the Python Standard and DesignScript Libraries
import sys
import clr
clr.AddReference('ProtoGeometry')
from Autodesk.DesignScript.Geometry import *

# The inputs to this node will be stored as a list in the IN variables.
dataEnteringNode = IN

# Place your code below this line
element_names = IN[0]
output_name = IN[1]
# Assign your output to the OUT variable.
bool_names = []

for i in element_names:
	check = i==output_name
	bool_names.append(check)

OUT = bool_names
# ----------------------------------------
flatten_2 = List.Flatten(list=python_script)
boolean_3 = BoolSelector(true)
allIndicesOf = List.AllIndicesOf(list=flatten_2, item=boolean_3)

# group: POPULATE SHARED PARAMETERS
getItemAtIndex = List.GetItemAtIndex(list=temporarilyIsolateElement.element, index=allIndicesOf)
code_block_4 = CodeBlock(x=code_block) { x[0]; x[1]; }
setParameterByName = Element.SetParameterByName(element=getItemAtIndex, parameterName=code_block_4.out0, value=code_block_3.out1)
setParameterByName_2 = Element.SetParameterByName(element=setParameterByName, parameterName=code_block_4.out1, value=code_block_3.out2)
selectInRevit = Custom[SelectInRevit](ElemsOrIDs=setParameterByName_2)

view_to_add_tag = Views(index=105)  # graph input
tag_elements = BoolSelector(true)
gate = Data.Gate(true)  # unwired: arg0
gate_2 = Data.Gate(false)  # unwired: arg0
if_ = If(test=tag_elements, true=gate, false=gate_2)
getLocation = Element.GetLocation(element=if_)
tag_family_type = FamilyTypes(index=43)  # graph input
create_tag = BoolSelector(false)  # graph input
create_tag_2 = Custom[Create Tag](view=view_to_add_tag, element=if_, TagLocation=getLocation, TagType=tag_family_type, RunIt=create_tag)

# group: EXTRACT ALL ROOMS IN THE DOCUMENT AND FIND ELEMENTS IN EACH ROOM
all_elements_of_category_2 = ElementsOfCategory(Category=select_category)
categories = Categories(index=416)
all_elements_of_category_3 = ElementsOfCategory(Category=categories)
elements_in_room = Custom[Elements in Room](elements=all_elements_of_category_2, rooms=all_elements_of_category_3)
isNotEmpty = Custom[List.IsNotEmpty](seq=elements_in_room@L2)  # Just the inversion of the built-in Is Empty List node.
boolean_4 = BoolSelector(true)
allIndicesOf_2 = List.AllIndicesOf(list=isNotEmpty, item=boolean_4)
getItemAtIndex_2 = List.GetItemAtIndex(list=elements_in_room, index=allIndicesOf_2)
getItemAtIndex_3 = List.GetItemAtIndex(list=all_elements_of_category_3, index=allIndicesOf_2)
name_2 = Room.Name(room=getItemAtIndex_3)

# group: SELECT ALL THE ELEMENT PRESENT IN A ROOM - POPULATES THE MARK PARAMETER
setParameterByName_3 = Element.SetParameterByName(element=getItemAtIndex_2, parameterName=parameter_3, value=name_2)
count_2 = List.Count(list=setParameterByName_3@L2)
code_block_5 = CodeBlock(x=count_2) { "Mark"; 1..List.Count(x); }
code_block_6 = CodeBlock { 1; }
range = Range(start=code_block_6, end=count_2, step=code_block_6)
string_from_object = FromObject(obj=range)
setParameterByName_4 = Element.SetParameterByName(element=setParameterByName_3, parameterName=code_block_5.out0, value=string_from_object)
selectInRevit_2 = Custom[SelectInRevit](ElemsOrIDs=setParameterByName_4)
