# Dynamo graph Shared Parameter Lighting Fixtures_(Data Export).dyn (Dynamo 2.3.0.5885)
# packages: bimorphNodes 3.0.3, archi-lab.net 2021.25.2621

# group: CURRENT DOCUMENT ELEMENTS BASED ON CATEGORY
element_category_in_document = Categories("OST_LightingFixtures")
all_elements_of_category = ElementsOfCategory(Category=element_category_in_document)

# group: PARAMETERS TO EXTRACT
parameter_1 = StringInput("ReferenceID_1")
parameter_2 = StringInput("ReferenceID_2")
parameter_3 = StringInput("ReferenceID_1_Room Name")
parameter_4 = StringInput("Mark")
code_block = CodeBlock(a=parameter_1, b=parameter_2, c=parameter_3, d=parameter_4) { [a, b, c, d]; }

# group: GET LINKED ELEMENTS BASED ON CATEGORY
getDocuments = archilab.Revit.Selection.Select.GetDocuments()
code_block_2 = CodeBlock(x=getDocuments.Link_Instance, Y=getDocuments.Link_Doc) { x[0]; Y[0]; }
link_category = Categories("OST_LightingFixtures")
ofCategory = Revit.LinkElement.OfCategory(linkInstance=code_block_2.out0, Category=link_category)
element = Revit.LinkElement.Element(linkElement=ofCategory)

# group: DATA SELECTION BOX
code_block_3 = CodeBlock { a = 0; b = 1; c = 2; d = 3; }
code_block_4 = CodeBlock(x=code_block, a=code_block_3.a, b=code_block_3.b, c=code_block_3.c, d=code_block_3.d) { x[a]; x[b]; x[c]; x[d]; }
getParameterValueByName = Element.GetParameterValueByName(element=element, parameterName=code_block, lacing=CrossProduct)

# group: POPULATE 1ST PARAMETER (CODE 1)
getItemAtIndex = List.GetItemAtIndex(index=code_block_3.a)  # unwired: list
map = List.Map(list=getParameterValueByName, f_x=getItemAtIndex)
setParameterByName = Element.SetParameterByName(element=all_elements_of_category, parameterName=code_block_4.out0, value=map)

# group: POPULATE 2ND PARAMETER (CODE 2)
getItemAtIndex_2 = List.GetItemAtIndex(index=code_block_3.b)  # unwired: list
map_2 = List.Map(list=getParameterValueByName, f_x=getItemAtIndex_2)
setParameterByName_2 = Element.SetParameterByName(element=setParameterByName, parameterName=code_block_4.out1, value=map_2)

# group: POPULATE 3RD PARAMETER (ROOMS)
getItemAtIndex_3 = List.GetItemAtIndex(index=code_block_3.c)  # unwired: list
map_3 = List.Map(list=getParameterValueByName, f_x=getItemAtIndex_3)
setParameterByName_3 = Element.SetParameterByName(element=setParameterByName_2, parameterName=code_block_4.out2, value=map_3)

# group: POPULATE 4TH PARAMETER (MARKS)
getItemAtIndex_4 = List.GetItemAtIndex(index=code_block_3.d)  # unwired: list
map_4 = List.Map(list=getParameterValueByName, f_x=getItemAtIndex_4)
setParameterByName_4 = Element.SetParameterByName(element=setParameterByName_3, parameterName=code_block_4.out3, value=map_4)
