# Dynamo graph Shared Parameter Lighting Fixtures_8.dyn (Dynamo 2.3.0.5885)
# packages: Clockwork for Dynamo 2.x 2.3.0, Data-Shapes 2021.2.92, Modelical 2.2.19, Genius Loci 2021.1.20, ExcelReader 134.1.1

# group: EXTRACT LIGHTING FIXTURES ELEMENTS BASED ON CATEGORY
isolate_selected_category = BoolSelector(false)
views = Views("{3D}")
code_block = CodeBlock { null; }
if_ = If(test=isolate_selected_category, true=views, false=code_block)
select_element_category = Categories("OST_LightingFixtures")  # graph input
all_elements_of_category = ElementsOfCategory(Category=select_element_category)
elementType = Element.ElementType(element=all_elements_of_category)
uniqueItems = List.UniqueItems(list=elementType)
all_elements_of_family_type = ElementsOfFamilyType(Family_Type=uniqueItems)
flatten = List.Flatten(list=all_elements_of_family_type)
temporarilyIsolateElement = Custom[View.TemporarilyIsolateElement](view=if_, element=flatten)  # package Clockwork for Dynamo 2.x; (Temporarily) isolates elements in the given view
if_2 = If(test=isolate_selected_category, true=temporarilyIsolateElement.element, false=flatten)

# group: INTERACTIVE SELECTION OF LIGHTING FIXTURE FAMILY TYPES
string = StringInput("Lighting Fixtures")
name = Element.Name(element=if_2)
string_2 = StringInput("LIGHTING FIXTURES PARAMETERS")
populate_shared_parameters_data = BoolSelector(true)  # graph input
string_3 = StringInput("Finish")
uniqueItems_2 = List.UniqueItems(list=name)
dropdown_data = Custom[DropDown Data](Keys=uniqueItems_2, Values=uniqueItems_2)  # package Data-Shapes; Create data for DropDown input in UI.MultiInputForm ++ . Check out www.data-shapes.net for more infos.
code_block_2 = CodeBlock { ["code 1", "code 2"]; }
select_excel_file = Filename(".\Lighting Fixtures Excel.xlsx")  # graph input
file_from_path = FileObject(path=select_excel_file)
sheet_name = StringInput("Sheet1")
read = EPPlus.ExcelReader.ExcelFile.Read(file=file_from_path, sheetName=sheet_name)
dropdown_data_2 = Custom[DropDown Data](InputName=code_block_2, Keys=read, Values=read)
join = List.Join(list0=dropdown_data, list1=dropdown_data_2)
string_4 = StringInput("Cancel")
number_slider = DoubleSlider(1000, range=400..1000 step 1)
number_slider_2 = DoubleSlider(525, range=400..1000 step 1)
multipleinputform = Custom[MultipleInputForm ++](Description_optional=string_2, Logo_optional=populate_shared_parameters_data, ButtonText_optional=string_3, Inputs=join, Toggle=populate_shared_parameters_data, CancelButtonText_optional=string_4, MaxHeight_optional=number_slider, Width_optional=number_slider_2)  # package Data-Shapes; Create a form with multiple inputs. see www.data-shapes.net for tutorials and infos!

# group: FAMILY TYPE CONDITIONALS FILTERING
code_block_3 = CodeBlock(x=multipleinputform.User_Inputs) { x[0]; x[1]; x[2]; }
python_script = Python(IN[0]=name, IN[1]=code_block_3.out0, IN[2]=if_2)
# ---------- python_script.python (31 lines) ----------
# Load the Python Standard and DesignScript Libraries
import sys
import clr
clr.AddReference('ProtoGeometry')
from Autodesk.DesignScript.Geometry import *

# The inputs to this node will be stored as a list in the IN variables.
dataEnteringNode = IN

# Place your code below this line
element_names = IN[0]
output_name = IN[1]
elems = IN[2]
# Assign your output to the OUT variable.
bool_names = []

for i in element_names:
	check = i==output_name
	bool_names.append(check)

def duplicates(lst, item):
	return [i for i, x in enumerate(lst) if x == item]

indices = duplicates(bool_names, True)

elems_filter = []

for i in indices:
	elems_filter.append(elems[i])

OUT = elems_filter
# ----------------------------------------

# group: CODE PARAMETERS
parameter_1 = StringInput("ReferenceID_1")
parameter_2 = StringInput("ReferenceID_2")

# group: POPULATE SHARED PARAMETERS
code_block_4 = CodeBlock(a=parameter_1, b=parameter_2) { [a, b]; }
code_block_5 = CodeBlock(a=code_block_3.out1, b=code_block_3.out2) { [a, b]; }
setParameterByName = Element.SetParameterByName(element=python_script, parameterName=code_block_4@L2, value=code_block_5@L2, lacing=Longest)
selectInRevit = Custom[SelectInRevit](ElemsOrIDs=setParameterByName)  # package Modelical; Select elements in Revit by Element or ID

# group: ADD TAG TO VIEW
view_to_add_tag = Views("Level 1")  # graph input
getLocation = Element.GetLocation(element=selectInRevit)
tag_family_type = FamilyTypes("Family1:Family1")  # graph input
create_tag = BoolSelector(false)  # graph input
create_tag_2 = Custom[Create Tag](view=view_to_add_tag, element=selectInRevit, TagLocation=getLocation, TagType=tag_family_type, RunIt=create_tag)  # package Genius Loci; Works only in Revit 2018 and later. Creates a tag at a given location, of given type and in a supplied view. The node also works with Linked Elements (except space and area), Multi Category tag and Material Tag. Based on an archilab node
