# Dynamo graph Get Elements and Family Types (Excel export).dyn (Dynamo 2.3.0.5885)
# packages: archi-lab.net 2021.25.2621, bimorphNodes 3.0.3, Data-Shapes 2021.2.92

# group: SET TRUE FOR LINK AND FALSE FOR ACTIVE DOCUMENT
string = StringInput("Tick the box if you want to run the script for a Linked Revit Model, otherwise for current Revit model")
run_script = BoolSelector(true)  # graph input
string_2 = StringInput("Finish")
string_3 = StringInput("Linked File")
boolean = BoolSelector(true)
boolean_input = Custom[Boolean input](InputName=string_3, DefaultValue=boolean)  # package Data-Shapes; Creates a boolean input for UI.MultipleInputForm ++ . Check out www.data-shapes.net for more infos!
string_4 = StringInput("Cancel")
multipleinputform = Custom[MultipleInputForm ++](Description_optional=string, Logo_optional=run_script, ButtonText_optional=string_2, Inputs=boolean_input, Toggle=run_script, CancelButtonText_optional=string_4)  # package Data-Shapes; Create a form with multiple inputs. see www.data-shapes.net for tutorials and infos!
code_block = CodeBlock(x=multipleinputform.User_Inputs) { x[0]; }

string_5 = StringInput("Finish")
string_6 = StringInput("Select Categories")
string_7 = StringInput("Finish")
string_8 = StringInput("Select Linked File")
getDocuments = archilab.Revit.Selection.Select.GetDocuments()
dropdown_data = Custom[DropDown Data](InputName=string_8, Keys=getDocuments.Link_Name, Values=getDocuments.Link_Instance)  # package Data-Shapes; Create data for DropDown input in UI.MultiInputForm ++ . Check out www.data-shapes.net for more infos.
string_9 = StringInput("Cancel")
multipleinputform_2 = Custom[MultipleInputForm ++](Logo_optional=code_block, ButtonText_optional=string_7, Inputs=dropdown_data, Toggle=code_block, CancelButtonText_optional=string_9)
code_block_2 = CodeBlock(x=multipleinputform_2.User_Inputs) { x[0]; }
getAll = archilab.Revit.Elements.Categories.GetAll()
ofCategory = Revit.LinkElement.OfCategory(linkInstance=code_block_2, Category=getAll.Model)
boolean_2 = BoolSelector(false)
clean = List.Clean(list=ofCategory, preserveIndices=boolean_2)
element = Revit.LinkElement.Element(linkElement=clean)
getCategory = Element.GetCategory(element=element)
uniqueItems = List.UniqueItems()  # unwired: list
map = List.Map(list=getCategory, f_x=uniqueItems)
flatten = List.Flatten(list=map)
string_from_object = FromObject(obj=flatten)
code_block_3 = CodeBlock()
# ---------- code_block_3.designscript (5 lines) ----------
["HVAC Zones",
"Materials",
"Pipe Segments",
"Project Information",
"RVT Links"];
# ----------------------------------------
contains = String.Contains(str=string_from_object, searchFor=code_block_3, lacing=CrossProduct)
boolean_3 = BoolSelector(true)
contains_2 = List.Contains(list=contains@L2, item=boolean_3)
boolean_4 = BoolSelector(false)
allIndicesOf = List.AllIndicesOf(list=contains_2, item=boolean_4)
getItemAtIndex = List.GetItemAtIndex(list=flatten, index=allIndicesOf)
listview_data = Custom[Listview Data](InputName=string_6, Keys=getItemAtIndex, Values=getItemAtIndex)  # package Data-Shapes; Create data for ListView input in UI.MultiInputForm ++ . Check out www.data-shapes.net for more infos.
string_10 = StringInput("Excel File Path")
file_path = Filename("..\Excel Files\All Model Elements.xlsx")
filepath_data = Custom[FilePath Data](InputName=string_10, DefaulPath=file_path)  # package Data-Shapes; Create filepath input for UI.MultipleInputForm ++ . Check out www.data-shapes.net for more infos !
string_11 = StringInput("Excel Sheet Name")
string_12 = StringInput("Architecture")
textbox_data = Custom[TextBox Data](InputName=string_11, DefaultText=string_12)  # package Data-Shapes; Create Data for TextBox input in UI.MultipleInputForm ++ . Check out www.data-shapes.net for more informations
list_create = List.Create(item0=listview_data, item1=filepath_data, item2=textbox_data)
string_13 = StringInput("Cancel")
multipleinputform_3 = Custom[MultipleInputForm ++](Logo_optional=code_block, ButtonText_optional=string_5, Inputs=list_create, Toggle=code_block, CancelButtonText_optional=string_13)
code_block_4 = CodeBlock(x=multipleinputform_3.User_Inputs) { x[0]; x[1]; x[2]; }
all_elements_in_active_view = ElementsInView()
getCategory_2 = Element.GetCategory(element=all_elements_in_active_view)
uniqueItems_2 = List.UniqueItems(list=getCategory_2)
string_from_object_2 = FromObject(obj=uniqueItems_2)
code_block_5 = CodeBlock()
# ---------- code_block_5.designscript (5 lines) ----------
["HVAC Zones",
"Materials",
"Pipe Segments",
"Project Information",
"RVT Links", "Array"];
# ----------------------------------------
contains_3 = String.Contains(str=string_from_object_2, searchFor=code_block_5, lacing=CrossProduct)
boolean_5 = BoolSelector(true)
contains_4 = List.Contains(list=contains_3@L2, item=boolean_5)
boolean_6 = BoolSelector(false)
allIndicesOf_2 = List.AllIndicesOf(list=contains_4, item=boolean_6)
getItemAtIndex_2 = List.GetItemAtIndex(list=uniqueItems_2, index=allIndicesOf_2)
listview_data_2 = Custom[Listview Data](InputName=string_6, Keys=getItemAtIndex_2, Values=getItemAtIndex_2)
list_create_2 = List.Create(item0=listview_data_2, item1=filepath_data, item2=textbox_data)
boolean_7 = BoolSelector(false)
boolean_8 = BoolSelector(true)
if_ = If(test=code_block, true=boolean_7, false=boolean_8)
multipleinputform_4 = Custom[MultipleInputForm ++](Logo_optional=code_block, ButtonText_optional=string_5, Inputs=list_create_2, Toggle=if_, CancelButtonText_optional=string_13)
code_block_6 = CodeBlock(x=multipleinputform_4.User_Inputs) { x[0]; x[1]; x[2]; }

# group: Excel File Path and Sheet Name
if_2 = If(test=code_block, true=code_block_4.out1, false=code_block_6.out1)
if_3 = If(test=code_block, true=code_block_4.out2, false=code_block_6.out2)

code_block_7 = CodeBlock(x=multipleinputform_4.User_Inputs) { x[0]; }

# group: REARRANGE DATA FOR EXCEL EXPORT
all_elements_of_category = ElementsOfCategory(Category=code_block_6.out0)
name = FamilyType.Name(familyType=all_elements_of_category)
uniqueItems_3 = List.UniqueItems(list=name@L2)

list_create_3 = List.Create(item0=code_block_7, item1=uniqueItems_3)
transpose = List.Transpose(lists=list_create_3)
code_block_8 = CodeBlock { -2; }
flatten_2 = List.Flatten(amt=code_block_8)  # unwired: list
map_2 = List.Map(list=transpose, f_x=flatten_2)
transpose_2 = List.Transpose(lists=map_2)

# group: REARRANGE DATA FOR EXCEL EXPORT
ofCategory_2 = Revit.LinkElement.OfCategory(linkInstance=code_block_2, Category=multipleinputform_3.User_Inputs)
name_2 = FamilyType.Name(familyType=ofCategory_2)
uniqueItems_4 = List.UniqueItems(list=name_2@L2)

list_create_4 = List.Create(item0=code_block_4.out0, item1=uniqueItems_4)
transpose_3 = List.Transpose(lists=list_create_4)
code_block_9 = CodeBlock { -2; }
flatten_3 = List.Flatten(amt=code_block_9)  # unwired: list
map_3 = List.Map(list=transpose_3, f_x=flatten_3)
transpose_4 = List.Transpose(lists=map_3)

# group: DOCUMENT DATA
code_block_10 = CodeBlock(file=if_2, sheet=if_3) { file; sheet; }
code_block_11 = CodeBlock { 0; }
python_script = Python(IN[0]=code_block, IN[1]=transpose_2, IN[2]=transpose_4)
# ---------- python_script.python (23 lines) ----------
# Load the Python Standard and DesignScript Libraries
import sys
import clr
clr.AddReference('ProtoGeometry')
from Autodesk.DesignScript.Geometry import *

# The inputs to this node will be stored as a list in the IN variables.
dataEnteringNode = IN

# Place your code below this line
test = IN[0]
doc = IN[1]
link = IN[2]

output = []

if test == True:
	output.append(link)
else:
	output.append(doc)

# Assign your output to the OUT variable.
OUT = output[0]
# ----------------------------------------
overwrite_excel_data = BoolSelector(true)  # graph input
exportExcel = Data.ExportExcel(filePath=code_block_10.file, sheetName=code_block_10.sheet, startRow=code_block_11, startCol=code_block_11, data=python_script, overWrite=overwrite_excel_data)
