# Dynamo graph Navisworks Clash Detection.dyn (Dynamo 2.3.0.5885)
# packages: DynaWorks20 2.0.0

file_path = Filename("Federated Navisworks Model\Federated Model.nwf")
boolean = BoolSelector(true)
openFile = DynaWorks20.FileSettings.OpenNavisFile.OpenFile(FilePath=file_path, Visible=boolean)
getFilesInProject = DynaWorks20.Objects.NavisNodes.GetFilesInProject(OpenNavisFile=openFile)
getNodeChildren = DynaWorks20.Objects.NavisNodes.GetNodeChildren(Node=getFilesInProject)
getSelectionSetsInProject = DynaWorks20.Objects.NavisSelection.GetSelectionSetsInProject(OpenNavisFile=openFile)
getClashPoint = DynaWorks20.ClashDetection.ClashDetection.GetClashPoint()  # unwired: Result, FirstClashItem
