# Dynamo graph 20210413 Pre-csat st element modeling(v1).dyn "모델링 자동화(v1)" (Dynamo 2.5.0.7460)
# packages: LunchBox for Dynamo 2018.7.6, Synthesize toolkit 7.5.3, Clockwork for Dynamo 2.x 2.3.0, Structural Design 2020.4.10, bimorphNodes 3.0.3, SteamNodes 1.2.4

flatten = List.Flatten()  # unwired: list
categories = Categories("OST_Levels")
all_elements_of_category = ElementsOfCategory(Category=categories)
watch = Watch(all_elements_of_category)
elevation = Level.Elevation(level=watch)
byOutlineTypeAndLevel = Floor.ByOutlineTypeAndLevel()  # unwired: outlineCurves, floorType, level
perimeterCurves = Surface.PerimeterCurves()  # unwired: surface
deconstruct = List.Deconstruct(list=watch)
elevation_2 = Level.Elevation(level=deconstruct.rest)
watch_2 = Watch(elevation_2)
deconstruct_2 = List.Deconstruct(list=watch_2)
code_block = CodeBlock(a=watch_2, b=deconstruct_2.first) { a-b; }
slab_types = FloorTypes("Floor_Timber_22Cbd-225Joist")
categories_2 = Categories("OST_StructuralColumns")
categories_3 = Categories("OST_StructuralFraming")
frame_place = BoolSelector(false)  # graph input
categories_4 = Categories("OST_Grids")
all_elements_of_category_2 = ElementsOfCategory(Category=categories_4)
curve = Grid.Curve(grid=all_elements_of_category_2)
intersect = Geometry.Intersect(geometry=curve, other=curve, lacing=CrossProduct)
flatten_2 = List.Flatten(list=intersect)
string = StringInput("Autodesk.DesignScript.Geometry.Line")
removeIfNot = List.RemoveIfNot(list=flatten_2, type=string)
string_2 = StringInput("Autodesk.DesignScript.Geometry.Point")
removeIfNot_2 = List.RemoveIfNot(list=flatten_2, type=string_2)
pruneDuplicates = Point.PruneDuplicates(points=removeIfNot_2)
splitByPoints = Curve.SplitByPoints(curve=removeIfNot, points=pruneDuplicates)
flatten_3 = List.Flatten(list=splitByPoints)
uniqueItems = List.UniqueItems(list=flatten_3)
string_3 = StringInput("Autodesk.DesignScript.Geometry.Curve")
removeIfNot_3 = List.RemoveIfNot(list=uniqueItems, type=string_3)
select_model_element = DSModelElementSelection()  # 1 picked in the model; graph input
geometry = Element.Geometry(element=select_model_element)
intersectAll = Geometry.IntersectAll(geometry=removeIfNot_3, others=geometry)
flatten_4 = List.Flatten(list=intersectAll)
removeNulls = Lists.Manage.RemoveNulls(Data=flatten_4)
watch_3 = Watch(removeNulls.Cleaned)
explode = Geometry.Explode(geometry=geometry)
filterByOrientation = Custom[CW.Surface.FilterByOrientation](VARsurfaces=explode)  # package Synthesize toolkit; Sorts surfaces in three lists based on their orientation (vertical, horizontal up & horizontal down) and also returns three corresponding lists of booleans.
watch_4 = Watch(filterByOrientation.VARhorizontalDown)
perimeterCurves_2 = Surface.PerimeterCurves(surface=watch_4)
doesIntersect = Geometry.DoesIntersect(geometry=perimeterCurves_2@L2, other=watch_3, lacing=Longest)
anyTrue = Custom[Booleans.AnyTrue](seq=doesIntersect)  # package Clockwork for Dynamo 2.x; Returns true if any item in a list of booleans is true.
filterByBoolMask = List.FilterByBoolMask(list=watch_3, mask=anyTrue)
watch_5 = Watch(filterByBoolMask.out)

# group: 평행한 그리드선 그룹핑
byLine = StructuralDesign.Model.Geom.Vector.ByLine(line=curve)
XAxis = Vector.XAxis()
angleWithVector = Vector.AngleWithVector(vector=byLine, otherVector=XAxis)
groupByKey = List.GroupByKey(list=byLine, keys=angleWithVector)
firstItem = List.FirstItem(list=groupByKey.groups@L2)
byLine_2 = StructuralDesign.Model.Geom.Vector.ByLine(line=watch_5)
isParallel = Vector.IsParallel(vector=firstItem@L1, other=byLine_2)

code_block_2 = CodeBlock(list=isParallel) { list[0]; }
filterByBoolMask_2 = List.FilterByBoolMask(list=watch_5, mask=code_block_2)
y_grid_framing_girder = StructuralFramingTypes("6PSG62_700X900X400")  # graph input

# group: Y Grid Framing Girder
watch_6 = Watch(filterByBoolMask_2.in)

code_block_3 = CodeBlock(a=frame_place, b=watch_6)
# ---------- code_block_3.designscript (3 lines) ----------
a==true?
b:
"";
# ----------------------------------------

# group (continued): Y Grid Framing Girder
translate = Geometry.Translate(geometry=code_block_3, zTranslation=elevation_2@@L1)
beamByCurve = StructuralFraming.BeamByCurve(curve=translate@L2, level=deconstruct.rest@@L1, structuralFramingType=y_grid_framing_girder)

x_grid_framing_girder = StructuralFramingTypes("지붕PSG71C_1900X700X400")  # graph input

# group: X Grid Framing Girder
watch_7 = Watch(filterByBoolMask_2.out)

code_block_4 = CodeBlock(a=frame_place, b=watch_7)  # same code as code_block_3

# group (continued): X Grid Framing Girder
translate_2 = Geometry.Translate(geometry=code_block_4, zTranslation=elevation_2@@L1)
beamByCurve_2 = StructuralFraming.BeamByCurve(curve=translate_2@L2, level=deconstruct.rest@@L1, structuralFramingType=x_grid_framing_girder)

column_types = StructuralColumnTypes("1PC21_1000X1100")  # graph input
column_place = BoolSelector(false)  # graph input
doesIntersect_2 = Geometry.DoesIntersect(geometry=geometry, other=pruneDuplicates, lacing=Longest)
filterByBoolMask_3 = List.FilterByBoolMask(list=pruneDuplicates, mask=doesIntersect_2)
watch_8 = Watch(filterByBoolMask_3.in)
code_block_5 = CodeBlock(a=column_place, b=watch_8)  # same code as code_block_3
elevation_3 = Level.Elevation()  # unwired: level
sortByFunction = List.SortByFunction(list=all_elements_of_category, func=elevation_3)
watch_9 = Watch(sortByFunction)
dropLastItem = Custom[CW.List.DropLastItem](VARlist=watch_9)  # package Synthesize toolkit; Drops the last item from a given list.
byPointAndLevel = FamilyInstance.ByPointAndLevel(familyType=column_types, point=code_block_5, level=dropLastItem@@L1)
string_4 = StringInput("Top Level")
code_block_6 = CodeBlock { 1; }
dropItems = List.DropItems(list=watch_9, amount=code_block_6)
setParameterByName = Element.SetParameterByName(element=byPointAndLevel, parameterName=string_4, value=dropItems)
string_5 = StringInput("Top Offset")
code_block_7 = CodeBlock { 0; }
setParameterByName_2 = Element.SetParameterByName(element=setParameterByName, parameterName=string_5, value=code_block_7)
watch_10 = Watch(setParameterByName_2)
list_create = List.Create(item0=categories_2, item1=categories_3, item2=beamByCurve, item3=beamByCurve_2, item4=watch_10)
code_block_8 = CodeBlock(list=list_create) { list[0]; list[1]; }
all_elements_of_category_3 = ElementsOfCategory(Category=code_block_8.out1)
geometry_2 = Element.Geometry(lacing=Shortest)  # unwired: element
geometry_3 = Element.Geometry(lacing=Shortest)  # unwired: element
doesIntersect_3 = Geometry.DoesIntersect(geometry=geometry_2, other=geometry_3)
byUnion = Solid.ByUnion(solids=geometry_2)
intersectsElement = Revit.Element.IntersectsElement()  # unwired: elementSetA, elementSetB
watch_11 = Watch(intersectsElement.Element)
watch_12 = Watch(intersectsElement.intersectsWith)
intersectionChecker = Custom[Tool.IntersectionChecker]()  # package SteamNodes; Checks if elements have a geometrical intersection. The result is a list of list, with First Element is checked against the others.; unwired: ElementA, ElementB
all_elements_of_category_4 = ElementsOfCategory(Category=code_block_8.out0)
string_6 = StringInput("Top Level")
getParameterValueByName = Element.GetParameterValueByName(element=all_elements_of_category_4, parameterName=string_6)
groupByFunction = List.GroupByFunction()  # unwired: list, func
code_block_9 = CodeBlock {  }
slab_types_2 = FamilyTypes("PC_Slab_RPS:10PS22_2400X250X170")  # graph input
slab_place = BoolSelector(true)  # graph input
watch_13 = Watch(filterByOrientation.VARhorizontalDown)
flatten_5 = List.Flatten(list=watch_13)
translate_3 = Geometry.Translate(geometry=flatten_5, zTranslation=deconstruct_2.first)
flatten_6 = List.Flatten(list=translate_3)
categories_5 = Categories("OST_StructuralFraming")
list_create_2 = List.Create(item0=categories_5, item1=beamByCurve, item2=beamByCurve_2)
code_block_10 = CodeBlock(list=list_create_2) { list[0]; }
all_elements_of_category_5 = ElementsOfCategory(Category=code_block_10)
geometry_4 = Element.Geometry(element=all_elements_of_category_5)
flatten_7 = List.Flatten(list=geometry_4)
byUnion_2 = Solid.ByUnion(solids=flatten_7)
geometrySplit = Geometry.Intersection.GeometrySplit(geometry=flatten_6, cutting=byUnion_2)
watch_14 = Watch(perimeterCurves_2)
translate_4 = Geometry.Translate(geometry=watch_14, zTranslation=deconstruct_2.first)
flatten_8 = List.Flatten(list=translate_4)
byJoinedCurves = PolyCurve.ByJoinedCurves(curves=flatten_8)
doesIntersect_4 = Geometry.DoesIntersect(geometry=geometrySplit, other=byJoinedCurves, lacing=Longest)
filterByBoolMask_4 = List.FilterByBoolMask(list=geometrySplit, mask=doesIntersect_4)
watch_15 = Watch(filterByBoolMask_4.out)
flatten_9 = List.Flatten(list=watch_15)
perimeterCurves_3 = Surface.PerimeterCurves(surface=flatten_9)
byJoinedCurves_2 = PolyCurve.ByJoinedCurves(curves=perimeterCurves_3)
isClosed = Curve.IsClosed(curve=byJoinedCurves_2)
code_block_11 = CodeBlock { false; }
replaceNulls = Lists.Manage.ReplaceNulls(Data=isClosed, ReplaceWith=code_block_11)
filterByBoolMask_5 = List.FilterByBoolMask(list=flatten_9, mask=replaceNulls)
code_block_12 = CodeBlock { 1; }
getIsoline = Surface.GetIsoline(surface=filterByBoolMask_5.in, isoDirection=code_block_12)
length = Curve.Length(curve=getIsoline)
code_block_13 = CodeBlock { 0; }
getIsoline_2 = Surface.GetIsoline(surface=filterByBoolMask_5.in, isoDirection=code_block_13)
length_2 = Curve.Length(curve=getIsoline_2)
code_block_14 = CodeBlock(a=length, b=length_2)
# ---------- code_block_14.designscript (5 lines) ----------
a>b?
a:
a<b?
b:
0;
# ----------------------------------------
slab_length = DoubleSlider(2400, range=1200..2400 step 1200)  # graph input
code_block_15 = CodeBlock(a=code_block_14, b=slab_length) { a/b; }
code_block_16 = CodeBlock { 0; }
round = Math.Round(number=code_block_15, digits=code_block_16)
code_block_17 = CodeBlock(a=length, b=length_2, c=round)
# ---------- code_block_17.designscript (6 lines) ----------
a>b?
c:
1;
b>a?
c:
1;
# ----------------------------------------
lb_lunchbox_quad_grid_by_face = Custom[LB.LunchBox Quad Grid by Face](VARSurface=filterByBoolMask_5.in, VARU=code_block_17.out1, VARV=code_block_17.out0)  # package Synthesize toolkit; Create a quadrangular XYZ grid on a face. The face surface must have an untrimmed UV parameter space.
code_block_18 = CodeBlock { 0.5; }
pointAtParameter = Surface.PointAtParameter(surface=lb_lunchbox_quad_grid_by_face.VARPanelFaces, u=code_block_18, v=code_block_18)
code_block_19 = CodeBlock(a=slab_place, b=pointAtParameter)  # same code as code_block_3
watch_16 = Watch(deconstruct.rest)
deconstruct_3 = List.Deconstruct(list=watch_16)
byPointAndLevel_2 = FamilyInstance.ByPointAndLevel(familyType=slab_types_2, point=code_block_19, level=deconstruct_3.first)
code_block_20 = CodeBlock(b=length_2, a=length)
# ---------- code_block_20.designscript (3 lines) ----------
b>a?
90:
0;
# ----------------------------------------
setRotation = FamilyInstance.SetRotation(familyInstance=byPointAndLevel_2, degree=code_block_20)
code_block_21 = CodeBlock { "Elevation from Level"; }
code_block_22 = CodeBlock { 0; }
setParameterByName_3 = Element.SetParameterByName(element=setRotation, parameterName=code_block_21, value=code_block_22)
copyToLevel = Custom[Element.CopyToLevel](element=setParameterByName_3, level=deconstruct_3.rest)  # package Clockwork for Dynamo 2.x; Copies an element or a list of elements to a given level. Preserves the element's transform. PLEASE NOTE: This node only works for levels that have at least one view (e.g. floor plan) associated with them.
X = Point.X(point=pointAtParameter)
Y = Point.Y(point=pointAtParameter)
code_block_23 = CodeBlock { 0; }
byCoordinates = Point.ByCoordinates(x=X, y=Y, z=code_block_23)
