# Dynamo graph Adaptive Panel Placement.dyn (Dynamo 2.3.0.5885)
# packages: spring nodes 204.1.0

# group: INPUT
lower_floor_surface = DSFaceSelection()  # nothing selected; graph input
offset_from_floor_edge = DoubleInput(0.5)  # graph input
reverse_curve_direction = BoolSelector(false)  # graph input
upper_floor_surface = DSFaceSelection()  # nothing selected; graph input
panel_top_offset_value_reduces = DoubleInput(0.3)  # "Panel Top Offset (Value reduces panel height at the top)"; graph input
panel_family_type_adaptive = FamilyTypes("Sky-Hive_Panel:Sky-Hive_Panel")  # graph input

# group: MATH
perimeterCurves = Surface.PerimeterCurves(surface=lower_floor_surface)
byJoinedCurves = PolyCurve.ByJoinedCurves(curves=perimeterCurves)
perimeterCurves_2 = Surface.PerimeterCurves(surface=upper_floor_surface)
byJoinedCurves_2 = PolyCurve.ByJoinedCurves(curves=perimeterCurves_2)
reverse = Curve.Reverse(curve=byJoinedCurves_2)
if_ = If(test=reverse_curve_direction, true=reverse, false=byJoinedCurves_2)

# group: OFFSET CURVES
code_block = CodeBlock(offset=offset_from_floor_edge) { offset*-1; }
offset = Curve.Offset(curve=byJoinedCurves, distance=code_block)
offset_2 = Curve.Offset(curve=if_, distance=code_block)

# group: PANEL HEIGHT FLOOR REDUCTION
code_block_2 = CodeBlock(Zoffset=panel_top_offset_value_reduces) { Zoffset*-1; }
translate = Geometry.Translate(geometry=offset_2, zTranslation=code_block_2)

# group: CURVE DIVISION CONDITIONALS
length = Curve.Length(curve=offset)
length_2 = Curve.Length(curve=translate)
gt = length > length_2
if_2 = If(test=gt, true=length, false=length_2)
number = DoubleInput(2)
code_block_3 = CodeBlock(Crvlength=if_2, Seglength=number) { div = Crvlength/Seglength; 1 + Math.Round(div); }

# group: CURVE DIVISION BASED ON CURVE DIVISIONS
code_block_4 = CodeBlock(divisions=code_block_3.out1) { 0..1..#divisions; }
pointAtParameter = Curve.PointAtParameter(curve=offset, param=code_block_4, lacing=CrossProduct)
flatten = List.Flatten(list=pointAtParameter)
pointAtParameter_2 = Curve.PointAtParameter(curve=translate, param=code_block_4, lacing=CrossProduct)
flatten_2 = List.Flatten(list=pointAtParameter_2)
list_create = List.Create(item0=flatten, item1=flatten_2)
transpose = List.Transpose(lists=list_create)

# group: ADAPTIVE FAMILY
ꟿ_quads_bypointmatrix = Custom[ꟿ Quads.ByPointMatrix](points=transpose)  # package spring nodes; Creates a CCW or CW list of quad pairs from a rectangular nested list of points.
byPoints = AdaptiveComponent.ByPoints(points=ꟿ_quads_bypointmatrix, familyType=panel_family_type_adaptive)
