# Dynamo graph Column location line - Oculus.dyn (Dynamo 2.3.0.5885)
# packages: Clockwork for Dynamo 2.x 2.3.0, Data-Shapes 2021.2.92

select_model_elements = DSModelElementsSelection()  # 22 picked in the model
boolean = BoolSelector(false)
python_script = Python(IN[0]=select_model_elements, IN[1]=boolean)
# ---------- python_script.python (90 lines) ----------
import clr
import math 

clr.AddReference('RevitAPI')
from Autodesk.Revit.DB import *

clr.AddReference('ProtoGeometry')
from Autodesk.DesignScript.Geometry import *

clr.AddReference("RevitNodes")
import Revit
clr.ImportExtensions(Revit.GeometryConversion)

clr.AddReference("RevitServices")
import RevitServices
from RevitServices.Persistence import DocumentManager

clr.AddReference("DSCoreNodes")
from DSCore import*

doc = DocumentManager.Instance.CurrentDBDocument

columnz = UnwrapElement(IN[0])
projectElevBool = IN[1]
startpointlist = list()
endpointlist = list()
rotations = list()
curves = list()
columnstyle=list()

for col in columnz:
	paramlist = col.Parameters
	rotparam = BuiltInParameter.STRUCTURAL_BEND_DIR_ANGLE
	colstyle=-1
	baselevel = -1
	toplevel=-1
	baseoff ='nada'
	topoff = 'nada'
	for p in paramlist:
		if p.Definition.Name =='Column Style':
			colstyle = col.get_Parameter(p.Definition).AsInteger()
		if p.Definition.Name =='Base Level':
			baselevel= doc.GetElement(col.get_Parameter(p.Definition).AsElementId())
		if p.Definition.Name =='Base Offset':
			baseoff= col.get_Parameter(p.Definition).AsDouble()
		if p.Definition.Name =='Top Level':
			toplevel= doc.GetElement(col.get_Parameter(p.Definition).AsElementId())
		if p.Definition.Name =='Top Offset':
			topoff= col.get_Parameter(p.Definition).AsDouble()
	if projectElevBool == True:
		basel = baselevel.ProjectElevation
		topel = toplevel.ProjectElevation
	else:
		basel = baselevel.Elevation
		topel = toplevel.Elevation
	
	if colstyle ==0:		
		columnloc =col.Location.Point
		rotations.append(math.degrees(col.Location.Rotation))
		#rotations.append(col.Location.Rotation)
		newXYZbottom =XYZ(columnloc.X,columnloc.Y,basel + baseoff)
		newXYZTop =XYZ(columnloc.X,columnloc.Y,topel + topoff)
		startpointlist.append(newXYZbottom.ToPoint())
		endpointlist.append(newXYZTop.ToPoint())
		curves.append(Line.ByStartPointEndPoint(newXYZbottom.ToPoint(),newXYZTop.ToPoint()))
		columnstyle.append(0)
		
	elif colstyle ==1 or colstyle ==2:
		startpointlist.append(col.Location.Curve.GetEndPoint(0).ToPoint())
		endpointlist.append(col.Location.Curve.GetEndPoint(1).ToPoint())
		rotations.append(math.degrees(col.get_Parameter(rotparam).AsDouble()))
		#rotations.append(col.get_Parameter(rotparam).AsDouble())
		curves.append(col.Location.Curve.ToProtoType())
		columnstyle.append(2)
		
	else:
		columnloc =col.Location.Point
		rotations.append(math.degrees(col.Location.Rotation))
		newXYZbottom =XYZ(columnloc.X,columnloc.Y,basel + baseoff)
		newXYZTop =XYZ(columnloc.X,columnloc.Y,topel + topoff)
		startpointlist.append(newXYZbottom.ToPoint())
		endpointlist.append(newXYZTop.ToPoint())
		rotations.append(-1*math.degrees(col.Location.Rotation))
		#rotations.append(col.Location.Rotation)
		curves.append(Line.ByStartPointEndPoint(newXYZbottom.ToPoint(),newXYZTop.ToPoint()))
		columnstyle.append(0)
	
	
		
OUT = (startpointlist, endpointlist, curves, rotations, columnstyle)
# ----------------------------------------
code_block = CodeBlock(x=python_script) { a = 1; _Points = x[a]; _Elevation = x[a].Z; }
byPoints = PolyCurve.ByPoints(points=code_block._Points)
curves = PolyCurve.Curves(polyCurve=byPoints)
string = StringInput("Top Level")
getParameterValueByName = Element.GetParameterValueByName(element=select_model_elements, parameterName=string)
uniqueItems = List.UniqueItems(list=getParameterValueByName)
code_block_2 = CodeBlock(level=uniqueItems) { level[0]; }
structural_framing_types = StructuralFramingTypes("400 x 800mm")
beamByCurve = StructuralFraming.BeamByCurve(curve=curves, level=code_block_2, structuralFramingType=structural_framing_types)
level = Custom[Element.Level](element=select_model_elements)  # package Clockwork for Dynamo 2.x; Gets an element's level
categories = Categories("OST_StructuralColumns")
boolean_2 = BoolSelector(true)
select_model_elements_of = Custom[Select Model Elements of Category](Categories=categories, Toggle=boolean_2)  # package Data-Shapes; Allows to perform a manual selection with a category filter.
select_model_element = DSModelElementSelection()  # 1 picked in the model
select_model_element_2 = DSModelElementSelection()  # 1 picked in the model
join = List.Join(list0=select_model_element, list1=select_model_element_2)
boolean_3 = BoolSelector(true)
python_script_2 = Python(IN[0]=join, IN[1]=boolean_3)  # same code as python_script
code_block_3 = CodeBlock(x=python_script_2) { a = x[0][1]; b = x[1][0]; List.Join([a,b]); }
byPoints_2 = PolyCurve.ByPoints(points=code_block_3.out2)
curves_2 = PolyCurve.Curves(polyCurve=byPoints_2)
select_model_element_3 = DSModelElementSelection()  # 1 picked in the model
