# Dynamo graph Connect two columns.dyn (Dynamo 2.3.0.5885)

lower_column = DSModelElementSelection()  # 1 picked in the model; graph input
upper_column = DSModelElementSelection()  # 1 picked in the model; graph input
join = List.Join(list0=lower_column, list1=upper_column)
boolean = BoolSelector(true)
python_script = Python(IN[0]=join, IN[1]=boolean)
# ---------- python_script.python (90 lines) ----------
import clr
import math 

clr.AddReference('RevitAPI')
from Autodesk.Revit.DB import *

clr.AddReference('ProtoGeometry')
from Autodesk.DesignScript.Geometry import *

clr.AddReference("RevitNodes")
import Revit
clr.ImportExtensions(Revit.GeometryConversion)

clr.AddReference("RevitServices")
import RevitServices
from RevitServices.Persistence import DocumentManager

clr.AddReference("DSCoreNodes")
from DSCore import*

doc = DocumentManager.Instance.CurrentDBDocument

columnz = UnwrapElement(IN[0])
projectElevBool = IN[1]
startpointlist = list()
endpointlist = list()
rotations = list()
curves = list()
columnstyle=list()

for col in columnz:
	paramlist = col.Parameters
	rotparam = BuiltInParameter.STRUCTURAL_BEND_DIR_ANGLE
	colstyle=-1
	baselevel = -1
	toplevel=-1
	baseoff ='nada'
	topoff = 'nada'
	for p in paramlist:
		if p.Definition.Name =='Column Style':
			colstyle = col.get_Parameter(p.Definition).AsInteger()
		if p.Definition.Name =='Base Level':
			baselevel= doc.GetElement(col.get_Parameter(p.Definition).AsElementId())
		if p.Definition.Name =='Base Offset':
			baseoff= col.get_Parameter(p.Definition).AsDouble()
		if p.Definition.Name =='Top Level':
			toplevel= doc.GetElement(col.get_Parameter(p.Definition).AsElementId())
		if p.Definition.Name =='Top Offset':
			topoff= col.get_Parameter(p.Definition).AsDouble()
	if projectElevBool == True:
		basel = baselevel.ProjectElevation
		topel = toplevel.ProjectElevation
	else:
		basel = baselevel.Elevation
		topel = toplevel.Elevation
	
	if colstyle ==0:		
		columnloc =col.Location.Point
		rotations.append(math.degrees(col.Location.Rotation))
		#rotations.append(col.Location.Rotation)
		newXYZbottom =XYZ(columnloc.X,columnloc.Y,basel + baseoff)
		newXYZTop =XYZ(columnloc.X,columnloc.Y,topel + topoff)
		startpointlist.append(newXYZbottom.ToPoint())
		endpointlist.append(newXYZTop.ToPoint())
		curves.append(Line.ByStartPointEndPoint(newXYZbottom.ToPoint(),newXYZTop.ToPoint()))
		columnstyle.append(0)
		
	elif colstyle ==1 or colstyle ==2:
		startpointlist.append(col.Location.Curve.GetEndPoint(0).ToPoint())
		endpointlist.append(col.Location.Curve.GetEndPoint(1).ToPoint())
		rotations.append(math.degrees(col.get_Parameter(rotparam).AsDouble()))
		#rotations.append(col.get_Parameter(rotparam).AsDouble())
		curves.append(col.Location.Curve.ToProtoType())
		columnstyle.append(2)
		
	else:
		columnloc =col.Location.Point
		rotations.append(math.degrees(col.Location.Rotation))
		newXYZbottom =XYZ(columnloc.X,columnloc.Y,basel + baseoff)
		newXYZTop =XYZ(columnloc.X,columnloc.Y,topel + topoff)
		startpointlist.append(newXYZbottom.ToPoint())
		endpointlist.append(newXYZTop.ToPoint())
		rotations.append(-1*math.degrees(col.Location.Rotation))
		#rotations.append(col.Location.Rotation)
		curves.append(Line.ByStartPointEndPoint(newXYZbottom.ToPoint(),newXYZTop.ToPoint()))
		columnstyle.append(0)
	
	
		
OUT = (startpointlist, endpointlist, curves, rotations, columnstyle)
# ----------------------------------------
code_block = CodeBlock(x=python_script) { a = x[0][1]; b = x[1][0]; c = List.Join([a,b]); d1 = c[0].Z; d2 = c[1].Z; e = (d1-d2); d2..d1..3; }
byPoints = PolyCurve.ByPoints(points=code_block.c)
byCoordinates = Point.ByCoordinates(z=code_block.out6)
byOriginNormal = Plane.ByOriginNormal(origin=byCoordinates)
intersect = Geometry.Intersect(geometry=byPoints, other=byOriginNormal)
flatten = List.Flatten(list=intersect)
curves = PolyCurve.Curves(polyCurve=byPoints)
reverse = Curve.Reverse(curve=curves)
levels = Levels("Level 1")
structural_column_types = StructuralColumnTypes("600mm")  # graph input
columnByCurve = StructuralFraming.ColumnByCurve(curve=reverse, level=levels, structuralColumnType=structural_column_types)
getColumnGeometryCurves = Custom[GetColumnGeometryCurves]()  # Get all associated column geometry curves, points and elevations; unwired: Columns, ProjectElevation
