# Dynamo graph Flip Curtain Walls.dyn (Dynamo 2.3.0.5885)
# packages: archi-lab.net 2021.25.2621, Clockwork for Dynamo 2.x 2.3.0

flip = Custom[Wall.Flip]()  # package Clockwork for Dynamo 2.x; Flips the orientation of a given wall - DO ***NOT*** USE IN AUTOMATIC MODE; unwired: wall
flipHandOrientation = Custom[FamilyInstance.FlipHandOrientation]()  # package Clockwork for Dynamo 2.x; Flips the hand orientation of a given family instance; unwired: familyInstance
categories = Categories("OST_Walls")
all_elements_of_category = ElementsOfCategory(Category=categories)
type = archilab.Revit.Elements.Elements.Type(element=all_elements_of_category)
select_model_element = DSModelElementSelection()  # 1 picked in the model
elementType = Element.ElementType(element=select_model_element)
name = Element.Name(element=elementType)
name_2 = Element.Name(element=type)
eq = name == name_2
filterByBoolMask = List.FilterByBoolMask(list=type, mask=eq)
all_elements_of_type = ElementsOfType(element_type=filterByBoolMask.in)
