# Dynamo graph Horizontal Beams to Columns_3.dyn (Dynamo 2.3.0.5885)
# packages: KennyStruct Nodes 0.0.1, Genius Loci 2021.1.20, Data-Shapes 2021.2.92

categories_to_modify = Categories("OST_StructuralColumns")  # graph input
current_view = Views("{3D - kehindeayobade}")  # graph input
all_elements_of_category_in_view = ElementsOfCategoryInView(Category=categories_to_modify, View=current_view)
string = StringInput("Element Selection Group")
getParameterValueByName = Element.GetParameterValueByName(element=all_elements_of_category_in_view, parameterName=string)
uniqueItems = List.UniqueItems(list=getParameterValueByName)
string_2 = StringInput("Col-OSC")
string_3 = StringInput("Col-MIC")
join = List.Join(list0=string_2, list1=string_3)
byKeysValues = DesignScript.Builtin.Dictionary.ByKeysValues(keys=uniqueItems, values=join)
values = DesignScript.Builtin.Dictionary.Values(dictionary=byKeysValues)
allIndicesOf = List.AllIndicesOf(list=getParameterValueByName, item=uniqueItems)
getItemAtIndex = List.GetItemAtIndex(list=all_elements_of_category_in_view, index=allIndicesOf)
byKeysValues_2 = DesignScript.Builtin.Dictionary.ByKeysValues(keys=values, values=getItemAtIndex)
valueAtKey = DesignScript.Builtin.Dictionary.ValueAtKey(dictionary=byKeysValues_2, key=values)
code_block = CodeBlock(x=valueAtKey) { x[0]; x[1]; }
boolean = BoolSelector(true)
getColumnGeometry = Custom[GetColumnGeometry](Columns=code_block.out0, ProjectElevation=boolean)  # package KennyStruct Nodes; Get all column associated geometries (curves, start and end points, rotations and column style)
getColumnGeometry_2 = Custom[GetColumnGeometry](Columns=code_block.out1, ProjectElevation=boolean)

# group: VISUALIZE
list_create = List.Create(item0=getColumnGeometry.Curves, item1=getColumnGeometry_2.Curves)

# group: LEVEL TO WORK ON
level_to_work_on = IntegerSlider(36, range=8..41 step 1)  # graph input

Z = Point.Z(point=getColumnGeometry.StartPoints)
python_script = Python(IN[0]=Z)
# ---------- python_script.python (23 lines) ----------
# Load the Python Standard and DesignScript Libraries
import sys
import clr
clr.AddReference('ProtoGeometry')
from Autodesk.DesignScript.Geometry import *
import math
# The inputs to this node will be stored as a list in the IN variables.
dataEnteringNode = IN

# Place your code below this line

elevs = IN[0]

output = []

for i in elevs:
	rounded = round(i,1)
	output.append(rounded)



# Assign your output to the OUT variable.
OUT = output, set(output)
# ----------------------------------------
code_block_2 = CodeBlock(x=python_script) { x[0]; x[1]; }
allIndicesOf_2 = List.AllIndicesOf(list=code_block_2.out0, item=code_block_2.out1)
getItemAtIndex_2 = List.GetItemAtIndex(list=code_block.out0, index=allIndicesOf_2)

# group: LEVEL ARRANGED FOR COLUMNS ALIGNMENT
categories = Categories("OST_Levels")
all_elements_of_category = ElementsOfCategory(Category=categories)
code_block_3 = CodeBlock { 2; 1; }
shiftIndices = List.ShiftIndices(list=all_elements_of_category, amount=code_block_3.out0)
dropItems = List.DropItems(list=shiftIndices, amount=code_block_3.out0)
shiftIndices_2 = List.ShiftIndices(list=all_elements_of_category, amount=code_block_3.out1)
dropItems_2 = List.DropItems(list=shiftIndices_2, amount=code_block_3.out0)

code_block_4 = CodeBlock(base_levels=dropItems, top_levels=dropItems_2)
# ---------- code_block_4.designscript (14 lines) ----------
elem_count = List.Count(base_levels);
cycles = List.Cycle(0, elem_count);

//SET COLUMN BASE LEVEL PARAMETER
"Base Level";
"Base Offset";
base_levels;
base_offset = List.Cycle(0, List.Count(base_levels));

//SET COLUM TOP LEVEL PARAMETER
"Top Level";
"Top Offset";
top_levels;
List.Cycle(0, List.Count(top_levels));
# ----------------------------------------
setParameterByName = Element.SetParameterByName(element=getItemAtIndex_2, parameterName=code_block_4.out2, value=code_block_4.base_levels)
setParameterByName_2 = Element.SetParameterByName(element=setParameterByName, parameterName=code_block_4.out3, value=code_block_4.base_offset)
setParameterByName_3 = Element.SetParameterByName(element=setParameterByName_2, parameterName=code_block_4.out6, value=code_block_4.top_levels)
setParameterByName_4 = Element.SetParameterByName(element=setParameterByName_3, parameterName=code_block_4.out7, value=code_block_4.out9)
count = List.Count(list=setParameterByName_4@L2)
code_block_5 = CodeBlock(count=count) { 1..count..1; }
Z_2 = Point.Z(point=getColumnGeometry_2.StartPoints)
python_script_2 = Python(IN[0]=Z_2)  # same code as python_script
code_block_6 = CodeBlock(x=python_script_2) { x[0]; x[1]; }
allIndicesOf_3 = List.AllIndicesOf(list=code_block_6.out0, item=code_block_6.out1)
getItemAtIndex_3 = List.GetItemAtIndex(list=code_block.out1, index=allIndicesOf_3)
code_block_7 = CodeBlock(base_levels=dropItems, top_levels=dropItems_2)  # same code as code_block_4
setParameterByName_5 = Element.SetParameterByName(element=getItemAtIndex_3, parameterName=code_block_7.out2, value=code_block_7.base_levels)
setParameterByName_6 = Element.SetParameterByName(element=setParameterByName_5, parameterName=code_block_7.out3, value=code_block_7.base_offset)
setParameterByName_7 = Element.SetParameterByName(element=setParameterByName_6, parameterName=code_block_7.out6, value=code_block_7.top_levels)
setParameterByName_8 = Element.SetParameterByName(element=setParameterByName_7, parameterName=code_block_7.out7, value=code_block_7.out9)
count_2 = List.Count(list=setParameterByName_8@L2)
code_block_8 = CodeBlock(count=count_2) { 1..count..1; }

# group: POPULATE MARK PARAMETER BASED ON LEVELS
code_block_9 = CodeBlock(pre=values, count1=code_block_5, count2=code_block_8, Elem1=setParameterByName_4, Elem2=setParameterByName_8) { "Mark"; mark1 = pre[0] + "-" + count1; mark2 = pre[1] + "-" + count2; [Elem1, Elem2]; [mark1, mark2]; }
setParameterByName_9 = Element.SetParameterByName(element=code_block_9.out3, parameterName=code_block_9.out0, value=code_block_9.out4)

integer_slider = IntegerSlider(22, range=10..50 step 1)

# group: OBTAIN COLUMN GEOMETRY
code_block_10 = CodeBlock(x=setParameterByName_9, level=level_to_work_on) { x[0][level-1]; x[1][level-1]; }
boolean_2 = BoolSelector(true)
getColumnGeometry_3 = Custom[GetColumnGeometry](Columns=code_block_10.out0, ProjectElevation=boolean_2)
getColumnGeometry_4 = Custom[GetColumnGeometry](Columns=code_block_10.out1, ProjectElevation=boolean_2)
list_create_2 = List.Create(item0=getColumnGeometry_4.Curves)
code_block_11 = CodeBlock(div=integer_slider) { 0..1..#div; }

# group: INTERSECTING BEAM PARAMETERS
beam_parameter_1 = DoubleInput(0.2)  # graph input
beam_parameter_2 = DoubleInput(0.5)  # graph input
beam_parameter_3 = DoubleInput(0.8)  # graph input

# group: INTERSECTING LINES
number = DoubleInput(0)
ne = beam_parameter_2 != number
code_block_12 = CodeBlock { null; }
if_ = If(test=ne, true=beam_parameter_2, false=code_block_12)
ne_2 = beam_parameter_3 != number
code_block_13 = CodeBlock { null; }
if_2 = If(test=ne_2, true=beam_parameter_3, false=code_block_13)
code_block_14 = CodeBlock(a=beam_parameter_1, b=if_, c=if_2) { [a,b,c]; }
boolean_3 = BoolSelector(false)

# group: PARAMETIZE CURVES FOR BEAM PLACEMENT
categories_2 = Categories("OST_Levels")
pointAtParameter = Curve.PointAtParameter(curve=list_create_2, param=code_block_11)
code_block_15 = CodeBlock(x=pointAtParameter) { points = List.Flatten(x[0],-1); Point.PruneDuplicates(points, 0.001); }
list_create_3 = List.Create(item0=getColumnGeometry_3.StartPoints)
byPoints = PolyCurve.ByPoints(points=list_create_3)
boolean_4 = BoolSelector(true)
byPoints_2 = PolyCurve.ByPoints(points=code_block_15.out1, connectLastToFirst=boolean_4)
normalAtParameter = Curve.NormalAtParameter(curve=byPoints_2, param=code_block_11, lacing=CrossProduct)
beam_extension_line_length_m = DoubleInput(50)  # graph input
byStartPointDirectionLength = Line.ByStartPointDirectionLength(startPoint=code_block_15.out1, direction=normalAtParameter, length=beam_extension_line_length_m)
intersect = Geometry.Intersect(geometry=byPoints, other=byStartPointDirectionLength, lacing=CrossProduct)
flatten = List.Flatten(list=intersect)
byStartPointEndPoint = Line.ByStartPointEndPoint(startPoint=code_block_15.out1, endPoint=flatten)
clean = List.Clean(list=code_block_14, preserveIndices=boolean_3)
pointAtParameter_2 = Curve.PointAtParameter(curve=byStartPointEndPoint, param=clean, lacing=CrossProduct)
transpose = List.Transpose(lists=pointAtParameter_2)
boolean_5 = BoolSelector(true)
byPoints_3 = PolyCurve.ByPoints(points=transpose, connectLastToFirst=boolean_5)

# group: CREATE CONNECTING BEAMS AND MODIFY PARAMETER VALUES
all_elements_of_category_2 = ElementsOfCategory(Category=categories_2)
code_block_16 = CodeBlock(index=level_to_work_on) { index-1; }
getItemAtIndex_4 = List.GetItemAtIndex(list=all_elements_of_category_2, index=code_block_16)
curves = PolyCurve.Curves(polyCurve=byPoints_3)
join_2 = List.Join(list0=byStartPointEndPoint, list1=curves)
flatten_2 = List.Flatten(list=join_2)
create_beams = BoolSelector(false)  # graph input
structural_framing_types = StructuralFramingTypes("UB305x165x40")  # graph input
code_block_17 = CodeBlock { null; }
if_3 = If(test=create_beams, true=structural_framing_types, false=code_block_17)
beamByCurve = StructuralFraming.BeamByCurve(curve=flatten_2, level=getItemAtIndex_4, structuralFramingType=if_3)
string_4 = StringInput("Start Level Offset")
code_block_18 = CodeBlock { -0.3; }
setParameterByName_10 = Element.SetParameterByName(element=beamByCurve, parameterName=string_4, value=code_block_18)
string_5 = StringInput("End Level Offset")
setParameterByName_11 = Element.SetParameterByName(element=setParameterByName_10, parameterName=string_5, value=code_block_18)

# group: CREATE TAG IN PLAN VIEWS
categories_3 = Categories("OST_Views")
all_elements_of_category_3 = ElementsOfCategory(Category=categories_3)
string_from_object = FromObject(obj=all_elements_of_category_3)
string_6 = StringInput("StructuralPlanView")
boolean_6 = BoolSelector(true)
contains = String.Contains(str=string_from_object, searchFor=string_6, ignoreCase=boolean_6)
filterByBoolMask = List.FilterByBoolMask(list=all_elements_of_category_3, mask=contains)
name = Element.Name(element=getItemAtIndex_4)
name_2 = Element.Name(element=filterByBoolMask.in)
eq = name == name_2
filterByBoolMask_2 = List.FilterByBoolMask(list=filterByBoolMask.in, mask=eq)
list_create_4 = List.Create(item0=code_block_10.out0, item1=code_block_10.out1)
list_create_5 = List.Create(item0=getColumnGeometry_3.StartPoints, item1=getColumnGeometry_3.StartPoints)
tag_family_type = FamilyTypes("Structural Tags (Marks):Structural Tags (Marks)")  # graph input
create_column_tags = BoolSelector(false)  # graph input
create_tag = Custom[Create Tag](view=filterByBoolMask_2.in, element=list_create_4, TagLocation=list_create_5, TagType=tag_family_type, RunIt=create_column_tags)  # package Genius Loci; Works only in Revit 2018 and later. Creates a tag at a given location, of given type and in a supplied view. The node also works with Linked Elements (except space and area), Multi Category tag and Material Tag. Based on an archilab node

all_elements_of_categories_in = Custom[All Elements Of Categories in View]()  # package Data-Shapes; Retrieves all elements of the given categories in the given view; unwired: Views, Categories
