# Dynamo graph Split Columns by Levels.dyn (Dynamo 2.3.0.5885)
# packages: KennyStruct Nodes 0.0.1

column_base_offset = DoubleInput(0)  # graph input
run_script = BoolSelector(false)  # graph input
splitColumnsByLevels = Custom[SplitColumnsByLevels](BaseOffset=column_base_offset, RunScript=run_script)  # package KennyStruct Nodes; Split selected revit structural columns base on associated levels in the document
