# Dynamo graph 3D Rooms with colors_v_.2.dyn "3D Rooms with colors" (Dynamo 2.0.4.12684)

getDocuments = archilab.Revit.Selection.Select.GetDocuments()
categories = Categories(index=416)
ofCategory = Revit.LinkElement.OfCategory(linkInstance=getDocuments.Link_Instance, Category=categories)
element = Revit.LinkElement.Element(linkElement=ofCategory)
flatten = List.Flatten(list=element)
all_elements_of_category = ElementsOfCategory(Category=categories)
flatten_2 = List.Flatten(list=all_elements_of_category)

# group: SET TRUE FOR ROOMS IN REVIT LINK
rooms_from_revit_link = BoolSelector(false)

python_script = Python(IN[0]=flatten, IN[1]=flatten_2, IN[2]=rooms_from_revit_link)
# ---------- python_script.python (19 lines) ----------
# Load the Python Standard and DesignScript Libraries
import sys
import clr
clr.AddReference('ProtoGeometry')
from Autodesk.DesignScript.Geometry import *

link_room = IN[0]
doc_room = IN[1]
test_bool = IN[2]

output = []

if test_bool == True:
	output.append(link_room)

else:
	output.append(doc_room)

OUT = output[0]
# ----------------------------------------
geometry = Element.Geometry(element=python_script)
flatten_3 = List.Flatten(list=geometry)
isEmpty = List.IsEmpty(list=geometry, lacing=CrossProduct)
boolean = BoolSelector(false)
allIndicesOf = List.AllIndicesOf(list=isEmpty, item=boolean)
getItemAtIndex = List.GetItemAtIndex(list=geometry, index=allIndicesOf)
flatten_4 = List.Flatten(list=getItemAtIndex)
name = Room.Name(room=python_script)
getItemAtIndex_2 = List.GetItemAtIndex(list=name, index=allIndicesOf)
ꟿ_directshape_bygeometry = Custom[ꟿ DirectShape.ByGeometry](geometry=flatten_4, category=categories, name=getItemAtIndex_2)  # Convert the input geometry to DirectShape element inside the Revit document. It supports solids or surfaces. It is based on an alternative process that uses a SAT import and can produce smooth surfaces. Each created DS will have a unique type. Make sure that each input geometry has a unique name. You can either feed a single category for all geometries or a unique category for each geometry - the node's lacing is set to longest by default. The default category is Generic Models.
code_block = CodeBlock(rooms=name) { 0..List.Count(rooms)-1; }
random_color_battlebim = Custom[Random Color (BattleBIM)](list=code_block)
overrideColorInView = Element.OverrideColorInView(element=ꟿ_directshape_bygeometry, color=random_color_battlebim)
string = StringInput("Mark")
setParameterByName = Element.SetParameterByName(element=overrideColorInView, parameterName=string, value=name)
