# Dynamo graph 3D Rooms with colors_v_3.dyn (Dynamo 2.3.0.5885)
# packages: spring nodes 204.1.0, BattleBIM 2018.12.17, archi-lab.net 2021.25.2621, bimorphNodes 3.0.3

getDocuments = archilab.Revit.Selection.Select.GetDocuments()
categories = Categories("OST_MEPSpaces")
ofCategory = Revit.LinkElement.OfCategory(linkInstance=getDocuments.Link_Instance, Category=categories)
element = Revit.LinkElement.Element(linkElement=ofCategory)
flatten = List.Flatten(list=element)
all_elements_of_category = ElementsOfCategory(Category=categories)
flatten_2 = List.Flatten(list=all_elements_of_category)

# group: SET TRUE FOR ROOMS IN REVIT LINK
rooms_from_revit_link = BoolSelector(true)

python_script = Python(IN[0]=flatten, IN[1]=flatten_2, IN[2]=rooms_from_revit_link)
# ---------- python_script.python (19 lines) ----------
# Load the Python Standard and DesignScript Libraries
import sys
import clr
clr.AddReference('ProtoGeometry')
from Autodesk.DesignScript.Geometry import *

link_room = IN[0]
doc_room = IN[1]
test_bool = IN[2]

output = []

if test_bool == True:
	output.append(link_room)

else:
	output.append(doc_room)

OUT = output[0]
# ----------------------------------------

# group: REMOVE NON-COHERENT ROOMS
geometry = Element.Geometry(element=python_script)
isEmpty = List.IsEmpty(list=geometry, lacing=CrossProduct)
boolean = BoolSelector(false)
allIndicesOf = List.AllIndicesOf(list=isEmpty, item=boolean)
getItemAtIndex = List.GetItemAtIndex(list=geometry, index=allIndicesOf)
name = Room.Name(room=python_script)
getItemAtIndex_2 = List.GetItemAtIndex(list=name, index=allIndicesOf)

# group: POPULATE ROOM NAME PARAMETER INTO SOLID GEOMETRY
flatten_3 = List.Flatten(list=getItemAtIndex)
ꟿ_directshape_bygeometry = Custom[ꟿ DirectShape.ByGeometry](geometry=flatten_3, category=categories, name=getItemAtIndex_2)  # package spring nodes; Convert the input geometry to DirectShape element inside the Revit document. It supports solids or surfaces. It is based on an alternative process that uses a SAT import and can produce smooth surfaces. Each created DS will have a unique type. Make sure that each input geometry has a unique name. You can either feed a single category for all geometries or a unique category for each geometry - the node's lacing is set to longest by default. The default category is Generic Models.
code_block = CodeBlock(rooms=getItemAtIndex_2) { 0..List.Count(rooms)-1; }
random_color_battlebim = Custom[Random Color (BattleBIM)](list=code_block)  # package BattleBIM; This custom node will generate random color
overrideColorInView = Element.OverrideColorInView(element=ꟿ_directshape_bygeometry, color=random_color_battlebim)
string = StringInput("Mark")
setParameterByName = Element.SetParameterByName(element=overrideColorInView, parameterName=string, value=getItemAtIndex_2)

# group: NON COHERENT ROOMS SOLID GEOMETRY
boolean_2 = BoolSelector(true)
allIndicesOf_2 = List.AllIndicesOf(list=isEmpty, item=boolean_2)
getItemAtIndex_3 = List.GetItemAtIndex(list=python_script, index=allIndicesOf_2)
boundaries = archilab.Revit.Elements.Room.Boundaries(room=getItemAtIndex_3)
byJoinedCurves = PolyCurve.ByJoinedCurves(curves=boundaries)
isNull = Object.IsNull(obj=byJoinedCurves)
boolean_3 = BoolSelector(false)
allIndicesOf_3 = List.AllIndicesOf(list=isNull, item=boolean_3)
getItemAtIndex_4 = List.GetItemAtIndex(list=byJoinedCurves, index=allIndicesOf_3)
getItemAtIndex_5 = List.GetItemAtIndex(list=getItemAtIndex_3, index=allIndicesOf_3)
string_2 = StringInput("Limit Offset")
getParameterValueByName = Element.GetParameterValueByName(element=getItemAtIndex_5, parameterName=string_2)
extrudeAsSolid = Curve.ExtrudeAsSolid(curve=getItemAtIndex_4, distance=getParameterValueByName)
name_2 = Room.Name(room=getItemAtIndex_5)

# group: POPULATE NON-COHERENT ROOM NAME PARAMETER INTO SOLID GEOMETRY
flatten_4 = List.Flatten(list=extrudeAsSolid)
ꟿ_directshape_bygeometry_2 = Custom[ꟿ DirectShape.ByGeometry](geometry=flatten_4, category=categories, name=name_2)
code_block_2 = CodeBlock(rooms=name_2) { 0..List.Count(rooms)-1; }
random_color_battlebim_2 = Custom[Random Color (BattleBIM)](list=code_block_2)
overrideColorInView_2 = Element.OverrideColorInView(element=ꟿ_directshape_bygeometry_2, color=random_color_battlebim_2)
string_3 = StringInput("Mark")
setParameterByName_2 = Element.SetParameterByName(element=overrideColorInView_2, parameterName=string_3, value=name_2)
