# Dynamo graph 00-Beams St UI.dyn (Dynamo 2.12.0.5650)
# packages: Structural Design 2021.9.23, Clockwork for Dynamo 2.x 2.3.0, Data-Shapes 2022.2.100

# note: Download
# 1- Data Shapes 2022.2.100
# 2-Structural Design 2021.9.23

# group: User Inter Face
code_block = CodeBlock { "Create Beams St."; "Create"; "Cancel"; 800; 600; 200; }
code_block_2 = CodeBlock { "Select Beams"; "Select"; }
selectmodelelements_data = Custom[SelectModelElements Data](InputName=code_block_2.out0, ButtonText=code_block_2.out1)  # package Data-Shapes; Creates a Revit element selection input for UI.MultipleInputForm++ . Check out www.data-shapes.net for more infos!
code_block_3 = CodeBlock { "Sttirups Diameter"; }
element_types = ElementTypes("RebarBarType")
all_elements_of_type = ElementsOfType(element_type=element_types)
name = Element.Name(element=all_elements_of_type)
dropdown_data = Custom[DropDown Data](InputName=code_block_3, Keys=name, Values=all_elements_of_type)  # package Data-Shapes; Create data for DropDown input in UI.MultiInputForm ++ . Check out www.data-shapes.net for more infos.
code_block_4 = CodeBlock { "1st Distance"; }
code_block_5 = CodeBlock { "1000"; }
boolean = BoolSelector(true)
textbox_data = Custom[TextBox Data](InputName=code_block_4, DefaultText=code_block_5, IsNumberEntry=boolean)  # package Data-Shapes; Create Data for TextBox input in UI.MultipleInputForm ++ . Check out www.data-shapes.net for more informations
code_block_6 = CodeBlock { "1st Spacing"; }
code_block_7 = CodeBlock { "100"; }
boolean_2 = BoolSelector(true)
textbox_data_2 = Custom[TextBox Data](InputName=code_block_6, DefaultText=code_block_7, IsNumberEntry=boolean_2)
code_block_8 = CodeBlock { "2nd Spacing"; }
code_block_9 = CodeBlock { "200"; }
boolean_3 = BoolSelector(true)
textbox_data_3 = Custom[TextBox Data](InputName=code_block_8, DefaultText=code_block_9, IsNumberEntry=boolean_3)
code_block_10 = CodeBlock { "3rd Spacing"; }
code_block_11 = CodeBlock { "100"; }
boolean_4 = BoolSelector(true)
textbox_data_4 = Custom[TextBox Data](InputName=code_block_10, DefaultText=code_block_11, IsNumberEntry=boolean_4)
code_block_12 = CodeBlock { "Cleareance"; }
code_block_13 = CodeBlock { "50"; }
boolean_5 = BoolSelector(true)
textbox_data_5 = Custom[TextBox Data](InputName=code_block_12, DefaultText=code_block_13, IsNumberEntry=boolean_5)
list_create = List.Create(item0=selectmodelelements_data, item1=dropdown_data, item2=textbox_data, item3=textbox_data_2, item4=textbox_data_3, item5=textbox_data_4, item6=textbox_data_5)
boolean_6 = BoolSelector(true)
multipleinputform = Custom[MultipleInputForm ++](Description_optional=code_block.out0, ButtonText_optional=code_block.out1, Inputs=list_create, Toggle=boolean_6, CancelButtonText_optional=code_block.out2, MaxHeight_optional=code_block.out3, Width_optional=code_block.out4, LabelWidth_optional=code_block.out5)  # package Data-Shapes; Create a form with multiple inputs. see www.data-shapes.net for tutorials and infos!
code_block_14 = CodeBlock { 0; 1; 2; 3; 4; 5; 6; }
selected_element = List.GetItemAtIndex(list=multipleinputform.User_Inputs, index=code_block_14.out0)
st_diameter = List.GetItemAtIndex(list=multipleinputform.User_Inputs, index=code_block_14.out1)
clearance = List.GetItemAtIndex(list=multipleinputform.User_Inputs, index=code_block_14.out6)
n1st_set_spacing = List.GetItemAtIndex(list=multipleinputform.User_Inputs, index=code_block_14.out3)  # "1st Set Spacing"
n1st_distance = List.GetItemAtIndex(list=multipleinputform.User_Inputs, index=code_block_14.out2)  # "1st Distance"
n2nd_set_spacing = List.GetItemAtIndex(list=multipleinputform.User_Inputs, index=code_block_14.out4)  # "2nd Set Spacing"
n3rd_set_spacing = List.GetItemAtIndex(list=multipleinputform.User_Inputs, index=code_block_14.out5)  # "3rd Set Spacing"
number = DoubleInput(1000)

# group: Get The Beam Face
solids = Element.Solids(element=selected_element)
explode = Geometry.Explode(geometry=solids)
perimeter = Surface.Perimeter(surface=explode)
sortIndexByValue = List.SortIndexByValue(list=perimeter)
reorder = List.Reorder(list=explode@L2, indices=sortIndexByValue@L2)
list_create_2 = List.Create(item0=reorder)
code_block_15 = CodeBlock { 0; }
getItemAtIndex = List.GetItemAtIndex(list=list_create_2@L2, index=code_block_15)
code_block_16 = CodeBlock { 1; }
getItemAtIndex_2 = List.GetItemAtIndex(list=list_create_2@L2, index=code_block_16)
list_create_3 = List.Create(item0=getItemAtIndex, item1=getItemAtIndex_2)
transpose = List.Transpose(lists=list_create_3)

# group: Get The Offset Distance
rebarBarType = RevitRebarBarType()  # nothing selected; graph input
rebarHostCover = StructuralDesign.Rebar.Properties.RebarHostCover(element=selected_element)
firstItem = List.FirstItem(list=rebarHostCover.Top_Exterior)
rebarDiameter = StructuralDesign.Rebar.Properties.RebarDiameter(rebar=st_diameter)
code_block_17 = CodeBlock(a=firstItem, b=rebarDiameter) { -(a+b/2); }

flatten = List.Flatten(list=explode)
flatten_2 = List.Flatten(list=perimeter)
groupByKey = List.GroupByKey(list=flatten, keys=flatten_2)
sortByKey = List.SortByKey(list=groupByKey.groups, keys=groupByKey.uniqueKeys)
code_block_18 = CodeBlock(x=sortByKey.sortedList) { x[0]; }
code_block_19 = CodeBlock { 2; }
chop = List.Chop(list=code_block_18, lengths=code_block_19)

# group: Get The St Curve
perimeterCurves = Surface.PerimeterCurves(surface=chop)
startPoint = Curve.StartPoint(curve=perimeterCurves)
byCornerPoints = Rectangle.ByCornerPoints(points=startPoint)
offset = Curve.Offset(curve=byCornerPoints, distance=code_block_17)
firstItem_2 = List.FirstItem(list=offset@L2)

# group: Get The Direction
byPatch = Surface.ByPatch(closedCurve=offset)
code_block_20 = CodeBlock { 0.5; }
pointAtParameter = Surface.PointAtParameter(surface=byPatch, u=code_block_20, v=code_block_20)
code_block_21 = CodeBlock { 0; }
getItemAtIndex_3 = List.GetItemAtIndex(list=pointAtParameter@L2, index=code_block_21)
code_block_22 = CodeBlock { 1; }
getItemAtIndex_4 = List.GetItemAtIndex(list=pointAtParameter@L2, index=code_block_22)
byStartPointEndPoint = Line.ByStartPointEndPoint(startPoint=getItemAtIndex_3, endPoint=getItemAtIndex_4)

direction = Line.Direction(line=byStartPointEndPoint)

# group (continued): Get The St Curve
translate = Geometry.Translate(geometry=firstItem_2, direction=direction, distance=clearance)
curves = PolyCurve.Curves(polyCurve=translate)

code_block_23 = CodeBlock(Rebar_Bar_Type=st_diameter) { Rebar_Bar_Type; }
code_block_24 = CodeBlock(host=selected_element) { host; }

# group: 2nd Rebar Set
code_block_25 = CodeBlock(a=n1st_distance) { a+50; }
translate_2 = Geometry.Translate(geometry=firstItem_2, direction=direction, distance=code_block_25@L1)
flatten_3 = List.Flatten(list=translate_2)
explode_2 = Geometry.Explode(geometry=flatten_3)

length = Curve.Length(curve=byStartPointEndPoint)

# group: 3rd Rebar Set
code_block_26 = CodeBlock(Total_Length=length, F_L_Distance=n1st_distance, Clearence=clearance) { Total_Length-2*F_L_Distance-2*Clearence; }
translate_3 = Geometry.Translate(geometry=flatten_3, direction=direction, distance=code_block_26, lacing=Longest)
explode_3 = Geometry.Explode(geometry=translate_3)

# group: Create Rebar
length_2 = Curve.Length(curve=byStartPointEndPoint)
rebarStyle = RevitRebarStyle("StirrupTie")
code_block_27 = CodeBlock(Rebar_Bar_Type=code_block_23) { Rebar_Bar_Type; }
rebarHookType = RevitRebarHookType("Stirrup/Tie - 135 deg.")
rebarHookOrientation = RevitRebarHookOrientation("Right")
code_block_28 = CodeBlock(host=code_block_24) { host; }
direction_2 = Line.Direction(line=byStartPointEndPoint)
fromCurves = StructuralDesign.Rebar.Create.FromCurves(curves=curves@L2, rebarStyle=rebarStyle, rebarBarType=code_block_27, startHookType=rebarHookType, endHookType=rebarHookType, startHookOrientation=rebarHookOrientation, endHookOrientation=rebarHookOrientation, hostElement=code_block_28, vector=direction_2)
flatten_4 = List.Flatten(list=fromCurves)
boolean_7 = BoolSelector(true)
setLayoutAsMaximumSpacing = StructuralDesign.Rebar.Layout.SetLayoutAsMaximumSpacing(rebar=flatten_4, spacing=n1st_set_spacing, arrayLength=n1st_distance, includeFirstBar=boolean_7)
fromCurves_2 = StructuralDesign.Rebar.Create.FromCurves(curves=explode_2@L2, rebarStyle=rebarStyle, rebarBarType=code_block_27, startHookType=rebarHookType, endHookType=rebarHookType, startHookOrientation=rebarHookOrientation, endHookOrientation=rebarHookOrientation, hostElement=code_block_28, vector=direction_2)
flatten_5 = List.Flatten(list=fromCurves_2)
boolean_8 = BoolSelector(true)
boolean_9 = BoolSelector(false)
setLayoutAsMaximumSpacing_2 = StructuralDesign.Rebar.Layout.SetLayoutAsMaximumSpacing(rebar=flatten_5, spacing=n2nd_set_spacing, arrayLength=code_block_26, includeFirstBar=boolean_8, includeLastBar=boolean_9)
fromCurves_3 = StructuralDesign.Rebar.Create.FromCurves(curves=explode_3@L2, rebarStyle=rebarStyle, rebarBarType=code_block_27, startHookType=rebarHookType, endHookType=rebarHookType, startHookOrientation=rebarHookOrientation, endHookOrientation=rebarHookOrientation, hostElement=code_block_28, vector=direction_2)
flatten_6 = List.Flatten(list=fromCurves_3)
boolean_10 = BoolSelector(true)
boolean_11 = BoolSelector(true)
setLayoutAsMaximumSpacing_3 = StructuralDesign.Rebar.Layout.SetLayoutAsMaximumSpacing(rebar=flatten_6, spacing=n3rd_set_spacing, arrayLength=n1st_distance, includeFirstBar=boolean_10, includeLastBar=boolean_11)

# group: Set Rebar As Solid
list_create_4 = List.Create(item0=setLayoutAsMaximumSpacing, item1=setLayoutAsMaximumSpacing_2, item2=setLayoutAsMaximumSpacing_3)
flatten_7 = List.Flatten(list=list_create_4)
default3DView = Custom[Document.Default3DView]()  # package Clockwork for Dynamo 2.x; Returns the default 3D view of the current model (if there is such a view)
boolean_12 = BoolSelector(true)
setSolidInView = StructuralDesign.Rebar.Create.SetSolidInView(rebar=flatten_7, view=default3DView, solid=boolean_12)
setUnobscuredInView = StructuralDesign.Rebar.Create.SetUnobscuredInView(rebar=setSolidInView, view=default3DView, unobscured=boolean_12)
