# Dynamo graph 01-Coloums RFT.dyn (Dynamo 2.12.0.5650)
# packages: Structural Design 2021.9.23, Chynamo 0.8.5, Clockwork for Dynamo 2.x 2.3.0

# group: Inputs
# note: Script Name: 01-Coloums RFT.dyn
# Packages used in this script:
# Structural Design 2021.9.23
# Chynamo 0.8.5
# Clockwork for Dynamo 2.x 2.3.0
# TimeStamp : 2022/2/24 15:33
select_model_elements = DSModelElementsSelection()  # 1 picked in the model; graph input
sttirups = RevitRebarBarType("10M")  # graph input
column_diameter = RevitRebarBarType("16T")  # graph input
L1 = DoubleInput(1000)  # graph input
S2 = DoubleInput(200)  # graph input
S1 = DoubleInput(100)  # graph input
set_as_solid = BoolSelector(true)  # graph input

# group: Get The Face
solids = Element.Solids(element=select_model_elements)
explode = Geometry.Explode(geometry=solids)
code_block = CodeBlock { 0.5; }
normalAtParameter = Surface.NormalAtParameter(surface=explode, u=code_block, v=code_block)
ZAxis = Vector.ZAxis()
isParallel = Vector.IsParallel(vector=normalAtParameter, otherVector=ZAxis)
filterByBoolMask = List.FilterByBoolMask(list=explode, mask=isParallel)

# group: Reorder Face
flatten = List.Flatten(list=filterByBoolMask.in)
code_block_2 = CodeBlock { 0.5; }
pointAtParameter = Surface.PointAtParameter(surface=flatten, u=code_block_2, v=code_block_2)
Z = Point.Z(point=pointAtParameter)
sortIndexByValue = List.SortIndexByValue(list=Z)
reorder = List.Reorder(list=flatten, indices=sortIndexByValue)

# group: Get The Faces
code_block_3 = CodeBlock { 0; 1; }
getItemAtIndex = List.GetItemAtIndex(list=reorder, index=code_block_3.out0)
getItemAtIndex_2 = List.GetItemAtIndex(list=reorder, index=code_block_3.out1)

code_block_4 = CodeBlock { 0.5; }
pointAtParameter_2 = Surface.PointAtParameter(surface=getItemAtIndex, u=code_block_4, v=code_block_4)
pointAtParameter_3 = Surface.PointAtParameter(surface=getItemAtIndex_2, u=code_block_4, v=code_block_4)
byTwoPoints = Vector.ByTwoPoints(start=pointAtParameter_2, end=pointAtParameter_3)
rebarHostCover = StructuralDesign.Rebar.Properties.RebarHostCover(element=select_model_elements)
firstItem = List.FirstItem(list=rebarHostCover.Bottom_Interior)
rebarDiameter = StructuralDesign.Rebar.Properties.RebarDiameter(rebar=sttirups)
rebarDiameter_2 = StructuralDesign.Rebar.Properties.RebarDiameter(rebar=column_diameter)
offset_distance_main_rft = CodeBlock(Cover=firstItem, Sttirups=rebarDiameter, Col_Diameter=rebarDiameter_2) { -(Cover+Sttirups+(Col_Diameter/2)); }

# group: Offset And Sort Points
perimeterCurves = Surface.PerimeterCurves(surface=getItemAtIndex)
startPoint = Curve.StartPoint(curve=perimeterCurves)
byCornerPoints = Rectangle.ByCornerPoints(points=startPoint)
offset = Curve.Offset(curve=byCornerPoints, distance=offset_distance_main_rft)
explode_2 = Geometry.Explode(geometry=offset)
startPoint_2 = Curve.StartPoint(curve=explode_2)
sortByCoordinateXY = Custom[SortByCoordinateXY](points=startPoint_2)  # package Chynamo; Group and sort the points on TWO(XY or YZ or XZ) direction, default is XY

# group: Get The Bigger Distance And Small
flatten_2 = List.Flatten(list=sortByCoordinateXY.Points)
code_block_5 = CodeBlock { 0; 1; 0; 2; }
getItemAtIndex_3 = List.GetItemAtIndex(list=flatten_2, index=code_block_5.out0)
getItemAtIndex_4 = List.GetItemAtIndex(list=flatten_2, index=code_block_5.out1)
distanceTo = Geometry.DistanceTo(geometry=getItemAtIndex_3, other=getItemAtIndex_4)
getItemAtIndex_5 = List.GetItemAtIndex(list=flatten_2, index=code_block_5.out2)
getItemAtIndex_6 = List.GetItemAtIndex(list=flatten_2, index=code_block_5.out3)
distanceTo_2 = Geometry.DistanceTo(geometry=getItemAtIndex_5, other=getItemAtIndex_6)
gt = distanceTo > distanceTo_2
list_create = List.Create(item0=getItemAtIndex_3, item1=getItemAtIndex_4)
list_create_2 = List.Create(item0=getItemAtIndex_5, item1=getItemAtIndex_6)
bigger_distance_if = RefactoredIf(test=gt, true=list_create, false=list_create_2)
lt = distanceTo < distanceTo_2
smaller_distance_if = RefactoredIf(test=lt, true=list_create, false=list_create_2)

# group: Get The Height
code_block_6 = CodeBlock { "Base Level"; "Top Level"; "Base Offset"; "Top Offset"; }
getParameterValueByName = Element.GetParameterValueByName(element=select_model_elements, parameterName=code_block_6.out1)
elevation = Level.Elevation(level=getParameterValueByName)
getParameterValueByName_2 = Element.GetParameterValueByName(element=select_model_elements, parameterName=code_block_6.out0)
elevation_2 = Level.Elevation(level=getParameterValueByName_2)
code_block_7 = CodeBlock(Level_Top=elevation, Level_Bot=elevation_2) { Level_Top-Level_Bot; }
getParameterValueByName_3 = Element.GetParameterValueByName(element=select_model_elements, parameterName=code_block_6.out2)
code_block_8 = CodeBlock { 0; }
gt_2 = getParameterValueByName_3 > code_block_8
code_block_9 = CodeBlock(a=getParameterValueByName_3) { -a; a; }
if_ = RefactoredIf(test=gt_2, true=code_block_9.out0, false=code_block_9.a)
getParameterValueByName_4 = Element.GetParameterValueByName(element=select_model_elements, parameterName=code_block_6.out3)
code_block_10 = CodeBlock(Lev=code_block_7, off_b=if_, Off_T=getParameterValueByName_4) { Lev+off_b+Off_T; }

LD = CodeBlock(Col_Diameter=rebarDiameter_2) { 60*Col_Diameter; }

# group: Create 1st Line with LD
firstItem_2 = List.FirstItem(list=bigger_distance_if)
ZAxis_2 = Vector.ZAxis()
byStartPointDirectionLength = Line.ByStartPointDirectionLength(startPoint=firstItem_2, direction=ZAxis_2, length=code_block_10)
extendEnd = Curve.ExtendEnd(curve=byStartPointDirectionLength, distance=LD)

# group: Create 2nd Line
code_block_11 = CodeBlock { 0; 1; }
getItemAtIndex_7 = List.GetItemAtIndex(list=smaller_distance_if, index=code_block_11.out0)
getItemAtIndex_8 = List.GetItemAtIndex(list=smaller_distance_if, index=code_block_11.out1)
byStartPointEndPoint = Line.ByStartPointEndPoint(startPoint=getItemAtIndex_7, endPoint=getItemAtIndex_8)
code_block_12 = CodeBlock { 0.5; }
planeAtParameter = Curve.PlaneAtParameter(curve=byStartPointEndPoint, param=code_block_12)
mirror = Geometry.Mirror(geometry=extendEnd, mirrorPlane=planeAtParameter)

# group: Final Lines
list_create_3 = List.Create(item0=extendEnd, item1=mirror)

code_block_13 = CodeBlock(Col_RFT_Rebar_Bar_Type=column_diameter) { Col_RFT_Rebar_Bar_Type; }
host_element = CodeBlock(Host_Element=select_model_elements) { Host_Element; }
code_block_14 = CodeBlock { 0; 1; }
getItemAtIndex_9 = List.GetItemAtIndex(list=bigger_distance_if, index=code_block_14.out0)
getItemAtIndex_10 = List.GetItemAtIndex(list=bigger_distance_if, index=code_block_14.out1)

# group: Create Rebar
rebarStyle = RevitRebarStyle("Standard")
code_block_15 = CodeBlock(Col_RFT_Rebar_Bar_Type=code_block_13) { Col_RFT_Rebar_Bar_Type; }
rebarHookType = RevitRebarHookType("None")
rebarHookOrientation = RevitRebarHookOrientation("Right")
host_element_2 = CodeBlock(Host_Element=host_element) { Host_Element; }
byTwoPoints_2 = Vector.ByTwoPoints(start=getItemAtIndex_9, end=getItemAtIndex_10)
fromCurves = StructuralDesign.Rebar.Create.FromCurves(curves=list_create_3@L1, rebarStyle=rebarStyle, rebarBarType=code_block_15, startHookType=rebarHookType, endHookType=rebarHookType, startHookOrientation=rebarHookOrientation, endHookOrientation=rebarHookOrientation, hostElement=host_element_2, vector=byTwoPoints_2, lacing=Longest)

number_of_bars_long_direction = DoubleInput(8)  # graph input

# group: Create Rebar Number
array_length_geometry_distance = Geometry.DistanceTo(geometry=getItemAtIndex_9, other=getItemAtIndex_10)  # "Array Length Geometry Distance To"
setLayoutAsFixedNumber = StructuralDesign.Rebar.Layout.SetLayoutAsFixedNumber(rebar=fromCurves, arrayLength=array_length_geometry_distance, numberOfBarPositions=number_of_bars_long_direction)

offset_distance_main_st = CodeBlock(Cover=firstItem, Sttirups=rebarDiameter) { -(Cover+Sttirups/2); }

# group: Sttirups Offset
code_block_16 = CodeBlock(Bot_Surface=getItemAtIndex) { Bot_Surface; }
perimeterCurves_2 = Surface.PerimeterCurves(surface=code_block_16)
startPoint_3 = Curve.StartPoint(curve=perimeterCurves_2)
byCornerPoints_2 = Rectangle.ByCornerPoints(points=startPoint_3)
offset_2 = Curve.Offset(curve=byCornerPoints_2, distance=offset_distance_main_st)

# group: 1st St
code_block_17 = CodeBlock { 50; }
translate = Geometry.Translate(geometry=offset_2, zTranslation=code_block_17)

# group: 2nd Group
code_block_18 = CodeBlock(f_Distance=L1, sec_Spacing=S2) { f_Distance+sec_Spacing; }
translate_2 = Geometry.Translate(geometry=translate, zTranslation=code_block_18)

# group: 3rd Group
X = CodeBlock(Heighth=code_block_10, f_Distance=L1, Sec_Spacing=S2, A=code_block_17) { Heighth-2*(f_Distance+Sec_Spacing+A); }
code_block_19 = CodeBlock(f_dISTANCE=L1, SEC_Spacing=S2, X=X) { f_dISTANCE+2*SEC_Spacing+50+X; }
translate_3 = Geometry.Translate(geometry=offset_2, zTranslation=code_block_19)

# group: Create ST.
list_create_4 = List.Create(item0=translate, item1=translate_2, item2=translate_3)
explode_3 = Geometry.Explode(geometry=list_create_4)
rebarStyle_2 = RevitRebarStyle("StirrupTie")
code_block_20 = CodeBlock(St_Rebar_Bar_Type=sttirups) { St_Rebar_Bar_Type; }
rebarHookType_2 = RevitRebarHookType("Stirrup/Tie - 135 deg.")
rebarHookOrientation_2 = RevitRebarHookOrientation("Left")
host_element_3 = CodeBlock(Host_Element=host_element) { Host_Element; }
ZAxis_3 = Vector.ZAxis()
fromCurves_2 = StructuralDesign.Rebar.Create.FromCurves(curves=explode_3@L3, rebarStyle=rebarStyle_2, rebarBarType=code_block_20, startHookType=rebarHookType_2, endHookType=rebarHookType_2, startHookOrientation=rebarHookOrientation_2, endHookOrientation=rebarHookOrientation_2, hostElement=host_element_3, vector=ZAxis_3, lacing=Longest)
code_block_21 = CodeBlock { 1; }
chop = List.Chop(list=fromCurves_2@L2, lengths=code_block_21)
list_create_5 = List.Create(item0=S1, item1=S2, item2=S1)
list_create_6 = List.Create(item0=L1, item1=X, item2=L1)
setLayoutAsMaximumSpacing = StructuralDesign.Rebar.Layout.SetLayoutAsMaximumSpacing(rebar=chop@L3, spacing=list_create_5, arrayLength=list_create_6)

# group: Set Rebar As Solid
list_create_7 = List.Create(item0=setLayoutAsFixedNumber, item1=setLayoutAsMaximumSpacing)
flatten_3 = List.Flatten(list=list_create_7)
default3DView = Custom[Document.Default3DView]()  # package Clockwork for Dynamo 2.x; Returns the default 3D view of the current model (if there is such a view)
setSolidInView = StructuralDesign.Rebar.Create.SetSolidInView(rebar=flatten_3, view=default3DView, solid=set_as_solid)
setUnobscuredInView = StructuralDesign.Rebar.Create.SetUnobscuredInView(rebar=setSolidInView, view=default3DView, unobscured=set_as_solid)

code_block_22 = CodeBlock { 0; }
number_of_bars_short_direction = DoubleInput(3)  # graph input
eq = code_block_22 == number_of_bars_short_direction
code_block_23 = CodeBlock { null; }

# group: Create Short Direction Rebar
direction = Line.Direction(line=byStartPointEndPoint)
distanceTo_3 = Geometry.DistanceTo(geometry=getItemAtIndex_7, other=getItemAtIndex_8)
total_number = CodeBlock(Total_Number=number_of_bars_short_direction) { Total_Number; }
no_Of_Spacing_between_Bars = CodeBlock(Total_Bar_Number=total_number) { Total_Bar_Number-1; }
spacing = CodeBlock(Distance=distanceTo_3, No_Of_SPacing_Between_Bars=no_Of_Spacing_between_Bars) { Distance/No_Of_SPacing_Between_Bars; }
translate_4 = Geometry.Translate(geometry=extendEnd, direction=direction, distance=spacing)
real_rebar_number_short = CodeBlock(Total_number=number_of_bars_short_direction) { Total_number-2; }

# group: Create Short Line Miror
code_block_24 = CodeBlock { 0; 1; }
getItemAtIndex_11 = List.GetItemAtIndex(list=bigger_distance_if, index=code_block_24.out0)
getItemAtIndex_12 = List.GetItemAtIndex(list=bigger_distance_if, index=code_block_24.out1)
byStartPointEndPoint_2 = Line.ByStartPointEndPoint(startPoint=getItemAtIndex_11, endPoint=getItemAtIndex_12)
code_block_25 = CodeBlock { 0.5; }
planeAtParameter_2 = Curve.PlaneAtParameter(curve=byStartPointEndPoint_2, param=code_block_25)
mirror_2 = Geometry.Mirror(geometry=translate_4, mirrorPlane=planeAtParameter_2)

list_create_8 = List.Create(item0=translate_4, item1=mirror_2)
if_2 = RefactoredIf(test=eq, true=code_block_23, false=list_create_8)

# group: Create Rebar Short
rebarStyle_3 = RevitRebarStyle("Standard")
code_block_26 = CodeBlock(Col_RFT_Rebar_Bar_Type=code_block_13) { Col_RFT_Rebar_Bar_Type; }
rebarHookType_3 = RevitRebarHookType("None")
rebarHookOrientation_3 = RevitRebarHookOrientation("Right")
host_element_4 = CodeBlock(Host_Element=host_element) { Host_Element; }
fromCurves_3 = StructuralDesign.Rebar.Create.FromCurves(curves=if_2@L1, rebarStyle=rebarStyle_3, rebarBarType=code_block_26, startHookType=rebarHookType_3, endHookType=rebarHookType_3, startHookOrientation=rebarHookOrientation_3, endHookOrientation=rebarHookOrientation_3, hostElement=host_element_4, vector=direction, lacing=Longest)

setLayoutAsNumberWithSpacing = StructuralDesign.Rebar.Layout.SetLayoutAsNumberWithSpacing(rebar=fromCurves_3, numberOfBarPositions=real_rebar_number_short, spacing=spacing)
code_block_27 = CodeBlock { null; }
eq_2 = setLayoutAsNumberWithSpacing == code_block_27
if_3 = RefactoredIf(test=eq_2, true=fromCurves_3, false=setLayoutAsNumberWithSpacing)

# group: Set Rebar As Solid
flatten_4 = List.Flatten(list=if_3)
default3DView_2 = Custom[Document.Default3DView]()
setSolidInView_2 = StructuralDesign.Rebar.Create.SetSolidInView(rebar=flatten_4, view=default3DView_2, solid=set_as_solid)
setUnobscuredInView_2 = StructuralDesign.Rebar.Create.SetUnobscuredInView(rebar=setSolidInView_2, view=default3DView_2, unobscured=set_as_solid)
