# Dynamo graph 02-Column Stirrup Distributio.dyn "02-Create St Dist." (Dynamo 2.12.0.5650)
# packages: Structural Design 2021.9.23, Clockwork for Dynamo 2.x 2.3.0

# group: Inputs
boolean = BoolSelector(true)  # graph input
# note: Script Name: 02-Create St Dist..dyn
# Packages used in this script:
# Structural Design 2021.9.23
# Clockwork for Dynamo 2.x 2.3.0
# TimeStamp : 2022/2/24 16:26
pickElements = StructuralDesign.Model.Selection.PickElements(refresh=boolean)
L1 = DoubleInput(1000)  # graph input
S2 = DoubleInput(200)  # graph input
rebarHookType = RevitRebarHookType("Stirrup/Tie - 135 deg.")  # graph input
S1 = DoubleInput(100)  # graph input

rebarHostElement = StructuralDesign.Rebar.Properties.RebarHostElement(rebar=pickElements)
solids = Element.Solids(element=rebarHostElement)

# group: Get The Faces
explode = Geometry.Explode(geometry=solids)
flatten = List.Flatten(list=explode)
code_block = CodeBlock { 0.5; }
normalAtParameter = Surface.NormalAtParameter(surface=flatten, u=code_block, v=code_block)
ZAxis = Vector.ZAxis()
isParallel = Vector.IsParallel(vector=normalAtParameter, otherVector=ZAxis)
filterByBoolMask = List.FilterByBoolMask(list=flatten, mask=isParallel)

# group: Re order Faces
flatten_2 = List.Flatten(list=filterByBoolMask.in)
code_block_2 = CodeBlock { 0.5; }
pointAtParameter = Surface.PointAtParameter(surface=flatten_2, u=code_block_2, v=code_block_2)
Z = Point.Z(point=pointAtParameter)
sortIndexByValue = List.SortIndexByValue(list=Z)
reorder = List.Reorder(list=flatten_2, indices=sortIndexByValue)
code_block_3 = CodeBlock { 1; }
getItemAtIndex = List.GetItemAtIndex(list=reorder, index=code_block_3)
code_block_4 = CodeBlock { 0; }
getItemAtIndex_2 = List.GetItemAtIndex(list=reorder, index=code_block_4)

rebarCenterlineCurves = StructuralDesign.Rebar.Properties.RebarCenterlineCurves(rebar=pickElements)
firstItem = List.FirstItem(list=rebarCenterlineCurves@L2)

# group: Create Lines
ZAxis_2 = Vector.ZAxis()
reverse = Vector.Reverse(vector=ZAxis_2)
distanceTo = Geometry.DistanceTo(geometry=firstItem, other=getItemAtIndex_2)
translate = Geometry.Translate(geometry=rebarCenterlineCurves, direction=reverse, distance=distanceTo)

number = DoubleInput(50)

# group: 1st St
translate_2 = Geometry.Translate(geometry=translate, zTranslation=number)

# group: 2nd Group
code_block_5 = CodeBlock(L_1=L1, S_2=S2) { L_1+S_2; }
translate_3 = Geometry.Translate(geometry=translate_2, zTranslation=code_block_5)

# group: Get The Height
code_block_6 = CodeBlock { "Base Level"; "Top Level"; "Base Offset"; "Top Offset"; }
getParameterValueByName = Element.GetParameterValueByName(element=rebarHostElement, parameterName=code_block_6.out1)
elevation = Level.Elevation(level=getParameterValueByName)
getParameterValueByName_2 = Element.GetParameterValueByName(element=rebarHostElement, parameterName=code_block_6.out0)
elevation_2 = Level.Elevation(level=getParameterValueByName_2)
code_block_7 = CodeBlock(Level_Top=elevation, Level_Bot=elevation_2) { Level_Top-Level_Bot; }
getParameterValueByName_3 = Element.GetParameterValueByName(element=rebarHostElement, parameterName=code_block_6.out2)
code_block_8 = CodeBlock { 0; }
gt = getParameterValueByName_3 > code_block_8
code_block_9 = CodeBlock(a=getParameterValueByName_3) { -a; a; }
if_ = RefactoredIf(test=gt, true=code_block_9.out0, false=code_block_9.a)
getParameterValueByName_4 = Element.GetParameterValueByName(element=rebarHostElement, parameterName=code_block_6.out3)
code_block_10 = CodeBlock(Lev=code_block_7, off_b=if_, Off_T=getParameterValueByName_4) { Lev+off_b+Off_T; }

round = Math.Round(number=code_block_10)

# group: 3rd Group
X = CodeBlock(Heighth=round, L_1=L1, S_2=S2, A=number) { Heighth-2*(L_1+S_2+A); }
code_block_11 = CodeBlock(L_1=L1, S_2=S2, A=number, X=X) { L_1+2*S_2+A+X; }
translate_4 = Geometry.Translate(geometry=translate, zTranslation=code_block_11)

rebarProperties = StructuralDesign.Rebar.Properties.RebarProperties(rebar=pickElements)

# group: Create ST.
list_create = List.Create(item0=translate_2, item1=translate_3, item2=translate_4)
rebarStyle = RevitRebarStyle("StirrupTie")
code_block_12 = CodeBlock(St_Rebar_Bar_Type=rebarProperties.Rebar_Bar_Type) { St_Rebar_Bar_Type; }
rebarHookOrientation = RevitRebarHookOrientation("Left")
host_element = CodeBlock(Host_Element=rebarHostElement) { Host_Element; }
ZAxis_3 = Vector.ZAxis()
fromCurves = StructuralDesign.Rebar.Create.FromCurves(curves=list_create@L4, rebarStyle=rebarStyle, rebarBarType=code_block_12, startHookType=rebarHookType, endHookType=rebarHookType, startHookOrientation=rebarHookOrientation, endHookOrientation=rebarHookOrientation, hostElement=host_element, vector=ZAxis_3, lacing=Longest)
code_block_13 = CodeBlock { 1; }
list_create_2 = List.Create(item0=S1, item1=S2, item2=S1)
list_create_3 = List.Create(item0=L1, item1=X, item2=L1)

flatten_3 = List.Flatten(list=fromCurves)

# group (continued): Create ST.
chop = List.Chop(list=flatten_3, lengths=code_block_13)
setLayoutAsMaximumSpacing = StructuralDesign.Rebar.Layout.SetLayoutAsMaximumSpacing(rebar=chop@L3, spacing=list_create_2, arrayLength=list_create_3)

# group: Delete Refrence ST
passthrough = Custom[Passthrough](passThrough=pickElements, waitFor=setLayoutAsMaximumSpacing)  # package Clockwork for Dynamo 2.x; Forces a sequential order of execution. The node wired into the output of the Passthrough node will be executed *after* the node wired into the waitFor input (e.g. important for some Revit operations). The value of the passThrough input will be passed on to the node wired into the output port of the Passthrough node.

deleteElement = StructuralDesign.Model.Geometry.DeleteElement(element=passthrough)
default3DView = Custom[Document.Default3DView]()  # package Clockwork for Dynamo 2.x; Returns the default 3D view of the current model (if there is such a view)
boolean_2 = BoolSelector(true)
setUnobscuredInView = StructuralDesign.Rebar.Create.SetUnobscuredInView(rebar=setLayoutAsMaximumSpacing, view=default3DView, unobscured=boolean_2)
setSolidInView = StructuralDesign.Rebar.Create.SetSolidInView(rebar=setUnobscuredInView, view=default3DView, solid=boolean_2)
