# Dynamo graph 03_Rebar on all Framings.dyn (Dynamo 2.6.1.8786)
# packages: PracticalBIM 2020.0.43, Dynamo for Rebar 2.0.2, Structural Design 2021.9.23

# group: INPUTS
select_beam = DSModelElementSelection()  # 1 picked in the model; graph input
stiffup_bar_type = RebarBarType("H10", ElementType="Autodesk.Revit.DB.Structure.RebarBarType, RevitAPI, Version=21.0.0.0, Culture=neutral, PublicKeyToken=null")  # graph input
top_bar_type = RebarBarType("H16", ElementType="Autodesk.Revit.DB.Structure.RebarBarType, RevitAPI, Version=21.0.0.0, Culture=neutral, PublicKeyToken=null")  # graph input
number_of_top_bars = DoubleInput(4)  # graph input
top_hook_type = RevitRebarHookType("None", ElementType="Autodesk.Revit.DB.Structure.RebarHookType, RevitAPI, Version=21.0.0.0, Culture=neutral, PublicKeyToken=null")  # graph input
buttom_bar_type = RebarBarType("H25", ElementType="Autodesk.Revit.DB.Structure.RebarBarType, RevitAPI, Version=21.0.0.0, Culture=neutral, PublicKeyToken=null")  # graph input
number_of_buttom_bars = DoubleInput(3)  # graph input
buttom_hook_type = RevitRebarHookType("None", ElementType="Autodesk.Revit.DB.Structure.RebarHookType, RevitAPI, Version=21.0.0.0, Culture=neutral, PublicKeyToken=null")  # graph input
stirrup_hook_type = RevitRebarHookType("Stirrup/Tie - 135 deg.", ElementType="Autodesk.Revit.DB.Structure.RebarHookType, RevitAPI, Version=21.0.0.0, Culture=neutral, PublicKeyToken=null")  # graph input
stirrup_spacing_mm = DoubleInput(150)  # graph input
refresh_script = BoolSelector(true)  # graph input

geometry = Element.Geometry(element=select_beam)
code_block = CodeBlock { 100; }
code_block_2 = CodeBlock { 255; }
byARGB = Color.ByARGB(a=code_block, r=code_block_2, g=code_block_2, b=code_block_2)
byGeometryColor = Modifiers.GeometryColor.ByGeometryColor(geometry=geometry, color=byARGB)
code_block_3 = CodeBlock { 2; }
allocateFacesofaSolid = Custom[AllocateFacesofaSolid](solids=geometry)  # package PracticalBIM; Separate all faces of a Solid for Analysis
rebarCoverLengthsfromanElement = Custom[RebarCoverLengthsfromanElement](element=select_beam)  # package PracticalBIM; Gets the Rebar Cover Lengths from an Element
python_script = Python(IN[0]=rebarCoverLengthsfromanElement.topcoveroffset, IN[1]=rebarCoverLengthsfromanElement.bottomcoveroffset)
# ---------- python_script.python (23 lines) ----------
# Load the Python Standard and DesignScript Libraries
import sys
import clr
clr.AddReference('ProtoGeometry')
from Autodesk.DesignScript.Geometry import *

# The inputs to this node will be stored as a list in the IN variables.

tCover = IN[0]
bCover = IN[1]
X = []

# Place your code below this line

if IN[0] == None:
	x = bCover
else:
	x = tCover



# Assign your output to the OUT variable.
OUT = x
# ----------------------------------------
rebarDiameter = StructuralDesign.Rebar.Properties.RebarDiameter(rebar=stiffup_bar_type)
rebarDiameter_2 = StructuralDesign.Rebar.Properties.RebarDiameter(rebar=top_bar_type)
code_block_4 = CodeBlock(cover=python_script, linkDia=rebarDiameter, MDia=rebarDiameter_2) { cover+linkDia+MDia/2; }
longDistanceRebarLineswithTopandSmallsid = Custom[LongDistanceRebarLineswithTopandSmallsides](topsurface=allocateFacesofaSolid.TopSide, smallsurface=allocateFacesofaSolid.SmallSides, topoffsetdistance=code_block_4, otheroffsetdistance=code_block_4, numberofelements=number_of_top_bars)  # package PracticalBIM; Create a number of long distance Rebar using top and small sides and a number of lines
flatten = List.Flatten(list=longDistanceRebarLineswithTopandSmallsid)
startPoint = Curve.StartPoint(curve=flatten)
direction = Line.Direction(line=flatten)
code_block_5 = CodeBlock { -90; }
rotate = Geometry.Rotate(geometry=flatten, origin=startPoint, axis=direction, degrees=code_block_5)
code_block_6 = CodeBlock { 1; }

# group: TOP REBAR
flatten_2 = List.Flatten(list=rotate, amt=code_block_6)
id = Element.Id(element=select_beam)
rebar_style = RebarStyle("Standard", EnumerationType="Autodesk.Revit.DB.Structure.RebarStyle, RevitAPI, Version=21.0.0.0, Culture=neutral, PublicKeyToken=null")
rebar_hook_orientation = RebarHookOrientation("Left", EnumerationType="Autodesk.Revit.DB.Structure.RebarHookOrientation, RevitAPI, Version=21.0.0.0, Culture=neutral, PublicKeyToken=null")
normal = Curve.Normal(curve=flatten_2)
byCurve = Rebar.ByCurve(curve=flatten_2, hostElementId=id, rebarStyle=rebar_style, rebarBarType=top_bar_type, startHookOrientation=rebar_hook_orientation, endHookOrientation=rebar_hook_orientation, startHookType=top_hook_type, endHookType=top_hook_type, vector=normal)  # frozen
direction_2 = Line.Direction(line=flatten_2)

rebarDiameter_3 = StructuralDesign.Rebar.Properties.RebarDiameter(rebar=buttom_bar_type)
code_block_7 = CodeBlock(cover=python_script, linkDia=rebarDiameter, MDia=rebarDiameter_3) { cover+linkDia+MDia/2; }
longDistanceRebarLineswithTopandSmallsid_2 = Custom[LongDistanceRebarLineswithTopandSmallsides](topsurface=allocateFacesofaSolid.BottomSide, smallsurface=allocateFacesofaSolid.SmallSides, topoffsetdistance=code_block_7, otheroffsetdistance=code_block_7, numberofelements=number_of_buttom_bars)
code_block_8 = CodeBlock { false; }
clean = List.Clean(list=longDistanceRebarLineswithTopandSmallsid_2, preserveIndices=code_block_8)
code_block_9 = CodeBlock { 1; }

# group: BOTTOM REBAR
flatten_3 = List.Flatten(list=clean, amt=code_block_9)
id_2 = Element.Id(element=select_beam)
rebar_style_2 = RebarStyle("Standard", EnumerationType="Autodesk.Revit.DB.Structure.RebarStyle, RevitAPI, Version=21.0.0.0, Culture=neutral, PublicKeyToken=null")
rebar_hook_orientation_2 = RebarHookOrientation("Left", EnumerationType="Autodesk.Revit.DB.Structure.RebarHookOrientation, RevitAPI, Version=21.0.0.0, Culture=neutral, PublicKeyToken=null")
normal_2 = Curve.Normal(curve=flatten_3)
byCurve_2 = Rebar.ByCurve(curve=flatten_3, hostElementId=id_2, rebarStyle=rebar_style_2, rebarBarType=buttom_bar_type, startHookOrientation=rebar_hook_orientation_2, endHookOrientation=rebar_hook_orientation_2, startHookType=buttom_hook_type, endHookType=buttom_hook_type, vector=normal_2)  # frozen

freeFormRebarByCurves = Rebar.FreeFormRebarByCurves(curves=flatten_2, hostElementId=id, rebarBarType=top_bar_type)
freeFormRebarByCurves_2 = Rebar.FreeFormRebarByCurves(curves=flatten_3, hostElementId=id_2, rebarBarType=buttom_bar_type)
number = DoubleInput(50)
code_block_10 = CodeBlock(cover=rebarCoverLengthsfromanElement.othercoveroffset, add=number) { cover+add; }
stirrupPolycurveandlinefromTopBottomandL = Custom[StirrupPolycurveandlinefromTopBottomandLongsidefaces](topsurface=allocateFacesofaSolid.TopSide, topdistance=rebarCoverLengthsfromanElement.topcoveroffset, bottomsurface=allocateFacesofaSolid.BottomSide, bottomdistance=rebarCoverLengthsfromanElement.bottomcoveroffset, smallsidesurface=allocateFacesofaSolid.SmallSides, smallsidedistance=code_block_10, sideoffset=rebarCoverLengthsfromanElement.othercoveroffset)  # package PracticalBIM; Gets the Stirrup Polycurve from the Top Bottom and Long Side faces
code_block_11 = CodeBlock { false; }
clean_2 = List.Clean(list=stirrupPolycurveandlinefromTopBottomandL.PolyCurve, preserveIndices=code_block_11)
code_block_12 = CodeBlock { 1; }
code_block_13 = CodeBlock { false; }
clean_3 = List.Clean(list=stirrupPolycurveandlinefromTopBottomandL.Line, preserveIndices=code_block_13)
code_block_14 = CodeBlock { true; }

# group: STIRRUP REBAR
flatten_4 = List.Flatten(list=clean_2, amt=code_block_12)
id_3 = Element.Id(element=select_beam)
rebar_style_3 = RebarStyle("StirrupTie", EnumerationType="Autodesk.Revit.DB.Structure.RebarStyle, RevitAPI, Version=21.0.0.0, Culture=neutral, PublicKeyToken=null")
rebar_hook_orientation_3 = RebarHookOrientation("Right", EnumerationType="Autodesk.Revit.DB.Structure.RebarHookOrientation, RevitAPI, Version=21.0.0.0, Culture=neutral, PublicKeyToken=null")
normal_3 = Curve.Normal(curve=flatten_4)
byCurve_3 = Rebar.ByCurve(curve=flatten_4, hostElementId=id_3, rebarStyle=rebar_style_3, rebarBarType=stiffup_bar_type, startHookOrientation=rebar_hook_orientation_3, endHookOrientation=rebar_hook_orientation_3, startHookType=stirrup_hook_type, endHookType=stirrup_hook_type, vector=normal_3)
length = Curve.Length(curve=clean_3)
setLayoutAsMaximumSpacing = DynamoRebar.Rebar.SetLayoutAsMaximumSpacing(rebar=byCurve_3, spacing=stirrup_spacing_mm, arrayLength=length, barsOnNormalSide=code_block_14, includeFirstBar=code_block_14, includeLastBar=code_block_14, lacing=Longest)

join = List.Join(list0=freeFormRebarByCurves, list1=freeFormRebarByCurves_2, list2=setLayoutAsMaximumSpacing)
active_view_python_script = Python(IN[0]=refresh_script)
# ---------- active_view_python_script.python (18 lines) ----------
# Load the Python Standard and DesignScript Libraries
import sys
import clr
clr.AddReference('ProtoGeometry')
from Autodesk.DesignScript.Geometry import *

clr.AddReference("RevitAPI")
from Autodesk.Revit.DB import *

clr.AddReference("RevitServices")
import RevitServices
from RevitServices.Persistence import DocumentManager 
from RevitServices.Transactions import TransactionManager 

doc = DocumentManager.Instance.CurrentDBDocument


OUT = doc.ActiveView
# ----------------------------------------
setSolidInView = Rebar.SetSolidInView(rebar=join, view=active_view_python_script, solid=code_block_14)
code_block_15 = CodeBlock { false; }
clean_4 = List.Clean(list=flatten, preserveIndices=code_block_15)
code_block_16 = CodeBlock(Longsides=allocateFacesofaSolid.LongSides, cover=rebarCoverLengthsfromanElement.othercoveroffset, barDia=rebarDiameter)
# ---------- code_block_16.designscript (7 lines) ----------
pt1 = Surface.PointAtParameter(Longsides[0],0.5,0.5);
pt2 = Surface.PointAtParameter(Longsides[1],0.5,0.5);
line = Line.ByStartPointEndPoint(pt1,pt2);
length = Autodesk.Geometry.Curve.Length(line);
L = Math.Round(length);

arrayLength = L-(2*cover + 2*barDia);
# ----------------------------------------
setUnobscuredInView = StructuralDesign.Rebar.Create.SetUnobscuredInView(rebar=join, view=active_view_python_script)
