# Dynamo graph Area Reinforcement Rebar Position Mark.dyn (Dynamo 2.6.1.8786)
# packages: Structural Design 2021.9.23, KennyStruct Nodes 0.0.1, ACOPackage 1.0.4

element_category = Categories("OST_StructuralFoundation")  # graph input
run_script = BoolSelector(true)  # graph input
pickObjectsOfCategory = StructuralDesign.Model.Selection.PickObjectsOfCategory(category=element_category, refresh=run_script)
getRebarFromHost = Custom[GetRebarFromHost](HostElement=pickObjectsOfCategory)  # package KennyStruct Nodes; Works with both Area Reinforcement and Normal Reinforcements
code_block = CodeBlock(x=getRebarFromHost) { x[0]; }
removeAreaReinforcementSystem = StructuralDesign.Rebar.AreaReinforcement.AreaReinforcement.RemoveAreaReinforcementSystem(areaReinforcement=code_block)
isEmpty = List.IsEmpty(list=removeAreaReinforcementSystem)
getRebarsInHost = ACOSolution.Rebars.GetRebarsInHost(element=pickObjectsOfCategory)
code_block_2 = CodeBlock(x=getRebarsInHost) { x[0]; }
python_script = Python(IN[0]=isEmpty, IN[1]=code_block_2, IN[2]=removeAreaReinforcementSystem)
# ---------- python_script.python (21 lines) ----------
# Load the Python Standard and DesignScript Libraries
import sys
import clr
clr.AddReference('ProtoGeometry')
from Autodesk.DesignScript.Geometry import *

test = IN[0]
trueA = IN[1]
falseA = IN[2]

outs = []

if test==True:
	outs.append(trueA)
else:
	outs.append(falseA)

# Place your code below this line

# Assign your output to the OUT variable.
OUT = outs
# ----------------------------------------
code_block_3 = CodeBlock(x=python_script) { x[0]; }
string = StringInput("Spacing")
getParameterValueByName = Element.GetParameterValueByName(element=code_block_3, parameterName=string)
isNull = Object.IsNull(obj=getParameterValueByName, lacing=Longest)
string_2 = StringInput("Spacing")
string_3 = StringInput("")
eq = getParameterValueByName == string_3
filterByBoolMask = List.FilterByBoolMask(list=getParameterValueByName, mask=eq)
ceiling = Math.Ceiling(number=filterByBoolMask.out)
code_block_4 = CodeBlock { 2; }
add = ceiling + code_block_4
python_script_2 = Python(IN[0]=add)
# ---------- python_script_2.python (16 lines) ----------
# Load the Python Standard and DesignScript Libraries
import sys
import clr
clr.AddReference('ProtoGeometry')
from Autodesk.DesignScript.Geometry import *

# The inputs to this node will be stored as a list in the IN variables.
space = IN[0]

output = []
for L in space:
	output.append(round(L,-1))	
# Place your code below this line

# Assign your output to the OUT variable.
OUT = output
# ----------------------------------------
setParameterByName = Element.SetParameterByName(element=code_block_3, parameterName=string_2, value=python_script_2)
flatten = List.Flatten(list=setParameterByName)
boolean = BoolSelector(true)
boolean_2 = BoolSelector(false)
code_block_5 = CodeBlock { 0; }
rebarCenterlineCurves = StructuralDesign.Rebar.Properties.RebarCenterlineCurves(rebar=setParameterByName, adjustForSelfIntersection=boolean, suppressBendRadius=boolean_2, barPositionIndex=code_block_5, lacing=Longest)
byJoinedCurves = PolyCurve.ByJoinedCurves(curves=rebarCenterlineCurves)
flatten_2 = List.Flatten(list=byJoinedCurves)
code_block_6 = CodeBlock { 0.5; }
pointAtParameter = Curve.PointAtParameter(curve=flatten_2, param=code_block_6)
Z = Point.Z(point=pointAtParameter)
code_block_7 = CodeBlock { 2; }
add_2 = Z + code_block_7
python_script_3 = Python(IN[0]=add_2)
# ---------- python_script_3.python (15 lines) ----------
# Load the Python Standard and DesignScript Libraries
import sys
import clr
clr.AddReference('ProtoGeometry')
from Autodesk.DesignScript.Geometry import *

# The inputs to this node will be stored as a list in the IN variables.
space = IN[0]

output = []
for L in space:
	output.append(round(L,-1))

# Assign your output to the OUT variable.
OUT = output
# ----------------------------------------
groupByKey = List.GroupByKey(list=flatten, keys=python_script_3)
sortByKey = List.SortByKey(list=groupByKey.groups, keys=groupByKey.unique_keys)
string_4 = StringInput("Mark")
code_block_8 = CodeBlock { ["BB","BT","TB","TT"]; }
setParameterByName_2 = Element.SetParameterByName(element=sortByKey.sorted_list, parameterName=string_4, value=code_block_8)
string_5 = StringInput("Partition")
string_6 = StringInput("Mark")
getParameterValueByName_2 = Element.GetParameterValueByName(element=pickObjectsOfCategory, parameterName=string_6)
code_block_9 = CodeBlock(x=getParameterValueByName_2) { x[0]; }
string_7 = StringInput("")
eq_2 = code_block_9 == string_7
string_8 = StringInput("Category")
getParameterValueByName_3 = Element.GetParameterValueByName(element=pickObjectsOfCategory, parameterName=string_8)
code_block_10 = CodeBlock(x=getParameterValueByName_3) { x[0]; }
string_from_object = FromObject(obj=code_block_10)
if_ = If(test=eq_2, true=string_from_object, false=code_block_9)
setParameterByName_3 = Element.SetParameterByName(element=setParameterByName_2, parameterName=string_5, value=if_, lacing=Longest)
