# Dynamo graph Area Reinforcement to Rebars.dyn (Dynamo 2.6.1.8786)
# packages: Structural Design 2021.9.23

categories = Categories("OST_AreaRein")
all_elements_of_category = ElementsOfCategory(Category=categories)
python_script = Python(IN[0]=all_elements_of_category)
# ---------- python_script.python (16 lines) ----------
import clr
clr.AddReference('RevitAPI')
from Autodesk.Revit.DB.Structure import *
clr.AddReference('RevitServices')
import RevitServices
from RevitServices.Persistence import DocumentManager
doc = DocumentManager.Instance.CurrentDBDocument

if isinstance(IN[0], list):
	OUT=[]
	elements = UnwrapElement(IN[0])
	for element in elements:
		OUT.append([doc.GetElement(id) for id in element.GetRebarInSystemIds()])
else:
	element = UnwrapElement(IN[0])
	OUT=[doc.GetElement(id) for id in element.GetRebarInSystemIds()]
# ----------------------------------------
string = StringInput("Mark")
getParameterValueByName = Element.GetParameterValueByName(element=all_elements_of_category, parameterName=string)
setParameterByName = Element.SetParameterByName(element=python_script, parameterName=string, value=getParameterValueByName, lacing=Longest)
boolean = BoolSelector(true)
code_block = CodeBlock { document1 = Revit.Document.Current; Revit.Document.ActiveView(document1); }
if_ = If(test=boolean, true=code_block.out1, false=code_block.out1)
boolean_2 = BoolSelector(true)
setUnobscuredInView = StructuralDesign.Rebar.AreaReinforcement.AreaReinforcement.SetUnobscuredInView(areaReinforcement=all_elements_of_category, view=if_, unobscured=boolean_2)
