# Dynamo graph Beam_Wall Rebars.dyn (Dynamo 2.3.1.11775)
# packages: KennyStruct Nodes 0.0.1, BIM4Struc.Rebar 1.2.4, Structural Design 2021.1.22, Rhythm 2021.4.2, Dynamo for Rebar 1.2.0

# group: INPUTS
refresh_script = BoolSelector(true)  # graph input
cover = DoubleInput(30)
stirrup_spacing = DoubleInput(200)  # graph input
no_of_bottom_rebars = DoubleInput(4)  # graph input
no_of_top_rebars = DoubleInput(2)  # graph input
number_of_side_bars = DoubleInput(2)  # graph input

pickElements = StructuralDesign.Model.Selection.PickElements(refresh=refresh_script)
getLocation = Element.GetLocation(element=pickElements)
shorten = DynamoRebar.Rebar.Shorten(curves=getLocation, length=cover)
length = Curve.Length(curve=shorten)
boolean = BoolSelector(false)
geometry = Element.Geometry(element=pickElements)
flatten = List.Flatten(list=geometry)

# group: FILTER OUT TOP AND BOTTOM FACES OF SELECTED BEAMS
explode = Geometry.Explode(geometry=flatten)
code_block = CodeBlock { 0.5; }
pointAtParameter = Surface.PointAtParameter(surface=explode, u=code_block, v=code_block)
Z = Point.Z(point=pointAtParameter)
sortByKey = List.SortByKey(list=explode@L2, keys=Z@L2)
firstItem = List.FirstItem(list=sortByKey.sorted_list@L2)
lastItem = List.LastItem(list=sortByKey.sorted_list@L2)

code_block_2 = CodeBlock(D=sortByKey.sorted_list) { L=D[0]; x = List.Count(L); [0,x-1]; }
removeItemAtIndex = List.RemoveItemAtIndex(list=sortByKey.sorted_list@L2, indices=code_block_2.out2)
code_block_3 = CodeBlock(x=removeItemAtIndex) { x[0]; }
area = Surface.Area(surface=removeItemAtIndex)
code_block_4 = CodeBlock(x=area) { x[0]; }
round = Math.Round(number=code_block_4)
minimumItem = List.MinimumItem(list=round)
eq = minimumItem == round
filterByBoolMask = List.FilterByBoolMask(list=code_block_3, mask=eq)
code_block_5 = CodeBlock(x=filterByBoolMask.in) { x[0]; x[1]; }
if_ = If(test=boolean, true=code_block_5.out0, false=code_block_5.out1)
direction = Line.Direction(line=getLocation)
stirrup_rebarbartype = RevitRebarBarType("H8")  # graph input

# group: STIRRUPS REBARS
perimeterCurves = Surface.PerimeterCurves(surface=if_)
byJoinedCurves = PolyCurve.ByJoinedCurves(curves=perimeterCurves)
formula = Formula("d*-1", d=cover)
offset = Curve.Offset(curve=byJoinedCurves, distance=formula)
patch = Curve.Patch(curve=offset)
translate = Geometry.Translate(geometry=patch, direction=direction, distance=cover)
flipNormalDirection = Surface.FlipNormalDirection(surface=translate)
perimeterCurves_2 = Surface.PerimeterCurves(surface=flipNormalDirection)
rebarStyle = RevitRebarStyle("StirrupTie")
rebarHookType = RevitRebarHookType("Stirrup/Tie - 135 deg.")
rebarHookOrientation = RevitRebarHookOrientation("Left")
byJoinedCurves_2 = PolyCurve.ByJoinedCurves(curves=perimeterCurves_2)
normal = Curve.Normal(curve=byJoinedCurves_2)
reverse = Vector.Reverse(vector=normal)
fromCurves = StructuralDesign.Rebar.Create.FromCurves(curves=perimeterCurves_2, rebarStyle=rebarStyle, rebarBarType=stirrup_rebarbartype, startHookType=rebarHookType, endHookType=rebarHookType, startHookOrientation=rebarHookOrientation, endHookOrientation=rebarHookOrientation, hostElement=pickElements, vector=reverse)  # frozen
code_block_6 = CodeBlock(x=fromCurves) { x[0]; }
setRebarAsSolidUnobscured = Custom[SetRebarAsSolidUnobscured](rebar=code_block_6)  # package KennyStruct Nodes; Set rebar as both solid and unobscured in current view
setStirrupLayoutRuleAndSpacing = Custom[SetStirrupLayoutRuleAndSpacing](Spacing=stirrup_spacing, Rebar=setRebarAsSolidUnobscured)  # package KennyStruct Nodes; Set rebar layout as "maximum spacing" with spacing as input
rebarShape = RevitRebarShape("51")
hook_at_start = RevitRebarHookType("Stirrup/Tie - 135 deg.")
hook_at_end = RevitRebarHookType("Stirrup/Tie - 135 deg.")
setRebarHookAndShape = Custom[SetRebarHookAndShape](Rebar=setStirrupLayoutRuleAndSpacing, RebarShape=rebarShape, HookType_Start=hook_at_start, HookType_End=hook_at_end)  # package KennyStruct Nodes; Set rebar shape and hook types

bottom_rebarbartype = RevitRebarBarType("H20")  # graph input
rebarShape_2 = RevitRebarShape("00")
hook_at_start_2 = RevitRebarHookType("None")

# group: BOTTOM MAIN REBARS
boolean_2 = BoolSelector(false)
getBarDiameter = Custom[RebarType.GetBarDiameter](rebarBarType=stirrup_rebarbartype, ConvertToMM=boolean_2)  # package BIM4Struc.Rebar; Get the diameter of a given Rebar Bar Type
getBarDiameter_2 = Custom[RebarType.GetBarDiameter](rebarBarType=bottom_rebarbartype, ConvertToMM=boolean_2)
code_block_7 = CodeBlock(cover=cover, stirrupdia=getBarDiameter, maindia=getBarDiameter_2) { cover + stirrupdia + maindia/2; }
code_block_8 = CodeBlock(z=code_block_7) { z*1; }
translate_2 = Geometry.Translate(geometry=firstItem, zTranslation=code_block_8)
perimeterCurves_3 = Surface.PerimeterCurves(surface=translate_2)
length_2 = Curve.Length(curve=perimeterCurves_3)
sortByKey_2 = List.SortByKey(list=perimeterCurves_3@L2, keys=length_2@L2)
code_block_9 = CodeBlock { 2; }
dropItems = List.DropItems(list=sortByKey_2.sorted_list, amount=code_block_9, lacing=Longest)
firstItem_2 = List.FirstItem(list=dropItems@L2)
lastItem_2 = List.LastItem(list=dropItems@L2)
reverse_2 = Curve.Reverse(curve=lastItem_2)
code_block_10 = CodeBlock(x1=firstItem_2, x2=reverse_2) { [x1,x2]; }
transpose = List.Transpose(lists=code_block_10)
integer_slider = IntegerSlider(50, range=1..100 step 1)
code_block_11 = CodeBlock(div=integer_slider) { 0..1..#div; }
pointAtParameter_2 = Curve.PointAtParameter(curve=transpose, param=code_block_11, lacing=CrossProduct)
byPoints = PolyCurve.ByPoints(points=pointAtParameter_2)
code_block_12 = CodeBlock(TopNo=no_of_bottom_rebars) { 0..1..#TopNo; }

shorten_2 = DynamoRebar.Rebar.Shorten(curves=byPoints, length=code_block_7)

# group (continued): BOTTOM MAIN REBARS
pointAtParameter_3 = Curve.PointAtParameter(curve=shorten_2@L2, param=code_block_12, lacing=CrossProduct)
transpose_2 = List.Transpose(lists=pointAtParameter_3)
byPoints_2 = NurbsCurve.ByPoints(points=transpose_2)
transpose_3 = List.Transpose(lists=byPoints_2)

freeFormRebar = StructuralDesign.Rebar.Create.FreeFormRebar(rebarBarType=bottom_rebarbartype, hostElement=pickElements, curves=transpose_3, lacing=Longest)

# group (continued): BOTTOM MAIN REBARS
setRebarAsSolidUnobscured_2 = Custom[SetRebarAsSolidUnobscured](rebar=freeFormRebar)
setRebarHookAndShape_2 = Custom[SetRebarHookAndShape](Rebar=setRebarAsSolidUnobscured_2, RebarShape=rebarShape_2, HookType_Start=hook_at_start_2, HookType_End=hook_at_start_2, lacing=CrossProduct)

top_rebarbartype = RevitRebarBarType("H16")  # graph input
rebarShape_3 = RevitRebarShape("00")
hook_at_start_3 = RevitRebarHookType("None")

# group: TOP MAIN REBARS
boolean_3 = BoolSelector(false)
getBarDiameter_3 = Custom[RebarType.GetBarDiameter](rebarBarType=stirrup_rebarbartype, ConvertToMM=boolean_3)
getBarDiameter_4 = Custom[RebarType.GetBarDiameter](rebarBarType=top_rebarbartype, ConvertToMM=boolean_3)
code_block_13 = CodeBlock(cover=cover, stirrupdia=getBarDiameter_3, maindia=getBarDiameter_4) { cover + stirrupdia + maindia/2; }
code_block_14 = CodeBlock(z=code_block_13) { z*-1; }
translate_3 = Geometry.Translate(geometry=lastItem, zTranslation=code_block_14)
perimeterCurves_4 = Surface.PerimeterCurves(surface=translate_3)
length_3 = Curve.Length(curve=perimeterCurves_4)
sortByKey_3 = List.SortByKey(list=perimeterCurves_4@L2, keys=length_3@L2)
code_block_15 = CodeBlock { 2; }
dropItems_2 = List.DropItems(list=sortByKey_3.sorted_list, amount=code_block_15, lacing=Longest)
firstItem_3 = List.FirstItem(list=dropItems_2@L2)
lastItem_3 = List.LastItem(list=dropItems_2@L2)
reverse_3 = Curve.Reverse(curve=lastItem_3)
code_block_16 = CodeBlock(x1=firstItem_3, x2=reverse_3) { [x1,x2]; }
transpose_4 = List.Transpose(lists=code_block_16)
integer_slider_2 = IntegerSlider(50, range=1..100 step 1)
code_block_17 = CodeBlock(div=integer_slider_2) { 0..1..#div; }
pointAtParameter_4 = Curve.PointAtParameter(curve=transpose_4, param=code_block_17, lacing=CrossProduct)
byPoints_3 = PolyCurve.ByPoints(points=pointAtParameter_4)
code_block_18 = CodeBlock(TopNo=no_of_top_rebars) { 0..1..#TopNo; }

shorten_3 = DynamoRebar.Rebar.Shorten(curves=byPoints_3, length=code_block_13)

# group (continued): TOP MAIN REBARS
pointAtParameter_5 = Curve.PointAtParameter(curve=shorten_3@L2, param=code_block_18, lacing=CrossProduct)
transpose_5 = List.Transpose(lists=pointAtParameter_5)
byPoints_4 = NurbsCurve.ByPoints(points=transpose_5)
transpose_6 = List.Transpose(lists=byPoints_4)

freeFormRebar_2 = StructuralDesign.Rebar.Create.FreeFormRebar(rebarBarType=top_rebarbartype, hostElement=pickElements, curves=transpose_6, lacing=Longest)

# group (continued): TOP MAIN REBARS
setRebarAsSolidUnobscured_3 = Custom[SetRebarAsSolidUnobscured](rebar=freeFormRebar_2)
setRebarHookAndShape_3 = Custom[SetRebarHookAndShape](Rebar=setRebarAsSolidUnobscured_3, RebarShape=rebarShape_3, HookType_Start=hook_at_start_3, HookType_End=hook_at_start_3, lacing=CrossProduct)

side_rebarbartype = RevitRebarBarType("H12")  # graph input
rebarShape_4 = RevitRebarShape("01")
hook_at_start_4 = RevitRebarHookType("None")

# group: SIDE REBARS
count = List.Count(list=sortByKey.sorted_list@L2)
code_block_19 = CodeBlock(x=count) { [0,x[0]-1]; }
removeItemAtIndex_2 = List.RemoveItemAtIndex(list=sortByKey.sorted_list@L2, indices=code_block_19)
code_block_20 = CodeBlock { 2; }
dropItems_3 = List.DropItems(list=removeItemAtIndex_2, amount=code_block_20)
perimeterCurves_5 = Surface.PerimeterCurves(surface=dropItems_3)
integer_slider_3 = IntegerSlider(3, range=0..10 step 1)
code_block_21 = CodeBlock(x=removeItemAtIndex_2, n=integer_slider_3) { x[0][n]; }
flatten_2 = List.Flatten(list=removeItemAtIndex_2)
area_2 = Surface.Area(surface=removeItemAtIndex_2)
minimumItem_2 = List.MinimumItem(list=area_2)
eq_2 = area_2 == minimumItem_2  # lacing=Longest
filterByBoolMask_2 = List.FilterByBoolMask(list=removeItemAtIndex_2, mask=eq_2)
getBarDiameter_5 = Custom[RebarType.GetBarDiameter](rebarBarType=side_rebarbartype, ConvertToMM=boolean_3)
code_block_22 = CodeBlock(cover=cover, stirrupdia=getBarDiameter_3, maindia=getBarDiameter_5) { cover + stirrupdia + maindia/2; }
code_block_23 = CodeBlock(c=code_block_22) { c*-1; }
allIndicesOf = List.AllIndicesOf(list=area_2@L3, item=minimumItem_2, lacing=Longest)

followingSurface = DynamoRebar.Rebar.FollowingSurface(face=filterByBoolMask_2.out, numberOfCurves=number_of_side_bars, offset=code_block_23)
freeFormRebar_3 = StructuralDesign.Rebar.Create.FreeFormRebar(rebarBarType=top_rebarbartype, hostElement=pickElements, curves=followingSurface@L2, lacing=Longest)

# group (continued): SIDE REBARS
setRebarAsSolidUnobscured_4 = Custom[SetRebarAsSolidUnobscured](rebar=freeFormRebar_3)
setRebarHookAndShape_4 = Custom[SetRebarHookAndShape](Rebar=setRebarAsSolidUnobscured_4, RebarShape=rebarShape_4, HookType_Start=hook_at_start_4, HookType_End=hook_at_start_4, lacing=CrossProduct)

integer_slider_4 = IntegerSlider(3, range=0..3 step 1)
getItemAtIndex = List.GetItemAtIndex(list=code_block_3, index=integer_slider_4)
perimeterCurves_6 = Surface.PerimeterCurves(surface=getItemAtIndex)
code_block_24 = CodeBlock(x=sortByKey.sorted_list) { x[0]; }

# group: SELECT CATEGORY
categories = Categories("OST_StructuralFraming")

ʳʰʸᵗʰᵐ_selection_pick = Rhythm.Revit.Selection.Selection.Pick(runIt=refresh_script, category=categories)  # frozen
select_edge = DSEdgeSelection()  # 1 picked in the model
reverse_4 = Curve.Reverse(curve=select_edge)
