# Dynamo graph Circular Columns Main Rebar.dyn (Dynamo 2.6.1.8786)
# packages: KennyStruct Nodes 0.0.1, Structural Design 2021.1.22, archi-lab.net 2021.25.2621, Dynamo for Rebar 1.2.0, Rhythm 2021.4.2, BIM4Struc.Rebar 1.2.4, archi-lab.net 2022.210.2522, Structural Design 2021.9.23

# group: SELECTION/INPUTS
links_offset_from_top = DoubleInput(600)
lap_rebarbartype = RevitRebarBarType()  # nothing selected
run_script = BoolSelector(true)  # graph input
categories = Categories("OST_StructuralColumns")
links_rebarbartype = RevitRebarBarType()  # nothing selected; graph input
main_rebarbartype = RevitRebarBarType()  # nothing selected; graph input
number_of_main_bars = DoubleInput(5)  # graph input
lap_length = DoubleInput(450)
links_offset_from_base = DoubleInput(100)
current = Document.Current()
activeView = Document.ActiveView(document=current)
links_spacing = DoubleInput(150)
length_of_bar = DoubleInput(12000)  # graph input
rebar_top_extension = DoubleInput(750)  # graph input

ʳʰʸᵗʰᵐ_selection_pick = Rhythm.Revit.Selection.Selection.Pick(runIt=run_script, category=categories)
code_block = CodeBlock(bars=number_of_main_bars) { bars+1; }

# group: EVALUATORS
geometry = Element.Geometry(element=ʳʰʸᵗʰᵐ_selection_pick)
getFloorSurfaceandCurves = Custom[GetFloorSurfaceandCurves](Element_Geometry=geometry)  # package KennyStruct Nodes; Get the top surface and outline curves of a Revit Floor
code_block_2 = CodeBlock(x=getFloorSurfaceandCurves.Top_Curves) { x; }
byJoinedCurves = PolyCurve.ByJoinedCurves(curves=code_block_2)
basePlane = PolyCurve.BasePlane(polyCurve=byJoinedCurves)
type = archilab.Revit.Elements.Elements.Type(element=ʳʰʸᵗʰᵐ_selection_pick)
string = StringInput("b")
getParameterValueByName = Element.GetParameterValueByName(element=type, parameterName=string)
getRebarCover = Custom[Element.GetRebarCover](element=ʳʰʸᵗʰᵐ_selection_pick)  # package BIM4Struc.Rebar; Get the rebar cover dimensions for a selected element.
code_block_3 = CodeBlock(cover=getRebarCover.Other) { cover; }
coverToOffset = DynamoRebar.Rebar.CoverToOffset(cover=code_block_3, barType=links_rebarbartype)
code_block_4 = CodeBlock(diameter=getParameterValueByName, cover=coverToOffset) { (diameter - cover)/2; }
byPlaneRadius = Circle.ByPlaneRadius(plane=basePlane, radius=code_block_4)
string_2 = StringInput("Bar Diameter")
getParameterValueByName_2 = Element.GetParameterValueByName(element=main_rebarbartype, parameterName=string_2)
getParameterValueByName_3 = Element.GetParameterValueByName(element=links_rebarbartype, parameterName=string_2)
getParameterValueByName_4 = Element.GetParameterValueByName(element=lap_rebarbartype, parameterName=string_2)
code_block_5 = CodeBlock(MainBar=getParameterValueByName_2, LinkBar=getParameterValueByName_3, Cover=code_block_3, elems=ʳʰʸᵗʰᵐ_selection_pick, Lap=getParameterValueByName_4) { M = (MainBar); L = (LinkBar/2); List.Cycle(-1*(L+Cover),List.Count(elems)); List.Cycle(M+(-1*Lap/2),List.Count(elems)); }
offset = Curve.Offset(curve=byPlaneRadius, distance=[code_block_5.out2, code_block_5.out2], lacing=Longest)
code_block_6 = CodeBlock(divisions=code_block) { 0..1..#divisions; }
boolean = BoolSelector(false)
getColumnGeometry = Custom[GetColumnGeometry](Columns=ʳʰʸᵗʰᵐ_selection_pick@L2, ProjectElevation=boolean)  # package KennyStruct Nodes; Get all column associated geometries (curves, start and end points, rotations and column style)
code_block_7 = CodeBlock(curves=getColumnGeometry.Curves, startpoints=getColumnGeometry.StartPoints, endpoints=getColumnGeometry.EndPoints) { curves; startpoints[0][0]; endpoints[0][0]; }
direction = Line.Direction(line=code_block_7.curves)
code_block_8 = CodeBlock(directions=direction) { directions[0]; }
length = Curve.Length(curve=code_block_7.curves)
flatten = List.Flatten(list=byPlaneRadius)
code_block_9 = CodeBlock(spacing=links_spacing) { spacing * -1; }
translate = Geometry.Translate(geometry=flatten, direction=code_block_8, distance=code_block_9, lacing=Longest)

# group: LAP BARS
code_block_10 = CodeBlock { MainBarDiameter*-1; }  # unwired: MainBarDiameter
offset_2 = Curve.Offset(curve=offset, distance=code_block_5.out3)
pointAtParameter = Curve.PointAtParameter(curve=offset_2, param=code_block_6, lacing=CrossProduct)
code_block_11 = CodeBlock(Lap=lap_length, elems=ʳʰʸᵗʰᵐ_selection_pick) { Lap; occur = List.Count(elems); LCycle = List.Cycle(Lap,occur); }
byStartPointDirectionLength = Line.ByStartPointDirectionLength(startPoint=pointAtParameter, direction=code_block_8, length=code_block_11.LCycle)
extendStart = Curve.ExtendStart(curve=byStartPointDirectionLength, distance=code_block_11.LCycle)
freeFormRebar = StructuralDesign.Rebar.Create.FreeFormRebar(rebarBarType=lap_rebarbartype, hostElement=ʳʰʸᵗʰᵐ_selection_pick, curves=extendStart)  # frozen

watch = Watch(code_block_5.out2)
map = List.Map()  # unwired: list, f_x

# group: VERTICAL MAIN BARS
reverse = Vector.Reverse(vector=code_block_8)
code_block_12 = CodeBlock(len=length, LVector=reverse) { length = len[0]; List.Chop(length,1); List.Chop(LVector,1); }
pointAtParameter_2 = Curve.PointAtParameter(curve=offset, param=code_block_6, lacing=CrossProduct)
byStartPointDirectionLength_2 = Line.ByStartPointDirectionLength(startPoint=pointAtParameter_2, direction=reverse, length=length_of_bar, lacing=Longest)

flatten_2 = List.Flatten(list=code_block_12.length)

# group: STIRRUP REBARS
code_block_13 = CodeBlock { 0.5; }
pointAtParameter_3 = Surface.PointAtParameter(surface=getFloorSurfaceandCurves.Top_Surface, u=code_block_13, v=code_block_13)
type_2 = archilab.Revit.Elements.Elements.Type(element=ʳʰʸᵗʰᵐ_selection_pick)
string_3 = StringInput("b")
getParameterValueByName_5 = Element.GetParameterValueByName(element=type_2, parameterName=string_3)
code_block_14 = CodeBlock(diameter=getParameterValueByName_5) { diameter/2; }
byCenterPointRadius = Circle.ByCenterPointRadius(centerPoint=pointAtParameter_3, radius=code_block_14)
number = DoubleInput(20)
code_block_15 = CodeBlock { 0.5; }
splitByParameter = Curve.SplitByParameter(curve=translate, parameters=code_block_15)
code_block_16 = CodeBlock(x=splitByParameter) { crv = x[0][0]; 50; }
rebarStyle = RevitRebarStyle("StirrupTie")
rebarHookType = RevitRebarHookType("None")
rebarHookOrientation = RevitRebarHookOrientation("Right")
normal = Curve.Normal(curve=code_block_16.crv)
fromCurve = StructuralDesign.Rebar.Create.FromCurve(curve=code_block_16.crv, rebarStyle=rebarStyle, rebarBarType=links_rebarbartype, startHookType=rebarHookType, endHookType=rebarHookType, startHookOrientation=rebarHookOrientation, endHookOrientation=rebarHookOrientation, hostElement=ʳʰʸᵗʰᵐ_selection_pick, vector=normal, lacing=Longest)  # frozen
setRebarAsSolidUnobscured = Custom[SetRebarAsSolidUnobscured](rebar=fromCurve)  # package KennyStruct Nodes; Set rebar as both solid and unobscured in current view
rebarShape = RevitRebarShape("75")
rebarHookType_2 = RevitRebarHookType("Stirrup/Tie - 90 deg.")
setRebarHookAndShape = Custom[SetRebarHookAndShape](Rebar=setRebarAsSolidUnobscured, RebarShape=rebarShape, HookType_Start=rebarHookType_2, HookType_End=rebarHookType_2)  # package KennyStruct Nodes; Set rebar shape and hook types
setStirrupLayoutRuleSpacingAndQuantity = Custom[SetStirrupLayoutRuleSpacingAndQuantity](spacing=links_spacing, quantity=number, Rebar=setRebarHookAndShape)  # Set Stirrups Layout rule as Number with spacing, Input the spacing and quantity of the rebar
code_block_17 = CodeBlock(diameter=getParameterValueByName_5) { "A"; diameter; }
setParameterByName = Element.SetParameterByName(parameterName=code_block_17.out0, value=code_block_17.diameter, lacing=Longest)  # unwired: element

byThreePoints = Arc.ByThreePoints()  # unwired: firstPoint, secondPoint, thirdPoint
extendStart_2 = Curve.ExtendStart(curve=byStartPointDirectionLength_2, distance=rebar_top_extension)

# group (continued): VERTICAL MAIN BARS
freeFormRebar_2 = StructuralDesign.Rebar.Create.FreeFormRebar(rebarBarType=main_rebarbartype, hostElement=ʳʰʸᵗʰᵐ_selection_pick, curves=extendStart_2, lacing=Longest)
setRebarAsSolidUnobscured_2 = Custom[SetRebarAsSolidUnobscured](rebar=freeFormRebar_2)
