# Dynamo graph Column Dowel Bars.dyn (Dynamo 2.3.1.11775)
# packages: Rhythm 2021.4.2, KennyStruct Nodes 0.0.1, Structural Design 2021.1.22, archi-lab.net 2021.25.2621

boolean = BoolSelector(true)
categories = Categories("OST_StructuralColumns")
ʳʰʸᵗʰᵐ_selection_pick = Rhythm.Revit.Selection.Selection.Pick(runIt=boolean, category=categories)
geometry = Element.Geometry(element=ʳʰʸᵗʰᵐ_selection_pick)
flatten = List.Flatten(list=geometry)
faces = Topology.Faces(topology=flatten)
surfaceGeometry = Face.SurfaceGeometry(face=faces)
code_block = CodeBlock { 0.5; }
pointAtParameter = Surface.PointAtParameter(surface=surfaceGeometry, u=code_block, v=code_block)
Z = Point.Z(point=pointAtParameter)
sortIndexByValue = List.SortIndexByValue(list=Z)
code_block_2 = CodeBlock(t1=sortIndexByValue) { t2 = List.FirstItem(t1@L2<1>); }
code_block_3 = CodeBlock(PList=sortIndexByValue) { First = List.FirstItem(PList@L2<1>); Last = List.LastItem(PList@L2<1>); List.Transpose([First,Last]); }
getItemAtIndex = List.GetItemAtIndex(list=surfaceGeometry@L2, index=code_block_3.out2@L2)
bottom_of_column = BoolSelector(false)
firstItem = List.FirstItem()  # unwired: list
lastItem = List.LastItem()  # unwired: list
if_ = If(test=bottom_of_column, true=firstItem, false=lastItem)
map = List.Map(list=getItemAtIndex, f_x=if_)
perimeterCurves = Surface.PerimeterCurves(surface=map)
byJoinedCurves = PolyCurve.ByJoinedCurves(curves=perimeterCurves)
number_slider = DoubleSlider(50, range=20..100 step 5)
code_block_4 = CodeBlock(offset=number_slider) { offset*-1; }
offset = Curve.Offset(curve=byJoinedCurves, distance=code_block_4)
number = DoubleInput(10)
number_2 = DoubleInput(20)
code_block_5 = CodeBlock(linkdia=number, bardia=number_2) { ((linkdia/2)+(bardia))*-1; }
offset_2 = Curve.Offset(curve=offset, distance=code_block_5)
byPatch = Surface.ByPatch(closedCurve=offset_2)
perimeterCurves_2 = Surface.PerimeterCurves(surface=byPatch)
integer_slider = IntegerSlider(3, range=3..100 step 1)
code_block_6 = CodeBlock(divs=integer_slider) { 0..1..#divs; }
pointAtParameter_2 = Curve.PointAtParameter(curve=perimeterCurves_2, param=code_block_6, lacing=CrossProduct)
flatten_2 = List.Flatten()  # unwired: list
map_2 = List.Map(list=pointAtParameter_2, f_x=flatten_2)
pruneDuplicates = Point.PruneDuplicates(points=map_2)
boolean_2 = BoolSelector(true)
getColumnGeometry = Custom[GetColumnGeometry](Columns=ʳʰʸᵗʰᵐ_selection_pick, ProjectElevation=boolean_2)  # package KennyStruct Nodes; Get all column associated geometries (curves, start and end points, rotations and column style)
direction = Line.Direction(line=getColumnGeometry.Curves)
reverse = Vector.Reverse(vector=direction)
if_2 = If(test=bottom_of_column, true=reverse, false=direction)
number_3 = DoubleInput(500)
byStartPointDirectionLength = Line.ByStartPointDirectionLength(startPoint=pruneDuplicates, direction=if_2, length=number_3)
number_4 = DoubleInput(1000)
extendStart = Curve.ExtendStart(curve=byStartPointDirectionLength, distance=number_4)
rebarShape = RevitRebarShape("51")
select_face = DSFaceSelection()  # 1 picked in the model
sortByKey = List.SortByKey(list=faces@L2, keys=Z@L2)
watch = Watch(sortByKey.sorted_list)
map_3 = List.Map(list=sortByKey.sorted_list, f_x=if_)
type = archilab.Revit.Elements.Elements.Type(element=ʳʰʸᵗʰᵐ_selection_pick)
code_block_7 = CodeBlock { ["b","h"]; }
getParameterValueByName = Element.GetParameterValueByName(element=type@L2, parameterName=code_block_7, lacing=Longest)
code_block_8 = CodeBlock(N=getParameterValueByName) { Stirrup = N-70; Stirrup[0]; Stirrup[1]; }
stirrupShapeCurves = StructuralDesign.Rebar.Designs.StirrupShapeCurves(face=map, segmentA=code_block_8.out1, segmentB=code_block_8.out2)
rebarStyle = RevitRebarStyle("StirrupTie")
rebarBarType = RevitRebarBarType("H10")
rebarHookType = RevitRebarHookType("Stirrup/Tie - 135 deg.")
rebarHookOrientation = RevitRebarHookOrientation("Right")
fromCurves = StructuralDesign.Rebar.Create.FromCurves(curves=stirrupShapeCurves.Curves@L2, rebarStyle=rebarStyle, rebarBarType=rebarBarType, startHookType=rebarHookType, endHookType=rebarHookType, startHookOrientation=rebarHookOrientation, endHookOrientation=rebarHookOrientation, hostElement=ʳʰʸᵗʰᵐ_selection_pick, vector=if_2, lacing=Longest)
current = Document.Current()
activeView = Document.ActiveView(document=current)
setSolidInView = StructuralDesign.Rebar.Create.SetSolidInView(rebar=fromCurves, view=activeView)
