# Dynamo graph Copy Rebars from Element to another.dyn (Dynamo 2.6.1.8786)
# packages: ACOPackage 1.0.4, Rhythm 2021.7.3

# group: INPUTS
select_model_element_to_copy = DSModelElementSelection()  # "Select Model Element To Copy Element from"; 1 picked in the model; graph input
boolean = BoolSelector(true)
getCategory = Element.GetCategory(element=select_model_element_to_copy)
boolean_2 = BoolSelector(false)
ʳʰʸᵗʰᵐ_selection_pick = Rhythm.Revit.Selection.Selection.Pick(runIt=boolean, category=getCategory, singleSelection=boolean_2)

getRebarsInHost = ACOSolution.Rebars.GetRebarsInHost(element=select_model_element_to_copy)
geometry = Element.Geometry(element=select_model_element_to_copy)
code_block = CodeBlock(x=geometry) { x[0]; }
centroid = Solid.Centroid(solid=code_block)
python_script = Python(IN[0]=select_model_element_to_copy, IN[1]=centroid)
# ---------- python_script.python (29 lines) ----------
import clr

clr.AddReference('ProtoGeometry')
from Autodesk.DesignScript.Geometry import *

clr.AddReference("RevitNodes")
import Revit
clr.ImportExtensions(Revit.Elements)
clr.ImportExtensions(Revit.GeometryConversion)

clr.AddReference("RevitServices")
import RevitServices
from RevitServices.Persistence import DocumentManager 
from RevitServices.Transactions import TransactionManager 

clr.AddReference("RevitAPI")
from Autodesk.Revit.DB import *

clr.AddReference("RevitAPIUI")
from Autodesk.Revit.UI import *

doc = DocumentManager.Instance.CurrentDBDocument

hostElement = UnwrapElement(IN[0])

if hasattr(hostElement.Location, "Point"):
	OUT = hostElement.Location.Point.ToPoint()
else:
	OUT = IN[1]
# ----------------------------------------
python_script_2 = Python(IN[0]=python_script)
# ---------- python_script_2.python (26 lines) ----------
# Load the Python Standard and DesignScript Libraries
import sys
import clr
clr.AddReference('ProtoGeometry')
from Autodesk.DesignScript.Geometry import *

# The inputs to this node will be stored as a list in the IN variables.
location = IN[0]

pointType = Point.ByCoordinates(0,0,0)

pt2 = Point.ByCoordinates(10,0,0)

LineType = Line.ByStartPointEndPoint(pointType, pt2)
# Place your code below this line

newLocation = []
if type(location).__name__ == type(LineType).__name__:
	pt = Curve.PointAtParameter(location,0.5)
	newLocation.append(pt)
elif type(location).__name__ == type(pointType).__name__:
	pt = location
	newLocation.append(pt)

# Assign your output to the OUT variable.
OUT = newLocation[0]
# ----------------------------------------
geometry_2 = Element.Geometry(element=ʳʰʸᵗʰᵐ_selection_pick)
flatten = List.Flatten(list=geometry_2)
centroid_2 = Solid.Centroid(solid=flatten)
python_script_3 = Python(IN[0]=ʳʰʸᵗʰᵐ_selection_pick, IN[1]=centroid_2)
# ---------- python_script_3.python (32 lines) ----------
import clr

clr.AddReference('ProtoGeometry')
from Autodesk.DesignScript.Geometry import *

clr.AddReference("RevitNodes")
import Revit
clr.ImportExtensions(Revit.Elements)
clr.ImportExtensions(Revit.GeometryConversion)

clr.AddReference("RevitServices")
import RevitServices
from RevitServices.Persistence import DocumentManager 
from RevitServices.Transactions import TransactionManager 

clr.AddReference("RevitAPI")
from Autodesk.Revit.DB import *

clr.AddReference("RevitAPIUI")
from Autodesk.Revit.UI import *

doc = DocumentManager.Instance.CurrentDBDocument

targetElement = UnwrapElement(IN[0])

targetLocations = []
for elem in targetElement:
	if hasattr(elem, "Point"):
		targetLocations.append(elem.Location.Point.ToPoint())
	OUT = targetLocations		
else:
	OUT = IN[1]
# ----------------------------------------
python_script_4 = Python(IN[0]=python_script_3)
# ---------- python_script_4.python (34 lines) ----------
# Load the Python Standard and DesignScript Libraries
import sys
import clr
clr.AddReference('ProtoGeometry')
from Autodesk.DesignScript.Geometry import *

# The inputs to this node will be stored as a list in the IN variables.
location = IN[0]

pointType = Point.ByCoordinates(0,0,0)

pt2 = Point.ByCoordinates(10,0,0)

LineType = Line.ByStartPointEndPoint(pointType, pt2)
# Place your code below this line

newLocation = []
if isinstance(location,list):
	for loc in location:
		if type(loc).__name__ == type(LineType).__name__:
			pt = Curve.PointAtParameter(loc,0.5)
			newLocation.append(pt)
		elif type(loc).__name__ == type(pointType).__name__:
			pt = loc
			newLocation.append(pt)
		OUT = newLocation
else:
	if type(location).__name__ == type(LineType).__name__:
		pt = Curve.PointAtParameter(location,0.5)
		newLocation.append(pt)
	elif type(location).__name__ == type(pointType).__name__:
		pt = location
		newLocation.append(pt)
	OUT = newLocation[0]
# ----------------------------------------
byTwoPoints = Vector.ByTwoPoints(start=python_script_2, end=python_script_4, lacing=Longest)
asPoint = Vector.AsPoint(vector=byTwoPoints)
python_script_5 = Python(IN[0]=getRebarsInHost, IN[1]=asPoint)
# ---------- python_script_5.python (42 lines) ----------
import clr
from System.Collections.Generic import *
clr.AddReference('RevitAPI')
from Autodesk.Revit.DB import *
import Autodesk

clr.AddReference("RevitNodes")
import Revit
clr.ImportExtensions(Revit.Elements)
clr.ImportExtensions(Revit.GeometryConversion)

clr.AddReference("RevitServices")
import RevitServices
from RevitServices.Persistence import DocumentManager
from RevitServices.Transactions import TransactionManager

doc = DocumentManager.Instance.CurrentDBDocument
items = UnwrapElement(IN[0])
xyz = []

for i in UnwrapElement(IN[1]):
	xyz.append(i.ToXyz())
ids = list()
for item in items:
	ids.append(item.Id)	
itemlist = List[ElementId](ids)

TransactionManager.Instance.EnsureInTransaction(doc)
newitems = []

for p in xyz:
	newitems.append(ElementTransformUtils.CopyElements(doc,itemlist,p))
TransactionManager.Instance.TransactionTaskDone()

elementlist = list()

output = []
for x in range(len(newitems)):
	for item in newitems[x]:
		elementlist.append(doc.GetElement(item).ToDSType(False))

OUT = elementlist
# ----------------------------------------
count = List.Count(list=getRebarsInHost)
chop = List.Chop(list=python_script_5, lengths=count)
boolean_3 = BoolSelector(true)

# group: OUTPUT
python_script_6 = Python(IN[0]=chop, IN[1]=ʳʰʸᵗʰᵐ_selection_pick, IN[2]=boolean_3)
# ---------- python_script_6.python (26 lines) ----------
import clr
clr.AddReference('RevitNodes')
import Revit
clr.ImportExtensions(Revit.Elements)

clr.AddReference('RevitServices')
import RevitServices
from RevitServices.Persistence import DocumentManager
from RevitServices.Transactions import TransactionManager
doc = DocumentManager.Instance.CurrentDBDocument
TransactionManager.Instance.EnsureInTransaction(doc)

rebarElements = UnwrapElement(IN[0])
hostElement = UnwrapElement(IN[1])

if IN[2]==True:
	count = range(len(rebarElements))
	for x in count:
		for rebarElement in rebarElements[x]:
			rebarElement.SetHostId(doc,hostElement[x].Id)
	
	OUT = (IN[2],rebarElements,hostElement)
else:
	OUT = (IN[2],"","")
	
TransactionManager.Instance.TransactionTaskDone()
# ----------------------------------------
