# Dynamo graph Copy Rebars from Element to same Type.dyn (Dynamo 2.6.1.8786)
# packages: ACOPackage 1.0.4, archi-lab.net 2022.210.2522, Data-Shapes 2022.2.96, Rhythm 2021.7.3

# group: INPUTS
boolean = BoolSelector(true)
select_category = Categories("OST_StructuralFoundation")  # graph input
boolean_2 = BoolSelector(true)
ʳʰʸᵗʰᵐ_selection_pick = Rhythm.Revit.Selection.Selection.Pick(runIt=boolean, category=select_category, singleSelection=boolean_2)

getRebarsInHost = ACOSolution.Rebars.GetRebarsInHost(element=ʳʰʸᵗʰᵐ_selection_pick)
getLocation = Element.GetLocation(element=ʳʰʸᵗʰᵐ_selection_pick)
type = archilab.Revit.Elements.Elements.Type(element=ʳʰʸᵗʰᵐ_selection_pick)
all_elements_of_family_type = ElementsOfFamilyType(Family_Type=type)
id = Element.Id(element=ʳʰʸᵗʰᵐ_selection_pick)
id_2 = Element.Id(element=all_elements_of_family_type)
eq = id == id_2
filterByBoolMask = List.FilterByBoolMask(list=all_elements_of_family_type, mask=eq)
getLocation_2 = Element.GetLocation(element=filterByBoolMask.out)
byTwoPoints = Vector.ByTwoPoints(start=getLocation, end=getLocation_2, lacing=Longest)
asPoint = Vector.AsPoint(vector=byTwoPoints)
python_script = Python(IN[0]=getRebarsInHost, IN[1]=asPoint)
# ---------- python_script.python (42 lines) ----------
import clr
from System.Collections.Generic import *
clr.AddReference('RevitAPI')
from Autodesk.Revit.DB import *
import Autodesk

clr.AddReference("RevitNodes")
import Revit
clr.ImportExtensions(Revit.Elements)
clr.ImportExtensions(Revit.GeometryConversion)

clr.AddReference("RevitServices")
import RevitServices
from RevitServices.Persistence import DocumentManager
from RevitServices.Transactions import TransactionManager

doc = DocumentManager.Instance.CurrentDBDocument
items = UnwrapElement(IN[0])
xyz = []

for i in UnwrapElement(IN[1]):
	xyz.append(i.ToXyz())
ids = list()
for item in items:
	ids.append(item.Id)	
itemlist = List[ElementId](ids)

TransactionManager.Instance.EnsureInTransaction(doc)
newitems = []

for p in xyz:
	newitems.append(ElementTransformUtils.CopyElements(doc,itemlist,p))
TransactionManager.Instance.TransactionTaskDone()

elementlist = list()

output = []
for x in range(len(newitems)):
	for item in newitems[x]:
		elementlist.append(doc.GetElement(item).ToDSType(False))

OUT = elementlist
# ----------------------------------------
count = List.Count(list=getRebarsInHost)
chop = List.Chop(list=python_script, lengths=count)
boolean_3 = BoolSelector(true)

# group: OUTPUT
python_script_2 = Python(IN[0]=chop, IN[1]=filterByBoolMask.out, IN[2]=boolean_3)
# ---------- python_script_2.python (26 lines) ----------
import clr
clr.AddReference('RevitNodes')
import Revit
clr.ImportExtensions(Revit.Elements)

clr.AddReference('RevitServices')
import RevitServices
from RevitServices.Persistence import DocumentManager
from RevitServices.Transactions import TransactionManager
doc = DocumentManager.Instance.CurrentDBDocument
TransactionManager.Instance.EnsureInTransaction(doc)

rebarElements = UnwrapElement(IN[0])
hostElement = UnwrapElement(IN[1])

if IN[2]==True:
	count = range(len(rebarElements))
	for x in count:
		for rebarElement in rebarElements[x]:
			rebarElement.SetHostId(doc,hostElement[x].Id)
	
	OUT = (IN[2],rebarElements,hostElement)
else:
	OUT = (IN[2],"","")
	
TransactionManager.Instance.TransactionTaskDone()
# ----------------------------------------

XAxis = Vector.XAxis()
ZAxis = Vector.ZAxis()
angleAboutAxis = Vector.AngleAboutAxis(vector=byTwoPoints, otherVector=XAxis, rotationAxis=ZAxis)  # frozen
code_block = CodeBlock { 2; }
round = Math.Round(number=angleAboutAxis, digits=code_block)
number = DoubleInput(180)
sub = round - number
groupByKey = List.GroupByKey(list=filterByBoolMask.out, keys=sub)
flatten = List.Flatten(list=groupByKey.groups)
geometry = Element.Geometry(element=flatten)
flatten_2 = List.Flatten(list=geometry)
groupByKey_2 = List.GroupByKey(list=getLocation_2, keys=sub)
flatten_3 = List.Flatten(list=groupByKey_2.groups)
ZAxis_2 = Vector.ZAxis()
byOriginNormal = Plane.ByOriginNormal(origin=flatten_3, normal=ZAxis_2)
groupByKey_3 = List.GroupByKey(list=sub, keys=sub)
flatten_4 = List.Flatten(list=groupByKey_3.groups)
rotate = Geometry.Rotate(geometry=flatten_2, basePlane=byOriginNormal, degrees=flatten_4)
geomPreview = GeomPreviewNodeModel(Geometry=rotate, SliderValue=255, rValue="164", gValue="255", bValue="41")
code_block_2 = CodeBlock(x=sub) { x[0]-x[1]; }
maximumItem = List.MaximumItem(list=groupByKey_3.unique_keys)
sub_2 = groupByKey_3.groups - _  # unwired: y
map = List.Map(list=maximumItem, f_x=sub_2)
flatten_5 = List.Flatten(list=map)
elementFaceReferences = Element.ElementFaceReferences(element=flatten)
elementPlaneReference = ReferencePlane.ElementPlaneReference(referencePlane=elementFaceReferences)
reference = archilab.Revit.Elements.Faces.Reference(faces=elementFaceReferences)
