# Dynamo graph Curved Beam Rebar.dyn (Dynamo 2.3.1.11775)
# packages: Dynamo for Rebar 1.2.0, Structural Design 2021.1.22, Rhythm 2021.4.2, KennyStruct Nodes 0.0.1, BIM4Struc.Rebar 1.2.4

# group: INPUTS
refresh_script = BoolSelector(true)  # graph input
cover = DoubleInput(50)
stirrup_spacing = DoubleInput(200)  # graph input
stirrup_rebarbartype = RevitRebarBarType("H10")  # graph input
bottom_rebarbartype = RevitRebarBarType("H16")  # graph input
no_of_bottom_rebars = DoubleInput(4)  # graph input
top_rebarbartype = RevitRebarBarType("H16")  # graph input
no_of_top_rebars = DoubleInput(3)  # graph input
number_of_side_bars = DoubleInput(3)  # graph input
side_rebarbartype = RevitRebarBarType("H12")  # graph input

# group: SELECT CATEGORY
categories = Categories("OST_StructuralFraming")
ʳʰʸᵗʰᵐ_selection_pick = Rhythm.Revit.Selection.Selection.Pick(runIt=refresh_script, category=categories)

# group: STIRRUPS REBARS
geometry = Element.Geometry(element=ʳʰʸᵗʰᵐ_selection_pick)
flatten = List.Flatten(list=geometry)
getLocation = Element.GetLocation(element=ʳʰʸᵗʰᵐ_selection_pick)
shorten = DynamoRebar.Rebar.Shorten(curves=getLocation, length=cover)
length = Curve.Length(curve=shorten)
formula = Formula("a/b", a=length, b=stirrup_spacing)
ceiling = Math.Ceiling(number=formula)
code_block = CodeBlock(no=ceiling) { 0..1..#no; }
planeAtParameter = Curve.PlaneAtParameter(curve=shorten, param=code_block)
code_block_2 = CodeBlock { 3000; }
byWidthLength = Rectangle.ByWidthLength(plane=planeAtParameter, width=code_block_2, length=code_block_2)
byPatch = Surface.ByPatch(closedCurve=byWidthLength)
intersect = Geometry.Intersect(geometry=flatten, other=byPatch)
code_block_3 = CodeBlock { 1; }
flatten_2 = List.Flatten(amt=code_block_3)  # unwired: list
map = List.Map(list=intersect, f_x=flatten_2)
perimeterCurves = Surface.PerimeterCurves(surface=map)
byJoinedCurves = PolyCurve.ByJoinedCurves(curves=perimeterCurves)
formula_2 = Formula("d*-1", d=cover)
offset = Curve.Offset(curve=byJoinedCurves, distance=formula_2)
patch = Curve.Patch(curve=offset)
perimeterCurves_2 = Surface.PerimeterCurves(surface=patch)
rebarStyle = RevitRebarStyle("StirrupTie")
rebarHookType = RevitRebarHookType("Stirrup/Tie - 135 deg.")
rebarHookOrientation = RevitRebarHookOrientation("Right")
byJoinedCurves_2 = PolyCurve.ByJoinedCurves(curves=perimeterCurves_2)
normal = Curve.Normal(curve=byJoinedCurves_2)
fromCurves = StructuralDesign.Rebar.Create.FromCurves(curves=perimeterCurves_2, rebarStyle=rebarStyle, rebarBarType=stirrup_rebarbartype, startHookType=rebarHookType, endHookType=rebarHookType, startHookOrientation=rebarHookOrientation, endHookOrientation=rebarHookOrientation, hostElement=ʳʰʸᵗʰᵐ_selection_pick, vector=normal)
setRebarAsSolidUnobscured = Custom[SetRebarAsSolidUnobscured](rebar=fromCurves)  # package KennyStruct Nodes; Set rebar as both solid and unobscured in current view
rebarShape = RevitRebarShape("51")
hook_at_start = RevitRebarHookType("Stirrup/Tie - 135 deg.")
hook_at_end = RevitRebarHookType("Stirrup/Tie - 135 deg.")
setRebarHookAndShape = Custom[SetRebarHookAndShape](Rebar=setRebarAsSolidUnobscured, RebarShape=rebarShape, HookType_Start=hook_at_start, HookType_End=hook_at_end)  # package KennyStruct Nodes; Set rebar shape and hook types

# group: FILTER OUT TOP AND BOTTOM FACES OF SELECTED BEAMS
explode = Geometry.Explode(geometry=flatten)
code_block_4 = CodeBlock { 0.5; }
pointAtParameter = Surface.PointAtParameter(surface=explode, u=code_block_4, v=code_block_4)
Z = Point.Z(point=pointAtParameter)
sortByKey = List.SortByKey(list=explode@L2, keys=Z@L2)
firstItem = List.FirstItem(list=sortByKey.sorted_list@L2)
lastItem = List.LastItem(list=sortByKey.sorted_list@L2)

# group: BOTTOM MAIN REBARS
boolean = BoolSelector(false)
getBarDiameter = Custom[RebarType.GetBarDiameter](rebarBarType=stirrup_rebarbartype, ConvertToMM=boolean)  # package BIM4Struc.Rebar; Get the diameter of a given Rebar Bar Type
getBarDiameter_2 = Custom[RebarType.GetBarDiameter](rebarBarType=bottom_rebarbartype, ConvertToMM=boolean)
code_block_5 = CodeBlock(cover=cover, stirrupdia=getBarDiameter, maindia=getBarDiameter_2) { cover + stirrupdia + maindia/2; }
code_block_6 = CodeBlock(z=code_block_5) { z*1; }
translate = Geometry.Translate(geometry=firstItem, zTranslation=code_block_6)
perimeterCurves_3 = Surface.PerimeterCurves(surface=translate)
length_2 = Curve.Length(curve=perimeterCurves_3)
sortByKey_2 = List.SortByKey(list=perimeterCurves_3@L2, keys=length_2@L2)
code_block_7 = CodeBlock { 2; }
dropItems = List.DropItems(list=sortByKey_2.sorted_list, amount=code_block_7, lacing=Longest)
firstItem_2 = List.FirstItem(list=dropItems@L2)
lastItem_2 = List.LastItem(list=dropItems@L2)
reverse = Curve.Reverse(curve=lastItem_2)
code_block_8 = CodeBlock(x1=firstItem_2, x2=reverse) { [x1,x2]; }
transpose = List.Transpose(lists=code_block_8)
integer_slider = IntegerSlider(50, range=1..100 step 1)
code_block_9 = CodeBlock(div=integer_slider) { 0..1..#div; }
pointAtParameter_2 = Curve.PointAtParameter(curve=transpose, param=code_block_9, lacing=CrossProduct)
byPoints = PolyCurve.ByPoints(points=pointAtParameter_2)
shorten_2 = DynamoRebar.Rebar.Shorten(curves=byPoints, length=code_block_5)
code_block_10 = CodeBlock(TopNo=no_of_bottom_rebars) { 0..1..#TopNo; }
pointAtParameter_3 = Curve.PointAtParameter(curve=shorten_2@L2, param=code_block_10, lacing=CrossProduct)
transpose_2 = List.Transpose(lists=pointAtParameter_3)
byPoints_2 = NurbsCurve.ByPoints(points=transpose_2)
transpose_3 = List.Transpose(lists=byPoints_2)
freeFormRebar = StructuralDesign.Rebar.Create.FreeFormRebar(rebarBarType=bottom_rebarbartype, hostElement=ʳʰʸᵗʰᵐ_selection_pick, curves=transpose_3, lacing=Longest)  # frozen
setRebarAsSolidUnobscured_2 = Custom[SetRebarAsSolidUnobscured](rebar=freeFormRebar)
rebarShape_2 = RevitRebarShape("00")
hook_at_start_2 = RevitRebarHookType("None")
setRebarHookAndShape_2 = Custom[SetRebarHookAndShape](Rebar=setRebarAsSolidUnobscured_2, RebarShape=rebarShape_2, HookType_Start=hook_at_start_2, HookType_End=hook_at_start_2, lacing=CrossProduct)

# group: TOP MAIN REBARS
boolean_2 = BoolSelector(false)
getBarDiameter_3 = Custom[RebarType.GetBarDiameter](rebarBarType=stirrup_rebarbartype, ConvertToMM=boolean_2)
getBarDiameter_4 = Custom[RebarType.GetBarDiameter](rebarBarType=top_rebarbartype, ConvertToMM=boolean_2)
code_block_11 = CodeBlock(cover=cover, stirrupdia=getBarDiameter_3, maindia=getBarDiameter_4) { cover + stirrupdia + maindia/2; }
code_block_12 = CodeBlock(z=code_block_11) { z*-1; }
translate_2 = Geometry.Translate(geometry=lastItem, zTranslation=code_block_12)
perimeterCurves_4 = Surface.PerimeterCurves(surface=translate_2)
length_3 = Curve.Length(curve=perimeterCurves_4)
sortByKey_3 = List.SortByKey(list=perimeterCurves_4@L2, keys=length_3@L2)
code_block_13 = CodeBlock { 2; }
dropItems_2 = List.DropItems(list=sortByKey_3.sorted_list, amount=code_block_13, lacing=Longest)
firstItem_3 = List.FirstItem(list=dropItems_2@L2)
lastItem_3 = List.LastItem(list=dropItems_2@L2)
reverse_2 = Curve.Reverse(curve=lastItem_3)
code_block_14 = CodeBlock(x1=firstItem_3, x2=reverse_2) { [x1,x2]; }
transpose_4 = List.Transpose(lists=code_block_14)
integer_slider_2 = IntegerSlider(50, range=1..100 step 1)
code_block_15 = CodeBlock(div=integer_slider_2) { 0..1..#div; }
pointAtParameter_4 = Curve.PointAtParameter(curve=transpose_4, param=code_block_15, lacing=CrossProduct)
byPoints_3 = PolyCurve.ByPoints(points=pointAtParameter_4)
shorten_3 = DynamoRebar.Rebar.Shorten(curves=byPoints_3, length=code_block_11)
code_block_16 = CodeBlock(TopNo=no_of_top_rebars) { 0..1..#TopNo; }
pointAtParameter_5 = Curve.PointAtParameter(curve=shorten_3@L2, param=code_block_16, lacing=CrossProduct)
transpose_5 = List.Transpose(lists=pointAtParameter_5)
byPoints_4 = NurbsCurve.ByPoints(points=transpose_5)
transpose_6 = List.Transpose(lists=byPoints_4)
freeFormRebar_2 = StructuralDesign.Rebar.Create.FreeFormRebar(rebarBarType=top_rebarbartype, hostElement=ʳʰʸᵗʰᵐ_selection_pick, curves=transpose_6, lacing=Longest)  # frozen
setRebarAsSolidUnobscured_3 = Custom[SetRebarAsSolidUnobscured](rebar=freeFormRebar_2)
rebarShape_3 = RevitRebarShape("00")
hook_at_start_3 = RevitRebarHookType("None")
setRebarHookAndShape_3 = Custom[SetRebarHookAndShape](Rebar=setRebarAsSolidUnobscured_3, RebarShape=rebarShape_3, HookType_Start=hook_at_start_3, HookType_End=hook_at_start_3, lacing=CrossProduct)

# group: SIDE REBARS
count = List.Count(list=sortByKey.sorted_list@L2)
code_block_17 = CodeBlock(x=count) { [0,x[0]-1]; }
removeItemAtIndex = List.RemoveItemAtIndex(list=sortByKey.sorted_list@L2, indices=code_block_17)
code_block_18 = CodeBlock { 2; }
dropItems_3 = List.DropItems(list=removeItemAtIndex, amount=code_block_18)
perimeterCurves_5 = Surface.PerimeterCurves(surface=dropItems_3)
integer_slider_3 = IntegerSlider(3, range=0..10 step 1)
code_block_19 = CodeBlock(x=removeItemAtIndex, n=integer_slider_3) { x[0][n]; }
flatten_3 = List.Flatten(list=removeItemAtIndex)
area = Surface.Area(surface=removeItemAtIndex)
minimumItem = List.MinimumItem(list=area)
eq = area == minimumItem  # lacing=Longest
filterByBoolMask = List.FilterByBoolMask(list=removeItemAtIndex, mask=eq)
getBarDiameter_5 = Custom[RebarType.GetBarDiameter](rebarBarType=side_rebarbartype, ConvertToMM=boolean_2)
code_block_20 = CodeBlock(cover=cover, stirrupdia=getBarDiameter_3, maindia=getBarDiameter_5) { cover + stirrupdia + maindia/2; }
code_block_21 = CodeBlock(c=code_block_20) { c*-1; }
followingSurface = DynamoRebar.Rebar.FollowingSurface(face=filterByBoolMask.out, numberOfCurves=number_of_side_bars, offset=code_block_21)
freeFormRebar_3 = StructuralDesign.Rebar.Create.FreeFormRebar(rebarBarType=top_rebarbartype, hostElement=ʳʰʸᵗʰᵐ_selection_pick, curves=followingSurface@L2, lacing=Longest)  # frozen
setRebarAsSolidUnobscured_4 = Custom[SetRebarAsSolidUnobscured](rebar=freeFormRebar_3)
rebarShape_4 = RevitRebarShape("01")
hook_at_start_4 = RevitRebarHookType("None")
setRebarHookAndShape_4 = Custom[SetRebarHookAndShape](Rebar=setRebarAsSolidUnobscured_4, RebarShape=rebarShape_4, HookType_Start=hook_at_start_4, HookType_End=hook_at_start_4, lacing=CrossProduct)
allIndicesOf = List.AllIndicesOf(list=area@L3, item=minimumItem, lacing=Longest)
