# Dynamo graph Floor Area Reinforcement.dyn (Dynamo 2.6.1.8786)
# packages: ACOPackage 1.0.4, Structural Design 2021.9.23, Dynamo for Rebar 2.0.2, BIM4Struc.Rebar 1.2.4, archi-lab.net 2022.210.2522

code_block = CodeBlock { 0; }
run_script = BoolSelector(true)  # graph input
selectFloor = ACOSolution.Selection.SelectFloor(refresh=run_script)
flatten = List.Flatten(list=selectFloor)
YAxis = Vector.YAxis()
top_major_rebar = RevitRebarBarType("H16")  # graph input
top_major_spacing = DoubleInput(150)  # graph input
number = DoubleInput(4)
top_minor_rebar = RevitRebarBarType("H10")  # graph input
top_minor_spacing = DoubleInput(200)  # graph input
bottom_major_rebar = RevitRebarBarType("H12")  # graph input
bottom_major_spacing = DoubleInput(150)  # graph input
bottom_minor_rebar = RevitRebarBarType("H10")  # graph input
bottom_minor_spacing = DoubleInput(175)  # graph input
createBasedOnHost = StructuralDesign.Rebar.AreaReinforcement.AreaReinforcement.CreateBasedOnHost(hostElement=selectFloor, majorDirection=YAxis, topMajorBarType=top_major_rebar, topMajorSpacing=top_major_spacing, topMajorNumberLines=number, topMinorBarType=top_minor_rebar, topMinorSpacing=top_minor_spacing, topMinorNumberLines=number, bottomMajorBarType=bottom_major_rebar, bottomMajorSpacing=bottom_major_spacing, bottomMajorNumberLines=number, bottomMinorBarType=bottom_minor_rebar, bottomMinorSpacing=bottom_minor_spacing, bottomMinorNumberLines=number)
removeAreaReinforcementSystem = StructuralDesign.Rebar.AreaReinforcement.AreaReinforcement.RemoveAreaReinforcementSystem(areaReinforcement=createBasedOnHost)  # frozen
flatten_2 = List.Flatten(list=removeAreaReinforcementSystem)
string = StringInput("Spacing")
getParameterValueByName = Element.GetParameterValueByName(element=flatten_2, parameterName=string)
code_block_2 = CodeBlock { ""; }
eq = getParameterValueByName == code_block_2
filterByBoolMask = List.FilterByBoolMask(list=flatten_2, mask=eq)
filterByBoolMask_2 = List.FilterByBoolMask(list=getParameterValueByName, mask=eq)
python_script = Python(IN[0]=filterByBoolMask_2.out)
# ---------- python_script.python (17 lines) ----------
# Load the Python Standard and DesignScript Libraries
import sys
import clr
clr.AddReference('ProtoGeometry')
from Autodesk.DesignScript.Geometry import *

# The inputs to this node will be stored as a list in the IN variables.
data = IN[0]

output = []

for d in data:
	output.append(round(d,-1))
# Place your code below this line

# Assign your output to the OUT variable.
OUT = output
# ----------------------------------------
setParameterByName = Element.SetParameterByName(element=filterByBoolMask.out, parameterName=string, value=python_script)
flatten_3 = List.Flatten(list=setParameterByName)
passThrough = Custom[PassThrough](passThrough=flatten_3)  # package archi-lab.net; Ripped this off from Clockwork. Sorry Andy.; unwired: waitFor
delete = archilab.Revit.Elements.Elements.Delete(element=passThrough)
rebarCenterlineCurves = StructuralDesign.Rebar.Properties.RebarCenterlineCurves(rebar=setParameterByName)
flatten_4 = List.Flatten(list=rebarCenterlineCurves)
number_2 = DoubleInput(12000)
number_3 = DoubleInput(600)
YAxis_2 = Vector.YAxis()
rebarDiameter = StructuralDesign.Rebar.Properties.RebarDiameter(rebar=setParameterByName)
split_curve_with_overlap = Custom[Split curve with overlap](CurveToSplit=flatten_4, MaximumLength=number_2, OverlapLength=number_3, DirectionSecondRow=YAxis_2, DistanceSecondRow=rebarDiameter)  # package BIM4Struc.Rebar; Splits a curve into multiple segments with a maximum length and a gap between two consecutive ones, and create a second curve next to it with similar division and overlap. This node is to prepare rebars centerlines with splice lengths.
isNull = Object.IsNull(obj=split_curve_with_overlap.FirstRowCurves)
boolean = BoolSelector(true)
flatten_5 = List.Flatten(list=split_curve_with_overlap.FirstRowCurves)
boolean_2 = BoolSelector(false)
clean = List.Clean(list=flatten_5, preserveIndices=boolean_2)
flatten_6 = List.Flatten(list=split_curve_with_overlap.SecondRowCurves)
clean_2 = List.Clean(list=flatten_6, preserveIndices=boolean_2)
join = List.Join(list0=clean, list1=clean_2)
startPoint = Curve.StartPoint(curve=join)
endPoint = Curve.EndPoint(curve=join)
byStartPointEndPoint = Line.ByStartPointEndPoint(startPoint=startPoint, endPoint=endPoint)
rebarStyle = RevitRebarStyle("Standard")
type = archilab.Revit.Elements.Elements.Type(element=setParameterByName)
rebarHookType = RevitRebarHookType("None")
rebarHookOrientation = RevitRebarHookOrientation("Left")
direction = Line.Direction(line=byStartPointEndPoint)
normalized = Vector.Normalized(vector=direction)
ZAxis = Vector.ZAxis()
code_block_3 = CodeBlock { 90; }
rotate = Vector.Rotate(vector=normalized, axis=ZAxis, degrees=code_block_3)
X = Vector.X(vector=rotate)
round = Math.Round(number=X)
Y = Vector.Y(vector=rotate)
round_2 = Math.Round(number=Y)
code_block_4 = CodeBlock(y=round_2) { y*-1; }
byCoordinates = Vector.ByCoordinates(x=round, y=code_block_4)
fromCurve = StructuralDesign.Rebar.Create.FromCurve(curve=byStartPointEndPoint, rebarStyle=rebarStyle, rebarBarType=type, startHookType=rebarHookType, endHookType=rebarHookType, startHookOrientation=rebarHookOrientation, endHookOrientation=rebarHookOrientation, hostElement=selectFloor, vector=byCoordinates, lacing=Longest)
ceiling = Math.Ceiling(number=filterByBoolMask_2.out)
isNull_2 = Object.IsNull(obj=split_curve_with_overlap.SecondRowCurves)
flatten_7 = List.Flatten(list=isNull_2)
boolean_3 = BoolSelector(false)
allIndicesOf = List.AllIndicesOf(list=flatten_7, item=boolean_3)
getItemAtIndex = List.GetItemAtIndex(list=ceiling, index=allIndicesOf)
join_2 = List.Join(list0=ceiling, list1=getItemAtIndex)
getArrayLength = DynamoRebar.Rebar.GetArrayLength(rebar=setParameterByName)
isNull_3 = Object.IsNull(obj=flatten_6)
filterByBoolMask_3 = List.FilterByBoolMask(list=getArrayLength, mask=isNull_3)
join_3 = List.Join(list0=getArrayLength, list1=filterByBoolMask_3.in)
boolean_4 = BoolSelector(false)
boolean_5 = BoolSelector(false)
setLayoutAsMaximumSpacing = StructuralDesign.Rebar.Layout.SetLayoutAsMaximumSpacing(rebar=fromCurve, spacing=join_2, arrayLength=join_3, barsOnNormalSide=boolean_4, includeFirstBar=boolean_5, includeLastBar=boolean_5, lacing=Longest)
rebarCenterlineCurves_2 = StructuralDesign.Rebar.Properties.RebarCenterlineCurves(rebar=setLayoutAsMaximumSpacing)
flatten_8 = List.Flatten(list=rebarCenterlineCurves_2)
code_block_5 = CodeBlock { 0.5; }
pointAtParameter = Curve.PointAtParameter(curve=flatten_8, param=code_block_5)
Z = Point.Z(point=pointAtParameter)
groupByKey = List.GroupByKey(list=setLayoutAsMaximumSpacing, keys=Z)
sortByKey = List.SortByKey(list=groupByKey.groups, keys=groupByKey.unique_keys)
string_2 = StringInput("Mark")
code_block_6 = CodeBlock { ["BB","BT","TB","TT"]; }
setParameterByName_2 = Element.SetParameterByName(element=sortByKey.sorted_list, parameterName=string_2, value=code_block_6, lacing=Longest)
flatten_9 = List.Flatten(list=setParameterByName_2)
setParameterByName_3 = Element.SetParameterByName(element=flatten_9, parameterName=string, value=python_script)
string_3 = StringInput("Partition")
string_4 = StringInput("Mark")
getParameterValueByName_2 = Element.GetParameterValueByName(element=selectFloor, parameterName=string_4)  # frozen
setParameterByName_4 = Element.SetParameterByName(element=setParameterByName_3, parameterName=string_3, value=getParameterValueByName_2, lacing=Longest)
