# Dynamo graph Get Rebar in Element.dyn (Dynamo 2.6.1.8786)

refresh = BoolSelector(true)
python_script = Python(IN[0]=refresh)
# ---------- python_script.python (81 lines) ----------
#Find the host family instance of a selected rebar object.
#Authored by Dieter Vermeulen, Autodesk, 2016
#http://revitbeyondbim.wordpress.com

import clr
clr.AddReference('ProtoGeometry')
from Autodesk.DesignScript.Geometry import *
# Import ToDSType(bool) extension method
clr.AddReference("RevitNodes")
import Revit
clr.ImportExtensions(Revit.Elements)
# Import geometry conversion extension methods
clr.ImportExtensions(Revit.GeometryConversion)
# Import DocumentManager and TransactionManager
clr.AddReference("RevitServices")
import RevitServices
from RevitServices.Persistence import DocumentManager
from RevitServices.Transactions import TransactionManager
from System.Collections.Generic import *
# Import RevitAPI
clr.AddReference("RevitAPI")
clr.AddReference("RevitAPIUI")

import Autodesk 
from Autodesk.Revit.DB import *
from Autodesk.Revit.UI import *

doc = DocumentManager.Instance.CurrentDBDocument
uiapp = DocumentManager.Instance.CurrentUIApplication 
app = uiapp.Application 
uidoc = uiapp.ActiveUIDocument

HostElements= uidoc.Selection.PickObjects(Selection.ObjectType.Element, "Select Elements Containing Rebar")
NonHostedRebar=[]

collector = FilteredElementCollector(doc)
rebars = collector.OfCategory(BuiltInCategory.OST_Rebar).WhereElementIsNotElementType().ToElements()

RebarInHost = []

for elem in HostElements:
	HostId = elem.ElementId
	for rebar in rebars:
		if rebar.GetHostId() == HostId:
			RebarInHost.append(rebar)

rebarIds = []

def toList(input):
	if isinstance(input,list) == False:
		return [input]
	else:
		return input

def flatten(x):
    result = []
    for el in x:
        if hasattr(el, "__iter__") and not isinstance(el, basestring):
            result.extend(flatten(el))
        else:
            result.append(el)
    return result

elementsOrIDs = flatten(toList(RebarInHost))

elementIds = List[ElementId]()

try:
	int(elementsOrIDs[0])

except:
	for e in elementsOrIDs:
		elementIds.Add(UnwrapElement(e).Id)
	selection = uidoc.Selection.SetElementIds(elementIds)
	
else:
	for ID in elementsOrIDs:
		elementIds.Add(Autodesk.Revit.DB.ElementId(int(ID)))
	selection = uidoc.Selection.SetElementIds(elementIds)

OUT = RebarInHost
# ----------------------------------------
