# Dynamo graph Multi-Rebar Position Mark.dyn (Dynamo 2.12.1.8246)
# packages: Structural Design 2021.9.23, ACOPackage 1.0.4

additional_bar_name = StringInput("U-BAR")  # graph input

# group: REBAR POSITION
element_category = Categories("OST_Floors")  # graph input
run_script = BoolSelector(true)  # graph input
pickObjectsOfCategory = StructuralDesign.Model.Selection.PickObjectsOfCategory(category=element_category, refresh=run_script)
getRebarsInHost = ACOSolution.Rebars.GetRebarsInHost(element=pickObjectsOfCategory)
code_block = CodeBlock(x=getRebarsInHost) { x[0]; }
flatten = List.Flatten(list=code_block)
boolean = BoolSelector(true)
boolean_2 = BoolSelector(true)
code_block_2 = CodeBlock { 0; }
rebarCenterlineCurves = StructuralDesign.Rebar.Properties.RebarCenterlineCurves(rebar=flatten, adjustForSelfIntersection=boolean, suppressBendRadius=boolean_2, barPositionIndex=code_block_2, lacing=Longest)
direction = Line.Direction(line=rebarCenterlineCurves)
normalized = Vector.Normalized(vector=direction)
ZAxis = Vector.ZAxis()
dot = Vector.Dot(vector=normalized, vec=ZAxis)
code_block_3 = CodeBlock { 1; }
eq = dot == code_block_3
boolean_3 = BoolSelector(true)
contains = List.Contains(list=eq, item=boolean_3, lacing=CrossProduct)
filterByBoolMask = List.FilterByBoolMask(list=flatten, mask=contains)
flatten_2 = List.Flatten(list=filterByBoolMask.out)
filterByBoolMask_2 = List.FilterByBoolMask(list=rebarCenterlineCurves, mask=contains)
byJoinedCurves = PolyCurve.ByJoinedCurves(curves=filterByBoolMask_2.out)
flatten_3 = List.Flatten(list=byJoinedCurves)
code_block_4 = CodeBlock { 0.5; }
pointAtParameter = Curve.PointAtParameter(curve=flatten_3, param=code_block_4)
Z = Point.Z(point=pointAtParameter)
python_script = Python(IN[0]=Z)  # IronPython2
# ---------- python_script.python (15 lines) ----------
# Load the Python Standard and DesignScript Libraries
import sys
import clr
clr.AddReference('ProtoGeometry')
from Autodesk.DesignScript.Geometry import *

# The inputs to this node will be stored as a list in the IN variables.
space = IN[0]

output = []
for L in space:
	output.append(round(L,-1))

# Assign your output to the OUT variable.
OUT = output
# ----------------------------------------
groupByKey = List.GroupByKey(list=flatten_2, keys=python_script)
sortByKey = List.SortByKey(list=groupByKey.groups, keys=groupByKey.uniqueKeys)
parameter_name = StringInput("Comments")  # graph input
code_block_5 = CodeBlock { ["BB","BT","TB","TT"]; "ADD BAR"; }
setParameterByName = Element.SetParameterByName(element=sortByKey.sortedList, parameterName=parameter_name, value=code_block_5.out0)
flatten_4 = List.Flatten(list=filterByBoolMask.in)
setParameterByName_2 = Element.SetParameterByName(element=flatten_4, parameterName=parameter_name, value=additional_bar_name)
