# Dynamo graph Multi-Rebar Tag for Floors.dyn (Dynamo 2.12.0.5650)
# packages: ACOPackage 1.0.4, Clockwork for Dynamo 2.x 2.3.0, spring nodes 204.1.0, Structural Design 2021.9.23, BattleBIM 2018.12.17

# group: INPUTS
run_script = BoolSelector(true)  # graph input
categories = Categories("OST_Floors")  # graph input
pickObjectsOfCategory = StructuralDesign.Model.Selection.PickObjectsOfCategory(category=categories, refresh=run_script)
select_edge = DSEdgeSelection()  # 1 picked in the model; graph input
tag_offset = DoubleInput(2000)  # graph input

# group: PRE-SELECTION OF TAG TYPE
categories_2 = Categories("OST_MultiReferenceAnnotations")
all_family_types_of_category = Custom[All Family Types Of Category](category=categories_2, toggle=run_script)  # package Clockwork for Dynamo 2.x; Gets all family types/symbols of a given category in the model.
name = Element.Name(element=all_family_types_of_category)
string = StringInput("Select Multi-Rebar Tag")
ꟿ_list_dropdown = Custom[ꟿ List.DropDown](list=all_family_types_of_category, names=name, customMsg=string, reset=run_script)  # package spring nodes; Selects one list item by a drop-down combo box. The optional names input will override the object representation.

# group: EXTRACT REBAR DATA AND ANALYZE REBAR DIRECTION
getRebarsInHost = ACOSolution.Rebars.GetRebarsInHost(element=pickObjectsOfCategory)
code_block = CodeBlock { 1; }
flatten = List.Flatten(list=getRebarsInHost, amount=code_block)
string_2 = StringInput("Spacing")
getParameterValueByName = Element.GetParameterValueByName(element=flatten, parameterName=string_2)
string_3 = StringInput("")
eq = getParameterValueByName == string_3
filterByBoolMask = List.FilterByBoolMask(list=flatten, mask=eq)
boolean = BoolSelector(true)
rebarCenterlineCurves = StructuralDesign.Rebar.Properties.RebarCenterlineCurves(rebar=filterByBoolMask.out, suppressHooks=boolean, suppressBendRadius=boolean)
flatten_2 = List.Flatten(list=rebarCenterlineCurves)
direction = Line.Direction(line=flatten_2)
normalized = Vector.Normalized(vector=direction)
XAxis = Vector.XAxis()
isParallel = Vector.IsParallel(vector=normalized, otherVector=XAxis, lacing=Longest)

# group: FLOOR EDGE DIRECTION REWORK
direction_2 = Line.Direction(line=select_edge)
normalized_2 = Vector.Normalized(vector=direction_2)
ZAxis = Vector.ZAxis()
code_block_2 = CodeBlock { -90; }
rotate = Vector.Rotate(vector=normalized_2, axis=ZAxis, degrees=code_block_2)

# group: POLYCURVES CONVERSION
boolean_2 = BoolSelector(false)
rebarCenterlineCurves_2 = StructuralDesign.Rebar.Properties.RebarCenterlineCurves(rebar=filterByBoolMask.out, suppressHooks=boolean_2, suppressBendRadius=boolean_2)
byJoinedCurves = PolyCurve.ByJoinedCurves(curves=rebarCenterlineCurves_2)

# group: GET TAG POINT DISTANCE FROM EDGE
isParallel_2 = Vector.IsParallel(vector=XAxis, otherVector=normalized_2)
filterByBoolMask_2 = List.FilterByBoolMask(list=byJoinedCurves, mask=isParallel)
python_script = Python(IN[0]=filterByBoolMask_2.in, IN[1]=filterByBoolMask_2.out, IN[2]=isParallel_2)  # IronPython2
# ---------- python_script.python (23 lines) ----------
# Load the Python Standard and DesignScript Libraries
import sys
import clr
clr.AddReference('ProtoGeometry')
from Autodesk.DesignScript.Geometry import *

# The inputs to this node will be stored as a list in the IN variables.

ArgA = IN[0]
ArgB = IN[1]
BOOL = IN[2]

output = []

if BOOL==True:
	output.append(ArgA)
else:
	output.append(ArgB)



# Assign your output to the OUT variable.
OUT = output[0]
# ----------------------------------------
code_block_3 = CodeBlock { 0.45; }
pointAtParameter = Curve.PointAtParameter(curve=python_script, param=code_block_3)
pointAtParameter_2 = Curve.PointAtParameter(curve=select_edge, param=code_block_3)
X = Point.X(point=pointAtParameter_2)
Y = Point.Y(point=pointAtParameter_2)
list_create = List.Create(item0=X, item1=Y)
X_2 = Vector.X(vector=rotate)
round = Math.Round(number=X_2)
Y_2 = Vector.Y(vector=rotate)
round_2 = Math.Round(number=Y_2)
list_create_2 = List.Create(item0=round, item1=round_2)
code_block_4 = CodeBlock { 0; }
eq_2 = list_create_2 == code_block_4
filterByBoolMask_3 = List.FilterByBoolMask(list=list_create, mask=eq_2)
flatten_3 = List.Flatten(list=filterByBoolMask_3.out)
X_3 = Point.X(point=pointAtParameter)
Y_3 = Point.Y(point=pointAtParameter)
list_create_3 = List.Create(item0=X_3, item1=Y_3)
filterByBoolMask_4 = List.FilterByBoolMask(list=list_create_3, mask=eq_2)
flatten_4 = List.Flatten(list=filterByBoolMask_4.out)
filterByBoolMask_5 = List.FilterByBoolMask(list=flatten_2, mask=isParallel)

# group: APPLY OFFSET DISTANCE FROM EDGE AND FILTER OUT EDGE TYPE
filterByBoolMask_6 = List.FilterByBoolMask(list=filterByBoolMask.out, mask=isParallel)
YAxis = Vector.YAxis()
XAxis_2 = Vector.XAxis()
if_ = If(test=isParallel_2, true=YAxis, false=XAxis_2)
Y_4 = Vector.Y(vector=rotate)
code_block_5 = CodeBlock { 1; }
eq_3 = Y_4 == code_block_5
sub = flatten_3 - flatten_4  # lacing=Longest
add = sub + tag_offset
sub_2 = sub - tag_offset
if_2 = If(test=eq_3, true=add, false=sub_2)

# group: MULTI-REBAR TAGGING
python_script_if_statement = Python(IN[0]=filterByBoolMask_6.in, IN[1]=filterByBoolMask_6.out, IN[2]=isParallel_2)  # IronPython2
# ---------- python_script_if_statement.python (16 lines) ----------
# Load the Python Standard and DesignScript Libraries
import sys
import clr
clr.AddReference('ProtoGeometry')
from Autodesk.DesignScript.Geometry import *

# The inputs to this node will be stored as a list in the IN variables.
Arg_A = IN[0]
Arg_B = IN[1]
BOOL = IN[2]

if BOOL:
	OUT = Arg_A

else:
	OUT = Arg_B
# ----------------------------------------
ꟿ_document_activeview = Custom[ꟿ Document.ActiveView](refresh=run_script)  # package spring nodes; Selects the current document's active view. Supports more view types than the built-in option. Will be depreciated once the bult in node works with all plan types.
translate = Geometry.Translate(geometry=pointAtParameter, direction=if_, distance=if_2, lacing=Longest)
boolean_3 = BoolSelector(false)
boolean_4 = BoolSelector(true)
if_3 = If(test=isParallel_2, true=boolean_3, false=boolean_4)
multiRebarAnnotation = ACOSolution.Annotation.MultiRebarAnnotation(typeMultiTag=ꟿ_list_dropdown, rebars=python_script_if_statement, sectionView=ꟿ_document_activeview, tagHead=translate, dimensionOrigin=pointAtParameter, horizontal=if_3, lacing=Longest)

# group: SINGLE BAR TAGGING
get_active_view_battlebim = Custom[Get Active View (BattleBIM)](refresh=run_script)  # package BattleBIM; Get Active View
flatten_5 = List.Flatten(list=filterByBoolMask.in)
reverse = Vector.Reverse(vector=if_)
scale = Vector.Scale(vector=reverse, scale_factor=tag_offset)
boolean_5 = BoolSelector(false)
boolean_6 = BoolSelector(true)
byElementAndOffset = Tag.ByElementAndOffset(view=get_active_view_battlebim, element=flatten_5, offset=scale, horizontal=boolean_5, addLeader=boolean_6)
rebarCenterlineCurves_3 = StructuralDesign.Rebar.Properties.RebarCenterlineCurves(rebar=filterByBoolMask.in)
direction_3 = Line.Direction(line=rebarCenterlineCurves_3)
isParallel_3 = Vector.IsParallel(vector=direction_3, otherVector=XAxis)
flatten_6 = List.Flatten(list=isParallel_3)
byCoordinates = Vector.ByCoordinates()
