# Dynamo graph Multi-Rebar Tag.dyn (Dynamo 2.6.1.8786)
# packages: ACOPackage 1.0.4, Clockwork for Dynamo 2.x 2.3.0, spring nodes 204.1.0, BIM4Struc.Rebar 1.2.4, Structural Design 2021.9.23

categories = Categories("OST_MultiReferenceAnnotations")
run_script = BoolSelector(true)  # graph input
all_family_types_of_category = Custom[All Family Types Of Category](category=categories, toggle=run_script)  # package Clockwork for Dynamo 2.x; Gets all family types/symbols of a given category in the model.
name = Element.Name(element=all_family_types_of_category)
string = StringInput("Select Multi-Rebar Tag")
ꟿ_list_dropdown = Custom[ꟿ List.DropDown](list=all_family_types_of_category, names=name, customMsg=string, reset=run_script)  # package spring nodes; Selects one list item by a drop-down combo box. The optional names input will override the object representation.
categories_2 = Categories("OST_Rebar")
string_2 = StringInput("Select Rebars")
pickObjectsOfCategory = StructuralDesign.Model.Selection.PickObjectsOfCategory(category=categories_2, statusPrompt=string_2, refresh=run_script)
ꟿ_document_activeview = Custom[ꟿ Document.ActiveView](refresh=run_script)  # package spring nodes; Selects the current document's active view. Supports more view types than the built-in option. Will be depreciated once the bult in node works with all plan types.
getCenterlineCurve = Custom[Rebar.GetCenterlineCurve](Rebar=pickObjectsOfCategory)  # package BIM4Struc.Rebar; Get the centerline curves from a selected set of rebars
code_block = CodeBlock { 0.5; }
pointAtParameter = Curve.PointAtParameter(curve=getCenterlineCurve, param=code_block)
horizontal_tags_true_vertical = BoolSelector(true)  # "Horizontal Tags==True / Vertical Tags==False"; graph input
multiRebarAnnotation = ACOSolution.Annotation.MultiRebarAnnotation(typeMultiTag=ꟿ_list_dropdown, rebars=pickObjectsOfCategory, sectionView=ꟿ_document_activeview, tagHead=pointAtParameter, dimensionOrigin=pointAtParameter, horizontal=horizontal_tags_true_vertical, lacing=Longest)
