# Dynamo graph Place Post Tension Tendons at Beams.dyn (Dynamo 2.6.1.8786)
# packages: Rhythm 2021.7.3, archi-lab.net 2022.210.2522

boolean = BoolSelector(true)
categories = Categories("OST_StructuralFraming")
ʳʰʸᵗʰᵐ_selection_pick = Rhythm.Revit.Selection.Selection.Pick(runIt=boolean, category=categories)
getLocation = Element.GetLocation(element=ʳʰʸᵗʰᵐ_selection_pick)
startPoint = Curve.StartPoint(curve=getLocation)
endPoint = Curve.EndPoint(curve=getLocation)
join = List.Join(list0=startPoint, list1=endPoint)
pruneDuplicates = Point.PruneDuplicates(points=join)
byPoints = PolyCurve.ByPoints(points=pruneDuplicates)
toNurbsCurve = Curve.ToNurbsCurve()  # unwired: curve
byJoinedCurves = PolyCurve.ByJoinedCurves(curves=getLocation)
code_block = CodeBlock {  }
code_block_2 = CodeBlock { 0..1..0.5; }
pointAtParameter = Curve.PointAtParameter(param=code_block_2)  # unwired: curve
code_block_3 = CodeBlock(x=pointAtParameter) { x[0]; x[1]; x[2]; }
trimByParameter = Curve.TrimByParameter()  # unwired: curve
tendon_height_at_support = DoubleInput(1000)
byPoints_2 = NurbsCurve.ByPoints(points=pruneDuplicates)
ZAxis = Vector.ZAxis()
reverse = Vector.Reverse(vector=ZAxis)
type = archilab.Revit.Elements.Elements.Type(element=ʳʰʸᵗʰᵐ_selection_pick)
uniqueItems = List.UniqueItems(list=type)
string = StringInput("h")
getParameterValueByName = Element.GetParameterValueByName(element=uniqueItems, parameterName=string)
tendon_distance_from_beam_soffit = DoubleInput(130)  # "Tendon Distance from Beam soffit (mm)"
code_block_4 = CodeBlock(x=getParameterValueByName, tdepth=tendon_distance_from_beam_soffit) { depth = x[0]; depth - tdepth; }
translate = Geometry.Translate(geometry=byPoints_2, direction=reverse, distance=code_block_4.out1)
XAxis = Vector.XAxis()
XAxis_2 = Vector.XAxis()
reverse_2 = Vector.Reverse(vector=XAxis_2)
join_2 = List.Join(list0=XAxis, list1=reverse_2)
code_block_5 = CodeBlock(x=type) { x[1]; }
string_2 = StringInput("b")
getParameterValueByName_2 = Element.GetParameterValueByName(element=code_block_5, parameterName=string_2)
number = DoubleInput(95)
code_block_6 = CodeBlock(b=getParameterValueByName_2, reduction=number) { offset = (b-(reduction*2))/2; (offset/5)..offset..#3; }
translate_2 = Geometry.Translate(geometry=translate, direction=join_2, distance=code_block_6.out1, lacing=CrossProduct)
lastItem = List.LastItem(list=translate_2@L2)
code_block_7 = CodeBlock { 0..1; 0.5; 0..1..0.5; }
pointAtParameter_2 = Curve.PointAtParameter(curve=lastItem, param=code_block_7.out0@L2, lacing=Longest)
ZAxis_2 = Vector.ZAxis()
number_slider = DoubleSlider(0.7, range=0..2 step 0.05)
code_block_8 = CodeBlock(x=number_slider) { x*1000; }
translate_3 = Geometry.Translate(geometry=pointAtParameter_2, direction=ZAxis_2, distance=code_block_8)
pointAtParameter_3 = Curve.PointAtParameter(curve=lastItem, param=code_block_7.out1@L2, lacing=Longest)
code_block_9 = CodeBlock { 1; }
insert = List.Insert(list=translate_3, element=pointAtParameter_3, index=code_block_9, lacing=Longest)
flatten = List.Flatten()  # unwired: list
map = List.Map(list=insert, f_x=flatten)
byPoints_3 = NurbsCurve.ByPoints(points=map)
code_block_10 = CodeBlock { 2; }
takeItems = List.TakeItems(list=translate_2@L2, amount=code_block_10)
flatten_2 = List.Flatten(list=takeItems)
code_block_11 = CodeBlock { 1; }
takeItems_2 = List.TakeItems(list=takeItems@L2, amount=code_block_11)
dropItems = List.DropItems(list=takeItems@L2, amount=code_block_11)
code_block_12 = CodeBlock(x=takeItems_2, y=dropItems) { [x,y]; 0..1..0.5; }
pointAtParameter_4 = Curve.PointAtParameter(curve=flatten_2, param=code_block_12.out1, lacing=CrossProduct)
byPoints_4 = AdaptiveComponent.ByPoints(points=pointAtParameter_4)  # unwired: familyType
family_types = FamilyTypes("PAC - Post Tension bar:12mm")
boolean_2 = BoolSelector(false)
reverse_3 = List.Reverse(list=map@L2)
if_ = If(test=boolean_2, true=reverse_3, false=map)
pointAtParameter_5 = Curve.PointAtParameter(curve=takeItems@L2, param=code_block_7.out2, lacing=CrossProduct)
transpose = List.Transpose()  # unwired: lists
map_2 = List.Map(list=pointAtParameter_5, f_x=transpose)
byPoints_5 = NurbsCurve.ByPoints(points=map_2)
code_block_13 = CodeBlock { 0.3; 0.7; }
trimByParameter_2 = Curve.TrimByParameter(curve=takeItems_2@L2, startParameter=code_block_13.out0, endParameter=code_block_13.out1, lacing=Longest)
toNurbsCurve_2 = Curve.ToNurbsCurve(curve=takeItems_2)
