# Dynamo graph Rebar Detail Curves.dyn (Dynamo 2.3.1.11775)
# packages: BattleBIM 2018.12.17, Rhythm 2021.4.2, BIM4Struc.Rebar 1.2.4, archi-lab.net 2021.25.2621, Clockwork for Dynamo 2.x 2.3.0

family_types = FamilyTypes("KSD - Stirrup-Bar:KSD - Stirrup-Bar")
boolean = BoolSelector(false)
categories = Categories("OST_Rebar")
ʳʰʸᵗʰᵐ_selection_pick = Rhythm.Revit.Selection.Selection.Pick(runIt=boolean, category=categories)
getCenterlineCurve = Custom[Rebar.GetCenterlineCurve](Rebars=ʳʰʸᵗʰᵐ_selection_pick)  # package BIM4Struc.Rebar; Get the centerline curves from a selected set of rebars
curves = PolyCurve.Curves(polyCurve=getCenterlineCurve)
flatten = List.Flatten(list=curves)
startPoint = Curve.StartPoint(curve=flatten)
byPoints = Polygon.ByPoints(points=startPoint)
byPatch = Surface.ByPatch(closedCurve=byPoints, lacing=Longest)
code_block = CodeBlock { 0.5; }
pointAtParameter = Surface.PointAtParameter(surface=byPatch, u=code_block, v=code_block)
ZAxis = Vector.ZAxis()
number = DoubleInput(300)
translate = Geometry.Translate(geometry=pointAtParameter, direction=ZAxis, distance=number)
get_active_view_battlebim = Custom[Get Active View (BattleBIM)]()  # package BattleBIM; Get Active View
number_2 = DoubleInput(20)
setScale = View.SetScale(view=get_active_view_battlebim, scale=number_2)
byView = archilab.Revit.Elements.FamilyInstances.ByView(familyType=family_types, point=translate, view=setScale)
string = StringInput("Fine")
geometry = Custom[Element.Geometry+](element=byView, detailLevel=string, view=get_active_view_battlebim)  # package Clockwork for Dynamo 2.x; Returns Dynamo AND native Revit geometry of a given element
code_block_2 = CodeBlock { ["A","B","C","D"]; }
getParameterValueByName = Element.GetParameterValueByName(element=ʳʰʸᵗʰᵐ_selection_pick, parameterName=code_block_2, lacing=Longest)
round = Math.Round(number=getParameterValueByName)
setParameterByName = Element.SetParameterByName(element=byView, parameterName=code_block_2, value=round, lacing=Longest)
geometry_2 = Element.Geometry(element=setParameterByName)
