# Dynamo graph Rebar Detail component.dyn (Dynamo 2.3.1.11775)
# packages: Clockwork for Dynamo 2.x 2.3.0, Structural Design 2021.1.22, BIM4Struc.Rebar 1.2.4, KennyStruct Nodes 0.0.1, Synthesize toolkit 11.7.3

categories = Categories("OST_Rebar")
string = StringInput("Select Rebar Element")
boolean = BoolSelector(true)
pickObjectsOfCategory = StructuralDesign.Model.Selection.PickObjectsOfCategory(category=categories, statusPrompt=string, refresh=boolean)
boolean_2 = BoolSelector(true)
boolean_3 = BoolSelector(false)
getCenterlineCurve = Custom[Rebar.GetCenterlineCurve](Rebars=pickObjectsOfCategory, AdjustForSelfIntersection=boolean_2, SuppressHooks=boolean_3)  # package BIM4Struc.Rebar; Get the centerline curves from a selected set of rebars
explode = Geometry.Explode(geometry=getCenterlineCurve)
flatten = List.Flatten(list=explode)
family_types = FamilyTypes("KSD - U-Bar:KSD - U-Bar")
activeView = Custom[ActiveView]()  # package KennyStruct Nodes; Get active view of current document
byCurve = Custom[DetailComponent.ByCurve](curve=flatten, familyType=family_types, view=activeView)  # package Clockwork for Dynamo 2.x; Places a line-based detail component in a given view
plane = Custom[View.Plane](view=activeView)  # package Clockwork for Dynamo 2.x; Retrieves the plane of a given view
origin = Plane.Origin(plane=plane)
byPlane = CoordinateSystem.ByPlane(plane=plane)
transform = Geometry.Transform(geometry=getCenterlineCurve, cs=byPlane)
normal = Curve.Normal(curve=transform)
normal_2 = Plane.Normal(plane=plane)
X = Vector.X(vector=normal_2)
round = Math.Round(number=X)
normal_3 = Curve.Normal(curve=getCenterlineCurve)
X_2 = Vector.X(vector=normal_3)
round_2 = Math.Round(number=X_2)
eq = round == round_2
Y = Vector.Y(vector=normal_2)
round_3 = Math.Round(number=Y)
Y_2 = Vector.Y(vector=normal_3)
round_4 = Math.Round(number=Y_2)
eq_2 = round_3 == round_4
xor = Math.Xor(a=eq, b=eq_2)
curveTransformToView = Custom[CurveTransformToView](CrvNormal=normal_3, View=activeView, curve=getCenterlineCurve)  # package KennyStruct Nodes; Transform geometry curve to any selected View. Inputs are the vector normal of the curve and the selected Revit view
python_script = Python(IN[0]=activeView)
# ---------- python_script.python (23 lines) ----------
import clr
clr.AddReference('RevitAPI')
from Autodesk.Revit.DB import *

clr.AddReference("RevitNodes")
import Revit
clr.ImportExtensions(Revit.GeometryConversion)

clr.AddReference('ProtoGeometry')
from Autodesk.DesignScript.Geometry import *

def ViewPlane(view):
	if hasattr(view, "ViewDirection") and hasattr(view, "Origin"):
		o = view.Origin
		n = view.ViewDirection
		if o and n: return Plane.ByOriginNormal(o.ToPoint(), n.ToVector())
		else: return None
	else: return None

views = UnwrapElement(IN[0])

if isinstance(IN[0], list): OUT = [ViewPlane(x) for x in views]
else: OUT = ViewPlane(views)
# ----------------------------------------
origin_2 = Plane.Origin(plane=python_script)
boolean_4 = BoolSelector(false)
XAxis = Vector.XAxis()
YAxis = Vector.YAxis()
ZAxis = Vector.ZAxis()
list_create = List.Create(item0=XAxis, item1=YAxis, item2=ZAxis)
normal_4 = Curve.Normal(curve=getCenterlineCurve)
X_3 = Vector.X(vector=normal_4)
round_5 = Math.Round(number=X_3)
normal_5 = Plane.Normal(plane=python_script)
X_4 = Vector.X(vector=normal_5)
round_6 = Math.Round(number=X_4)
eq_3 = round_5 == round_6
Y_3 = Vector.Y(vector=normal_3)
round_7 = Math.Round(number=Y_3)
Y_4 = Vector.Y(vector=normal_5)
round_8 = Math.Round(number=Y_4)
eq_4 = round_7 == round_8
Z = Vector.Z(vector=normal_4)
round_9 = Math.Round(number=Z)
Z_2 = Vector.Z(vector=normal_5)
round_10 = Math.Round(number=Z_2)
eq_5 = round_9 == round_10
list_create_2 = List.Create(item0=eq_3, item1=eq_4, item2=eq_5)
flatten_2 = List.Flatten(list=list_create_2)
filterByBoolMask = List.FilterByBoolMask(list=list_create, mask=flatten_2)
reverse = Vector.Reverse(vector=filterByBoolMask.in)
if_ = If(test=boolean_4, true=reverse, false=filterByBoolMask.in)
angleWithVector = Vector.AngleWithVector(vector=normal_5, otherVector=normal_3)
rotate = Geometry.Rotate(origin=origin_2, axis=if_, degrees=angleWithVector, lacing=Longest)  # unwired: geometry
if_2 = If(false=rotate)  # unwired: test, true

# group: To Revit
code_block = CodeBlock(CurveInView=if_2) { CurveInView; }

byPlane_2 = CoordinateSystem.ByPlane(plane=python_script)
rotate_2 = CoordinateSystem.Rotate(coordinateSystem=byPlane_2, origin=origin_2, axis=if_, degrees=angleWithVector)
byCoordinates = Vector.ByCoordinates(x=round_5, y=round_7, z=round_9)
isAlmostEqualTo = Vector.IsAlmostEqualTo(vector=byCoordinates, other=list_create@L1, lacing=Longest)
reverse_2 = Vector.Reverse(vector=list_create)
isAlmostEqualTo_2 = Vector.IsAlmostEqualTo(vector=byCoordinates, other=reverse_2@L1, lacing=Longest)
allFalse = List.AllFalse()  # unwired: list
angleWithVector_2 = Vector.AngleWithVector(vector=byCoordinates, otherVector=list_create@L1, lacing=Longest)
code_block_2 = CodeBlock { 0; 180; }
eq_6 = angleWithVector_2 == code_block_2.out0
boolean_5 = BoolSelector(true)
contains = List.Contains(list=eq_6, item=boolean_5)
eq_7 = angleWithVector_2 == code_block_2.out1
contains_2 = List.Contains(list=eq_7, item=boolean_5)
or_ = Or(bool0=contains, bool1=contains_2)
if_3 = If(test=or_, true=byCoordinates)  # unwired: false
isParallelToPlane = Custom[CW.Vector.IsParallelToPlane](VARVector=normal_4, VARPlane=python_script)  # package Synthesize toolkit; Checks if a given vector is parallel to a given plane
filterByBoolMask_2 = List.FilterByBoolMask()  # unwired: list, mask
allIndicesOf = List.AllIndicesOf(list=eq_7, item=or_)
getItemAtIndex = List.GetItemAtIndex(list=list_create, index=allIndicesOf)
rotate_3 = Vector.Rotate()  # unwired: vector, axis
add = _ + _  # unwired: x, y
code_block_3 = CodeBlock { 90; }
eq_8 = angleWithVector_2 == code_block_3
boolean_6 = BoolSelector(true)
allIndicesOf_2 = List.AllIndicesOf(list=eq_8, item=boolean_6)
getItemAtIndex_2 = List.GetItemAtIndex(list=list_create, index=allIndicesOf_2)
integer_slider = IntegerSlider(1, range=0..1 step 1)
getItemAtIndex_3 = List.GetItemAtIndex(list=getItemAtIndex_2, index=integer_slider)
allTrue = List.AllTrue(list=flatten_2)
transform_2 = Geometry.Transform(geometry=getCenterlineCurve, cs=byPlane_2, lacing=Longest)
if_4 = If(test=allTrue, true=getCenterlineCurve, false=transform_2)
code_block_4 = CodeBlock { 0.5; }
pointAtParameter = Curve.PointAtParameter(curve=if_4, param=code_block_4)
X_5 = Point.X(point=pointAtParameter)
Y_5 = Point.Y(point=pointAtParameter)
Z_3 = Point.Z(point=pointAtParameter)
join = List.Join(list0=X_5, list1=Y_5, list2=Z_3)
join_2 = List.Join(list0=round_6, list1=round_8, list2=round_10)
code_block_5 = CodeBlock { 0; }
eq_9 = join_2 == code_block_5
boolean_7 = BoolSelector(false)
allIndicesOf_3 = List.AllIndicesOf(list=eq_9, item=boolean_7)
getItemAtIndex_4 = List.GetItemAtIndex(list=join, index=allIndicesOf_3)
origin_3 = Plane.Origin(plane=python_script)
X_6 = Point.X(point=origin_3)
Y_6 = Point.Y(point=origin_3)
Z_4 = Point.Z(point=origin_3)
join_3 = List.Join(list0=X_6, list1=Y_6, list2=Z_4)
getItemAtIndex_5 = List.GetItemAtIndex(list=join_3, index=allIndicesOf_3)
sub = getItemAtIndex_4 - getItemAtIndex_5
translate = Geometry.Translate(geometry=if_4, direction=normal_5, distance=sub)
ZAxis_2 = Vector.ZAxis()
normal_6 = Curve.Normal(curve=translate)
angleWithVector_3 = Vector.AngleWithVector(vector=normal_6, otherVector=normal_5)
code_block_6 = CodeBlock { 90; 0; }
lt = angleWithVector_3 < code_block_6.out0
round_11 = Math.Round(number=angleWithVector_3)
if_5 = If(test=lt, true=code_block_6.out1, false=round_11)
rotate_4 = Geometry.Rotate(geometry=translate, origin=pointAtParameter, axis=ZAxis_2, degrees=if_5)
rotate_5 = Geometry.Rotate(geometry=rotate_4, origin=pointAtParameter, axis=normal_4, degrees=if_5)
number_slider = DoubleSlider(1.21, range=0.01..10 step 0.1)
code_block_7 = CodeBlock(d=number_slider) { 1000*d; }
translate_2 = Geometry.Translate(geometry=rotate_5, direction=ZAxis_2, distance=code_block_7)
explode_2 = Geometry.Explode(geometry=translate_2)
family_types_2 = FamilyTypes("KSD - Line Based Detail Component:KSD - Line Based Detail Component")
byCurve_2 = Custom[DetailComponent.ByCurve](curve=explode_2, familyType=family_types_2, view=activeView)  # frozen
code_block_8 = CodeBlock(t=getCenterlineCurve) { t; }
