# Dynamo graph Rebar Shape Detail.dyn (Dynamo 2.3.1.11775)
# packages: Clockwork for Dynamo 2.x 2.3.0, Structural Design 2021.1.22, BIM4Struc.Rebar 1.2.4, KennyStruct Nodes 0.0.1, ACOPackage 1.0.4

boolean = BoolSelector(true)
boolean_2 = BoolSelector(false)
getCenterlineCurve = Custom[Rebar.GetCenterlineCurve](AdjustForSelfIntersection=boolean, SuppressHooks=boolean_2, SuppressBendRadius=boolean_2)  # package BIM4Struc.Rebar; Get the centerline curves from a selected set of rebars; unwired: Rebars
explode = Geometry.Explode(geometry=getCenterlineCurve)
flatten = List.Flatten(list=explode)
family_types = FamilyTypes("Det-Rebar:Det-Rebar")
activeView = Custom[ActiveView]()  # package KennyStruct Nodes; Get active view of current document
byCurve = Custom[DetailComponent.ByCurve](curve=flatten, familyType=family_types, view=activeView, lacing=Longest)  # package Clockwork for Dynamo 2.x; Places a line-based detail component in a given view
categories = Categories("OST_Rebar")
string = StringInput("Select Rebar Element to Detail")
boolean_3 = BoolSelector(true)
pickObjectsOfCategory = StructuralDesign.Model.Selection.PickObjectsOfCategory(category=categories, statusPrompt=string, refresh=boolean_3)
plane = Custom[View.Plane](view=activeView)  # package Clockwork for Dynamo 2.x; Retrieves the plane of a given view
origin = Plane.Origin(plane=plane)
pickPoint = ACOSolution.Selection.PickPoint()  # frozen; unwired: refresh
