# Dynamo graph Rebar Tag Check.dyn (Dynamo 2.6.1.8786)
# packages: archi-lab.net 2022.210.2522, spring nodes 204.1.0

categories = Categories("OST_Rebar")
run_script = BoolSelector(true)  # graph input
ꟿ_document_activeview = Custom[ꟿ Document.ActiveView](refresh=run_script)  # package spring nodes; Selects the current document's active view. Supports more view types than the built-in option. Will be depreciated once the bult in node works with all plan types.
byCategoryAndView = archilab.Revit.Selection.Select.ByCategoryAndView(category=categories, view=ꟿ_document_activeview)
categories_2 = Categories("OST_RebarTags")
byCategoryAndView_2 = archilab.Revit.Selection.Select.ByCategoryAndView(category=categories_2, view=ꟿ_document_activeview)
python_script = Python(IN[0]=byCategoryAndView_2)
# ---------- python_script.python (31 lines) ----------
import clr

clr.AddReference('RevitAPI')
from Autodesk.Revit.DB import *
from Autodesk.Revit.DB.Structure import *

clr.AddReference('RevitNodes')
import Revit
clr.ImportExtensions(Revit.GeometryConversion)
clr.ImportExtensions(Revit.Elements)

clr.AddReference('RevitServices')
import RevitServices
from RevitServices.Persistence import DocumentManager
from RevitServices.Transactions import TransactionManager

doc = DocumentManager.Instance.CurrentDBDocument

#Preparing input from dynamo to revit
tag = UnwrapElement(IN[0])
OUT = []
for t in tag:
	id = t.TaggedLocalElementId
	element = doc.GetElement(id)

	if element.GetType().ToString() == "Autodesk.Revit.DB.Dimension":
		uId = set([r.ElementId for r in element.References])
		for ui in uId:
			OUT.append(doc.GetElement(ui).ToDSType(True))
	else:
			OUT.append(element.ToDSType(True))
# ----------------------------------------
setDifference = List.SetDifference(list1=byCategoryAndView, list2=python_script)
select_in_revit = Python(IN[0]=setDifference)
# ---------- select_in_revit.python (57 lines) ----------
# This node has been made by Modelical
# www.modelical.com
import clr

#Load Dynamo wrappers
clr.AddReference("RevitNodes")
import Revit
clr.ImportExtensions(Revit.Elements)

#Load Revit API
clr.AddReference('RevitAPI')
import Autodesk
from Autodesk.Revit.DB import *

#Load document reference
clr.AddReference("RevitServices")
import RevitServices
from RevitServices.Persistence import DocumentManager
from System.Collections.Generic import *

doc = DocumentManager.Instance.CurrentDBDocument
uidoc = DocumentManager.Instance.CurrentUIApplication.ActiveUIDocument

def toList(input):
	if isinstance(input,list) == False:
		return [input]
	else:
		return input

def flatten(x):
    result = []
    for el in x:
        if hasattr(el, "__iter__") and not isinstance(el, basestring):
            result.extend(flatten(el))
        else:
            result.append(el)
    return result

elementsOrIDs = flatten(toList(IN[0]))

elementIds = List[ElementId]()

try:
	int(elementsOrIDs[0])

except:
	for e in elementsOrIDs:
		elementIds.Add(UnwrapElement(e).Id)
	selection = uidoc.Selection.SetElementIds(elementIds)
	
else:
	for ID in elementsOrIDs:
		elementIds.Add(Autodesk.Revit.DB.ElementId(int(ID)))
	selection = uidoc.Selection.SetElementIds(elementIds)


OUT = IN[0]
# ----------------------------------------
