# Dynamo graph Remove Area Reinforcement.dyn (Dynamo 2.6.1.8786)
# packages: KennyStruct Nodes 0.0.1, Structural Design 2021.9.23

rebar_host_category = Categories("OST_Floors")  # graph input
run_script = BoolSelector(true)  # graph input
pickObjectsOfCategory = StructuralDesign.Model.Selection.PickObjectsOfCategory(category=rebar_host_category, refresh=run_script)
getRebarFromHost = Custom[GetRebarFromHost](HostElement=pickObjectsOfCategory)  # package KennyStruct Nodes; Works with both Area Reinforcement and Normal Reinforcements
flatten = List.Flatten(list=getRebarFromHost)
removeAreaReinforcementSystem = StructuralDesign.Rebar.AreaReinforcement.AreaReinforcement.RemoveAreaReinforcementSystem(areaReinforcement=flatten)
