# Dynamo graph Set Multi-Rebar Presentation.dyn (Dynamo 2.6.1.8786)
# packages: ACOPackage 1.0.4, Structural Design 2021.9.23

# group: INPUTS
run_script = BoolSelector(true)  # graph input
rebar_presentation_0_all_1 = IntegerSlider(2, range=0..3 step 1)  # "Rebar Presentation; 0 = All, 1 = FirstLast, 2 = Middle, 3 = Select"; graph input

# group: SET REBAR PRESENTATION
host_element_category = Categories("OST_Floors")  # graph input
pickObjectsOfCategory = StructuralDesign.Model.Selection.PickObjectsOfCategory(category=host_element_category, refresh=run_script)
getRebarsInHost = ACOSolution.Rebars.GetRebarsInHost(element=pickObjectsOfCategory)
isEmpty = List.IsEmpty(list=getRebarsInHost, lacing=Longest)
code_block = CodeBlock(x=isEmpty) { x[0]; }
categories = Categories("OST_AreaRein")
all_elements_of_category = ElementsOfCategory(Category=categories)
id = Element.Id(element=pickObjectsOfCategory)
python_script = Python(IN[0]=all_elements_of_category)
# ---------- python_script.python (40 lines) ----------
import clr
clr.AddReference('ProtoGeometry')
from Autodesk.DesignScript.Geometry import *
# Import ToDSType(bool) extension method
clr.AddReference("RevitNodes")
import Revit
clr.ImportExtensions(Revit.Elements)
# Import geometry conversion extension methods
clr.ImportExtensions(Revit.GeometryConversion)
# Import DocumentManager and TransactionManager
clr.AddReference("RevitServices")
import RevitServices
from RevitServices.Persistence import DocumentManager
from RevitServices.Transactions import TransactionManager
from System.Collections.Generic import *
# Import RevitAPI
clr.AddReference("RevitAPI")
import Autodesk
from Autodesk.Revit.DB import *

doc = DocumentManager.Instance.CurrentDBDocument
uiapp = DocumentManager.Instance.CurrentUIApplication
app = uiapp.Application

HostElements=[]
NonHostedRebar=[]

ID = []
#get Host Family Instance
for i in IN[0]:
	rebar=UnwrapElement(i)
	try:
		id=rebar.GetHostId()
		inst=doc.GetElement.Overloads[Autodesk.Revit.DB.ElementId](id).ToDSType(True)
		HostElements.append(inst)
		ID.append(id)
	except:
		NonHostedRebar.append(i)
		
OUT = [int(ids.ToString()) for ids in ID]
# ----------------------------------------
eq = id == python_script  # lacing=Longest
filterByBoolMask = List.FilterByBoolMask(list=all_elements_of_category, mask=eq)
categories_2 = Categories("OST_Rebar")
all_elements_of_category_2 = ElementsOfCategory(Category=categories_2)
python_script_2 = Python(IN[0]=all_elements_of_category_2)  # same code as python_script
eq_2 = id == python_script_2  # lacing=Longest
filterByBoolMask_2 = List.FilterByBoolMask(list=all_elements_of_category_2, mask=eq_2)
python_script_3 = Python(IN[0]=code_block, IN[1]=filterByBoolMask.in, IN[2]=filterByBoolMask_2.in)
# ---------- python_script_3.python (22 lines) ----------
# Load the Python Standard and DesignScript Libraries
import sys
import clr
clr.AddReference('ProtoGeometry')
from Autodesk.DesignScript.Geometry import *

# The inputs to this node will be stored as a list in the IN variables.
test = IN[0]
trueA = IN[1]
falseA = IN[2]

output = []

if test == True:
	output.append(trueA)
else:
	output.append(falseA)



# Assign your output to the OUT variable.
OUT = output
# ----------------------------------------
flatten = List.Flatten(list=python_script_3)
string = StringInput("Layout Rule")
getParameterValueByName = Element.GetParameterValueByName(element=flatten, parameterName=string)
code_block_2 = CodeBlock { 0; }
eq_3 = getParameterValueByName == code_block_2
filterByBoolMask_3 = List.FilterByBoolMask(list=flatten, mask=eq_3)
python_script_4 = Python(IN[0]=filterByBoolMask_3.out, IN[1]=rebar_presentation_0_all_1)
# ---------- python_script_4.python (51 lines) ----------
# Load the Python Standard and DesignScript Libraries
import sys
import clr
clr.AddReference('ProtoGeometry')
from Autodesk.DesignScript.Geometry import *
clr.AddReference("RevitServices")
import RevitServices
from RevitServices.Persistence import DocumentManager 
from RevitServices.Transactions import TransactionManager 

clr.AddReference("RevitAPI")
clr.AddReference("RevitAPIUI")
import Autodesk 
from Autodesk.Revit.DB.Structure import RebarInSystem,Rebar, RebarPresentationMode
from Autodesk.Revit.DB.Document import GetElement

doc = DocumentManager.Instance.CurrentDBDocument


AreaRebar = UnwrapElement(IN[0])
output = []
outs = []
rebars = []
A = RebarPresentationMode.All
B = RebarPresentationMode.FirstLast
C = RebarPresentationMode.Middle
D = RebarPresentationMode.Select

PresentType = [A,B,C,D]
TransactionManager.Instance.EnsureInTransaction(doc)
if hasattr(AreaRebar[0], 'GetRebarInSystemIds'):
	for r in AreaRebar:
		output.append(hasattr(r, 'GetRebarInSystemIds'))
		R = r.GetRebarInSystemIds()
		elemsA = []
		for RID in R:
			elemsA.append(GetElement(doc,RID).SetPresentationMode(doc.ActiveView, PresentType[IN[1]]))
			rebars.append(elemsA)
			outs.append(GetElement(doc,RID))
			
else:
	elemsB = []
	for rb in AreaRebar:
		elemsB.append(rb.SetPresentationMode(doc.ActiveView, PresentType[IN[1]]))
		rebars.append(elemsB)
		outs.append(rb)
		
TransactionManager.Instance.TransactionTaskDone()

# Assign your output to the OUT variable.
OUT = outs
# ----------------------------------------
get_rebar_host = Python(IN[0]=all_elements_of_category)
# ---------- get_rebar_host.python (42 lines) ----------
#Find the host family instance of a selected rebar object.
#Authored by Dieter Vermeulen, Autodesk, 2016
#http://revitbeyondbim.wordpress.com

import clr
clr.AddReference('ProtoGeometry')
from Autodesk.DesignScript.Geometry import *
# Import ToDSType(bool) extension method
clr.AddReference("RevitNodes")
import Revit
clr.ImportExtensions(Revit.Elements)
# Import geometry conversion extension methods
clr.ImportExtensions(Revit.GeometryConversion)
# Import DocumentManager and TransactionManager
clr.AddReference("RevitServices")
import RevitServices
from RevitServices.Persistence import DocumentManager
from RevitServices.Transactions import TransactionManager
from System.Collections.Generic import *
# Import RevitAPI
clr.AddReference("RevitAPI")
import Autodesk
from Autodesk.Revit.DB import *

doc = DocumentManager.Instance.CurrentDBDocument
uiapp = DocumentManager.Instance.CurrentUIApplication
app = uiapp.Application

HostElements=[]
NonHostedRebar=[]

#get Host Family Instance
for i in IN[0]:
	rebar=UnwrapElement(i)
	try:
		id=rebar.GetHostId()
		inst=doc.GetElement.Overloads[Autodesk.Revit.DB.ElementId](id).ToDSType(True)
		HostElements.append(inst)
	except:
		NonHostedRebar.append(i)
		
OUT = HostElements
# ----------------------------------------
code_block_3 = CodeBlock(x=python_script_3) { x[0]; }
