# Dynamo graph Floor split_(Selecting floors and Walls).dyn (Dynamo 2.3.1.11775)
# packages: Clockwork for Dynamo 0.8.2 0.82.8, Dyn-BIMHEX 2020.2.6, Genius Loci 2021.1.20, Crumple 1.0.7, Modelical 2.2.19

# group: SELECT LEVEL
start_level_to_split_floor = IntegerSlider(50, range=2..70 step 1)  # graph input
end_level_to_split_floor = IntegerSlider(61, range=2..70 step 1)  # graph input

code_block = CodeBlock { 1; }
range = Range(start=start_level_to_split_floor, end=end_level_to_split_floor, step=code_block)
code_block_2 = CodeBlock(levelIndex=range) { levelIndex-1; }

# group: GET CURTAIN WALL LOCATIONS BY SELECTED LEVELS
categories = Categories("OST_Walls")
all_elements_of_category = ElementsOfCategory(Category=categories)
name = Element.Name(element=all_elements_of_category)
string = StringInput("Interior Glazing")
boolean = BoolSelector(true)
contains = String.Contains(str=name, searchFor=string, ignoreCase=boolean, lacing=CrossProduct)
filterByBoolMask = List.FilterByBoolMask(list=all_elements_of_category, mask=contains)
level = Custom[Clockwork_Element.Level](element=filterByBoolMask.in)  # package Clockwork for Dynamo 0.8.2; Gets an element's level
elevation = Level.Elevation(level=level)
sortIndexByValue = List.SortIndexByValue(list=elevation)
getItemAtIndex = List.GetItemAtIndex(list=filterByBoolMask.in, index=sortIndexByValue)
getItemAtIndex_2 = List.GetItemAtIndex(list=level, index=sortIndexByValue)
groupByKey = List.GroupByKey(list=getItemAtIndex, keys=getItemAtIndex_2)
code_block_3 = CodeBlock { 1; }
operators = code_block_2 - code_block_3
getItemAtIndex_3 = List.GetItemAtIndex(list=groupByKey.groups, index=operators)
getLocation = Element.GetLocation(element=getItemAtIndex_3)

categories_2 = Categories("OST_Levels")
all_elements_of_category_2 = ElementsOfCategory(Category=categories_2)
string_from_object = FromObject(obj=all_elements_of_category_2)
code_block_4 = CodeBlock(level_no=range) { level_no; "Level" + " " + level_no; "Ramp"; }
boolean_2 = BoolSelector(true)
contains_2 = String.Contains(str=string_from_object, searchFor=code_block_4.out2, ignoreCase=boolean_2)
filterByBoolMask_2 = List.FilterByBoolMask(list=all_elements_of_category_2, mask=contains_2)
getItemAtIndex_4 = List.GetItemAtIndex(list=filterByBoolMask_2.out, index=code_block_2)
categories_3 = Categories("OST_Floors")
custom_nodes = Custom[Custom nodes_SelectByCategoryAndLevel](level=getItemAtIndex_4, category=categories_3)  # package Genius Loci; Select Elements by Category and Level. With a document input, use the Collector of Levels node to get the level input. This API filter doesn't work with MEP and Structural Framing elements.

# group: CREATE OPENING IN FLOOR AND REPLACE SPLIT FLOOR
dyn_bimhex_floor_openeing = Custom[Dyn-BIMHEX_Floor Openeing](floor=custom_nodes, curves=getLocation)  # package Dyn-BIMHEX; Create opening in floor by outline curves
custom_nodes__waitfor = Custom[Custom nodes_© WaitFor](data=getLocation, waitFor=dyn_bimhex_floor_openeing)  # package Crumple; Tells the first input to wait for the second input to arrive, then passes on the first input. Really useful for scripts which have branching paths that rely on their outputs to carry each other forward. Quite a few custom packages have a 'passthrough' or 'waitfor' node. I use these all the time, so find it useful to have them contained in this package also.
type = Custom[Clockwork_Element.Type](element=custom_nodes)  # package Clockwork for Dynamo 0.8.2; Gets the family type of a given element (if applicable). Unlike the OOTB node, it also works for elements in linked models.
byOutlineTypeAndLevel = Floor.ByOutlineTypeAndLevel(outlineCurves=custom_nodes__waitfor, floorType=type, level=getItemAtIndex_4)

# group: SELECT SPLITTED FLOORS
custom_nodes_selectinrevit = Custom[Custom nodes_SelectInRevit](ElemsOrIDs=dyn_bimhex_floor_openeing)  # package Modelical; Select elements in Revit by Element or ID
